# Dynamo graph 1 About Dynamo Player.dyn (Dynamo 2.17.0.3472)
# author: Autodesk
# Displays a message with information about Dynamo Player.

# group: About
# Dynamo Player Preview Graph
# note: The Dynamo Player application executes Dynamo graphs in the Revit environment. Dynamo graphs can be written to perform many complex functions in Revit, some of which can be very useful to minimize repetitive and time consuming tasks, to run model checks, or to extract and utilize information from the Revit model. Learn more at http://dynamobim.org.

code_block = CodeBlock { "You just ran a Dynamo graph in Dynamo Player!" + "\n\n" +  "Dynamo Player executes Dynamo graphs for Revit. Graphs can perform many complex functions in Revit. They can minimize repetitive tasks, run Revit model checks, or extract and utilize information from the model."; }
code_block_2 = CodeBlock { "Learn more about Dynamo graphs at dynamobim.org"; }
python_script = Python(IN[0]=code_block, IN[1]=code_block_2)  # CPython3
# ---------- python_script.python (14 lines) ----------
#This script pops up a dialog box with a message from the previous node.
import clr
clr.AddReference('RevitAPIUI')

from Autodesk.Revit.UI import TaskDialog

mainText = IN[0]
footerText = IN[1]

content = mainText + "\n\n" + footerText;

TaskDialog.Show("Dynamo Player",content)

OUT = "Success!"
# ----------------------------------------
result = Watch(python_script)  # graph output
