# Dynamo graph Add Levels.dyn (Dynamo 2.17.0.3472)
# author: Autodesk
# Creates a series of levels above or below the selected level.

# group: Create Levels
# Add Levels Above or Below Selected Level
# note: See graph properties for more information.

# group: Selection
# User Selections
# note: Select a level to use as the starting point for the other levels.
select_a_level = DSModelElementByCategorySelection("OST_Levels")  # nothing selected; graph input

# group: Spacing and Quantity
# Enter spacing for new levels and the number of levels to create. (negative distance results in levels below)
# note: Enter the spacing between levels including the units. For example: 1200 mm, 8 ft, 3.5 m.
distance_from_selected_level = UnitInput("10 ft", UnitType="autodesk.unit.unit:feet-1.0.1")  # graph input
number_of_new_levels_to_create = IntegerSlider(4, range=1..100 step 1)  # graph input

# group: Get Document Units
getProjectUnitsTypeId = Python()  # CPython3
# ---------- getProjectUnitsTypeId.python (34 lines) ----------
# Import DocumentManager and TransactionManager
import clr
clr.AddReference("RevitServices")
import RevitServices
from RevitServices.Persistence import DocumentManager


# Import RevitAPI
clr.AddReference("RevitAPI")
import Autodesk
from Autodesk.Revit.DB import *


# Revit Document
doc = DocumentManager.Instance.CurrentDBDocument

# Get the ForgeType from the Document object
forgeTypeId = doc.GetUnits().GetFormatOptions(SpecTypeId.Length).GetUnitTypeId()

# Temporary workaround for Forge SDK unit types that are missing in Revit 2023:
if (forgeTypeId.Equals(UnitTypeId.FeetFractionalInches)) or (forgeTypeId.Equals(UnitTypeId.StationingFeet)):
    forgeTypeId = UnitTypeId.Feet;

if forgeTypeId.Equals(UnitTypeId.StationingSurveyFeet):
    forgeTypeId = UnitTypeId.UsSurveyFeet;

if forgeTypeId.Equals(UnitTypeId.FractionalInches):
    forgeTypeId = UnitTypeId.Inches;

if (forgeTypeId.Equals(UnitTypeId.MetersCentimeters)) or (forgeTypeId.Equals(UnitTypeId.StationingMeters)):
    forgeTypeId = UnitTypeId.Meters;

# Assign your output to the OUT variable
OUT = forgeTypeId.TypeId
# ----------------------------------------
string_from_object = FromObject(object=getProjectUnitsTypeId)
byTypeID = DynamoUnits.Unit.ByTypeID(typeId=string_from_object)
convertByUnits = DynamoUnits.Utilities.ConvertByUnits(value=distance_from_selected_level.Value, fromUnit=distance_from_selected_level.Unit, toUnit=byTypeID)

# group: Distance Calculation
# Compute new level spacing.
sequence = Sequence(start=convertByUnits, amount=number_of_new_levels_to_create, step=convertByUnits)

# group: Level Creation
# Create levels based on existing and spacing.
byLevelAndOffset = Level.ByLevelAndOffset(level=select_a_level, offset=sequence)

# group: Output
# Newly created levels
new_levels = Watch(byLevelAndOffset)  # graph output
