# Dynamo graph Calculate Longest Exit Distance.dyn (Dynamo 2.17.0.3472)
# author: Autodesk
# Creates a single path of travel in a room from a point that is farthest away from its closest exit.

# group: Path of Travel
# Calculate Longest Exit Distance
# note: See graph properties for more information

# group: Floor Plan View to Use
# Uses the active view (Must be a floor plan view) to calculate the longest exit. Note: The model must have rooms.
current = Document.Current()
activeView = Document.ActiveView(document=current)

# group: START HERE!
# Use the select buttons and select two exit doors in the Revit model. Then press Run in the lower left of the Dynamo application window to run the script.
# note: Using a floor plan view, select an exit door in a room.
select_exit_door_1 = DSModelElementByCategorySelection("OST_Doors")  # nothing selected; graph input
# note: Select another exit door.
select_exit_door_2 = DSModelElementByCategorySelection("OST_Doors")  # nothing selected; graph input

# group: Exit points
# Collect list of end points at exits
list_create = List.Create(item0=select_exit_door_1, item1=select_exit_door_2)
boundingBox = Element.BoundingBox(element=list_create)
toCuboid = BoundingBox.ToCuboid(boundingBox=boundingBox)
centroid = Solid.Centroid(solid=toCuboid)

# group: Calculation
# Calculate longest path of travel for current floor plan view
longestOfShortestExitPaths = PathOfTravel.LongestOfShortestExitPaths(floorPlan=activeView, endPtsList=centroid)

# group: Data Extraction
# Get parameters for output
string = StringInput("Length")
string_2 = StringInput("Time")
string_3 = StringInput("Speed")
list_create_2 = List.Create(item0=string, item1=string_2, item2=string_3)
getParameterValueByName = Element.GetParameterValueByName(element=longestOfShortestExitPaths, parameterName=list_create_2)

# group: Get Units
# Retrieve units from file for output.
getProjectUnits = Python()  # CPython3; unwired: IN[0]
# ---------- getProjectUnits.python (25 lines) ----------
# Import DocumentManager and TransactionManager
import clr
clr.AddReference("RevitServices")
import RevitServices
from RevitServices.Persistence import DocumentManager
doc = DocumentManager.Instance.CurrentDBDocument

# Import RevitAPI
clr.AddReference("RevitAPI")
import Autodesk
from Autodesk.Revit.DB import *

# Set up inputs
value = IN[0]

# Execute definition
projectUnits = Document.GetUnits(doc).GetFormatOptions(SpecTypeId.Length).GetUnitTypeId()
projectDisplayUnits = LabelUtils.GetLabelForUnit(projectUnits)

speedUnits = Document.GetUnits(doc).GetFormatOptions(SpecTypeId.Speed).GetUnitTypeId()
speedDisplayUnits = LabelUtils.GetLabelForUnit(speedUnits)


# Assign your output to the OUT variable
OUT = projectDisplayUnits,speedDisplayUnits
# ----------------------------------------

# group: Build Output
# combine strings and return output for Dynamo Player. By using addition in a code block we convert numbers to string automatically
code_block = CodeBlock(data=getParameterValueByName) { totalLength = data[0]; travelTime = data[1]; speed = data[2]; }
code_block_2 = CodeBlock(data=getProjectUnits) { lengthUnits = data[0]; speedUnits = data[1]; }
code_block_3 = CodeBlock { "Longest Path is: "; " long"; "Total Travel Time: "; " seconds @ "; }
code_block_4 = CodeBlock(totalLength=code_block.totalLength, travelTime=code_block.travelTime, speed=code_block.speed, lengthUnits=code_block_2.lengthUnits, speedUnits=code_block_2.speedUnits, string1=code_block_3.out0, string2=code_block_3.out1, string3=code_block_3.out2, string4=code_block_3.out3)
# ---------- code_block_4.designscript (10 lines) ----------
//declare a few variables to combine for output
totalLength;
travelTime;
speed;
lengthUnits;
speedUnits;
//build output
//first line prefix + count + return line
string1 + totalLength + " " + lengthUnits + string2 + "\n" +
string3 + travelTime + string4 + speed + " " + speedUnits;
# ----------------------------------------
calculation_results = Watch(code_block_4.out5)  # graph output
