# Dynamo graph Calculate Room Occupancy Load.dyn (Dynamo 2.17.0.3472)
# author: Autodesk
# Returns a number for the calculated occupancy based on the room type of the selected room.

# group: Room Occupancy Load
# Calculate based on selection and area/occupant
# note: See graph properties for more information

# group: Room Selection
# Select room to run calculation on
select_a_room = DSModelElementByCategorySelection("OST_Rooms")  # nothing selected; graph input

# group: Area Per Occupant
# Enter area allowed per occupant in project units (Ft² or M²)
# note: Enter the area allowed per occupant in project units (sq. ft. or m²)
allowable_area_per_occupant = DoubleInput(15)  # graph input

# group: Calculations
# Calculate occupancy load given area and allowable area per occupant
name = Room.Name(room=select_a_room)
string = StringInput("Area")
getParameterValueByName = Element.GetParameterValueByName(element=select_a_room, parameterName=string)
ceiling = Math.Ceiling(number=getParameterValueByName)
div = getParameterValueByName / allowable_area_per_occupant
ceiling_2 = Math.Ceiling(number=div)

# group: Get Units
# Retrieve units from file for output.
getProjectUnits = Python(IN[0]=getParameterValueByName)  # CPython3
# ---------- getProjectUnits.python (22 lines) ----------
# Import DocumentManager and TransactionManager
import clr
clr.AddReference("RevitServices")
import RevitServices
from RevitServices.Persistence import DocumentManager
doc = DocumentManager.Instance.CurrentDBDocument

# Import RevitAPI
clr.AddReference("RevitAPI")
import Autodesk
from Autodesk.Revit.DB import *


# Set up inputs
value = IN[0]

# Execute definition
projectUnits = Document.GetUnits(doc).GetFormatOptions(SpecTypeId.Area).GetUnitTypeId()
displayUnit = LabelUtils.GetLabelForUnit(projectUnits)

# Assign your output to the OUT variable
OUT = displayUnit
# ----------------------------------------

# group: Build Output
# combine strings and return output for Dynamo Player. By using addition in a code block we convert numbers to string automatically
code_block = CodeBlock { "Room Name: "; "Area: ~ "; "Occupancy Load: "; }
code_block_2 = CodeBlock(roomName=name, area=ceiling, occupancyLoad=ceiling_2, roomString=code_block.out0, areaString=code_block.out1, units=getProjectUnits, occupancyString=code_block.out2)
# ---------- code_block_2.designscript (13 lines) ----------
//declare a few variables to combine for output
roomName;
area;
occupancyLoad;
//build output
//first line prefix + name + return line
roomString + roomName + "\n" +
//second line prefix + area + return line
areaString + area + " " + units+ "\n" +
//blank line
"\n"+
//third line prefix + occupancy load
occupancyString + occupancyLoad;
# ----------------------------------------
calculation_results = Watch(code_block_2.out3)  # graph output
