# Dynamo graph Calculate Total Length of Selected Lines.dyn (Dynamo 2.17.0.3472)
# author: Autodesk
# Calculates the total length of selected detail or model lines.

# group: Calculate Length
# Calculate Length of Selected Lines
# note: See graph properties for more information

# group: Selection
# Model/Detail Line Selection
select_detail_and_model_lines = DSModelElementsByCategorySelection("OST_Lines")  # nothing selected; graph input

# group: Get Lengths and Sum
# Get Length parameter from selected detail and model curves and sum up
string = StringInput("Length")
getParameterValueByName = Element.GetParameterValueByName(element=select_detail_and_model_lines, parameterName=string)
sum = Math.Sum(values=getParameterValueByName)

# group: Count Lines
# Count lines for output
count = List.Count(list=getParameterValueByName)

# group: Get Units
# Retrieve units from file for output.
getProjectUnits = Python()  # CPython3
# ---------- getProjectUnits.python (18 lines) ----------
# Import DocumentManager and TransactionManager
import clr
clr.AddReference("RevitServices")
import RevitServices
from RevitServices.Persistence import DocumentManager
doc = DocumentManager.Instance.CurrentDBDocument

# Import RevitAPI
clr.AddReference("RevitAPI")
import Autodesk
from Autodesk.Revit.DB import *

# Execute definition
projectUnits = Document.GetUnits(doc).GetFormatOptions(SpecTypeId.Length).GetUnitTypeId()
displayUnit = LabelUtils.GetLabelForUnit(projectUnits)

# Assign your output to the OUT variable
OUT = displayUnit
# ----------------------------------------

# group: Build Output
# combine strings and return output for Dynamo Player. By using addition in a code block we convert numbers to string automatically
code_block = CodeBlock { "Selected Curves: "; "Total Length: "; }
code_block_2 = CodeBlock(curveCount=count, totalLength=sum, units=getProjectUnits, outputString1=code_block.out0, outputString2=code_block.out1)
# ---------- code_block_2.designscript (9 lines) ----------
//declare a few variables to combine for output
curveCount;
totalLength;
units;
//build output
//first line prefix + count + return line
outputString1 + curveCount + "\n" +
//second line prefix + total length + space + units
outputString2 + totalLength + " " + units;
# ----------------------------------------
calculation_results = Watch(code_block_2.out3)  # graph output
