# Dynamo graph Delete Mark Values from MEP Content.dyn (Dynamo 2.17.0.3472)
# author: Autodesk
# Retrieves all elements from Revit MEP categories in the model and sets their Mark parameter values to empty.

# group: Delete Mark Values from MEP Content
# note: See graph properties for more information

# group: Selection
# MEP Category Selection
categories = Categories("OST_DuctTerminal")
categories_2 = Categories("OST_DuctFitting")
categories_3 = Categories("OST_DuctInsulations")
categories_4 = Categories("OST_DuctLinings")
categories_5 = Categories("OST_PlaceHolderDucts")
categories_6 = Categories("OST_DuctCurves")
categories_7 = Categories("OST_PipeFitting")
categories_8 = Categories("OST_PipeInsulations")
categories_9 = Categories("OST_PlaceHolderPipes")
categories_10 = Categories("OST_MechanicalEquipment")
categories_11 = Categories("OST_PlumbingFixtures")
categories_12 = Categories("OST_ElectricalEquipment")
categories_13 = Categories("OST_ElectricalFixtures")
categories_14 = Categories("OST_CommunicationDevices")
categories_15 = Categories("OST_ConduitFitting")
categories_16 = Categories("OST_ConduitRun")
categories_17 = Categories("OST_Conduit")
categories_18 = Categories("OST_Wire")
categories_19 = Categories("OST_LightingFixtures")
categories_20 = Categories("OST_LightingDevices")
categories_21 = Categories("OST_PipeCurves")

# group: Collection
# Get All Elements of MEP Categories
list_create = List.Create(item0=categories, item1=categories_2, item2=categories_3, item3=categories_4, item4=categories_5, item5=categories_6, item6=categories_7, item7=categories_8, item8=categories_9, item9=categories_10, item10=categories_11, item11=categories_12, item12=categories_13, item13=categories_14, item14=categories_15, item15=categories_16, item16=categories_17, item17=categories_18, item18=categories_19, item19=categories_20, item20=categories_21)
all_elements_of_category = ElementsOfCategory(Category=list_create)
flatten = List.Flatten(list=all_elements_of_category)

# group: Parameter Modification
# Clear the mark parameter
string = StringInput("Mark")
string_2 = StringInput("")
setParameterByName = Element.SetParameterByName(element=flatten, parameterName=string, value=string_2)

# group: Build Output
# Give user feedback based on the operation
code_block = CodeBlock { "Mark Values Cleared for "; " MEP Elements"; }
count = List.Count(list=setParameterByName)
code_block_2 = CodeBlock(string1=code_block.out0, count=count, string2=code_block.out1) { string1 + count + string2; }
result = Watch(code_block_2)  # graph output
