# Dynamo graph Random Family Instance Placement.dyn (Dynamo 2.17.0.3472)
# author: Autodesk
# Places a randomized set of family instances on a selected face given a base family type, density, and randomization seed.

# group: Revit Inputs
# note: The base family type determines the family instances to be randomly placed.
n02_base_family_type = FamilyTypes()  # "02 | Base Family Type"; nothing selected; graph input
# note: Family instances are placed on the selected face.
n01_select_face = DSFaceSelection()  # "01 | Select Face"; nothing selected; graph input

# group: Working / Functions
family = FamilyType.Family(familyType=n02_base_family_type)
types = Family.Types(family=family)

# group: Layout Inputs
# note: For a denser family instance layout, enter a higher number.
n03_density = IntegerSlider(15, range=10..200 step 1)  # "03 | Density"; graph input
# note: A number that starts the randomization process (can be any number)
n04_randomization_seed = IntegerSlider(8, range=0..100 step 1)  # "04 | Randomization Seed"; graph input

# group: Working / Functions
code_block = CodeBlock(seed=n04_randomization_seed) { 0; 1; seed; seed+1; }
list_create = List.Create(item0=code_block.seed, item1=code_block.out3)
randomList = Math.RandomList(amount=n03_density, value1=code_block.out0, value2=code_block.out1, seed=list_create)
code_block_2 = CodeBlock(data=randomList) { uValues = data[0]; vValues = data[1]; }
byCoordinates = UV.ByCoordinates(u=code_block_2.uValues, v=code_block_2.vValues)

# group: Generate
# Generate a random pattern on the surface using the voronoi node
byParametersOnSurface = Tessellation.Voronoi.ByParametersOnSurface(uvs=byCoordinates, face=n01_select_face)
flatten = List.Flatten(list=byParametersOnSurface)
doesIntersect = Geometry.DoesIntersect(geometry=n01_select_face, other=flatten, lacing=Longest)
filterByBoolMask = List.FilterByBoolMask(list=flatten, mask=doesIntersect)
pullOntoSurface = Curve.PullOntoSurface(curve=filterByBoolMask.in, surface=n01_select_face, lacing=Longest)
code_block_3 = CodeBlock { 0.5; }
pointAtParameter = Curve.PointAtParameter(curve=pullOntoSurface, param=code_block_3)

# group: Create
# Create random list of family types to use
count = List.Count(list=pointAtParameter)
number = DoubleInput(0)
count_2 = List.Count(list=types)
randomList_2 = Math.RandomList(amount=count, value1=number, value2=count_2, seed=n04_randomization_seed)
floor = Math.Floor(number=randomList_2)
getItemAtIndex = List.GetItemAtIndex(list=types, index=floor)
geometry = Element.Geometry(element=types)
getItemAtIndex_2 = List.GetItemAtIndex(list=geometry, index=floor)

# group: Create
# Revit family instances
byPoint = FamilyInstance.ByPoint(familyType=getItemAtIndex, point=pointAtParameter)

# group: Checking / Outputs
results = Watch(byPoint)  # graph output

# group: Visualize
# Visualize the family placement
byOrigin = CoordinateSystem.ByOrigin()
byOrigin_2 = CoordinateSystem.ByOrigin(origin=pointAtParameter)
transform = Geometry.Transform(geometry=getItemAtIndex_2, fromCoordinateSystem=byOrigin, contextCoordinateSystem=byOrigin_2)
