# Dynamo graph Select All Taggable Elements Not Tagged in the Active View.dyn (Dynamo 2.17.0.3472)
# author: Autodesk
# Selects all taggable elements that aren’t currently tagged in the active Revit view.

# group: Select All
# Not tagged in current view
# note: See graph properties for more information

# group: Current View Elements
# Collect current view elements to see if they are tagged
all_elements_in_active_view = ElementsInView()

# group: Collect Tags
# Collect all tags in the model for comparison to elements in current view
element_types = ElementTypes("IndependentTag")
all_elements_of_type = ElementsOfType(element_type=element_types)
taggedElement = Tag.TaggedElement(tag=all_elements_of_type)

# group: Filter by Function
# Filter the list of elements in active view by tagged elements
contains = List.Contains(list=taggedElement)  # unwired: item
filter = List.Filter(list=all_elements_in_active_view, condition=contains)

# group: Select in Revit
# Load the selection in Revit
select_elements = Python(IN[0]=filter.out)  # CPython3
# ---------- select_elements.python (25 lines) ----------
import clr
clr.AddReference("RevitAPI")
clr.AddReference("RevitAPIUI")
import Autodesk
from Autodesk.Revit.UI import *
from Autodesk.Revit.DB import *
clr.AddReference("RevitServices")
import RevitServices
from RevitServices.Persistence import DocumentManager
clr.AddReference("RevitNodes")
import Revit
# clr.ImportExtensions(Revit.Elements)
from System.Collections.Generic import *

elems = UnwrapElement(IN[0])

elemIds = []
for elem in elems:
	elemIds.append(elem.Id)
	
uidoc = DocumentManager.Instance.CurrentUIDocument
uidoc.Selection.SetElementIds(List[ElementId](elemIds))

# Just for fun - give it to the output!
OUT = elemIds
# ----------------------------------------

# group: Build Output
# Give user feedback based on the operation
count = List.Count(list=select_elements)
code_block = CodeBlock { "untagged elements selected"; }
code_block_2 = CodeBlock(count=count, outputString=code_block) { count + " " + outputString; }
result = Watch(code_block_2)  # graph output
