# Dynamo graph Update Sheet Names to Upper Case.dyn (Dynamo 2.17.0.3472)
# author: Autodesk
# Updates all sheet names in the active model to UPPER CASE.

# group: Sheet Names
# Update to upper case
# note: See graph properties for more information.

# group: Collect
# Collect sheets by category name
select_sheets = ElementTypes("ViewSheet")
all_elements_of_type = ElementsOfType(element_type=select_sheets)

# group: Parameter Name
# Sheet name parameter
string = StringInput("Sheet Name")

# group: Convert Sheet Name
# Convert sheet name to uppercase, then set it.
getParameterValueByName = Element.GetParameterValueByName(element=all_elements_of_type, parameterName=string)
toUpper = String.ToUpper(string=getParameterValueByName)

# group: Make Changes/ Return Results
# Set the sheet names to uppercase and return the result as an output.
setParameterByName = Element.SetParameterByName(element=all_elements_of_type, parameterName=string, value=toUpper)
sheets_with_names_converted = Watch(setParameterByName)  # graph output
