# Dynamo graph Warnings-Isolate Elements.dyn (Dynamo 2.17.0.3472)
# author: Autodesk
# Isolates elements that are contributing to the selected Revit warning. This graph is helpful for troubleshooting warnings in Revit.

# group: User Inputs
# Inputs for Dynamo Player
# note: Select a view in which to isolate elements. For best results, use a 3D view.
select_a_3d_view = Views()  # nothing selected; graph input
# note: Select a Revit warning to isolate the elements that are contributing to the warning.
select_a_revit_warning = AllWarningsOfType()  # nothing selected; graph input

# group: Parse Warnings
# parse warnings for elements, description and severity
getFailingElements = Warning.GetFailingElements(warning=select_a_revit_warning)
description = Warning.Description(warning=select_a_revit_warning)
severity = Warning.Severity(warning=select_a_revit_warning)

# group: Isolate Elements
# Isolate the elements that are contributing to the selected warning.
flatten = List.Flatten(list=getFailingElements)
isolateElementsTemporary = View.IsolateElementsTemporary(view=select_a_3d_view, elements=flatten)

# group: Outputs
# Feedback for Dynamo Player
elements_causing_warning = Watch(getFailingElements)  # graph output
firstItem = List.FirstItem(list=description)
warning_description = Watch(firstItem)  # graph output
firstItem_2 = List.FirstItem(list=severity)
warning_severity = Watch(firstItem_2)  # graph output
