# Dynamo graph Beam_Clear.dyn (Dynamo 3.6.0.9395)

structural_framing_types = StructuralFramingTypes("FTB-2")  # graph input
S01 = Python(IN[0]=structural_framing_types)  # CPython3
# ---------- S01.python (330 lines) ----------
# ============================================================
# S01 — CLEAR REBAR BY STRUCTURAL FRAMING TYPE
#
# IN[0] = Structural Framing Type
#         Native Dynamo "Structural Framing Types" node
#
# ACTION:
#   1. Finds all Structural Framing instances using
#      the selected type.
#   2. Finds Rebar hosted by those framing elements.
#   3. Deletes those Rebar elements.
#
# OUT:
# [0] Matching Framing Elements
# [1] Matching Framing IDs
# [2] Framing Type Name
# [3] Number of Framing Elements
# [4] Number of Rebars Deleted
# [5] Deleted Rebar IDs
# [6] Status
# ============================================================

import clr

# ------------------------------------------------------------
# REVIT SERVICES
# ------------------------------------------------------------

clr.AddReference("RevitServices")

from RevitServices.Persistence import DocumentManager
from RevitServices.Transactions import TransactionManager

doc = DocumentManager.Instance.CurrentDBDocument


# ------------------------------------------------------------
# REVIT API
# ------------------------------------------------------------

clr.AddReference("RevitAPI")

from Autodesk.Revit.DB import *
from Autodesk.Revit.DB.Structure import Rebar


# ------------------------------------------------------------
# REVIT / DYNAMO
# ------------------------------------------------------------

clr.AddReference("RevitNodes")

import Revit
clr.ImportExtensions(Revit.Elements)


# ------------------------------------------------------------
# INPUT
# ------------------------------------------------------------

input_type = IN[0]


# ------------------------------------------------------------
# SAFE ELEMENT ID
# Supports newer and older Revit versions
# ------------------------------------------------------------

def id_value(element_id):

    if element_id is None:
        return None

    try:
        return int(element_id.Value)
    except:
        pass

    try:
        return int(element_id.IntegerValue)
    except:
        pass

    return None


# ------------------------------------------------------------
# DEFAULT OUTPUT
# ------------------------------------------------------------

matching_elements = []
matching_ids = []

deleted_rebar_ids = []

type_name = None

framing_count = 0
deleted_count = 0

status = ""


# ------------------------------------------------------------
# VALIDATE INPUT
# ------------------------------------------------------------

if input_type is None:

    status = "No Structural Framing Type received."

else:

    # --------------------------------------------------------
    # UNWRAP SELECTED TYPE
    # --------------------------------------------------------

    try:
        selected_type = UnwrapElement(input_type)
    except:
        selected_type = input_type


    # --------------------------------------------------------
    # GET SELECTED TYPE ID
    # --------------------------------------------------------

    selected_type_id_value = None

    try:

        selected_type_id_value = id_value(
            selected_type.Id
        )

    except:
        pass


    # --------------------------------------------------------
    # GET TYPE NAME
    # --------------------------------------------------------

    try:
        type_name = selected_type.Name
    except:
        type_name = None


    if not type_name:

        try:

            p = selected_type.get_Parameter(
                BuiltInParameter.SYMBOL_NAME_PARAM
            )

            if p:
                type_name = p.AsString()

        except:
            pass


    if not type_name:
        type_name = "Unknown Type"


    # --------------------------------------------------------
    # FIND STRUCTURAL FRAMING INSTANCES
    # --------------------------------------------------------

    framing_collector = (
        FilteredElementCollector(doc)
        .OfCategory(
            BuiltInCategory.OST_StructuralFraming
        )
        .WhereElementIsNotElementType()
    )


    for framing in framing_collector:

        try:

            framing_type_id = id_value(
                framing.GetTypeId()
            )

            if framing_type_id == selected_type_id_value:

                matching_elements.append(framing)

                fid = id_value(framing.Id)

                if fid is not None:
                    matching_ids.append(fid)

        except:
            pass


    framing_count = len(matching_elements)


    # --------------------------------------------------------
    # CREATE HOST ID SET
    # --------------------------------------------------------

    host_id_set = set(matching_ids)


    # --------------------------------------------------------
    # FIND ALL STANDARD REBAR
    # --------------------------------------------------------

    all_rebars = (
        FilteredElementCollector(doc)
        .OfClass(Rebar)
        .WhereElementIsNotElementType()
    )


    rebars_to_delete = []


    # --------------------------------------------------------
    # CHECK REBAR HOST
    # --------------------------------------------------------

    for rebar in all_rebars:

        try:

            host_id = rebar.GetHostId()

            host_value = id_value(host_id)

            if host_value in host_id_set:

                rebars_to_delete.append(rebar)

                rid = id_value(rebar.Id)

                if rid is not None:
                    deleted_rebar_ids.append(rid)

        except:
            pass


    # --------------------------------------------------------
    # DELETE REBARS
    # --------------------------------------------------------

    if len(rebars_to_delete) > 0:

        TransactionManager.Instance.EnsureInTransaction(doc)

        actual_deleted = 0

        for rebar in rebars_to_delete:

            try:

                doc.Delete(rebar.Id)

                actual_deleted += 1

            except:
                pass

        TransactionManager.Instance.TransactionTaskDone()

        deleted_count = actual_deleted


    # --------------------------------------------------------
    # STATUS
    # --------------------------------------------------------

    if selected_type_id_value is None:

        status = (
            "ERROR: Could not determine selected "
            "Structural Framing Type ID."
        )

    elif framing_count == 0:

        status = (
            "No Structural Framing instances found "
            "for type '{}'."
        ).format(type_name)

    elif deleted_count == 0:

        status = (
            "Found {} framing element(s) of type '{}', "
            "but no hosted standard Rebar elements were found."
        ).format(
            framing_count,
            type_name
        )

    else:

        status = (
            "SUCCESS: Found {} framing element(s) of type '{}'. "
            "Deleted {} hosted Rebar element(s)."
        ).format(
            framing_count,
            type_name,
            deleted_count
        )


# ------------------------------------------------------------
# OUTPUT
# ------------------------------------------------------------

OUT = [
    matching_elements,
    matching_ids,
    type_name,
    framing_count,
    deleted_count,
    deleted_rebar_ids,
    status
]
# ----------------------------------------
watch = Watch(S01)
