# Dynamo graph Chatto's Auto Rebar.dyn (Dynamo 3.6.0.9395)

bar_types = Python()  # CPython3; unwired: IN[0]
# ---------- bar_types.python (37 lines) ----------
import clr

clr.AddReference("RevitAPI")
clr.AddReference("RevitServices")

from Autodesk.Revit.DB import (
    FilteredElementCollector,
    Element,
    BuiltInParameter
)
from Autodesk.Revit.DB.Structure import RebarBarType
from RevitServices.Persistence import DocumentManager

doc = DocumentManager.Instance.CurrentDBDocument

bar_types = list(
    FilteredElementCollector(doc)
    .OfClass(RebarBarType)
    .ToElements()
)

def get_name(bar_type):
    try:
        return Element.Name.GetValue(bar_type)
    except:
        parameter = bar_type.get_Parameter(
            BuiltInParameter.SYMBOL_NAME_PARAM
        )
        return parameter.AsString() if parameter else "Unnamed"

bar_types.sort(key=get_name)

names = [get_name(bar_type) for bar_type in bar_types]

# First output: elements used by the main script
# Second output: readable names for the Watch node
OUT = bar_types, names
# ----------------------------------------
watch = Watch(bar_types)
integer_slider = IntegerSlider(0, range=0..100 step 1)
getItemAtIndex = List.GetItemAtIndex(list=bar_types, index=integer_slider)
watch_2 = Watch(getItemAtIndex)
n3_main_bar_diameter = IntegerSlider(2, range=0..11 step 1)  # "3 Main Bar Diameter"
n3_main_bar_diameter_2 = CustomSelection("16mm", items={10mm: "0", 12mm: "1", 16mm: "2", 20mm: "3", 25mm: "5"}, IsVisibleDropDownTextBlock=true)  # "3 Main Bar Diameter"; graph input
getItemAtIndex_2 = List.GetItemAtIndex(list=getItemAtIndex, index=n3_main_bar_diameter_2)
watch_3 = Watch(getItemAtIndex_2)
n1_select_column = DSModelElementSelection()  # "1-Select Column"; 1 picked in the model; graph input
n2_number_of_bars = IntegerSlider(10, range=4..16 step 2)  # "2-Number of Bars"; graph input
main_bar = Python(IN[0]=n1_select_column, IN[1]=getItemAtIndex_2, IN[2]=n2_number_of_bars)  # CPython3
# ---------- main_bar.python (211 lines) ----------
import clr

clr.AddReference("RevitAPI")
clr.AddReference("RevitServices")

from Autodesk.Revit.DB import *
from Autodesk.Revit.DB.Structure import *
from RevitServices.Persistence import DocumentManager
from RevitServices.Transactions import TransactionManager
from System.Collections.Generic import List

doc = DocumentManager.Instance.CurrentDBDocument

# INPUTS
column = UnwrapElement(IN[0])
bar_type = UnwrapElement(IN[1])
number_of_bars = int(IN[2])

def mm(value):
    return UnitUtils.ConvertToInternalUnits(
        value,
        UnitTypeId.Millimeters
    )

def intermediate_values(start, end, quantity):
    """Creates equally spaced coordinates excluding the corners."""
    values = []

    if quantity <= 0:
        return values

    spacing = (end - start) / float(quantity + 1)

    for i in range(1, quantity + 1):
        values.append(start + spacing * i)

    return values

cover = mm(40)

if column is None:
    OUT = "ERROR: Select one structural column."

elif bar_type is None:
    OUT = "ERROR: Select one RebarBarType."

elif not isinstance(bar_type, RebarBarType):
    OUT = "ERROR: IN[1] is not a valid RebarBarType."

elif number_of_bars < 4:
    OUT = "ERROR: Minimum quantity is 4 bars."

elif number_of_bars % 2 != 0:
    OUT = "ERROR: Use an even quantity: 4, 6, 8, 10, 12..."

else:
    box = column.get_BoundingBox(None)

    if box is None:
        OUT = "ERROR: Could not obtain the column bounding box."

    else:
        bar_diameter = bar_type.BarNominalDiameter
        offset = cover + bar_diameter / 2.0

        x1 = box.Min.X + offset
        x2 = box.Max.X - offset
        y1 = box.Min.Y + offset
        y2 = box.Max.Y - offset

        z1 = box.Min.Z + offset
        z2 = box.Max.Z - offset

        usable_width = x2 - x1
        usable_depth = y2 - y1

        if usable_width <= 0 or usable_depth <= 0:
            OUT = "ERROR: Cover and bar diameter are too large for the column."

        else:
            # Four corner bars are always provided.
            # Remaining bars are added symmetrically to opposite faces.
            remaining_pairs = (number_of_bars - 4) // 2

            if remaining_pairs == 0:
                x_face_bars = 0
                y_face_bars = 0

            else:
                # Allocate more bars to the longer faces.
                x_face_bars = int(round(
                    remaining_pairs *
                    usable_width /
                    (usable_width + usable_depth)
                ))

                # From 8 bars upward, place at least one
                # intermediate bar on every face.
                if remaining_pairs >= 2:
                    x_face_bars = max(
                        1,
                        min(remaining_pairs - 1, x_face_bars)
                    )

                y_face_bars = remaining_pairs - x_face_bars

            bar_locations = [
                # Four corner bars
                (x1, y1),
                (x2, y1),
                (x2, y2),
                (x1, y2)
            ]

            # Intermediate bars on bottom and top faces
            for x in intermediate_values(x1, x2, x_face_bars):
                bar_locations.append((x, y1))
                bar_locations.append((x, y2))

            # Intermediate bars on left and right faces
            for y in intermediate_values(y1, y2, y_face_bars):
                bar_locations.append((x1, y))
                bar_locations.append((x2, y))

            # Find all existing rebars hosted by this column
            existing_rebars = []

            all_rebars = (
                FilteredElementCollector(doc)
                .OfClass(Rebar)
                .WhereElementIsNotElementType()
                .ToElements()
            )

            for existing_rebar in all_rebars:
                try:
                    if existing_rebar.GetHostId() == column.Id:
                        existing_rebars.append(existing_rebar)
                except:
                    pass

            deleted_count = len(existing_rebars)
            created_bars = []

            TransactionManager.Instance.EnsureInTransaction(doc)

            sub_transaction = SubTransaction(doc)
            sub_transaction.Start()

            try:
                # Delete existing rebars in the selected column
                for existing_rebar in existing_rebars:
                    doc.Delete(existing_rebar.Id)

                # Create the new main bars
                for x, y in bar_locations:
                    bar_line = Line.CreateBound(
                        XYZ(x, y, z1),
                        XYZ(x, y, z2)
                    )

                    curves = List[Curve]()
                    curves.Add(bar_line)

                    new_rebar = Rebar.CreateFromCurves(
                        doc,
                        RebarStyle.Standard,
                        bar_type,
                        None,
                        None,
                        column,
                        XYZ.BasisX,
                        curves,
                        RebarHookOrientation.Left,
                        RebarHookOrientation.Right,
                        True,
                        True
                    )

                    created_bars.append(new_rebar)

                sub_transaction.Commit()
                TransactionManager.Instance.TransactionTaskDone()

                diameter_mm = UnitUtils.ConvertFromInternalUnits(
                    bar_diameter,
                    UnitTypeId.Millimeters
                )

                OUT = [
                    "SUCCESS: Main bars updated.",
                    "Existing rebars deleted: {}".format(deleted_count),
                    "Main bars created: {}".format(len(created_bars)),
                    "Bar diameter: {:.0f} mm".format(diameter_mm),
                    "Intermediate bars on top/bottom: {}".format(
                        x_face_bars
                    ),
                    "Intermediate bars on left/right: {}".format(
                        y_face_bars
                    ),
                    created_bars
                ]

            except Exception as error:
                sub_transaction.RollBack()
                TransactionManager.Instance.TransactionTaskDone()

                OUT = [
                    "ERROR: No changes were retained.",
                    str(error)
                ]
# ----------------------------------------
watch_4 = Watch(main_bar)
integer_slider_2 = IntegerSlider(0, range=0..11 step 1)
rebar_type = List.GetItemAtIndex(list=getItemAtIndex, index=integer_slider_2)
watch_5 = Watch(rebar_type)
n4_connected_beams = DSModelElementsSelection()  # "4 Connected Beams"; 8 picked in the model; graph input
n5_confinement_spacing = IntegerSlider(100, range=75..125 step 25)  # "5 Confinement Spacing"; graph input
n6_middle_spacing = IntegerSlider(150, range=100..200 step 25)  # "6 Middle Spacing"; graph input
n7_concrete_cover = IntegerSlider(40, range=25..75 step 5)  # "7 Concrete Cover"; graph input
ties_stirrups = Python(IN[0]=n1_select_column, IN[1]=n4_connected_beams, IN[2]=rebar_type, IN[3]=n5_confinement_spacing, IN[4]=n6_middle_spacing, IN[5]=n7_concrete_cover, IN[6]=main_bar)  # CPython3
# ---------- ties_stirrups.python (815 lines) ----------
import clr
import math

clr.AddReference("RevitAPI")
clr.AddReference("RevitServices")

from Autodesk.Revit.DB import *
from Autodesk.Revit.DB.Structure import *
from RevitServices.Persistence import DocumentManager
from RevitServices.Transactions import TransactionManager
from System.Collections.Generic import List


doc = DocumentManager.Instance.CurrentDBDocument


# ============================================================
# DYNAMO INPUTS
# ============================================================
# IN[0] = Continuous structural column - Select Model Element
# IN[1] = Connected beams - Select Model Elements
# IN[2] = Stirrup/tie RebarBarType
# IN[3] = Confinement spacing in millimetres
# IN[4] = Middle-zone spacing in millimetres
# IN[5] = Concrete cover in millimetres
# IN[6] = Main-bar Python node OUT (execution-order trigger)

column = UnwrapElement(IN[0])
raw_beams = UnwrapElement(IN[1])
tie_type = UnwrapElement(IN[2])

# This input deliberately creates a Dynamo dependency. Connect the OUT port
# of the main-bar Python node to IN[6] of this tie node. Dynamo will then
# finish the main-bar node before this script deletes and recreates the ties.
# The value itself is not used for reinforcement geometry.
main_bar_completion = IN[6]


try:
    confinement_spacing_mm = float(IN[3])
except:
    confinement_spacing_mm = 0.0

try:
    middle_spacing_mm = float(IN[4])
except:
    middle_spacing_mm = 0.0

try:
    cover_mm = float(IN[5])
except:
    cover_mm = -1.0


# Fixed project rule:
# confinement zone = Lclear / 4 at each end of every clear segment.
CONFINEMENT_RATIO = 0.25


# ============================================================
# UNIT AND GENERAL HELPERS
# ============================================================

def mm(value):
    """Convert millimetres to Revit internal units."""
    return UnitUtils.ConvertToInternalUnits(
        value,
        UnitTypeId.Millimeters
    )


def to_mm(value):
    """Convert Revit internal units to millimetres."""
    return UnitUtils.ConvertFromInternalUnits(
        value,
        UnitTypeId.Millimeters
    )


def element_name(element):
    """Return a readable Revit element name."""
    try:
        return Element.Name.GetValue(element)
    except:
        try:
            return element.Name
        except:
            return "Unnamed"


def element_id_value(element):
    """Return an ElementId value in Revit 2026, with an older fallback."""
    try:
        return int(element.Id.Value)
    except:
        try:
            return int(element.Id.IntegerValue)
        except:
            return str(element.Id)


def make_element_list(value):
    """Normalize a Dynamo element input into a Python list."""
    if value is None:
        return []

    if isinstance(value, list):
        return value

    try:
        return list(value)
    except:
        return [value]


# ============================================================
# FIND A 135-DEGREE STIRRUP/TIE HOOK
# ============================================================

def find_135_seismic_hook():
    """Find a loaded 135-degree Stirrup/Tie hook."""
    target_angle = math.radians(135.0)
    angle_tolerance = math.radians(0.1)
    candidates = []

    hook_types = (
        FilteredElementCollector(doc)
        .OfClass(RebarHookType)
        .WhereElementIsElementType()
        .ToElements()
    )

    for hook in hook_types:
        try:
            correct_angle = (
                abs(hook.HookAngle - target_angle)
                <= angle_tolerance
            )
            correct_style = (
                hook.Style == RebarStyle.StirrupTie
            )

            if correct_angle and correct_style:
                candidates.append(hook)
        except:
            pass

    if not candidates:
        return None

    candidates.sort(
        key=lambda hook: (
            0 if "seismic" in element_name(hook).lower() else 1,
            element_name(hook).lower()
        )
    )

    return candidates[0]


# ============================================================
# BEAM-JOINT DETECTION HELPERS
# ============================================================

def boxes_touch_in_xy(column_box, beam_box, tolerance):
    """Check whether a beam bounding box reaches the column in plan."""
    overlap_x = not (
        beam_box.Max.X < column_box.Min.X - tolerance
        or beam_box.Min.X > column_box.Max.X + tolerance
    )

    overlap_y = not (
        beam_box.Max.Y < column_box.Min.Y - tolerance
        or beam_box.Min.Y > column_box.Max.Y + tolerance
    )

    return overlap_x and overlap_y


def merge_joint_ranges(ranges, tolerance):
    """
    Merge overlapping beam elevation ranges at each floor.

    The merged range is used only as an exclusion zone. No ties are
    created within it or directly on either joint face.
    """
    if not ranges:
        return []

    ordered_ranges = sorted(
        ranges,
        key=lambda item: item["start"]
    )

    merged = []

    for current in ordered_ranges:
        if not merged:
            merged.append({
                "start": current["start"],
                "end": current["end"],
                "beam_ids": list(current["beam_ids"])
            })
            continue

        previous = merged[-1]
        ranges_overlap = (
            current["start"] <= previous["end"] + tolerance
        )

        if ranges_overlap:
            previous["start"] = min(
                previous["start"],
                current["start"]
            )
            previous["end"] = max(
                previous["end"],
                current["end"]
            )
            previous["beam_ids"].extend(
                current["beam_ids"]
            )
        else:
            merged.append({
                "start": current["start"],
                "end": current["end"],
                "beam_ids": list(current["beam_ids"])
            })

    return merged


# ============================================================
# TIE-ZONE HELPERS
# ============================================================

def estimate_tie_quantity(
    zone_length,
    spacing,
    include_first,
    include_last
):
    """Estimate the number of visible tie positions in one set."""
    if zone_length <= 0 or spacing <= 0:
        return 0

    quantity = int(math.ceil(zone_length / spacing)) + 1

    if not include_first:
        quantity -= 1

    if not include_last:
        quantity -= 1

    return max(quantity, 0)


def add_zone(
    zones,
    name,
    start_z,
    end_z,
    spacing,
    include_first,
    include_last,
    zone_type
):
    """Add one valid clear-column tie-distribution zone."""
    zone_length = end_z - start_z
    tolerance = mm(1.0)

    if zone_length <= tolerance:
        return

    estimated_quantity = estimate_tie_quantity(
        zone_length,
        spacing,
        include_first,
        include_last
    )

    if estimated_quantity <= 0:
        return

    zones.append({
        "name": name,
        "type": zone_type,
        "start": start_z,
        "end": end_z,
        "spacing": spacing,
        "include_first": include_first,
        "include_last": include_last,
        "estimated_quantity": estimated_quantity
    })


def add_clear_segment_zones(
    zones,
    segment_number,
    start_z,
    end_z,
    include_segment_start,
    include_segment_end,
    confinement_spacing,
    middle_spacing
):
    """
    Divide one clear column segment into three zones:

    bottom confinement = Lclear / 4
    middle zone         = Lclear / 2
    top confinement    = Lclear / 4

    For a segment next to a beam joint, its joint-side endpoint is
    excluded so no tie is placed directly on the joint face.
    """
    clear_length = end_z - start_z

    if clear_length <= mm(1.0):
        return

    confinement_length = clear_length * CONFINEMENT_RATIO
    bottom_end = start_z + confinement_length
    top_start = end_z - confinement_length

    add_zone(
        zones,
        "Segment {} - Bottom L/4 confinement".format(
            segment_number
        ),
        start_z,
        bottom_end,
        confinement_spacing,
        include_segment_start,
        True,
        "Confinement"
    )

    add_zone(
        zones,
        "Segment {} - Middle zone".format(segment_number),
        bottom_end,
        top_start,
        middle_spacing,
        False,
        False,
        "Middle"
    )

    add_zone(
        zones,
        "Segment {} - Top L/4 confinement".format(
            segment_number
        ),
        top_start,
        end_z,
        confinement_spacing,
        True,
        include_segment_end,
        "Confinement"
    )


# ============================================================
# CREATE ONE SHAPE-DRIVEN TIE SET
# ============================================================

def create_tie_set(
    host_column,
    tie_bar_type,
    hook_type,
    x1,
    x2,
    y1,
    y2,
    zone
):
    """Create one rectangular shape-driven tie set."""
    z_start = zone["start"]
    z_end = zone["end"]
    distribution_length = z_end - z_start

    p1 = XYZ(x1, y1, z_start)
    p2 = XYZ(x2, y1, z_start)
    p3 = XYZ(x2, y2, z_start)
    p4 = XYZ(x1, y2, z_start)

    # Confirmed working counterclockwise curve order.
    curves = List[Curve]()
    curves.Add(Line.CreateBound(p1, p2))
    curves.Add(Line.CreateBound(p2, p3))
    curves.Add(Line.CreateBound(p3, p4))
    curves.Add(Line.CreateBound(p4, p1))

    # Revit 2026 hook termination settings.
    terminations = BarTerminationsData(doc)
    terminations.HookTypeIdAtStart = hook_type.Id
    terminations.HookTypeIdAtEnd = hook_type.Id

    # Confirmed working hook orientation.
    terminations.TerminationOrientationAtStart = (
        RebarHookOrientation.Left
    )
    terminations.TerminationOrientationAtEnd = (
        RebarHookOrientation.Left
    )

    new_tie = Rebar.CreateFromCurves(
        doc,
        RebarStyle.StirrupTie,
        tie_bar_type,
        host_column,
        XYZ.BasisZ,
        curves,
        terminations,
        True,
        True
    )

    if new_tie is None:
        raise Exception(
            "Revit could not create tie zone: {}".format(
                zone["name"]
            )
        )

    accessor = new_tie.GetShapeDrivenAccessor()
    accessor.SetLayoutAsMaximumSpacing(
        zone["spacing"],
        distribution_length,
        True,
        zone["include_first"],
        zone["include_last"]
    )

    return new_tie


# ============================================================
# NORMALIZE BEAM INPUT
# ============================================================

beams = make_element_list(raw_beams)
beams = [beam for beam in beams if beam is not None]


# ============================================================
# INPUT VALIDATION
# ============================================================

error_message = None

if column is None:
    error_message = (
        "ERROR: Select one continuous structural column."
    )
elif tie_type is None:
    error_message = (
        "ERROR: Select one stirrup RebarBarType."
    )
elif not isinstance(tie_type, RebarBarType):
    error_message = (
        "ERROR: IN[2] must be a RebarBarType."
    )
elif not beams:
    error_message = (
        "ERROR: Select all beams connected to the column using "
        "Select Model Elements."
    )
elif confinement_spacing_mm <= 0:
    error_message = (
        "ERROR: Confinement spacing must be greater than zero."
    )
elif middle_spacing_mm <= 0:
    error_message = (
        "ERROR: Middle-zone spacing must be greater than zero."
    )
elif cover_mm < 0:
    error_message = (
        "ERROR: Concrete cover cannot be negative."
    )


# ============================================================
# MAIN PROCESS
# ============================================================

if error_message is not None:
    OUT = error_message

else:
    seismic_hook = find_135_seismic_hook()

    if seismic_hook is None:
        OUT = [
            "ERROR: No compatible 135-degree hook was found.",
            "Load or create a 135-degree Stirrup/Tie hook."
        ]

    else:
        column_box = column.get_BoundingBox(None)

        if column_box is None:
            OUT = (
                "ERROR: Could not obtain the column bounding box."
            )

        else:
            tie_diameter = tie_type.BarNominalDiameter
            cover = mm(cover_mm)
            confinement_spacing = mm(confinement_spacing_mm)
            middle_spacing = mm(middle_spacing_mm)

            # Tie centreline is cover plus half the tie diameter.
            offset = cover + tie_diameter / 2.0

            x1 = column_box.Min.X + offset
            x2 = column_box.Max.X - offset
            y1 = column_box.Min.Y + offset
            y2 = column_box.Max.Y - offset

            column_z_start = column_box.Min.Z + offset
            column_z_end = column_box.Max.Z - offset

            if x2 <= x1 or y2 <= y1:
                OUT = (
                    "ERROR: Cover and tie diameter are too large "
                    "for the column section."
                )

            elif column_z_end <= column_z_start:
                OUT = (
                    "ERROR: Available tie distribution height "
                    "is invalid."
                )

            else:
                # -----------------------------------------------
                # DETECT SELECTED BEAM-JOINT EXCLUSION RANGES
                # -----------------------------------------------

                beam_ranges = []
                ignored_beams = []
                xy_tolerance = mm(25.0)

                for beam in beams:
                    beam_box = beam.get_BoundingBox(None)

                    if beam_box is None:
                        ignored_beams.append(
                            "{} | ID {} | no bounding box".format(
                                element_name(beam),
                                element_id_value(beam)
                            )
                        )
                        continue

                    touches_column = boxes_touch_in_xy(
                        column_box,
                        beam_box,
                        xy_tolerance
                    )

                    overlaps_column_height = not (
                        beam_box.Max.Z < column_z_start
                        or beam_box.Min.Z > column_z_end
                    )

                    if not touches_column or not overlaps_column_height:
                        ignored_beams.append(
                            "{} | ID {} | does not reach column".format(
                                element_name(beam),
                                element_id_value(beam)
                            )
                        )
                        continue

                    joint_start = max(
                        beam_box.Min.Z,
                        column_z_start
                    )
                    joint_end = min(
                        beam_box.Max.Z,
                        column_z_end
                    )

                    if joint_end > joint_start:
                        beam_ranges.append({
                            "start": joint_start,
                            "end": joint_end,
                            "beam_ids": [element_id_value(beam)]
                        })

                joint_ranges = merge_joint_ranges(
                    beam_ranges,
                    mm(10.0)
                )

                if not joint_ranges:
                    OUT = [
                        "ERROR: None of the selected beams were "
                        "recognized as connected to the column.",
                        "Check the selected column and beams.",
                        ignored_beams
                    ]

                else:
                    # --------------------------------------------
                    # BUILD CLEAR-COLUMN TIE ZONES ONLY
                    # --------------------------------------------
                    # The entire merged depth of every detected beam
                    # joint is skipped. No joint tie set is created.
                    # No tie is placed at the bottom or top joint face.

                    zones = []
                    cursor = column_z_start
                    segment_number = 1

                    for joint in joint_ranges:
                        clear_end = joint["start"]

                        if clear_end > cursor + mm(1.0):
                            include_segment_start = (
                                abs(cursor - column_z_start)
                                <= mm(1.0)
                            )

                            add_clear_segment_zones(
                                zones,
                                segment_number,
                                cursor,
                                clear_end,
                                include_segment_start,
                                False,
                                confinement_spacing,
                                middle_spacing
                            )

                            segment_number += 1

                        # Jump to the top of the joint, leaving its
                        # entire depth free of generated column ties.
                        cursor = max(cursor, joint["end"])

                    # Create zones in the clear column portion above
                    # the highest detected joint, if one exists.
                    if column_z_end > cursor + mm(1.0):
                        add_clear_segment_zones(
                            zones,
                            segment_number,
                            cursor,
                            column_z_end,
                            False,
                            True,
                            confinement_spacing,
                            middle_spacing
                        )

                    zones.sort(
                        key=lambda zone: (
                            zone["start"],
                            zone["end"]
                        )
                    )

                    if not zones:
                        OUT = (
                            "ERROR: No valid clear-column tie zones "
                            "were generated."
                        )

                    else:
                        # ----------------------------------------
                        # FIND EXISTING TIES ON SELECTED COLUMN
                        # ----------------------------------------

                        existing_ties = []

                        all_rebars = (
                            FilteredElementCollector(doc)
                            .OfClass(Rebar)
                            .WhereElementIsNotElementType()
                            .ToElements()
                        )

                        for existing_rebar in all_rebars:
                            try:
                                same_host = (
                                    existing_rebar.GetHostId()
                                    == column.Id
                                )
                                is_tie = (
                                    existing_rebar.Style
                                    == RebarStyle.StirrupTie
                                )

                                if same_host and is_tie:
                                    existing_ties.append(
                                        existing_rebar
                                    )
                            except:
                                pass

                        deleted_count = len(existing_ties)
                        created_sets = []
                        joint_report = []
                        zone_report = []

                        for index, joint in enumerate(joint_ranges):
                            joint_report.append(
                                "Excluded joint {} | {:.0f} to "
                                "{:.0f} mm | Beam IDs: {}".format(
                                    index + 1,
                                    to_mm(joint["start"]),
                                    to_mm(joint["end"]),
                                    joint["beam_ids"]
                                )
                            )

                        # ----------------------------------------
                        # TRANSACTION
                        # ----------------------------------------

                        TransactionManager.Instance.EnsureInTransaction(
                            doc
                        )

                        sub_transaction = SubTransaction(doc)
                        sub_transaction.Start()

                        try:
                            # Delete only existing stirrup/tie rebars
                            # hosted by the selected column. Main bars
                            # are retained.
                            for existing_tie in existing_ties:
                                doc.Delete(existing_tie.Id)

                            for zone in zones:
                                new_tie = create_tie_set(
                                    column,
                                    tie_type,
                                    seismic_hook,
                                    x1,
                                    x2,
                                    y1,
                                    y2,
                                    zone
                                )

                                created_sets.append(new_tie)

                                zone_report.append(
                                    "{} | {} | {:.0f} to {:.0f} mm | "
                                    "length {:.0f} mm | maximum spacing "
                                    "{:.0f} mm | estimated ties {}".format(
                                        zone["name"],
                                        zone["type"],
                                        to_mm(zone["start"]),
                                        to_mm(zone["end"]),
                                        to_mm(
                                            zone["end"] - zone["start"]
                                        ),
                                        to_mm(zone["spacing"]),
                                        zone["estimated_quantity"]
                                    )
                                )

                            sub_transaction.Commit()
                            TransactionManager.Instance.TransactionTaskDone()

                            OUT = [
                                "SUCCESS: Clear-column tie zones created.",
                                "Execution order: main bars completed before ties.",
                                "Column ID: {}".format(
                                    element_id_value(column)
                                ),
                                "Existing tie sets deleted: {}".format(
                                    deleted_count
                                ),
                                "New tie sets created: {}".format(
                                    len(created_sets)
                                ),
                                "Beam joints excluded: {}".format(
                                    len(joint_ranges)
                                ),
                                "Beam-joint regions contain no generated ties.",
                                "No generated tie is placed at a joint face.",
                                "Confinement length rule: Lclear / 4",
                                "Middle-zone length: Lclear / 2",
                                "Confinement spacing: {:.0f} mm".format(
                                    confinement_spacing_mm
                                ),
                                "Middle spacing: {:.0f} mm".format(
                                    middle_spacing_mm
                                ),
                                "Hook type: {}".format(
                                    element_name(seismic_hook)
                                ),
                                "Excluded beam-joint report:",
                                joint_report,
                                "Ignored beam selections:",
                                ignored_beams,
                                "Tie-zone report:",
                                zone_report,
                                created_sets
                            ]

                        except Exception as error:
                            sub_transaction.RollBack()
                            TransactionManager.Instance.TransactionTaskDone()

                            OUT = [
                                "ERROR: No tie changes were retained.",
                                str(error)
                            ]
# ----------------------------------------
watch_6 = Watch(ties_stirrups)
