# Dynamo graph Column_Auto_Rebar.dyn (Dynamo 3.6.0.9395)

structural_column_types = StructuralColumnTypes("C1")
s01_read_data = Python(IN[0]=structural_column_types)  # CPython3
# ---------- s01_read_data.python (176 lines) ----------
# ============================================================
# S01 — READ SELECTED STRUCTURAL COLUMN TYPE
#
# IN[0] = Structural Column Type
#
# Finds all placed Structural Column instances that use
# the selected type.
#
# OUT:
# [0] Selected Column Type
# [1] Column Instances
# [2] Element IDs
# [3] Instance Count
# [4] Type Name
# ============================================================

import clr

# ------------------------------------------------------------
# REVIT SERVICES
# ------------------------------------------------------------

clr.AddReference("RevitServices")

from RevitServices.Persistence import DocumentManager


# ------------------------------------------------------------
# REVIT API
# ------------------------------------------------------------

clr.AddReference("RevitAPI")

from Autodesk.Revit.DB import (
    FilteredElementCollector,
    BuiltInCategory,
    FamilyInstance,
    ElementId
)


# ------------------------------------------------------------
# DYNAMO / REVIT NODES
# ------------------------------------------------------------

clr.AddReference("RevitNodes")

import Revit
clr.ImportExtensions(Revit.Elements)


# ------------------------------------------------------------
# DOCUMENT
# ------------------------------------------------------------

doc = DocumentManager.Instance.CurrentDBDocument


# ------------------------------------------------------------
# INPUT
# ------------------------------------------------------------

input_type = IN[0]


# ------------------------------------------------------------
# UNWRAP INPUT
# ------------------------------------------------------------

try:
    selected_type = UnwrapElement(input_type)
except:
    selected_type = input_type


# ------------------------------------------------------------
# VALIDATION
# ------------------------------------------------------------

if selected_type is None:

    OUT = [
        None,
        [],
        [],
        0,
        "No column type selected"
    ]

else:

    # --------------------------------------------------------
    # SELECTED TYPE ID
    # --------------------------------------------------------

    selected_type_id = selected_type.Id


    # --------------------------------------------------------
    # GET TYPE NAME
    # --------------------------------------------------------

    try:
        type_name = selected_type.Name

    except:

        try:
            type_name = selected_type.get_Parameter(
                BuiltInParameter.SYMBOL_NAME_PARAM
            ).AsString()

        except:
            type_name = "Unknown"


    # --------------------------------------------------------
    # COLLECT STRUCTURAL COLUMNS
    # --------------------------------------------------------

    all_columns = (
        FilteredElementCollector(doc)
        .OfCategory(BuiltInCategory.OST_StructuralColumns)
        .WhereElementIsNotElementType()
        .ToElements()
    )


    # --------------------------------------------------------
    # FILTER BY SELECTED TYPE
    # --------------------------------------------------------

    matching_columns = []

    for column in all_columns:

        try:

            if column.GetTypeId() == selected_type_id:
                matching_columns.append(column)

        except:
            pass


    # --------------------------------------------------------
    # ELEMENT IDS
    # --------------------------------------------------------

    element_ids = []

    for column in matching_columns:

        try:
            element_ids.append(column.Id.Value)

        except:

            try:
                element_ids.append(column.Id.IntegerValue)

            except:
                element_ids.append(str(column.Id))


    # --------------------------------------------------------
    # OUTPUT
    # --------------------------------------------------------

    OUT = [
        selected_type,
        matching_columns,
        element_ids,
        len(matching_columns),
        type_name
    ]
# ----------------------------------------
s02_geometry = Python(IN[0]=s01_read_data)  # CPython3
# ---------- s02_geometry.python (578 lines) ----------
# ============================================================
# S02 — READ COLUMN GEOMETRY
#
# IN[0] = S01 OUT[1]
#
# Accepts nested Dynamo lists.
#
# OUT:
# [0]  Columns
# [1]  Width mm
# [2]  Depth mm
# [3]  Height mm
# [4]  Base Elevation mm
# [5]  Top Elevation mm
# [6]  Rotation degrees
# [7]  Center XYZ
# [8]  Local X Direction
# [9]  Local Y Direction
# [10] Diagnostic
# ============================================================

import clr
import math


# ------------------------------------------------------------
# REVIT SERVICES
# ------------------------------------------------------------

clr.AddReference("RevitServices")

from RevitServices.Persistence import DocumentManager

doc = DocumentManager.Instance.CurrentDBDocument


# ------------------------------------------------------------
# REVIT API
# ------------------------------------------------------------

clr.AddReference("RevitAPI")

from Autodesk.Revit.DB import (
    XYZ,
    LocationPoint,
    UnitUtils,
    UnitTypeId
)


# ------------------------------------------------------------
# REVIT NODES
# ------------------------------------------------------------

clr.AddReference("RevitNodes")

import Revit

clr.ImportExtensions(Revit.Elements)


# ============================================================
# FUNCTIONS
# ============================================================


# ------------------------------------------------------------
# RECURSIVELY FLATTEN INPUT
# ------------------------------------------------------------

def flatten(data):

    result = []

    if isinstance(data, (list, tuple)):

        for item in data:
            result.extend(flatten(item))

    else:

        if data is not None:
            result.append(data)

    return result


# ------------------------------------------------------------
# UNWRAP ELEMENT
# ------------------------------------------------------------

def unwrap(item):

    try:
        return UnwrapElement(item)

    except:
        return item


# ------------------------------------------------------------
# FEET TO MILLIMETRES
# ------------------------------------------------------------

def ft_to_mm(value):

    if value is None:
        return None

    try:

        return UnitUtils.ConvertFromInternalUnits(
            value,
            UnitTypeId.Millimeters
        )

    except:

        return value * 304.8


# ------------------------------------------------------------
# GET PARAMETER
# ------------------------------------------------------------

def get_parameter(element, names):

    if element is None:
        return None

    for name in names:

        try:

            parameter = element.LookupParameter(name)

            if parameter is not None:

                if parameter.HasValue:

                    return parameter.AsDouble()

        except:
            pass

    return None


# ------------------------------------------------------------
# GET COLUMN DIMENSIONS
# ------------------------------------------------------------

def get_dimensions(column):

    width = None
    depth = None

    try:

        type_id = column.GetTypeId()

        column_type = doc.GetElement(type_id)

    except:

        column_type = None


    if column_type is None:
        return None, None


    # --------------------------------------------------------
    # WIDTH
    # --------------------------------------------------------

    width_names = [
        "b",
        "B",
        "Width",
        "WIDTH",
        "Width 1"
    ]


    # --------------------------------------------------------
    # DEPTH
    # --------------------------------------------------------

    depth_names = [
        "h",
        "H",
        "Depth",
        "DEPTH",
        "Height",
        "Depth 1"
    ]


    width = get_parameter(
        column_type,
        width_names
    )

    depth = get_parameter(
        column_type,
        depth_names
    )


    return width, depth


# ------------------------------------------------------------
# GET COLUMN VERTICAL GEOMETRY
# ------------------------------------------------------------

def get_vertical_geometry(column):

    try:

        bbox = column.get_BoundingBox(None)

    except:

        return None, None, None, None


    if bbox is None:

        return None, None, None, None


    z_min = bbox.Min.Z
    z_max = bbox.Max.Z

    height = z_max - z_min


    center = XYZ(
        (bbox.Min.X + bbox.Max.X) / 2.0,
        (bbox.Min.Y + bbox.Max.Y) / 2.0,
        (bbox.Min.Z + bbox.Max.Z) / 2.0
    )


    return (
        z_min,
        z_max,
        height,
        center
    )


# ------------------------------------------------------------
# GET COLUMN ORIENTATION
# ------------------------------------------------------------

def get_orientation(column):

    rotation = 0.0
    insertion_point = None


    try:

        location = column.Location

        if isinstance(location, LocationPoint):

            insertion_point = location.Point

            rotation = location.Rotation

    except:
        pass


    # --------------------------------------------------------
    # LOCAL X DIRECTION
    # --------------------------------------------------------

    local_x = XYZ(
        math.cos(rotation),
        math.sin(rotation),
        0.0
    )


    # --------------------------------------------------------
    # LOCAL Y DIRECTION
    # --------------------------------------------------------

    local_y = XYZ(
        -math.sin(rotation),
        math.cos(rotation),
        0.0
    )


    return (
        rotation,
        insertion_point,
        local_x,
        local_y
    )


# ============================================================
# INPUT
# ============================================================

raw_input = IN[0]


# ------------------------------------------------------------
# FLATTEN INPUT COMPLETELY
# ------------------------------------------------------------

flat_input = flatten(raw_input)


# ------------------------------------------------------------
# UNWRAP
# ------------------------------------------------------------

columns = []


for item in flat_input:

    element = unwrap(item)

    if element is None:
        continue


    # --------------------------------------------------------
    # ONLY ACCEPT ACTUAL REVIT ELEMENTS
    # --------------------------------------------------------

    try:

        element.Id

        columns.append(element)

    except:

        pass


# ============================================================
# OUTPUT LISTS
# ============================================================

widths = []

depths = []

heights = []

base_elevations = []

top_elevations = []

rotations = []

centers = []

local_x_directions = []

local_y_directions = []

diagnostics = []


# ============================================================
# PROCESS EACH COLUMN
# ============================================================

for column in columns:

    messages = []


    # --------------------------------------------------------
    # COLUMN DIMENSIONS
    # --------------------------------------------------------

    width, depth = get_dimensions(column)


    if width is not None:

        width_mm = ft_to_mm(width)

    else:

        width_mm = None

        messages.append(
            "Width parameter not found"
        )


    if depth is not None:

        depth_mm = ft_to_mm(depth)

    else:

        depth_mm = None

        messages.append(
            "Depth parameter not found"
        )


    # --------------------------------------------------------
    # VERTICAL GEOMETRY
    # --------------------------------------------------------

    (
        z_min,
        z_max,
        height,
        bbox_center

    ) = get_vertical_geometry(column)


    if z_min is not None:

        base_mm = ft_to_mm(z_min)

        top_mm = ft_to_mm(z_max)

        height_mm = ft_to_mm(height)

    else:

        base_mm = None

        top_mm = None

        height_mm = None

        messages.append(
            "Bounding box unavailable"
        )


    # --------------------------------------------------------
    # ORIENTATION
    # --------------------------------------------------------

    (
        rotation,
        insertion_point,
        local_x,
        local_y

    ) = get_orientation(column)


    rotation_degrees = math.degrees(
        rotation
    )


    # --------------------------------------------------------
    # COLUMN CENTER
    # --------------------------------------------------------

    if (
        insertion_point is not None
        and
        bbox_center is not None
    ):

        center = XYZ(
            insertion_point.X,
            insertion_point.Y,
            bbox_center.Z
        )

    elif bbox_center is not None:

        center = bbox_center

    else:

        center = None


    # --------------------------------------------------------
    # DIAGNOSTIC
    # --------------------------------------------------------

    if len(messages) == 0:

        messages.append("OK")


    # --------------------------------------------------------
    # STORE RESULTS
    # --------------------------------------------------------

    widths.append(
        width_mm
    )

    depths.append(
        depth_mm
    )

    heights.append(
        height_mm
    )

    base_elevations.append(
        base_mm
    )

    top_elevations.append(
        top_mm
    )

    rotations.append(
        rotation_degrees
    )

    centers.append(
        center
    )

    local_x_directions.append(
        local_x
    )

    local_y_directions.append(
        local_y
    )

    diagnostics.append(
        " | ".join(messages)
    )


# ============================================================
# OUTPUT
# ============================================================

OUT = [

    columns,                 # 0

    widths,                  # 1

    depths,                  # 2

    heights,                 # 3

    base_elevations,         # 4

    top_elevations,          # 5

    rotations,               # 6

    centers,                 # 7

    local_x_directions,      # 8

    local_y_directions,      # 9

    diagnostics              # 10
]
# ----------------------------------------
s03_intersection = Python(IN[0]=s02_geometry)  # CPython3
# ---------- s03_intersection.python (1385 lines) ----------
# ============================================================
# S03 — COLUMN SUPPORT DETECTOR
#
# IN[0] = Columns from S02
#
# PURPOSE
# ------------------------------------------------------------
# Detect all structural framing and foundations associated
# with each selected structural column.
#
# Detection:
#   Beam       = LocationCurve crossing column footprint
#   Foundation = Column center inside foundation footprint
#
# IMPORTANT:
# S03 DOES NOT calculate confinement zones.
#
# It only detects and packages support information.
#
#
# OUTPUT
# ------------------------------------------------------------
#
# OUT = [
#
#   [                         # COLUMN 0 PACKAGE
#       Column,               # [0]
#       Column ID,            # [1]
#       Column Bottom mm,     # [2]
#       Column Top mm,        # [3]
#       Foundation Top mm,    # [4]
#
#       [                     # [5] BEAM JOINT DATA
#           [
#               Beam Bottom mm,
#               Beam Top mm,
#               Beam ID,
#               Beam Element
#           ],
#           ...
#       ],
#
#       [                     # [6] FOUNDATION DATA
#           [
#               Foundation Bottom mm,
#               Foundation Top mm,
#               Foundation ID,
#               Foundation Element
#           ],
#           ...
#       ],
#
#       Diagnostic            # [7]
#   ],
#
#   ...
# ]
#
# S03 OUT → S04 IN[0]
#
# ============================================================


import clr


# ============================================================
# REVIT SERVICES
# ============================================================

clr.AddReference("RevitServices")

from RevitServices.Persistence import DocumentManager

doc = DocumentManager.Instance.CurrentDBDocument


# ============================================================
# REVIT API
# ============================================================

clr.AddReference("RevitAPI")

from Autodesk.Revit.DB import (
    XYZ,
    BuiltInCategory,
    FilteredElementCollector,
    LocationCurve,
    UnitUtils,
    UnitTypeId
)


# ============================================================
# REVIT NODES
# ============================================================

clr.AddReference("RevitNodes")

import Revit

clr.ImportExtensions(
    Revit.Elements
)


# ============================================================
# SETTINGS
# ============================================================

# Extra plan allowance around the column for beam detection.

BEAM_PLAN_TOLERANCE_MM = 100.0


# Vertical allowance for joined/cut geometry.

VERTICAL_TOLERANCE_MM = 100.0


# Foundation plan allowance.

FOUNDATION_PLAN_TOLERANCE_MM = 100.0


# ============================================================
# UNIT CONVERSION
# ============================================================

def mm_to_ft(value):

    try:

        return UnitUtils.ConvertToInternalUnits(
            float(value),
            UnitTypeId.Millimeters
        )

    except:

        return float(value) / 304.8


def ft_to_mm(value):

    try:

        return UnitUtils.ConvertFromInternalUnits(
            float(value),
            UnitTypeId.Millimeters
        )

    except:

        return float(value) * 304.8


BEAM_PLAN_TOL = mm_to_ft(
    BEAM_PLAN_TOLERANCE_MM
)

VERTICAL_TOL = mm_to_ft(
    VERTICAL_TOLERANCE_MM
)

FOUNDATION_PLAN_TOL = mm_to_ft(
    FOUNDATION_PLAN_TOLERANCE_MM
)


# ============================================================
# GENERAL FUNCTIONS
# ============================================================

def flatten(data):

    result = []


    if isinstance(
        data,
        (list, tuple)
    ):

        for item in data:

            result.extend(
                flatten(item)
            )


    elif data is not None:

        result.append(
            data
        )


    return result


def unwrap(item):

    try:

        return UnwrapElement(
            item
        )

    except:

        return item


def get_id(element):

    if element is None:

        return None


    try:

        return int(
            element.Id.Value
        )

    except:
        pass


    try:

        return int(
            element.Id.IntegerValue
        )

    except:
        pass


    return None


# ============================================================
# BOUNDING BOX
# ============================================================

def get_bbox(element):

    try:

        return element.get_BoundingBox(
            None
        )

    except:

        return None


# ============================================================
# BBOX CENTER
# ============================================================

def bbox_center(bbox):

    return XYZ(

        (
            bbox.Min.X
            +
            bbox.Max.X
        ) / 2.0,

        (
            bbox.Min.Y
            +
            bbox.Max.Y
        ) / 2.0,

        (
            bbox.Min.Z
            +
            bbox.Max.Z
        ) / 2.0
    )


# ============================================================
# POINT INSIDE RECTANGLE
# ============================================================

def point_inside_rect(
    x,
    y,
    xmin,
    xmax,
    ymin,
    ymax
):

    return (

        x >= xmin
        and
        x <= xmax

        and

        y >= ymin
        and
        y <= ymax
    )


# ============================================================
# LINE SEGMENT INTERSECTION
# ============================================================

def orientation(
    ax,
    ay,
    bx,
    by,
    cx,
    cy
):

    value = (

        (by - ay)
        *
        (cx - bx)

        -

        (bx - ax)
        *
        (cy - by)
    )


    if abs(value) < 1e-9:

        return 0


    if value > 0:

        return 1


    return 2


def on_segment(
    ax,
    ay,
    bx,
    by,
    cx,
    cy
):

    return (

        bx <= max(ax, cx)
        and
        bx >= min(ax, cx)

        and

        by <= max(ay, cy)
        and
        by >= min(ay, cy)
    )


def segments_intersect(
    p1x,
    p1y,
    p2x,
    p2y,
    q1x,
    q1y,
    q2x,
    q2y
):

    o1 = orientation(
        p1x,
        p1y,
        p2x,
        p2y,
        q1x,
        q1y
    )


    o2 = orientation(
        p1x,
        p1y,
        p2x,
        p2y,
        q2x,
        q2y
    )


    o3 = orientation(
        q1x,
        q1y,
        q2x,
        q2y,
        p1x,
        p1y
    )


    o4 = orientation(
        q1x,
        q1y,
        q2x,
        q2y,
        p2x,
        p2y
    )


    # --------------------------------------------------------
    # GENERAL CASE
    # --------------------------------------------------------

    if (
        o1 != o2
        and
        o3 != o4
    ):

        return True


    # --------------------------------------------------------
    # COLLINEAR CASES
    # --------------------------------------------------------

    if (

        o1 == 0
        and
        on_segment(
            p1x,
            p1y,
            q1x,
            q1y,
            p2x,
            p2y
        )

    ):

        return True


    if (

        o2 == 0
        and
        on_segment(
            p1x,
            p1y,
            q2x,
            q2y,
            p2x,
            p2y
        )

    ):

        return True


    if (

        o3 == 0
        and
        on_segment(
            q1x,
            q1y,
            p1x,
            p1y,
            q2x,
            q2y
        )

    ):

        return True


    if (

        o4 == 0
        and
        on_segment(
            q1x,
            q1y,
            p2x,
            p2y,
            q2x,
            q2y
        )

    ):

        return True


    return False


# ============================================================
# SEGMENT / RECTANGLE
# ============================================================

def segment_intersects_rect(
    p1,
    p2,
    xmin,
    xmax,
    ymin,
    ymax
):

    # --------------------------------------------------------
    # ENDPOINT INSIDE RECTANGLE
    # --------------------------------------------------------

    if point_inside_rect(

        p1.X,
        p1.Y,

        xmin,
        xmax,

        ymin,
        ymax

    ):

        return True


    if point_inside_rect(

        p2.X,
        p2.Y,

        xmin,
        xmax,

        ymin,
        ymax

    ):

        return True


    # --------------------------------------------------------
    # RECTANGLE EDGES
    # --------------------------------------------------------

    edges = [

        (
            xmin,
            ymin,
            xmax,
            ymin
        ),

        (
            xmax,
            ymin,
            xmax,
            ymax
        ),

        (
            xmax,
            ymax,
            xmin,
            ymax
        ),

        (
            xmin,
            ymax,
            xmin,
            ymin
        )
    ]


    # --------------------------------------------------------
    # TEST AGAINST EACH EDGE
    # --------------------------------------------------------

    for edge in edges:

        if segments_intersect(

            p1.X,
            p1.Y,

            p2.X,
            p2.Y,

            edge[0],
            edge[1],

            edge[2],
            edge[3]

        ):

            return True


    return False


# ============================================================
# VERTICAL OVERLAP
# ============================================================

def vertical_overlap(
    bbox_a,
    bbox_b
):

    if bbox_a is None:

        return False


    if bbox_b is None:

        return False


    # --------------------------------------------------------
    # A ABOVE B
    # --------------------------------------------------------

    if (

        bbox_a.Min.Z
        >
        bbox_b.Max.Z
        +
        VERTICAL_TOL

    ):

        return False


    # --------------------------------------------------------
    # A BELOW B
    # --------------------------------------------------------

    if (

        bbox_a.Max.Z
        <
        bbox_b.Min.Z
        -
        VERTICAL_TOL

    ):

        return False


    return True


# ============================================================
# BEAM / COLUMN DETECTION
# ============================================================

def beam_hits_column(
    beam,
    beam_bbox,
    column_bbox
):

    # --------------------------------------------------------
    # VERTICAL CHECK
    # --------------------------------------------------------

    if not vertical_overlap(

        beam_bbox,
        column_bbox

    ):

        return False


    # --------------------------------------------------------
    # BEAM LOCATION CURVE
    # --------------------------------------------------------

    try:

        location = beam.Location

    except:

        return False


    if not isinstance(
        location,
        LocationCurve
    ):

        return False


    try:

        curve = location.Curve

        p1 = curve.GetEndPoint(
            0
        )

        p2 = curve.GetEndPoint(
            1
        )

    except:

        return False


    # --------------------------------------------------------
    # EXPANDED COLUMN FOOTPRINT
    # --------------------------------------------------------

    xmin = (

        column_bbox.Min.X
        -
        BEAM_PLAN_TOL
    )


    xmax = (

        column_bbox.Max.X
        +
        BEAM_PLAN_TOL
    )


    ymin = (

        column_bbox.Min.Y
        -
        BEAM_PLAN_TOL
    )


    ymax = (

        column_bbox.Max.Y
        +
        BEAM_PLAN_TOL
    )


    # --------------------------------------------------------
    # PLAN CHECK
    # --------------------------------------------------------

    return segment_intersects_rect(

        p1,
        p2,

        xmin,
        xmax,

        ymin,
        ymax
    )


# ============================================================
# FOUNDATION / COLUMN DETECTION
# ============================================================

def foundation_hits_column(
    foundation_bbox,
    column_bbox,
    center
):

    if foundation_bbox is None:

        return False


    # --------------------------------------------------------
    # PLAN CHECK
    # --------------------------------------------------------

    inside = (

        center.X
        >=
        foundation_bbox.Min.X
        -
        FOUNDATION_PLAN_TOL

        and

        center.X
        <=
        foundation_bbox.Max.X
        +
        FOUNDATION_PLAN_TOL

        and

        center.Y
        >=
        foundation_bbox.Min.Y
        -
        FOUNDATION_PLAN_TOL

        and

        center.Y
        <=
        foundation_bbox.Max.Y
        +
        FOUNDATION_PLAN_TOL
    )


    if not inside:

        return False


    # --------------------------------------------------------
    # FOUNDATION MUST BE ASSOCIATED WITH LOWER COLUMN END
    #
    # Foundation top can equal or slightly overlap the
    # column bottom.
    # --------------------------------------------------------

    column_bottom = (
        column_bbox.Min.Z
    )


    foundation_top = (
        foundation_bbox.Max.Z
    )


    # --------------------------------------------------------
    # Foundation completely above column bottom = reject.
    #
    # This prevents floor/slab-like foundation elements at
    # higher elevations from being mistaken for the footing.
    # --------------------------------------------------------

    if (

        foundation_bbox.Min.Z
        >
        column_bottom
        +
        VERTICAL_TOL

    ):

        return False


    # --------------------------------------------------------
    # Foundation too far below the column = reject.
    # --------------------------------------------------------

    if (

        foundation_top
        <
        column_bottom
        -
        VERTICAL_TOL

    ):

        return False


    return True


# ============================================================
# INPUT
# ============================================================

raw_columns = flatten(
    IN[0]
)


columns = []


for item in raw_columns:

    element = unwrap(
        item
    )


    if element is None:

        continue


    try:

        element.Id

        columns.append(
            element
        )

    except:

        pass


# ============================================================
# COLLECT STRUCTURAL FRAMING
# ============================================================

beams = list(

    FilteredElementCollector(doc)

    .OfCategory(
        BuiltInCategory.OST_StructuralFraming
    )

    .WhereElementIsNotElementType()

    .ToElements()
)


# ============================================================
# COLLECT FOUNDATIONS
# ============================================================

foundations = list(

    FilteredElementCollector(doc)

    .OfCategory(
        BuiltInCategory.OST_StructuralFoundation
    )

    .WhereElementIsNotElementType()

    .ToElements()
)


# ============================================================
# CACHE BEAM BOUNDING BOXES
# ============================================================

beam_bboxes = {}


for beam in beams:

    eid = get_id(
        beam
    )


    if eid is not None:

        beam_bboxes[eid] = (
            get_bbox(
                beam
            )
        )


# ============================================================
# CACHE FOUNDATION BOUNDING BOXES
# ============================================================

foundation_bboxes = {}


for foundation in foundations:

    eid = get_id(
        foundation
    )


    if eid is not None:

        foundation_bboxes[eid] = (
            get_bbox(
                foundation
            )
        )


# ============================================================
# RESULT
# ============================================================

support_packages = []


# ============================================================
# PROCESS EACH COLUMN
# ============================================================

for column in columns:

    column_id = get_id(
        column
    )


    column_bbox = get_bbox(
        column
    )


    # ========================================================
    # INVALID COLUMN
    # ========================================================

    if column_bbox is None:

        support_packages.append(

            [
                column,
                column_id,
                None,
                None,
                None,
                [],
                [],
                "Column {} | ERROR: no bounding box".format(
                    column_id
                )
            ]
        )


        continue


    # ========================================================
    # COLUMN DATA
    # ========================================================

    column_bottom_mm = ft_to_mm(
        column_bbox.Min.Z
    )


    column_top_mm = ft_to_mm(
        column_bbox.Max.Z
    )


    center = bbox_center(
        column_bbox
    )


    # ========================================================
    # DETECT BEAMS
    # ========================================================

    beam_package = []


    for beam in beams:

        beam_id = get_id(
            beam
        )


        if beam_id is None:

            continue


        beam_bbox = beam_bboxes.get(
            beam_id
        )


        if beam_bbox is None:

            continue


        try:

            hit = beam_hits_column(

                beam,
                beam_bbox,
                column_bbox
            )

        except:

            hit = False


        if not hit:

            continue


        # ----------------------------------------------------
        # BEAM ELEVATIONS
        # ----------------------------------------------------

        beam_bottom_mm = ft_to_mm(
            beam_bbox.Min.Z
        )


        beam_top_mm = ft_to_mm(
            beam_bbox.Max.Z
        )


        beam_package.append(

            [
                beam_bottom_mm,    # 0
                beam_top_mm,       # 1
                beam_id,           # 2
                beam               # 3
            ]
        )


    # ========================================================
    # SORT BEAMS BY BOTTOM ELEVATION
    # ========================================================

    beam_package.sort(
        key=lambda x: x[0]
    )


    # ========================================================
    # DETECT FOUNDATIONS
    # ========================================================

    foundation_package = []


    for foundation in foundations:

        foundation_id = get_id(
            foundation
        )


        if foundation_id is None:

            continue


        foundation_bbox = (
            foundation_bboxes.get(
                foundation_id
            )
        )


        if foundation_bbox is None:

            continue


        try:

            hit = foundation_hits_column(

                foundation_bbox,

                column_bbox,

                center
            )

        except:

            hit = False


        if not hit:

            continue


        foundation_bottom_mm = (
            ft_to_mm(
                foundation_bbox.Min.Z
            )
        )


        foundation_top_mm = (
            ft_to_mm(
                foundation_bbox.Max.Z
            )
        )


        foundation_package.append(

            [
                foundation_bottom_mm,   # 0
                foundation_top_mm,      # 1
                foundation_id,          # 2
                foundation              # 3
            ]
        )


    # ========================================================
    # SORT FOUNDATIONS
    # ========================================================

    foundation_package.sort(
        key=lambda x: x[1]
    )


    # ========================================================
    # DETERMINE PRIMARY FOUNDATION TOP
    # ========================================================

    foundation_top = None


    if len(
        foundation_package
    ) > 0:

        # ----------------------------------------------------
        # Choose foundation whose TOP is closest to the
        # column bottom.
        # ----------------------------------------------------

        closest_foundation = min(

            foundation_package,

            key=lambda x:
            abs(
                x[1]
                -
                column_bottom_mm
            )
        )


        foundation_top = (
            closest_foundation[1]
        )


    # ========================================================
    # DIAGNOSTIC
    # ========================================================

    diagnostic = (

        "Column {} | "
        "Z={:.0f} to {:.0f} mm | "
        "Beams={} | "
        "Foundations={} | "
        "FoundationTop={}"
    ).format(

        column_id,

        column_bottom_mm,

        column_top_mm,

        len(
            beam_package
        ),

        len(
            foundation_package
        ),

        (
            "{:.0f}".format(
                foundation_top
            )

            if
            foundation_top is not None

            else
            "NONE"
        )
    )


    # ========================================================
    # ONE PACKAGE FOR THIS COLUMN
    # ========================================================

    support_package = [

        column,                 # 0

        column_id,              # 1

        column_bottom_mm,       # 2

        column_top_mm,          # 3

        foundation_top,         # 4

        beam_package,           # 5

        foundation_package,     # 6

        diagnostic              # 7
    ]


    support_packages.append(
        support_package
    )


# ============================================================
# OUTPUT
# ============================================================

OUT = support_packages
# ----------------------------------------
bar_diameter = DoubleSlider(10, range=10..12 step 2)
confinement_spacing = DoubleSlider(100, range=75..125 step 5)
confinement_spacing_2 = DoubleSlider(150, range=125..200 step 25)
concrete_cover = DoubleSlider(40, range=40..75 step 35)
s04_confinement_zones = Python(IN[0]=s03_intersection, IN[1]=bar_diameter, IN[2]=confinement_spacing, IN[3]=confinement_spacing_2, IN[4]=concrete_cover)  # CPython3
# ---------- s04_confinement_zones.python (1334 lines) ----------
# ============================================================
# S04 — COLUMN CONFINEMENT ZONE + REBAR SETTINGS
#
# IN[0] = S03 Support Package
# IN[1] = Tie Diameter (mm)
# IN[2] = Confinement Spacing (mm)
# IN[3] = Regular Spacing (mm)
# IN[4] = Concrete Cover (mm)
#
# CONFINEMENT RULE:
#
# Code-style minimum:
#
# Lo = MAX(
#       Column Max Dimension,
#       Clear Height / 6,
#       450 mm
#      )
#
# Construction rule:
#
# L/4 = Clear Height / 4
#
# FINAL CONFINEMENT LENGTH:
#
# Lc = MAX(L/4, Lo)
#
# Therefore:
#
# Lc = MAX(
#       Clear Height / 4,
#       Column Max Dimension,
#       Clear Height / 6,
#       450 mm
#      )
#
#
# OUTPUT PACKAGE:
#
# [
#     Column,                  # [0]
#     Column ID,               # [1]
#     Clear Segments,          # [2]
#     Confinement Zones,       # [3]
#     Normal Zones,            # [4]
#     Confinement Spacing,     # [5]
#     Regular Spacing,         # [6]
#     Beam Joints,             # [7]
#     Column Max Dimension,    # [8]
#     Confinement Data,        # [9]
#     Tie Diameter,            # [10]
#     Concrete Cover           # [11]
# ]
#
# ============================================================


import clr


# ============================================================
# REVIT SERVICES
# ============================================================

clr.AddReference("RevitServices")

from RevitServices.Persistence import DocumentManager

doc = DocumentManager.Instance.CurrentDBDocument


# ============================================================
# REVIT API
# ============================================================

clr.AddReference("RevitAPI")

from Autodesk.Revit.DB import (
    UnitUtils,
    UnitTypeId
)


# ============================================================
# REVIT NODES
# ============================================================

clr.AddReference("RevitNodes")

import Revit

clr.ImportExtensions(
    Revit.Elements
)


# ============================================================
# CONSTANTS
# ============================================================

MINIMUM_LO_MM = 450.0

TOLERANCE_MM = 5.0


# ============================================================
# BASIC HELPERS
# ============================================================

def is_list(value):

    return isinstance(
        value,
        (list, tuple)
    )


def unwrap(value):

    try:

        return UnwrapElement(
            value
        )

    except:

        return value


def to_float(value):

    try:

        if value is None:

            return None

        return float(value)

    except:

        return None


def ft_to_mm(value):

    try:

        return UnitUtils.ConvertFromInternalUnits(
            float(value),
            UnitTypeId.Millimeters
        )

    except:

        return float(value) * 304.8


# ============================================================
# SAFE INPUT READER
# ============================================================

def get_input(index):

    try:

        if len(IN) > index:

            return IN[index]

    except:

        pass

    return None


# ============================================================
# READ USER SETTINGS
# ============================================================

data = get_input(0)

tie_diameter_mm = to_float(
    get_input(1)
)

confinement_spacing_mm = to_float(
    get_input(2)
)

regular_spacing_mm = to_float(
    get_input(3)
)

cover_mm = to_float(
    get_input(4)
)


# ============================================================
# INPUT VALIDATION
# ============================================================

input_errors = []


if tie_diameter_mm is None:

    input_errors.append(
        "Tie Diameter is missing or invalid."
    )

elif tie_diameter_mm <= 0:

    input_errors.append(
        "Tie Diameter must be greater than 0."
    )


if confinement_spacing_mm is None:

    input_errors.append(
        "Confinement Spacing is missing or invalid."
    )

elif confinement_spacing_mm <= 0:

    input_errors.append(
        "Confinement Spacing must be greater than 0."
    )


if regular_spacing_mm is None:

    input_errors.append(
        "Regular Spacing is missing or invalid."
    )

elif regular_spacing_mm <= 0:

    input_errors.append(
        "Regular Spacing must be greater than 0."
    )


if cover_mm is None:

    input_errors.append(
        "Concrete Cover is missing or invalid."
    )

elif cover_mm < 0:

    input_errors.append(
        "Concrete Cover cannot be negative."
    )


# ============================================================
# PARAMETER READER
# ============================================================

def get_parameter_double(
    element,
    names
):

    if element is None:

        return None


    for name in names:

        try:

            parameter = element.LookupParameter(
                name
            )


            if parameter is None:

                continue


            if not parameter.HasValue:

                continue


            value = parameter.AsDouble()


            if (
                value is not None
                and
                value > 0
            ):

                return value

        except:

            pass


    return None


# ============================================================
# COLUMN DIMENSIONS
# ============================================================

def get_column_dimensions_mm(
    column
):

    column = unwrap(
        column
    )


    if column is None:

        return (
            None,
            None,
            None
        )


    # ========================================================
    # GET COLUMN TYPE
    # ========================================================

    column_type = None


    try:

        column_type = doc.GetElement(
            column.GetTypeId()
        )

    except:

        pass


    # ========================================================
    # WIDTH
    # ========================================================

    width_ft = get_parameter_double(

        column_type,

        [
            "b",
            "B",
            "Width",
            "WIDTH",
            "Width 1"
        ]
    )


    # ========================================================
    # DEPTH
    # ========================================================

    depth_ft = get_parameter_double(

        column_type,

        [
            "h",
            "H",
            "Depth",
            "DEPTH",
            "Height",
            "Depth 1"
        ]
    )


    # ========================================================
    # TYPE PARAMETERS FOUND
    # ========================================================

    if (
        width_ft is not None
        and
        depth_ft is not None
    ):

        width_mm = ft_to_mm(
            width_ft
        )


        depth_mm = ft_to_mm(
            depth_ft
        )


        max_dimension_mm = max(
            width_mm,
            depth_mm
        )


        return (
            width_mm,
            depth_mm,
            max_dimension_mm
        )


    # ========================================================
    # BOUNDING BOX FALLBACK
    # ========================================================

    bbox = None


    try:

        bbox = column.get_BoundingBox(
            None
        )

    except:

        pass


    if bbox is None:

        return (
            None,
            None,
            None
        )


    width_mm = ft_to_mm(
        bbox.Max.X
        -
        bbox.Min.X
    )


    depth_mm = ft_to_mm(
        bbox.Max.Y
        -
        bbox.Min.Y
    )


    max_dimension_mm = max(
        width_mm,
        depth_mm
    )


    return (
        width_mm,
        depth_mm,
        max_dimension_mm
    )


# ============================================================
# BEAM JOINT DETECTION FROM S03 PACKAGE
# ============================================================

def get_beam_joints(
    beam_package,
    column_start,
    column_top
):

    raw = []


    if not is_list(
        beam_package
    ):

        return []


    for beam_data in beam_package:

        if not is_list(
            beam_data
        ):

            continue


        if len(beam_data) < 2:

            continue


        bottom = to_float(
            beam_data[0]
        )


        top = to_float(
            beam_data[1]
        )


        if (
            bottom is None
            or
            top is None
        ):

            continue


        beam_id = None


        if len(beam_data) >= 3:

            beam_id = beam_data[2]


        # ====================================================
        # CORRECT ORDER
        # ====================================================

        if top < bottom:

            temp = bottom

            bottom = top

            top = temp


        # ====================================================
        # IGNORE JOINTS OUTSIDE COLUMN
        # ====================================================

        if (
            top
            <
            column_start
            -
            TOLERANCE_MM
        ):

            continue


        if (
            bottom
            >
            column_top
            +
            TOLERANCE_MM
        ):

            continue


        # ====================================================
        # CLAMP TO COLUMN
        # ====================================================

        bottom = max(
            bottom,
            column_start
        )


        top = min(
            top,
            column_top
        )


        raw.append(
            [
                bottom,
                top,
                beam_id
            ]
        )


    # ========================================================
    # SORT BY ELEVATION
    # ========================================================

    raw.sort(
        key=lambda x: x[0]
    )


    # ========================================================
    # MERGE OVERLAPPING BEAMS INTO ONE JOINT
    # ========================================================

    joints = []


    for item in raw:

        bottom = item[0]

        top = item[1]

        beam_id = item[2]


        # ====================================================
        # FIRST JOINT
        # ====================================================

        if len(joints) == 0:

            ids = []


            if beam_id is not None:

                ids.append(
                    beam_id
                )


            joints.append(
                [
                    bottom,
                    top,
                    ids
                ]
            )


            continue


        last = joints[-1]


        # ====================================================
        # OVERLAPPING JOINT
        # ====================================================

        if (
            bottom
            <=
            last[1]
            +
            TOLERANCE_MM
        ):

            last[0] = min(
                last[0],
                bottom
            )


            last[1] = max(
                last[1],
                top
            )


            if (
                beam_id is not None
                and
                beam_id not in last[2]
            ):

                last[2].append(
                    beam_id
                )


        # ====================================================
        # NEW JOINT
        # ====================================================

        else:

            ids = []


            if beam_id is not None:

                ids.append(
                    beam_id
                )


            joints.append(
                [
                    bottom,
                    top,
                    ids
                ]
            )


    return joints


# ============================================================
# CLEAR COLUMN SEGMENTS
#
# Beam depth itself is excluded.
# ============================================================

def get_clear_segments(
    column_start,
    column_top,
    beam_joints
):

    clear_segments = []

    current = column_start


    for joint in beam_joints:

        beam_bottom = joint[0]

        beam_top = joint[1]


        # ====================================================
        # JOINT BELOW CURRENT POSITION
        # ====================================================

        if (
            beam_top
            <=
            current
            +
            TOLERANCE_MM
        ):

            continue


        # ====================================================
        # COLUMN BELOW JOINT
        # ====================================================

        if (
            beam_bottom
            >
            current
            +
            TOLERANCE_MM
        ):

            clear_segments.append(
                [
                    current,
                    beam_bottom
                ]
            )


        # ====================================================
        # SKIP BEAM DEPTH
        # ====================================================

        if beam_top > current:

            current = beam_top


    # ========================================================
    # FINAL CLEAR SEGMENT
    # ========================================================

    if (
        column_top
        >
        current
        +
        TOLERANCE_MM
    ):

        clear_segments.append(
            [
                current,
                column_top
            ]
        )


    return clear_segments


# ============================================================
# CONFINEMENT LENGTH
#
# Lo = max(h, L/6, 450)
#
# Construction confinement:
#
# Lc = max(L/4, Lo)
# ============================================================

def calculate_confinement_length(
    clear_height_mm,
    max_column_dimension_mm
):

    # ========================================================
    # L / 4
    # ========================================================

    quarter_height = (
        clear_height_mm
        /
        4.0
    )


    # ========================================================
    # L / 6
    # ========================================================

    sixth_height = (
        clear_height_mm
        /
        6.0
    )


    # ========================================================
    # CODE-STYLE Lo
    # ========================================================

    lo = max(
        max_column_dimension_mm,
        sixth_height,
        MINIMUM_LO_MM
    )


    # ========================================================
    # FINAL CONSTRUCTION CONFINEMENT LENGTH
    # ========================================================

    confinement_length = max(
        quarter_height,
        lo
    )


    return (
        confinement_length,
        quarter_height,
        lo,
        max_column_dimension_mm,
        sixth_height,
        MINIMUM_LO_MM
    )


# ============================================================
# CREATE REINFORCEMENT ZONES
# ============================================================

def get_rebar_zones(
    clear_segments,
    max_column_dimension_mm
):

    confinement_zones = []

    normal_zones = []

    confinement_data = []


    for segment_index in range(
        len(clear_segments)
    ):

        segment = clear_segments[
            segment_index
        ]


        start = segment[0]

        end = segment[1]


        clear_height = (
            end
            -
            start
        )


        if clear_height <= TOLERANCE_MM:

            continue


        # ====================================================
        # CALCULATE CONFINEMENT LENGTH
        # ====================================================

        (
            confinement_length,
            quarter_height,
            lo,
            column_dimension,
            sixth_height,
            minimum_lo

        ) = calculate_confinement_length(

            clear_height,

            max_column_dimension_mm
        )


        # ====================================================
        # STORE CALCULATION
        #
        # [
        #   Segment Index,
        #   Clear Height,
        #   L/4,
        #   Column Max Dimension,
        #   L/6,
        #   450,
        #   Lo,
        #   Final Lc
        # ]
        # ====================================================

        confinement_data.append(
            [
                segment_index,          # 0

                clear_height,           # 1

                quarter_height,         # 2

                column_dimension,       # 3

                sixth_height,           # 4

                minimum_lo,             # 5

                lo,                     # 6

                confinement_length      # 7
            ]
        )


        # ====================================================
        # SHORT SEGMENT
        #
        # If confinement zones overlap:
        #
        # entire segment = confinement.
        # ====================================================

        if (
            2.0
            *
            confinement_length

            >=

            clear_height
            -
            TOLERANCE_MM
        ):

            confinement_zones.append(
                [
                    start,
                    end,
                    segment_index,
                    confinement_length
                ]
            )


            continue


        # ====================================================
        # LOWER CONFINEMENT
        # ====================================================

        lower_end = (
            start
            +
            confinement_length
        )


        confinement_zones.append(
            [
                start,
                lower_end,
                segment_index,
                confinement_length
            ]
        )


        # ====================================================
        # REGULAR MIDDLE ZONE
        # ====================================================

        middle_start = lower_end


        middle_end = (
            end
            -
            confinement_length
        )


        if (
            middle_end
            >
            middle_start
            +
            TOLERANCE_MM
        ):

            normal_zones.append(
                [
                    middle_start,
                    middle_end,
                    segment_index,
                    confinement_length
                ]
            )


        # ====================================================
        # UPPER CONFINEMENT
        # ====================================================

        upper_start = (
            end
            -
            confinement_length
        )


        confinement_zones.append(
            [
                upper_start,
                end,
                segment_index,
                confinement_length
            ]
        )


    return (
        confinement_zones,
        normal_zones,
        confinement_data
    )


# ============================================================
# NORMALIZE S03 INPUT
# ============================================================

if data is None:

    packages = []


elif is_list(
    data
):

    packages = list(
        data
    )


else:

    packages = [
        data
    ]


# ============================================================
# RESULT
# ============================================================

result = []


# ============================================================
# ONLY PROCESS IF INPUT SETTINGS ARE VALID
# ============================================================

if len(input_errors) == 0:

    for package in packages:

        # ====================================================
        # VALIDATE S03 PACKAGE
        # ====================================================

        if not is_list(
            package
        ):

            continue


        if len(package) < 6:

            continue


        # ====================================================
        # READ S03 DATA
        # ====================================================

        column = package[0]

        column_id = package[1]


        column_bottom = to_float(
            package[2]
        )


        column_top = to_float(
            package[3]
        )


        foundation_top = to_float(
            package[4]
        )


        beam_package = package[5]


        # ====================================================
        # COLUMN HEIGHT VALIDATION
        # ====================================================

        if (
            column_bottom is None
            or
            column_top is None
        ):

            continue


        if column_top < column_bottom:

            temp = column_bottom

            column_bottom = column_top

            column_top = temp


        # ====================================================
        # COLUMN DIMENSIONS
        # ====================================================

        (
            width_mm,
            depth_mm,
            max_dimension_mm

        ) = get_column_dimensions_mm(
            column
        )


        if max_dimension_mm is None:

            continue


        # ====================================================
        # COLUMN START
        #
        # Foundation top is used as lower clear limit.
        # ====================================================

        if foundation_top is not None:

            column_start = max(
                column_bottom,
                foundation_top
            )


        else:

            column_start = column_bottom


        if column_start > column_top:

            column_start = column_bottom


        # ====================================================
        # DETECT/MERGE BEAM JOINTS
        # ====================================================

        beam_joints = get_beam_joints(

            beam_package,

            column_start,

            column_top
        )


        # ====================================================
        # CLEAR COLUMN SEGMENTS
        # ====================================================

        clear_segments = get_clear_segments(

            column_start,

            column_top,

            beam_joints
        )


        # ====================================================
        # REINFORCEMENT ZONES
        # ====================================================

        (
            confinement_zones,
            normal_zones,
            confinement_data

        ) = get_rebar_zones(

            clear_segments,

            max_dimension_mm
        )


        # ====================================================
        # FINAL PACKAGE
        # ====================================================

        result.append(
            [
                column,                         # [0]

                column_id,                      # [1]

                clear_segments,                 # [2]

                confinement_zones,              # [3]

                normal_zones,                   # [4]

                confinement_spacing_mm,         # [5]

                regular_spacing_mm,             # [6]

                beam_joints,                    # [7]

                max_dimension_mm,               # [8]

                confinement_data,               # [9]

                tie_diameter_mm,                # [10]

                cover_mm                        # [11]
            ]
        )


# ============================================================
# OUTPUT
# ============================================================

if len(input_errors) > 0:

    OUT = [
        [
            "S04 INPUT ERROR",
            input_errors
        ]
    ]


else:

    OUT = result
# ----------------------------------------
M01 = Python(IN[0]=s03_intersection, IN[1]=s04_confinement_zones)  # CPython3
# ---------- M01.python (1403 lines) ----------
# ============================================================
# M01 — COLUMN STACK BUILDER
# VERSION 2
#
# PURPOSE:
# Groups vertically related Structural Column instances into
# continuous column stacks for longitudinal reinforcement.
#
# Unlike V1, columns DO NOT need identical insertion points.
#
# Stack matching uses:
#   1. Plan footprint overlap
#   2. Relative center proximity
#   3. Vertical sequencing
#
# This allows:
#   - different column sizes between storeys
#   - small offsets
#   - different insertion/justification conditions
#
#
# IN[0] = S03 Support Packages
# IN[1] = S04 Column Zone Packages
#
#
# OUT = Column Stack Packages
#
#
# STACK PACKAGE
# ------------------------------------------------------------
# [0]  Stack Index
# [1]  Column Elements
# [2]  Column IDs
# [3]  Stack Bottom mm
# [4]  Stack Top mm
# [5]  Stack Height mm
# [6]  Average Center X mm
# [7]  Average Center Y mm
# [8]  Column Count
# [9]  Storey Packages
# [10] Foundation Package
# [11] Diagnostics
#
#
# STOREY PACKAGE
# ------------------------------------------------------------
# [0] Column Element
# [1] Column ID
# [2] Bottom mm
# [3] Top mm
# [4] Width mm
# [5] Depth mm
# [6] Center X mm
# [7] Center Y mm
# [8] Rotation degrees
# [9] S03 Package
# [10] S04 Package
#
# ============================================================


import clr
import math


# ============================================================
# REVIT SERVICES
# ============================================================

clr.AddReference("RevitServices")

from RevitServices.Persistence import DocumentManager

doc = DocumentManager.Instance.CurrentDBDocument


# ============================================================
# REVIT API
# ============================================================

clr.AddReference("RevitAPI")

from Autodesk.Revit.DB import *


# ============================================================
# REVIT / DYNAMO
# ============================================================

clr.AddReference("RevitNodes")

import Revit

clr.ImportExtensions(Revit.Elements)


# ============================================================
# CONSTANTS
# ============================================================

MM_PER_FOOT = 304.8


# ------------------------------------------------------------
# STACK MATCHING SETTINGS
# ------------------------------------------------------------

# Additional allowance around each column footprint.
PLAN_MARGIN_MM = 50.0


# Maximum acceptable horizontal offset expressed relative
# to the smaller column dimension.
#
# Example:
# 400 mm column:
#
# 0.50 x 400 = 200 mm allowable center offset
#
CENTER_OFFSET_FACTOR = 0.50


# Minimum absolute center tolerance.
MIN_CENTER_TOLERANCE_MM = 100.0


# Maximum vertical gap between one column top and the next
# column bottom that can still represent the next storey.
#
# This is intentionally generous because Revit columns may
# terminate at different beam/slab references.
#
MAX_VERTICAL_GAP_MM = 1500.0


# Maximum vertical overlap tolerated between consecutive
# Revit column instances.
#
MAX_VERTICAL_OVERLAP_MM = 1500.0


# ============================================================
# UTILITY FUNCTIONS
# ============================================================

def unwrap(element):

    if element is None:
        return None

    try:
        return UnwrapElement(element)
    except:
        return element


def id_value(element):

    element = unwrap(element)

    if element is None:
        return None

    try:
        return int(element.Id.Value)
    except:
        pass

    try:
        return int(element.Id.IntegerValue)
    except:
        pass

    return None


def feet_to_mm(value):

    if value is None:
        return None

    try:
        return float(value) * MM_PER_FOOT
    except:
        return None


def radians_to_degrees(value):

    try:
        return math.degrees(value)
    except:
        return 0.0


# ============================================================
# PACKAGE DETECTION
# ============================================================

def is_column_package(data):

    if not isinstance(data, (list, tuple)):
        return False

    if len(data) < 2:
        return False

    try:

        element = unwrap(data[0])

        if element is None:
            return False

        if not hasattr(element, "Id"):
            return False

        eid = id_value(element)

        try:
            package_id = int(data[1])
        except:
            return False

        return eid == package_id

    except:
        return False


def collect_packages(data):

    result = []

    if data is None:
        return result


    if is_column_package(data):

        result.append(data)

        return result


    if isinstance(data, (list, tuple)):

        for item in data:

            result.extend(
                collect_packages(item)
            )


    return result


# ============================================================
# PARAMETER READER
# ============================================================

def read_double_parameter(element, names):

    if element is None:
        return None


    for name in names:

        try:

            p = element.LookupParameter(name)

            if p is None:
                continue


            if p.StorageType == StorageType.Double:

                return feet_to_mm(
                    p.AsDouble()
                )

        except:
            pass


    return None


# ============================================================
# COLUMN GEOMETRY
# ============================================================

def get_column_geometry(column):

    column = unwrap(column)

    if column is None:
        return None


    cx = None
    cy = None

    bottom = None
    top = None

    width = None
    depth = None

    rotation = 0.0


    # --------------------------------------------------------
    # LOCATION POINT
    # --------------------------------------------------------

    try:

        loc = column.Location


        if isinstance(loc, LocationPoint):

            point = loc.Point

            cx = feet_to_mm(point.X)
            cy = feet_to_mm(point.Y)

            rotation = radians_to_degrees(
                loc.Rotation
            )

    except:
        pass


    # --------------------------------------------------------
    # BOUNDING BOX
    # --------------------------------------------------------

    bbox = None

    try:
        bbox = column.get_BoundingBox(None)
    except:
        bbox = None


    if bbox is not None:

        try:

            bottom = feet_to_mm(
                bbox.Min.Z
            )

            top = feet_to_mm(
                bbox.Max.Z
            )

        except:
            pass


    # --------------------------------------------------------
    # COLUMN TYPE
    # --------------------------------------------------------

    column_type = None

    try:

        column_type = doc.GetElement(
            column.GetTypeId()
        )

    except:
        pass


    # --------------------------------------------------------
    # WIDTH
    # --------------------------------------------------------

    if column_type is not None:

        width = read_double_parameter(
            column_type,
            [
                "b",
                "B",
                "Width",
                "WIDTH",
                "Width 1"
            ]
        )


    # --------------------------------------------------------
    # DEPTH
    # --------------------------------------------------------

    if column_type is not None:

        depth = read_double_parameter(
            column_type,
            [
                "h",
                "H",
                "Depth",
                "DEPTH",
                "Height",
                "Depth 1"
            ]
        )


    # --------------------------------------------------------
    # FALLBACK CENTER
    # --------------------------------------------------------

    if bbox is not None:

        if cx is None:

            try:

                cx = feet_to_mm(
                    (
                        bbox.Min.X +
                        bbox.Max.X
                    ) / 2.0
                )

            except:
                pass


        if cy is None:

            try:

                cy = feet_to_mm(
                    (
                        bbox.Min.Y +
                        bbox.Max.Y
                    ) / 2.0
                )

            except:
                pass


    # --------------------------------------------------------
    # FALLBACK WIDTH / DEPTH
    # --------------------------------------------------------

    if bbox is not None:

        if width is None:

            try:

                width = feet_to_mm(
                    bbox.Max.X -
                    bbox.Min.X
                )

            except:
                pass


        if depth is None:

            try:

                depth = feet_to_mm(
                    bbox.Max.Y -
                    bbox.Min.Y
                )

            except:
                pass


    if (
        cx is None or
        cy is None or
        bottom is None or
        top is None
    ):

        return None


    return {

        "cx": cx,
        "cy": cy,

        "bottom": bottom,
        "top": top,

        "width": width,
        "depth": depth,

        "rotation": rotation,

        "bbox": bbox
    }


# ============================================================
# PLAN DISTANCE
# ============================================================

def plan_distance(record_a, record_b):

    dx = (
        record_a["cx"] -
        record_b["cx"]
    )

    dy = (
        record_a["cy"] -
        record_b["cy"]
    )


    return math.sqrt(
        dx * dx +
        dy * dy
    )


# ============================================================
# COLUMN PLAN RECTANGLE
# ============================================================

def get_plan_rectangle(record):

    """
    Creates a conservative axis-aligned plan footprint.

    The actual column may be rotated.

    Bounding box is preferred because it already encloses
    rotated geometry.
    """

    bbox = record.get("bbox")


    if bbox is not None:

        try:

            return [

                feet_to_mm(bbox.Min.X),
                feet_to_mm(bbox.Max.X),

                feet_to_mm(bbox.Min.Y),
                feet_to_mm(bbox.Max.Y)
            ]

        except:
            pass


    width = record.get("width")
    depth = record.get("depth")


    if width is None:
        width = 0.0

    if depth is None:
        depth = 0.0


    return [

        record["cx"] - width / 2.0,
        record["cx"] + width / 2.0,

        record["cy"] - depth / 2.0,
        record["cy"] + depth / 2.0
    ]


# ============================================================
# PLAN OVERLAP
# ============================================================

def plan_overlap(record_a, record_b):

    rect_a = get_plan_rectangle(record_a)
    rect_b = get_plan_rectangle(record_b)


    ax1 = rect_a[0] - PLAN_MARGIN_MM
    ax2 = rect_a[1] + PLAN_MARGIN_MM

    ay1 = rect_a[2] - PLAN_MARGIN_MM
    ay2 = rect_a[3] + PLAN_MARGIN_MM


    bx1 = rect_b[0] - PLAN_MARGIN_MM
    bx2 = rect_b[1] + PLAN_MARGIN_MM

    by1 = rect_b[2] - PLAN_MARGIN_MM
    by2 = rect_b[3] + PLAN_MARGIN_MM


    overlap_x = (
        ax1 <= bx2 and
        ax2 >= bx1
    )

    overlap_y = (
        ay1 <= by2 and
        ay2 >= by1
    )


    return (
        overlap_x and
        overlap_y
    )


# ============================================================
# CENTER OFFSET CHECK
# ============================================================

def center_offset_allowed(record_a, record_b):

    distance = plan_distance(
        record_a,
        record_b
    )


    dimensions = []


    for record in [record_a, record_b]:

        width = record.get("width")
        depth = record.get("depth")


        if width is not None and width > 0:
            dimensions.append(width)

        if depth is not None and depth > 0:
            dimensions.append(depth)


    if len(dimensions) > 0:

        reference_dimension = min(
            dimensions
        )

        allowed = max(
            MIN_CENTER_TOLERANCE_MM,
            reference_dimension *
            CENTER_OFFSET_FACTOR
        )

    else:

        allowed = MIN_CENTER_TOLERANCE_MM


    return (
        distance <= allowed,
        distance,
        allowed
    )


# ============================================================
# VERTICAL RELATION
# ============================================================

def vertical_relation(lower, upper):

    gap = (
        upper["bottom"] -
        lower["top"]
    )


    valid = (

        gap <= MAX_VERTICAL_GAP_MM

        and

        gap >= -MAX_VERTICAL_OVERLAP_MM

        and

        upper["bottom"] >
        lower["bottom"]

    )


    return (
        valid,
        gap
    )


# ============================================================
# STACK MATCH TEST
# ============================================================

def can_follow(lower, upper):

    # Must actually be above lower column.
    vertical_ok, vertical_gap = (
        vertical_relation(
            lower,
            upper
        )
    )


    if not vertical_ok:

        return (
            False,
            None
        )


    footprint_ok = plan_overlap(
        lower,
        upper
    )


    (
        center_ok,
        center_distance,
        center_allowed

    ) = center_offset_allowed(
        lower,
        upper
    )


    # Require footprint overlap.
    #
    # Center offset is retained as a diagnostic and
    # secondary safeguard.
    valid = (
        footprint_ok and
        center_ok
    )


    score = (
        abs(vertical_gap) +
        center_distance
    )


    diagnostic = {

        "valid": valid,

        "vertical_gap": vertical_gap,

        "footprint_overlap":
            footprint_ok,

        "center_distance":
            center_distance,

        "center_allowed":
            center_allowed,

        "score":
            score
    }


    return (
        valid,
        diagnostic
    )


# ============================================================
# FOUNDATION PACKAGE
# ============================================================

def get_foundation_package(s03_package):

    if s03_package is None:
        return []


    try:

        foundations = s03_package[6]


        if foundations is None:
            return []


        if isinstance(
            foundations,
            (list, tuple)
        ):

            return foundations

    except:
        pass


    return []


# ============================================================
# INPUT
# ============================================================

s03_input = IN[0]
s04_input = IN[1]


# ============================================================
# COLLECT PACKAGES
# ============================================================

s03_packages = collect_packages(
    s03_input
)

s04_packages = collect_packages(
    s04_input
)


# ============================================================
# INDEX PACKAGES BY COLUMN ID
# ============================================================

s03_by_id = {}

for package in s03_packages:

    try:

        column = unwrap(
            package[0]
        )

        cid = id_value(
            column
        )


        if cid is not None:

            s03_by_id[cid] = package

    except:
        pass


s04_by_id = {}

for package in s04_packages:

    try:

        column = unwrap(
            package[0]
        )

        cid = id_value(
            column
        )


        if cid is not None:

            s04_by_id[cid] = package

    except:
        pass


# ============================================================
# BUILD COLUMN RECORDS
# ============================================================

all_ids = set(
    list(s03_by_id.keys()) +
    list(s04_by_id.keys())
)


records = []


for cid in all_ids:

    s03 = s03_by_id.get(cid)
    s04 = s04_by_id.get(cid)


    column = None


    if s03 is not None:

        try:
            column = unwrap(
                s03[0]
            )
        except:
            pass


    if column is None and s04 is not None:

        try:
            column = unwrap(
                s04[0]
            )
        except:
            pass


    if column is None:
        continue


    geometry = get_column_geometry(
        column
    )


    if geometry is None:
        continue


    record = {

        "column":
            column,

        "id":
            cid,

        "cx":
            geometry["cx"],

        "cy":
            geometry["cy"],

        "bottom":
            geometry["bottom"],

        "top":
            geometry["top"],

        "width":
            geometry["width"],

        "depth":
            geometry["depth"],

        "rotation":
            geometry["rotation"],

        "bbox":
            geometry["bbox"],

        "s03":
            s03,

        "s04":
            s04
    }


    records.append(
        record
    )


# ============================================================
# SORT LOWEST TO HIGHEST
# ============================================================

records.sort(

    key=lambda r: (

        r["bottom"],
        r["cx"],
        r["cy"]
    )
)


# ============================================================
# BUILD STACKS
# ============================================================

stacks = []


for record in records:

    candidates = []


    # --------------------------------------------------------
    # TEST AGAINST TOP COLUMN OF EACH EXISTING STACK
    # --------------------------------------------------------

    for stack_index, stack in enumerate(stacks):

        if len(stack) == 0:
            continue


        top_record = stack[-1]


        valid, diagnostic = can_follow(
            top_record,
            record
        )


        if valid:

            candidates.append(
                (
                    diagnostic["score"],
                    stack_index,
                    diagnostic
                )
            )


    # --------------------------------------------------------
    # ASSIGN TO BEST STACK
    # --------------------------------------------------------

    if len(candidates) > 0:

        candidates.sort(
            key=lambda x: x[0]
        )


        best = candidates[0]

        best_stack_index = best[1]


        stacks[
            best_stack_index
        ].append(
            record
        )


    # --------------------------------------------------------
    # OTHERWISE START NEW STACK
    # --------------------------------------------------------

    else:

        stacks.append(
            [record]
        )


# ============================================================
# SORT EACH STACK
# ============================================================

for stack in stacks:

    stack.sort(
        key=lambda r:
            r["bottom"]
    )


# ============================================================
# BUILD OUTPUT
# ============================================================

output = []


for stack_index, stack in enumerate(stacks):

    if len(stack) == 0:
        continue


    # --------------------------------------------------------
    # STACK EXTENTS
    # --------------------------------------------------------

    stack_bottom = min(
        r["bottom"]
        for r in stack
    )


    stack_top = max(
        r["top"]
        for r in stack
    )


    stack_height = (
        stack_top -
        stack_bottom
    )


    # --------------------------------------------------------
    # AVERAGE CENTER
    # --------------------------------------------------------

    average_x = sum(
        r["cx"]
        for r in stack
    ) / float(len(stack))


    average_y = sum(
        r["cy"]
        for r in stack
    ) / float(len(stack))


    # --------------------------------------------------------
    # COLUMN LISTS
    # --------------------------------------------------------

    columns = [
        r["column"]
        for r in stack
    ]


    column_ids = [
        r["id"]
        for r in stack
    ]


    # --------------------------------------------------------
    # STOREY PACKAGES
    # --------------------------------------------------------

    storey_packages = []


    for r in stack:

        storey_packages.append(

            [

                r["column"],       # [0]

                r["id"],           # [1]

                r["bottom"],       # [2]

                r["top"],          # [3]

                r["width"],        # [4]

                r["depth"],        # [5]

                r["cx"],           # [6]

                r["cy"],           # [7]

                r["rotation"],     # [8]

                r["s03"],          # [9]

                r["s04"]           # [10]
            ]
        )


    # --------------------------------------------------------
    # FOUNDATION
    # --------------------------------------------------------

    foundation_package = []


    # Foundation should normally belong to lowest column.
    lowest = stack[0]


    foundation_package = (
        get_foundation_package(
            lowest["s03"]
        )
    )


    # Fallback: search entire stack.
    if len(foundation_package) == 0:

        for r in stack:

            candidate = (
                get_foundation_package(
                    r["s03"]
                )
            )


            if len(candidate) > 0:

                foundation_package = (
                    candidate
                )

                break


    # --------------------------------------------------------
    # STACK DIAGNOSTICS
    # --------------------------------------------------------

    relationship_diagnostics = []


    if len(stack) > 1:

        for i in range(
            len(stack) - 1
        ):

            lower = stack[i]
            upper = stack[i + 1]


            valid, data = can_follow(
                lower,
                upper
            )


            if data is not None:

                relationship_diagnostics.append(

                    [
                        lower["id"],
                        upper["id"],

                        "CONNECTED"
                        if valid
                        else "NOT CONNECTED",

                        "Vertical Gap mm",
                        round(
                            data[
                                "vertical_gap"
                            ],
                            2
                        ),

                        "Center Offset mm",
                        round(
                            data[
                                "center_distance"
                            ],
                            2
                        ),

                        "Allowed Offset mm",
                        round(
                            data[
                                "center_allowed"
                            ],
                            2
                        ),

                        "Plan Overlap",
                        data[
                            "footprint_overlap"
                        ]
                    ]
                )


    # --------------------------------------------------------
    # FOUNDATION STATUS
    # --------------------------------------------------------

    if len(foundation_package) > 0:

        foundation_status = (
            "FOUNDATION DETECTED"
        )

    else:

        foundation_status = (
            "NO FOUNDATION DETECTED"
        )


    # --------------------------------------------------------
    # DIAGNOSTIC
    # --------------------------------------------------------

    diagnostic = [

        "STACK {}".format(
            stack_index + 1
        ),

        "COLUMN COUNT = {}".format(
            len(stack)
        ),

        "COLUMN IDS = {}".format(
            column_ids
        ),

        foundation_status,

        relationship_diagnostics
    ]


    # --------------------------------------------------------
    # FINAL STACK PACKAGE
    # --------------------------------------------------------

    stack_package = [

        stack_index + 1,          # [0]

        columns,                  # [1]

        column_ids,               # [2]

        stack_bottom,             # [3]

        stack_top,                # [4]

        stack_height,             # [5]

        average_x,                # [6]

        average_y,                # [7]

        len(stack),               # [8]

        storey_packages,          # [9]

        foundation_package,       # [10]

        diagnostic                # [11]
    ]


    output.append(
        stack_package
    )


# ============================================================
# OUTPUT
# ============================================================

OUT = output
# ----------------------------------------
main_diamter = IntegerSlider(16, range=10..25 step 2)
mainbar_count = IntegerSlider(8, range=4..16 step 2)
M02 = Python(IN[0]=M01, IN[1]=main_diamter, IN[2]=mainbar_count)  # CPython3
# ---------- M02.python (1488 lines) ----------
# ============================================================
# M02 — MAIN BAR LAYOUT + VALIDATION
# SIMPLIFIED USER INPUT VERSION
#
# IN[0] = M01 Column Stack Package
# IN[1] = Main Bar Diameter (mm)
# IN[2] = Total Number of Main Bars
#
# Tie Diameter and Concrete Cover are inherited from S04.
#
# S04 PACKAGE EXPECTED:
#
# [0]  Column
# [1]  Column ID
# [2]  Clear Segments
# [3]  Confinement Zones
# [4]  Normal Zones
# [5]  Confinement Spacing
# [6]  Regular Spacing
# [7]  Beam Joints
# [8]  Column Max Dimension
# [9]  Confinement Data
# [10] Tie Diameter
# [11] Concrete Cover
#
#
# M01 STOREY PACKAGE EXPECTED:
#
# [0]  Column
# [1]  Column ID
# [2]  Bottom mm
# [3]  Top mm
# [4]  Width mm
# [5]  Depth mm
# [6]  Center X mm
# [7]  Center Y mm
# [8]  Rotation degrees
# [9]  S03 Package
# [10] S04 Package
#
#
# OUTPUT — EACH STACK
#
# [0]  Stack Index
# [1]  Column IDs
# [2]  Main Bar Diameter
# [3]  Total Main Bars
# [4]  Single Bar Area
# [5]  Total Steel Area
# [6]  Storey Layout Packages
# [7]  Group A Bar Indices
# [8]  Group B Bar Indices
# [9]  Lap Length = 60db
# [10] Validation / Status
# [11] Original M01 Package
#
#
# STOREY LAYOUT PACKAGE
#
# [0]  Column
# [1]  Column ID
# [2]  Width
# [3]  Depth
# [4]  Bottom
# [5]  Top
# [6]  Rotation
# [7]  Tie Diameter
# [8]  Concrete Cover
# [9]  Main Bar Centerline Offset
# [10] Gross Area
# [11] Steel Ratio %
# [12] Bars on Width Face
# [13] Bars on Depth Face
# [14] Bar Layout
# [15] Minimum Clear Spacing
# [16] Validation
#
#
# BAR LAYOUT ITEM
#
# [0] Bar Index
# [1] Splice Group A/B
# [2] Local X
# [3] Local Y
# [4] Global X
# [5] Global Y
# [6] Bottom Z
# [7] Top Z
# [8] Face
#
# ============================================================


import clr
import math


# ============================================================
# REVIT SERVICES
# ============================================================

clr.AddReference("RevitServices")

from RevitServices.Persistence import DocumentManager

doc = DocumentManager.Instance.CurrentDBDocument


# ============================================================
# REVIT API
# ============================================================

clr.AddReference("RevitAPI")

from Autodesk.Revit.DB import *


# ============================================================
# REVIT / DYNAMO
# ============================================================

clr.AddReference("RevitNodes")

import Revit

clr.ImportExtensions(Revit.Elements)


# ============================================================
# CONSTANTS
# ============================================================

MIN_STEEL_RATIO = 0.01
MAX_STEEL_RATIO = 0.06

MIN_CLEAR_SPACING_MM = 40.0


# ============================================================
# BASIC FUNCTIONS
# ============================================================

def unwrap(element):

    if element is None:
        return None

    try:
        return UnwrapElement(element)
    except:
        return element


def safe_float(value, default=None):

    try:
        return float(value)
    except:
        return default


def safe_int(value, default=None):

    try:
        return int(value)
    except:
        pass

    try:
        return int(round(float(value)))
    except:
        return default


def rnd(value, digits=3):

    try:
        return round(float(value), digits)
    except:
        return value


# ============================================================
# INPUT
# ============================================================

def get_input(index):

    try:

        if len(IN) > index:
            return IN[index]

    except:
        pass

    return None


# ============================================================
# M01 PACKAGE DETECTION
# ============================================================

def is_m01_package(data):

    if not isinstance(data, (list, tuple)):
        return False

    if len(data) < 12:
        return False

    try:

        stack_index = int(data[0])

        columns = data[1]
        ids = data[2]
        storeys = data[9]

        if not isinstance(
            columns,
            (list, tuple)
        ):
            return False

        if not isinstance(
            ids,
            (list, tuple)
        ):
            return False

        if not isinstance(
            storeys,
            (list, tuple)
        ):
            return False

        return True

    except:
        return False


def collect_m01_packages(data):

    result = []

    if data is None:
        return result

    if is_m01_package(data):

        result.append(data)
        return result

    if isinstance(
        data,
        (list, tuple)
    ):

        for item in data:

            result.extend(
                collect_m01_packages(item)
            )

    return result


# ============================================================
# S04 DATA
# ============================================================

def get_s04_values(storey):

    """
    M01 Storey:
        [10] = S04 package

    S04:
        [10] = Tie Diameter
        [11] = Concrete Cover
    """

    tie_diameter = None
    cover = None
    s04 = None

    try:
        s04 = storey[10]
    except:
        return (
            None,
            None,
            None
        )

    if not isinstance(
        s04,
        (list, tuple)
    ):

        return (
            None,
            None,
            s04
        )

    try:
        tie_diameter = safe_float(
            s04[10]
        )
    except:
        pass

    try:
        cover = safe_float(
            s04[11]
        )
    except:
        pass

    return (
        tie_diameter,
        cover,
        s04
    )


# ============================================================
# AUTOMATIC FACE DISTRIBUTION
# ============================================================

def determine_face_counts(
    total_bars,
    width,
    depth
):

    """
    Determines a balanced rectangular perimeter arrangement.

    Total bars:

        N = 2*Nw + 2*(Nd - 2)

    Therefore:

        N = 2*Nw + 2*Nd - 4

    or:

        Nw + Nd = (N + 4) / 2


    Nw = bars INCLUDING corners on each width face.
    Nd = bars INCLUDING corners on each depth face.


    The algorithm searches all valid combinations and chooses
    the arrangement whose physical bar spacing is most uniform.

    This is better than simply splitting the total equally
    because rectangular columns may have different width/depth.
    """

    if total_bars < 4:
        return None

    # A symmetric rectangular perimeter arrangement using
    # identical opposite faces requires an even total count.
    if total_bars % 2 != 0:
        return None

    target_sum = int(
        (total_bars + 4) / 2
    )

    candidates = []

    for nw in range(
        2,
        target_sum
    ):

        nd = target_sum - nw

        if nd < 2:
            continue

        calculated_total = (
            2 * nw +
            2 * (nd - 2)
        )

        if calculated_total != total_bars:
            continue

        # Approximate center-to-center spacing.
        if nw > 1:

            spacing_width = (
                width /
                float(nw - 1)
            )

        else:

            spacing_width = width

        if nd > 1:

            spacing_depth = (
                depth /
                float(nd - 1)
            )

        else:

            spacing_depth = depth

        spacing_difference = abs(
            spacing_width -
            spacing_depth
        )

        candidates.append(
            [
                spacing_difference,
                nw,
                nd,
                spacing_width,
                spacing_depth
            ]
        )

    if len(candidates) == 0:
        return None

    candidates.sort(
        key=lambda x: x[0]
    )

    best = candidates[0]

    return [
        best[1],
        best[2]
    ]


# ============================================================
# INTERPOLATION
# ============================================================

def interpolate(
    start,
    end,
    count
):

    if count <= 0:
        return []

    if count == 1:

        return [
            (
                start +
                end
            ) / 2.0
        ]

    step = (
        end -
        start
    ) / float(
        count - 1
    )

    result = []

    for i in range(count):

        result.append(
            start +
            step * i
        )

    return result


# ============================================================
# LOCAL -> GLOBAL
# ============================================================

def local_to_global(
    local_x,
    local_y,
    center_x,
    center_y,
    rotation_degrees
):

    angle = math.radians(
        rotation_degrees
    )

    c = math.cos(angle)
    s = math.sin(angle)

    global_x = (
        center_x +
        local_x * c -
        local_y * s
    )

    global_y = (
        center_y +
        local_x * s +
        local_y * c
    )

    return (
        global_x,
        global_y
    )


# ============================================================
# CREATE PERIMETER LAYOUT
# ============================================================

def create_bar_layout(
    width,
    depth,
    center_x,
    center_y,
    rotation,
    bottom,
    top,
    offset,
    nw,
    nd
):

    half_x = (
        width / 2.0 -
        offset
    )

    half_y = (
        depth / 2.0 -
        offset
    )

    if (
        half_x <= 0 or
        half_y <= 0
    ):

        return (
            [],
            "INVALID BAR ENVELOPE"
        )

    x_positions = interpolate(
        -half_x,
        half_x,
        nw
    )

    y_positions = interpolate(
        -half_y,
        half_y,
        nd
    )

    local_bars = []


    # --------------------------------------------------------
    # TOP WIDTH FACE
    # left -> right
    # --------------------------------------------------------

    for x in x_positions:

        local_bars.append(
            [
                x,
                half_y,
                "TOP"
            ]
        )


    # --------------------------------------------------------
    # RIGHT DEPTH FACE
    # top -> bottom
    # corners excluded
    # --------------------------------------------------------

    if nd > 2:

        internal_y = list(
            reversed(
                y_positions[1:-1]
            )
        )

        for y in internal_y:

            local_bars.append(
                [
                    half_x,
                    y,
                    "RIGHT"
                ]
            )


    # --------------------------------------------------------
    # BOTTOM WIDTH FACE
    # right -> left
    # --------------------------------------------------------

    for x in reversed(
        x_positions
    ):

        local_bars.append(
            [
                x,
                -half_y,
                "BOTTOM"
            ]
        )


    # --------------------------------------------------------
    # LEFT DEPTH FACE
    # bottom -> top
    # corners excluded
    # --------------------------------------------------------

    if nd > 2:

        for y in y_positions[1:-1]:

            local_bars.append(
                [
                    -half_x,
                    y,
                    "LEFT"
                ]
            )


    # --------------------------------------------------------
    # FINAL BAR RECORDS
    # --------------------------------------------------------

    result = []

    for i, item in enumerate(
        local_bars
    ):

        local_x = item[0]
        local_y = item[1]
        face = item[2]

        global_x, global_y = (
            local_to_global(
                local_x,
                local_y,
                center_x,
                center_y,
                rotation
            )
        )

        bar_index = i + 1

        # Alternating perimeter splice grouping.
        if i % 2 == 0:
            group = "A"
        else:
            group = "B"

        result.append(
            [
                bar_index,          # [0]
                group,              # [1]

                rnd(local_x),       # [2]
                rnd(local_y),       # [3]

                rnd(global_x),      # [4]
                rnd(global_y),      # [5]

                rnd(bottom),        # [6]
                rnd(top),           # [7]

                face                # [8]
            ]
        )

    return (
        result,
        "OK"
    )


# ============================================================
# CLEAR SPACING
# ============================================================

def minimum_clear_spacing(
    width,
    depth,
    offset,
    nw,
    nd,
    db
):

    values = []

    available_width = (
        width -
        2.0 * offset
    )

    available_depth = (
        depth -
        2.0 * offset
    )

    if nw > 1:

        center_spacing_width = (
            available_width /
            float(nw - 1)
        )

        clear_width = (
            center_spacing_width -
            db
        )

        values.append(
            clear_width
        )

    if nd > 1:

        center_spacing_depth = (
            available_depth /
            float(nd - 1)
        )

        clear_depth = (
            center_spacing_depth -
            db
        )

        values.append(
            clear_depth
        )

    if len(values) == 0:
        return None

    return min(values)


# ============================================================
# READ INPUTS
# ============================================================

m01_input = get_input(0)

main_bar_diameter = safe_float(
    get_input(1)
)

total_main_bars = safe_int(
    get_input(2)
)


# ============================================================
# INPUT VALIDATION
# ============================================================

input_errors = []

if main_bar_diameter is None:

    input_errors.append(
        "MAIN BAR DIAMETER IS MISSING"
    )

elif main_bar_diameter <= 0:

    input_errors.append(
        "MAIN BAR DIAMETER MUST BE GREATER THAN ZERO"
    )


if total_main_bars is None:

    input_errors.append(
        "TOTAL NUMBER OF MAIN BARS IS MISSING"
    )

elif total_main_bars < 4:

    input_errors.append(
        "TOTAL MAIN BARS MUST BE AT LEAST 4"
    )

elif total_main_bars % 2 != 0:

    input_errors.append(
        "TOTAL MAIN BARS MUST BE EVEN FOR THIS SYMMETRIC RECTANGULAR LAYOUT"
    )


# ============================================================
# ERROR OUTPUT
# ============================================================

if len(input_errors) > 0:

    OUT = [
        "M02 INPUT ERROR",
        input_errors
    ]


else:

    # ========================================================
    # COLLECT M01 STACKS
    # ========================================================

    stacks = collect_m01_packages(
        m01_input
    )


    # ========================================================
    # BAR PROPERTIES
    # ========================================================

    single_bar_area = (
        math.pi *
        main_bar_diameter *
        main_bar_diameter /
        4.0
    )


    total_steel_area = (
        single_bar_area *
        total_main_bars
    )


    # --------------------------------------------------------
    # ADOPTED LAP RULE
    # --------------------------------------------------------

    lap_length = (
        60.0 *
        main_bar_diameter
    )


    # ========================================================
    # SPLICE GROUPS
    # ========================================================

    group_a = []
    group_b = []

    for i in range(
        total_main_bars
    ):

        bar_number = i + 1

        if i % 2 == 0:

            group_a.append(
                bar_number
            )

        else:

            group_b.append(
                bar_number
            )


    # ========================================================
    # PROCESS STACKS
    # ========================================================

    output = []


    for stack in stacks:

        stack_index = stack[0]
        column_ids = stack[2]
        storeys = stack[9]

        storey_outputs = []
        stack_status = []


        # ====================================================
        # PROCESS EACH COLUMN
        # ====================================================

        for storey in storeys:

            column = unwrap(
                storey[0]
            )

            column_id = storey[1]

            bottom = safe_float(
                storey[2]
            )

            top = safe_float(
                storey[3]
            )

            width = safe_float(
                storey[4]
            )

            depth = safe_float(
                storey[5]
            )

            center_x = safe_float(
                storey[6]
            )

            center_y = safe_float(
                storey[7]
            )

            rotation = safe_float(
                storey[8],
                0.0
            )


            # ------------------------------------------------
            # S04 VALUES
            # ------------------------------------------------

            (
                tie_diameter,
                cover,
                s04

            ) = get_s04_values(
                storey
            )


            validation = []


            # ------------------------------------------------
            # GEOMETRY VALIDATION
            # ------------------------------------------------

            if width is None or width <= 0:

                validation.append(
                    "FAIL: INVALID COLUMN WIDTH"
                )


            if depth is None or depth <= 0:

                validation.append(
                    "FAIL: INVALID COLUMN DEPTH"
                )


            if center_x is None:

                validation.append(
                    "FAIL: INVALID COLUMN CENTER X"
                )


            if center_y is None:

                validation.append(
                    "FAIL: INVALID COLUMN CENTER Y"
                )


            if bottom is None or top is None:

                validation.append(
                    "FAIL: INVALID COLUMN HEIGHT"
                )


            # ------------------------------------------------
            # S04 VALIDATION
            # ------------------------------------------------

            if tie_diameter is None:

                validation.append(
                    "FAIL: TIE DIAMETER NOT FOUND IN S04"
                )


            if cover is None:

                validation.append(
                    "FAIL: CONCRETE COVER NOT FOUND IN S04"
                )


            # ------------------------------------------------
            # STOP THIS STOREY IF REQUIRED DATA MISSING
            # ------------------------------------------------

            required_ok = (
                width is not None and
                width > 0 and

                depth is not None and
                depth > 0 and

                center_x is not None and
                center_y is not None and

                bottom is not None and
                top is not None and

                tie_diameter is not None and
                cover is not None
            )


            if not required_ok:

                storey_outputs.append(
                    [
                        column,
                        column_id,
                        width,
                        depth,
                        bottom,
                        top,
                        rotation,
                        tie_diameter,
                        cover,
                        None,
                        None,
                        None,
                        None,
                        None,
                        [],
                        None,
                        validation
                    ]
                )

                continue


            # ------------------------------------------------
            # MAIN BAR CENTERLINE OFFSET
            #
            # concrete face
            #      +
            # cover to outside of tie
            #      +
            # tie diameter
            #      +
            # 1/2 main bar diameter
            # ------------------------------------------------

            offset = (
                cover +
                tie_diameter +
                main_bar_diameter / 2.0
            )


            # ------------------------------------------------
            # AUTOMATIC FACE DISTRIBUTION
            # ------------------------------------------------

            face_counts = (
                determine_face_counts(
                    total_main_bars,
                    width,
                    depth
                )
            )


            if face_counts is None:

                validation.append(
                    "FAIL: CANNOT CREATE SYMMETRIC PERIMETER LAYOUT"
                )

                storey_outputs.append(
                    [
                        column,
                        column_id,
                        width,
                        depth,
                        bottom,
                        top,
                        rotation,
                        tie_diameter,
                        cover,
                        offset,
                        None,
                        None,
                        None,
                        None,
                        [],
                        None,
                        validation
                    ]
                )

                continue


            bars_width = face_counts[0]
            bars_depth = face_counts[1]


            # ------------------------------------------------
            # GROSS AREA
            # ------------------------------------------------

            gross_area = (
                width *
                depth
            )


            # ------------------------------------------------
            # STEEL RATIO
            # ------------------------------------------------

            steel_ratio = (
                total_steel_area /
                gross_area
            )


            steel_ratio_percent = (
                steel_ratio *
                100.0
            )


            if steel_ratio < MIN_STEEL_RATIO:

                validation.append(
                    "FAIL: STEEL RATIO {:.3f}% < 1.0%".format(
                        steel_ratio_percent
                    )
                )

            elif steel_ratio > MAX_STEEL_RATIO:

                validation.append(
                    "FAIL: STEEL RATIO {:.3f}% > 6.0%".format(
                        steel_ratio_percent
                    )
                )

            else:

                validation.append(
                    "PASS: STEEL RATIO = {:.3f}%".format(
                        steel_ratio_percent
                    )
                )


            # ------------------------------------------------
            # BAR ENVELOPE CHECK
            # ------------------------------------------------

            usable_width = (
                width -
                2.0 * offset
            )

            usable_depth = (
                depth -
                2.0 * offset
            )


            if usable_width <= 0:

                validation.append(
                    "FAIL: MAIN BARS DO NOT FIT COLUMN WIDTH"
                )


            if usable_depth <= 0:

                validation.append(
                    "FAIL: MAIN BARS DO NOT FIT COLUMN DEPTH"
                )


            # ------------------------------------------------
            # CLEAR SPACING
            # ------------------------------------------------

            min_clear = (
                minimum_clear_spacing(
                    width,
                    depth,
                    offset,
                    bars_width,
                    bars_depth,
                    main_bar_diameter
                )
            )


            required_clear = max(
                MIN_CLEAR_SPACING_MM,
                1.5 *
                main_bar_diameter
            )


            if min_clear is not None:

                if min_clear < required_clear:

                    validation.append(
                        "FAIL: MIN CLEAR SPACING {:.1f} mm < {:.1f} mm".format(
                            min_clear,
                            required_clear
                        )
                    )

                else:

                    validation.append(
                        "PASS: MIN CLEAR SPACING = {:.1f} mm".format(
                            min_clear
                        )
                    )


            # ------------------------------------------------
            # CREATE BAR POSITIONS
            # ------------------------------------------------

            (
                bar_layout,
                layout_status

            ) = create_bar_layout(

                width,
                depth,

                center_x,
                center_y,

                rotation,

                bottom,
                top,

                offset,

                bars_width,
                bars_depth
            )


            if layout_status != "OK":

                validation.append(
                    "FAIL: " +
                    layout_status
                )

            else:

                validation.append(
                    "PASS: {} MAIN BAR POSITIONS GENERATED".format(
                        len(bar_layout)
                    )
                )


            # ------------------------------------------------
            # COUNT CHECK
            # ------------------------------------------------

            if len(bar_layout) != total_main_bars:

                validation.append(
                    "FAIL: EXPECTED {} BARS BUT GENERATED {}".format(
                        total_main_bars,
                        len(bar_layout)
                    )
                )


            # ------------------------------------------------
            # DISTRIBUTION MESSAGE
            # ------------------------------------------------

            validation.append(
                "AUTO LAYOUT: {} BARS/WIDTH FACE, {} BARS/DEPTH FACE".format(
                    bars_width,
                    bars_depth
                )
            )


            # ------------------------------------------------
            # STOREY OUTPUT
            # ------------------------------------------------

            storey_output = [

                column,                         # [0]

                column_id,                      # [1]

                rnd(width),                     # [2]

                rnd(depth),                     # [3]

                rnd(bottom),                    # [4]

                rnd(top),                       # [5]

                rnd(rotation),                  # [6]

                rnd(tie_diameter),              # [7]

                rnd(cover),                     # [8]

                rnd(offset),                    # [9]

                rnd(gross_area),                # [10]

                rnd(
                    steel_ratio_percent
                ),                              # [11]

                bars_width,                     # [12]

                bars_depth,                     # [13]

                bar_layout,                     # [14]

                rnd(min_clear),                 # [15]

                validation                      # [16]
            ]


            storey_outputs.append(
                storey_output
            )


        # ====================================================
        # STACK STATUS
        # ====================================================

        stack_status.append(
            "MAIN BAR DIAMETER = {:.1f} mm".format(
                main_bar_diameter
            )
        )

        stack_status.append(
            "TOTAL MAIN BARS = {}".format(
                total_main_bars
            )
        )

        stack_status.append(
            "BAR AREA = {:.2f} mm2".format(
                single_bar_area
            )
        )

        stack_status.append(
            "TOTAL STEEL AREA = {:.2f} mm2".format(
                total_steel_area
            )
        )

        stack_status.append(
            "ADOPTED LAP = 60db = {:.1f} mm".format(
                lap_length
            )
        )

        stack_status.append(
            "GROUP A = {}".format(
                group_a
            )
        )

        stack_status.append(
            "GROUP B = {}".format(
                group_b
            )
        )


        # ====================================================
        # FINAL STACK PACKAGE
        # ====================================================

        main_package = [

            stack_index,               # [0]

            column_ids,                # [1]

            main_bar_diameter,         # [2]

            total_main_bars,           # [3]

            rnd(single_bar_area),      # [4]

            rnd(total_steel_area),     # [5]

            storey_outputs,            # [6]

            group_a,                   # [7]

            group_b,                   # [8]

            rnd(lap_length),           # [9]

            stack_status,              # [10]

            stack                      # [11]
        ]


        output.append(
            main_package
        )


    # ========================================================
    # OUTPUT
    # ========================================================

    OUT = output
# ----------------------------------------
M03 = Python(IN[0]=M02)  # CPython3
# ---------- M03.python (1676 lines) ----------
# ============================================================
# M03 — COMPLETE MAIN BAR ANCHORAGE / PATH PLANNER
# CORRECTED MULTI-STACK VERSION
#
# IN[0] = COMPLETE M02 OUTPUT
#
# FIX:
#   - Processes ALL M02 stack packages
#   - Does NOT collapse input to first stack
#   - Preserves existing M03 output architecture
#
# RULES:
#   FOUNDATION:
#       Bottom bend centerline =
#       footing bottom + cover + db/2
#
#       Bottom 90-degree hook =
#       12db, directed outward from column center
#
#   TOP JOINT:
#       Top bend centerline =
#       beam / column top - cover - db/2
#
#       Top 90-degree hook =
#       12db, directed toward column core
#
# M03 OUTPUT PER STACK:
#
# [0]  Stack Index
# [1]  Column IDs
# [2]  Main Bar Diameter
# [3]  Total Main Bars
# [4]  Lap Length = 60db
# [5]  Hook Extension = 12db
# [6]  Group A
# [7]  Group B
# [8]  Stack Bottom
# [9]  Stack Top
# [10] Foundation Data
# [11] Top Termination Data
# [12] Bar Path Packages
# [13] Maximum Preliminary Bar Path
# [14] Diagnostics
# [15] Original M02 Package
#
# BAR PATH:
#
# [0]  Bar Number
# [1]  Group
# [2]  Global X mm
# [3]  Global Y mm
# [4]  Bottom Bend Z mm
# [5]  Top Bend Z mm
# [6]  Bottom Hook Extension mm
# [7]  Vertical Length mm
# [8]  Top Hook Extension mm
# [9]  Total Path Length mm
# [10] Bottom DX
# [11] Bottom DY
# [12] Top DX
# [13] Top DY
# [14] Diagnostics
# ============================================================


import clr
import math


# ------------------------------------------------------------
# REVIT SERVICES
# ------------------------------------------------------------

clr.AddReference("RevitServices")

from RevitServices.Persistence import DocumentManager

doc = DocumentManager.Instance.CurrentDBDocument


# ------------------------------------------------------------
# REVIT API
# ------------------------------------------------------------

clr.AddReference("RevitAPI")

from Autodesk.Revit.DB import *


# ------------------------------------------------------------
# CONSTANTS
# ------------------------------------------------------------

FT_TO_MM = 304.8

HOOK_FACTOR = 12.0


# ------------------------------------------------------------
# HELPERS
# ------------------------------------------------------------

def is_list(value):

    return isinstance(
        value,
        (list, tuple)
    )


def safe_float(
    value,
    default=None
):

    try:
        return float(value)
    except:
        return default


def safe_int(
    value,
    default=-1
):

    try:
        return int(value)
    except:
        return default


# ------------------------------------------------------------
# IDENTIFY M02 PACKAGE
#
# Existing M02:
#
# [0] Stack Index
# [1] Column IDs
# [2] Main Bar Diameter
# [3] Total Main Bars
# [4] Bar Area
# [5] Total Steel Area
# [6] Storey Outputs
# [7] Group A
# [8] Group B
# [9] Lap Length
# [10] Diagnostics
# [11] Original M01
# ------------------------------------------------------------

def looks_like_m02(value):

    if not is_list(value):
        return False

    if len(value) < 12:
        return False


    try:

        stack_index = safe_int(
            value[0],
            -1
        )

        if stack_index < 0:
            return False


        if not is_list(
            value[1]
        ):
            return False


        if len(value[1]) == 0:
            return False


        db = safe_float(
            value[2],
            None
        )

        bars = safe_int(
            value[3],
            -1
        )


        if db is None or db <= 0:
            return False


        if bars <= 0:
            return False


        if not is_list(
            value[6]
        ):
            return False


        if not is_list(
            value[7]
        ):
            return False


        if not is_list(
            value[8]
        ):
            return False


        return True

    except:
        return False


# ------------------------------------------------------------
# COLLECT ALL M02 PACKAGES
#
# THIS IS THE MAIN CORRECTION.
#
# The previous M03 effectively processed only the first
# M02 package. This recursively finds ALL top-level M02
# packages while preventing duplicate collection.
# ------------------------------------------------------------

def collect_m02_packages(data):

    found = []

    seen = set()


    def walk(value):

        if value is None:
            return


        if looks_like_m02(
            value
        ):

            stack_index = safe_int(
                value[0],
                -1
            )


            ids = []

            try:

                for cid in value[1]:

                    ids.append(
                        safe_int(
                            cid,
                            -1
                        )
                    )

            except:
                pass


            key = (
                stack_index,
                tuple(ids)
            )


            if key not in seen:

                seen.add(
                    key
                )

                found.append(
                    value
                )

            # IMPORTANT:
            # Do not recurse inside an identified M02 package.
            # M01/S04 data nested inside it may resemble other
            # package structures.

            return


        if is_list(
            value
        ):

            for item in value:

                walk(
                    item
                )


    walk(
        data
    )


    found.sort(
        key=lambda package:
        safe_int(
            package[0],
            999999
        )
    )


    return found


# ------------------------------------------------------------
# FIND COLUMN IN M01 COLUMN PACKAGE
#
# M01:
# [9] Column Packages
#
# Column Package:
# [0] Column
# [1] ID
# [2] Bottom
# [3] Top
# [4] Width
# [5] Depth
# [6] Center X
# [7] Center Y
# [8] Rotation
# [9] S03
# [10] S04
# ------------------------------------------------------------

def find_m01_column_package(
    m02,
    column_id
):

    try:

        m01 = m02[11]

        column_packages = m01[9]


        for package in column_packages:

            if not is_list(
                package
            ):
                continue


            if len(package) < 11:
                continue


            cid = safe_int(
                package[1],
                -1
            )


            if cid == column_id:

                return package

    except:
        pass


    return None


# ------------------------------------------------------------
# FIND M02 STOREY PACKAGE
#
# M02[6]:
#
# [0] Column
# [1] ID
# [2] Width
# [3] Depth
# [4] Bottom Z
# [5] Top Z
# [6] Rotation
# [7] Tie Dia
# [8] Cover
# ...
# [14] Bar Layout
# ------------------------------------------------------------

def find_storey_package(
    m02,
    column_id
):

    try:

        storeys = m02[6]


        for storey in storeys:

            if not is_list(
                storey
            ):
                continue


            if len(storey) < 15:
                continue


            cid = safe_int(
                storey[1],
                -1
            )


            if cid == column_id:

                return storey

    except:
        pass


    return None


# ------------------------------------------------------------
# GET S03 FROM M01 COLUMN PACKAGE
# ------------------------------------------------------------

def get_s03(
    column_package
):

    try:

        s03 = column_package[9]


        if (
            is_list(s03)
            and len(s03) >= 8
        ):

            return s03

    except:
        pass


    return None


# ------------------------------------------------------------
# FOUNDATION DATA
#
# S03:
# [4] Foundation Top
# [6] Foundation Package
#
# Current foundation package:
#
# [
#   [
#       footing_bottom,
#       footing_top,
#       footing_id,
#       footing_name
#   ]
# ]
# ------------------------------------------------------------

def get_foundation_data(
    s03,
    cover,
    db
):

    detected = False

    footing_name = None
    footing_id = None

    footing_bottom = None
    footing_top = None

    bend_z = None


    if s03 is not None:

        try:

            foundations = s03[6]


            if (
                is_list(foundations)
                and len(foundations) > 0
            ):

                foundation = foundations[0]


                if (
                    is_list(foundation)
                    and len(foundation) >= 4
                ):

                    footing_bottom = safe_float(
                        foundation[0],
                        None
                    )


                    footing_top = safe_float(
                        foundation[1],
                        None
                    )


                    footing_id = safe_int(
                        foundation[2],
                        -1
                    )


                    footing_name = str(
                        foundation[3]
                    )


                    if (
                        footing_bottom is not None
                        and footing_top is not None
                    ):

                        detected = True

        except:
            pass


    if detected:

        bend_z = (
            footing_bottom
            + cover
            + db / 2.0
        )


        status = (
            "FOUNDATION ANCHORAGE GEOMETRY AVAILABLE"
        )

    else:

        status = (
            "NO FOUNDATION DETECTED"
        )


    return [
        detected,            # 0
        footing_name,        # 1
        footing_id,          # 2
        footing_bottom,      # 3
        footing_top,         # 4
        cover,               # 5
        bend_z,              # 6
        HOOK_FACTOR * db,    # 7
        status               # 8
    ]


# ------------------------------------------------------------
# TOP BEAM / JOINT
#
# S03[5] Beam Package:
#
# [
#   [beam_bottom, beam_top, beam_id, beam],
#   ...
# ]
#
# We select the beam/joint whose top is closest to the
# stack top.
# ------------------------------------------------------------

def get_top_termination(
    s03,
    column,
    column_id,
    stack_top,
    cover,
    db
):

    top_detected = False

    selected_beam = None
    selected_id = None

    beam_bottom = None
    beam_top = None

    beam_depth = None

    best_difference = None


    if s03 is not None:

        try:

            beams = s03[5]


            if is_list(
                beams
            ):

                for beam_data in beams:

                    if not is_list(
                        beam_data
                    ):
                        continue


                    if len(beam_data) < 4:
                        continue


                    bz0 = safe_float(
                        beam_data[0],
                        None
                    )


                    bz1 = safe_float(
                        beam_data[1],
                        None
                    )


                    bid = safe_int(
                        beam_data[2],
                        -1
                    )


                    beam = beam_data[3]


                    if (
                        bz0 is None
                        or bz1 is None
                    ):
                        continue


                    difference = abs(
                        bz1 - stack_top
                    )


                    if (
                        best_difference is None
                        or difference
                        < best_difference
                    ):

                        best_difference = difference

                        selected_beam = beam
                        selected_id = bid

                        beam_bottom = bz0
                        beam_top = bz1


        except:
            pass


    # --------------------------------------------------------
    # Consider a beam a top joint when it terminates at
    # approximately the column/stack top.
    # --------------------------------------------------------

    if (
        beam_top is not None
        and stack_top is not None
    ):

        if abs(
            beam_top - stack_top
        ) <= 5.0:

            top_detected = True


    if top_detected:

        beam_depth = (
            beam_top
            - beam_bottom
        )


        bend_z = (
            beam_top
            - cover
            - db / 2.0
        )


        status = (
            "TOP BEAM / JOINT DETECTED"
        )


        hook_status = (
            "TOP TERMINATION WITH 90 DEG HOOK "
            "PLANNED AT COVER LINE"
        )

    else:

        # No beam exactly at top.
        # Terminate at column top cover line.

        bend_z = (
            stack_top
            - cover
            - db / 2.0
        )


        status = (
            "NO TOP BEAM AT STACK TOP"
        )


        hook_status = (
            "TOP TERMINATION AT COLUMN COVER LINE"
        )


    return [
        column,                 # 0
        column_id,              # 1
        stack_top,              # 2
        top_detected,           # 3
        selected_beam,          # 4
        selected_id,            # 5
        beam_bottom,            # 6
        beam_top,               # 7
        beam_depth,             # 8
        (
            (
                stack_top - bend_z
            )
            if (
                stack_top is not None
                and bend_z is not None
            )
            else None
        ),                      # 9
        bend_z,                 # 10
        status,                 # 11
        True,                   # 12
        HOOK_FACTOR * db,       # 13
        hook_status,            # 14
        cover,                  # 15
        bend_z                  # 16
    ]


# ------------------------------------------------------------
# NORMALIZE VECTOR
# ------------------------------------------------------------

def normalize_vector(
    dx,
    dy
):

    length = math.sqrt(
        dx * dx
        + dy * dy
    )


    if length <= 1.0e-9:

        return (
            0.0,
            0.0
        )


    return (
        dx / length,
        dy / length
    )


# ------------------------------------------------------------
# PROCESS ONE M02 STACK
# ------------------------------------------------------------

def process_m02(
    m02
):

    stack_index = safe_int(
        m02[0],
        -1
    )


    column_ids = [
        safe_int(
            cid,
            -1
        )
        for cid in m02[1]
    ]


    db = safe_float(
        m02[2],
        0.0
    )


    total_main_bars = safe_int(
        m02[3],
        0
    )


    group_a = list(
        m02[7]
    )


    group_b = list(
        m02[8]
    )


    lap_length = safe_float(
        m02[9],
        60.0 * db
    )


    hook_extension = (
        HOOK_FACTOR
        * db
    )


    # --------------------------------------------------------
    # Stack limits from M01
    # --------------------------------------------------------

    m01 = m02[11]


    stack_bottom = safe_float(
        m01[3],
        None
    )


    stack_top = safe_float(
        m01[4],
        None
    )


    # --------------------------------------------------------
    # M03 currently creates one continuous preliminary path
    # for each longitudinal bar through the complete stack.
    #
    # Use the lowest storey for bottom anchorage and highest
    # storey for top termination.
    # --------------------------------------------------------

    storeys = []


    try:

        storeys = list(
            m02[6]
        )

    except:
        storeys = []


    if len(storeys) == 0:

        return None


    storeys.sort(
        key=lambda s:
        safe_float(
            s[4],
            1.0e99
        )
    )


    bottom_storey = storeys[0]

    top_storey = storeys[-1]


    bottom_column_id = safe_int(
        bottom_storey[1],
        -1
    )


    top_column_id = safe_int(
        top_storey[1],
        -1
    )


    # --------------------------------------------------------
    # Cover
    # --------------------------------------------------------

    cover = safe_float(
        bottom_storey[8],
        40.0
    )


    top_cover = safe_float(
        top_storey[8],
        cover
    )


    # --------------------------------------------------------
    # Bottom / top M01 column packages
    # --------------------------------------------------------

    bottom_column_package = (
        find_m01_column_package(
            m02,
            bottom_column_id
        )
    )


    top_column_package = (
        find_m01_column_package(
            m02,
            top_column_id
        )
    )


    bottom_s03 = get_s03(
        bottom_column_package
    )


    top_s03 = get_s03(
        top_column_package
    )


    # --------------------------------------------------------
    # Foundation
    # --------------------------------------------------------

    foundation_data = (
        get_foundation_data(
            bottom_s03,
            cover,
            db
        )
    )


    foundation_detected = (
        foundation_data[0]
    )


    foundation_bend_z = (
        foundation_data[6]
    )


    # --------------------------------------------------------
    # If no footing exists, use bottom cover line.
    # --------------------------------------------------------

    if foundation_bend_z is None:

        foundation_bend_z = (
            stack_bottom
            + cover
            + db / 2.0
        )


    # --------------------------------------------------------
    # Top termination
    # --------------------------------------------------------

    top_column = top_storey[0]


    top_termination = (
        get_top_termination(
            top_s03,
            top_column,
            top_column_id,
            stack_top,
            top_cover,
            db
        )
    )


    top_bend_z = safe_float(
        top_termination[16],
        None
    )


    if top_bend_z is None:

        top_bend_z = (
            stack_top
            - top_cover
            - db / 2.0
        )


    # --------------------------------------------------------
    # Column center
    # --------------------------------------------------------

    center_x = None
    center_y = None


    try:

        center_x = safe_float(
            m01[6],
            None
        )


        center_y = safe_float(
            m01[7],
            None
        )

    except:
        pass


    # --------------------------------------------------------
    # Bar layout
    #
    # For the preliminary continuous stack path, use the
    # bottom-storey bar coordinates. For a single-storey
    # column this is exactly the existing behavior.
    # --------------------------------------------------------

    bar_layout = []


    try:

        bar_layout = bottom_storey[14]

    except:
        bar_layout = []


    bar_paths = []

    maximum_path = 0.0


    for bar in bar_layout:

        if not is_list(
            bar
        ):

            continue


        if len(bar) < 9:

            continue


        bar_number = safe_int(
            bar[0],
            -1
        )


        group = str(
            bar[1]
        )


        global_x = safe_float(
            bar[4],
            None
        )


        global_y = safe_float(
            bar[5],
            None
        )


        if (
            global_x is None
            or global_y is None
        ):

            continue


        # ----------------------------------------------------
        # RADIAL VECTOR
        #
        # Bar -> outside:
        #     bar - center
        #
        # Bottom hook = outward
        # Top hook    = inward
        # ----------------------------------------------------

        if (
            center_x is not None
            and center_y is not None
        ):

            radial_x = (
                global_x
                - center_x
            )


            radial_y = (
                global_y
                - center_y
            )


            outward_dx, outward_dy = (
                normalize_vector(
                    radial_x,
                    radial_y
                )
            )

        else:

            outward_dx = 0.0
            outward_dy = 0.0


        # ----------------------------------------------------
        # Fallback for pathological center bar
        # ----------------------------------------------------

        if (
            abs(outward_dx) < 1.0e-9
            and abs(outward_dy) < 1.0e-9
        ):

            face = str(
                bar[8]
            ).upper()


            if face == "TOP":

                outward_dx = 0.0
                outward_dy = 1.0

            elif face == "RIGHT":

                outward_dx = 1.0
                outward_dy = 0.0

            elif face == "BOTTOM":

                outward_dx = 0.0
                outward_dy = -1.0

            elif face == "LEFT":

                outward_dx = -1.0
                outward_dy = 0.0


        # Bottom = outward
        bottom_dx = outward_dx
        bottom_dy = outward_dy


        # Top = toward column core
        top_dx = -outward_dx
        top_dy = -outward_dy


        # ----------------------------------------------------
        # Vertical length
        # ----------------------------------------------------

        vertical_length = abs(
            top_bend_z
            - foundation_bend_z
        )


        # ----------------------------------------------------
        # Both hooks currently 12db
        # ----------------------------------------------------

        bottom_hook = (
            hook_extension
        )


        top_hook = (
            hook_extension
        )


        total_path = (
            bottom_hook
            + vertical_length
            + top_hook
        )


        if total_path > maximum_path:

            maximum_path = (
                total_path
            )


        path_diagnostics = []


        if foundation_detected:

            path_diagnostics.append(
                "BOTTOM FOUNDATION HOOK = 12db"
            )

        else:

            path_diagnostics.append(
                "NO FOUNDATION - BOTTOM HOOK AT COLUMN COVER LINE"
            )


        if top_termination[3]:

            path_diagnostics.append(
                "TOP JOINT DETECTED"
            )

        else:

            path_diagnostics.append(
                "NO TOP BEAM AT STACK TOP"
            )


        path_diagnostics.append(
            "TOP HOOK = 12db AT COVER LINE - "
            "DIRECTION TOWARD COLUMN CORE"
        )


        bar_paths.append(
            [
                bar_number,             # 0
                group,                  # 1
                global_x,               # 2
                global_y,               # 3
                foundation_bend_z,      # 4
                top_bend_z,             # 5
                bottom_hook,            # 6
                vertical_length,        # 7
                top_hook,               # 8
                total_path,             # 9
                bottom_dx,              # 10
                bottom_dy,              # 11
                top_dx,                 # 12
                top_dy,                 # 13
                path_diagnostics        # 14
            ]
        )


    # --------------------------------------------------------
    # DIAGNOSTICS
    # --------------------------------------------------------

    diagnostics = [
        "MAIN BAR DIAMETER = {:.1f} mm".format(
            db
        ),

        "TOTAL MAIN BARS = {}".format(
            total_main_bars
        ),

        "ADOPTED LAP = 60db = {:.1f} mm".format(
            lap_length
        ),

        "90 DEG HOOK EXTENSION = 12db = {:.1f} mm".format(
            hook_extension
        ),

        "STACK BOTTOM = {:.1f} mm".format(
            stack_bottom
        ),

        "STACK TOP = {:.1f} mm".format(
            stack_top
        )
    ]


    # --------------------------------------------------------
    # FOUNDATION DIAGNOSTICS
    # --------------------------------------------------------

    if foundation_detected:

        diagnostics.append(
            "FOUNDATION DETECTED"
        )


        diagnostics.append(
            "FOUNDATION ID = {}".format(
                foundation_data[2]
            )
        )


        diagnostics.append(
            "FOUNDATION Z = {:.1f} TO {:.1f} mm".format(
                foundation_data[3],
                foundation_data[4]
            )
        )


        diagnostics.append(
            "FOUNDATION COVER = {:.1f} mm".format(
                cover
            )
        )


        diagnostics.append(
            "FOUNDATION BEND Z = {:.1f} mm".format(
                foundation_bend_z
            )
        )

    else:

        diagnostics.append(
            "NO FOUNDATION DETECTED"
        )


        diagnostics.append(
            "BOTTOM BEND Z = {:.1f} mm".format(
                foundation_bend_z
            )
        )


    # --------------------------------------------------------
    # TOP DIAGNOSTICS
    # --------------------------------------------------------

    if top_termination[3]:

        diagnostics.append(
            "TOP BEAM / JOINT DETECTED"
        )


        diagnostics.append(
            "TOP BEAM ID = {}".format(
                top_termination[5]
            )
        )


        if (
            top_termination[6] is not None
            and top_termination[7] is not None
        ):

            diagnostics.append(
                "TOP BEAM Z = {:.1f} TO {:.1f} mm".format(
                    top_termination[6],
                    top_termination[7]
                )
            )


        if top_termination[8] is not None:

            diagnostics.append(
                "TOP BEAM DEPTH = {:.1f} mm".format(
                    top_termination[8]
                )
            )

    else:

        diagnostics.append(
            "NO TOP BEAM / JOINT AT STACK TOP"
        )


    diagnostics.append(
        "TOP CONCRETE COVER = {:.1f} mm".format(
            top_cover
        )
    )


    diagnostics.append(
        "CORRECTED TOP BAR BEND Z = {:.1f} mm".format(
            top_bend_z
        )
    )


    if (
        center_x is not None
        and center_y is not None
    ):

        diagnostics.append(
            "COLUMN CENTER XY = ({:.3f}, {:.3f}) mm".format(
                center_x,
                center_y
            )
        )


    diagnostics.append(
        "GROUP A = {}".format(
            group_a
        )
    )


    diagnostics.append(
        "GROUP B = {}".format(
            group_b
        )
    )


    diagnostics.append(
        "TOP BAR BEND CENTERLINE = {:.1f} mm".format(
            top_bend_z
        )
    )


    diagnostics.append(
        "TOP BAR CENTERLINE IS {:.1f} mm BELOW CONCRETE TOP".format(
            stack_top - top_bend_z
        )
    )


    diagnostics.append(
        "TOP HOOK DIRECTIONS REVERSED TOWARD COLUMN CORE"
    )


    diagnostics.append(
        "M03 BAR PATH COUNT = {}".format(
            len(bar_paths)
        )
    )


    diagnostics.append(
        "MAXIMUM PRELIMINARY BAR PATH = {:.1f} mm".format(
            maximum_path
        )
    )


    if len(bar_paths) == total_main_bars:

        diagnostics.append(
            "PASS: ALL MAIN BAR PATHS GENERATED"
        )

    else:

        diagnostics.append(
            "WARNING: EXPECTED {} BAR PATHS, GENERATED {}".format(
                total_main_bars,
                len(bar_paths)
            )
        )


    # --------------------------------------------------------
    # PRESERVE ORIGINAL M03 ARCHITECTURE
    # --------------------------------------------------------

    return [
        stack_index,             # 0
        column_ids,              # 1
        db,                      # 2
        total_main_bars,         # 3
        lap_length,              # 4
        hook_extension,          # 5
        group_a,                 # 6
        group_b,                 # 7
        stack_bottom,            # 8
        stack_top,               # 9
        foundation_data,         # 10
        top_termination,         # 11
        bar_paths,               # 12
        maximum_path,            # 13
        diagnostics,             # 14
        m02                      # 15
    ]


# ============================================================
# MAIN
# ============================================================

raw_input = IN[0]


# ------------------------------------------------------------
# COLLECT EVERY M02 STACK
# ------------------------------------------------------------

m02_packages = collect_m02_packages(
    raw_input
)


# ------------------------------------------------------------
# PROCESS EVERY STACK
# ------------------------------------------------------------

output = []


for m02 in m02_packages:

    try:

        result = process_m02(
            m02
        )


        if result is not None:

            output.append(
                result
            )

    except Exception as ex:

        # Keep the remaining stacks running if one stack fails.

        try:

            stack_index = safe_int(
                m02[0],
                -1
            )

            column_ids = m02[1]

        except:

            stack_index = -1
            column_ids = []


        output.append(
            [
                stack_index,                 # 0
                column_ids,                  # 1
                None,                        # 2
                0,                           # 3
                None,                        # 4
                None,                        # 5
                [],                          # 6
                [],                          # 7
                None,                        # 8
                None,                        # 9
                [],                          # 10
                [],                          # 11
                [],                          # 12
                0.0,                         # 13
                [
                    "M03 ERROR",
                    str(ex)
                ],                            # 14
                m02                          # 15
            ]
        )


# ------------------------------------------------------------
# OUTPUT
# ------------------------------------------------------------

OUT = output
# ----------------------------------------
commercial_length = IntegerSlider(6000, range=6000..12000 step 3000)
M04 = Python(IN[0]=M03, IN[1]=commercial_length)  # CPython3
# ---------- M04.python (1687 lines) ----------
# ============================================================
# M04 — NSCP DEVELOPMENT + COMMERCIAL STOCK +
#       STAGGERED LAP PLANNER
# CORRECTED MULTI-STACK VERSION
#
# IN[0] = COMPLETE M03 OUTPUT
# IN[1] = Commercial Stock Length (mm)
#         Example: 6000 / 9000 / 12000
#
# FIX:
#   Processes ALL M03 stack packages.
#
# OUTPUT PER STACK:
# [0]  Stack Index
# [1]  Column IDs
# [2]  Main Bar Diameter
# [3]  Total Main Bars
# [4]  Stock Length
# [5]  Adopted Lap Length
# [6]  Group A
# [7]  Group B
# [8]  Splice Zones
# [9]  Group A Plan
# [10] Group B Plan
# [11] Individual Bar Plans
# [12] Stock Summary
# [13] Diagnostics
# [14] Original M03 Package
# [15] NSCP Development Data
# [16] Anchorage / Hook Geometry Check
# ============================================================

import math


# ============================================================
# DESIGN CONSTANTS
# ============================================================

FC = 21.0
FY = 420.0

CLASS_B_FACTOR = 1.30

CONSTRUCTION_LAP_FACTOR = 60.0
HOOK_EXTENSION_FACTOR = 12.0

# Existing M04 development equations retained to reproduce
# the current M04 values:
#
# D16:
# ld  ~= 533.2 mm
# lap ~= 693.2 mm
# ldh ~= 351.7 mm

LD_FACTOR = 2.908
LDH_FACTOR = 1.9175

DEFAULT_STOCK = 6000.0


# ============================================================
# HELPERS
# ============================================================

def is_list(x):
    return isinstance(x, (list, tuple))


def sf(x, default=None):
    try:
        return float(x)
    except:
        return default


def si(x, default=-1):
    try:
        return int(x)
    except:
        return default


def clean_number(x):
    if x is None:
        return None

    r = round(float(x))

    if abs(float(x) - r) < 1.0e-8:
        return int(r)

    return float(x)


def ceil_div(a, b):

    if b <= 0:
        return 0

    return int(
        math.ceil(
            float(a) / float(b)
        )
    )


# ============================================================
# IDENTIFY M03 PACKAGE
# ============================================================

def looks_like_m03(x):

    if not is_list(x):
        return False

    if len(x) < 16:
        return False

    try:

        if si(x[0], -1) < 0:
            return False

        if not is_list(x[1]):
            return False

        if len(x[1]) == 0:
            return False

        db = sf(x[2], None)
        qty = si(x[3], -1)

        if db is None or db <= 0:
            return False

        if qty <= 0:
            return False

        if not is_list(x[6]):
            return False

        if not is_list(x[7]):
            return False

        if not is_list(x[12]):
            return False

        # M03 bar path:
        # [bar, group, x, y, bottomZ, topZ, ...]
        if len(x[12]) > 0:

            p = x[12][0]

            if not is_list(p):
                return False

            if len(p) < 14:
                return False

        return True

    except:
        return False


# ============================================================
# COLLECT ALL M03 STACKS
#
# IMPORTANT:
# Once an M03 package is found, do not recurse into it.
# M03 contains the complete M02/M01/S04 packages.
# ============================================================

def collect_m03(data):

    result = []
    seen = set()

    def walk(x):

        if x is None:
            return

        if looks_like_m03(x):

            stack = si(x[0], -1)

            ids = []

            try:
                for cid in x[1]:
                    ids.append(si(cid, -1))
            except:
                pass

            key = (
                stack,
                tuple(ids)
            )

            if key not in seen:

                seen.add(key)
                result.append(x)

            return

        if is_list(x):

            for item in x:
                walk(item)

    walk(data)

    result.sort(
        key=lambda x: si(x[0], 999999)
    )

    return result


# ============================================================
# STOCK INPUT
# ============================================================

def get_stock_length(x):

    # Allow Dynamo to send a wrapped number.

    while is_list(x) and len(x) == 1:
        x = x[0]

    stock = sf(x, DEFAULT_STOCK)

    if stock is None or stock <= 0:
        stock = DEFAULT_STOCK

    return stock


# ============================================================
# ESTIMATE cb
#
# Try to obtain the actual minimum clear spacing from M02.
#
# M03[15] = M02
# M02[6]  = Storey Outputs
# Storey[15] = minimum clear spacing
#
# Existing M04 output used approximately:
#
# cb = min(
#       cover + tie diameter + db/2,
#       clear_spacing/2 + db/2
#      )
#
# This gives 58 mm for current 350x350 C1:
# cover 40 + tie 10 + db/2 8 = 58 mm
# ============================================================

def estimate_cb(m03, db):

    cover = 40.0
    tie_dia = 10.0
    clear_spacing = None

    try:

        m02 = m03[15]
        storeys = m02[6]

        if len(storeys) > 0:

            s = storeys[0]

            tie_dia = sf(
                s[7],
                tie_dia
            )

            cover = sf(
                s[8],
                cover
            )

            if len(s) > 15:

                clear_spacing = sf(
                    s[15],
                    None
                )

    except:
        pass

    cb_cover = (
        cover
        + tie_dia
        + db / 2.0
    )

    if clear_spacing is not None:

        cb_spacing = (
            clear_spacing / 2.0
            + db / 2.0
        )

        cb = min(
            cb_cover,
            cb_spacing
        )

    else:

        cb = cb_cover

    return cb


# ============================================================
# DEVELOPMENT DATA
# ============================================================

def development_data(m03):

    db = sf(m03[2], 0.0)

    cb = estimate_cb(
        m03,
        db
    )

    # Existing M04 formulation retained.

    ld = (
        LD_FACTOR
        * db
        * FY
        / math.sqrt(FC)
    )

    class_b_lap = (
        CLASS_B_FACTOR
        * ld
    )

    lap_60db = (
        CONSTRUCTION_LAP_FACTOR
        * db
    )

    adopted_lap = max(
        class_b_lap,
        lap_60db
    )

    hook_extension = (
        HOOK_EXTENSION_FACTOR
        * db
    )

    ldh = (
        LDH_FACTOR
        * db
        * FY
        / math.sqrt(FC)
    )

    return [
        FC,                     # 0
        FY,                     # 1
        db,                     # 2
        cb,                     # 3
        ld,                     # 4
        CLASS_B_FACTOR,         # 5
        class_b_lap,            # 6
        lap_60db,               # 7
        adopted_lap,            # 8
        hook_extension,         # 9
        ldh                     # 10
    ]


# ============================================================
# SPLICE ZONES
#
# Center-half zone for each column/storey in the stack.
#
# Output:
# [
#   segment,
#   column_id,
#   bottom,
#   top,
#   clear_height,
#   center_half_bottom,
#   center_half_top,
#   group_A_splice_z,
#   group_B_splice_z
# ]
# ============================================================

def build_splice_zones(m03):

    zones = []

    try:

        m02 = m03[15]
        storeys = m02[6]

    except:

        storeys = []

    index = 0

    for storey in storeys:

        try:

            cid = si(storey[1], -1)

            bottom = sf(
                storey[4],
                None
            )

            top = sf(
                storey[5],
                None
            )

            if bottom is None or top is None:
                continue

            index += 1

            h = top - bottom

            center_half_bottom = (
                bottom
                + h * 0.25
            )

            center_half_top = (
                top
                - h * 0.25
            )

            # Stagger groups inside the center half.
            #
            # A = lower third point of center-half
            # B = upper third point of center-half

            zone_height = (
                center_half_top
                - center_half_bottom
            )

            splice_a = (
                center_half_bottom
                + zone_height / 3.0
            )

            splice_b = (
                center_half_top
                - zone_height / 3.0
            )

            zones.append(
                [
                    index,
                    cid,
                    clean_number(bottom),
                    clean_number(top),
                    clean_number(h),
                    clean_number(
                        center_half_bottom
                    ),
                    clean_number(
                        center_half_top
                    ),
                    clean_number(splice_a),
                    clean_number(splice_b)
                ]
            )

        except:
            pass

    return zones


# ============================================================
# CUT ONE CONTINUOUS BAR PATH INTO STOCK PIECES
#
# Piece package:
#
# [0] Piece Number
# [1] Start Z
# [2] End Z
# [3] Vertical Component
# [4] Bottom Hook
# [5] Top Hook
# [6] Cut Length
# [7] Stock Length
# [8] Offcut
# [9] Start Description
# [10] End Description
# ============================================================

def one_piece_plan(
    start_z,
    end_z,
    bottom_hook,
    top_hook,
    stock
):

    vertical = abs(
        end_z - start_z
    )

    cut_length = (
        vertical
        + bottom_hook
        + top_hook
    )

    return [
        1,
        clean_number(start_z),
        clean_number(end_z),
        clean_number(vertical),
        clean_number(bottom_hook),
        clean_number(top_hook),
        clean_number(cut_length),
        clean_number(stock),
        clean_number(stock - cut_length),
        "FOUNDATION / START",
        "TOP TERMINATION"
    ]


# ============================================================
# MULTI-PIECE STOCK PLAN
#
# This is used only when one complete bar cannot fit in the
# selected commercial stock.
#
# The stock piece lengths include the adopted lap.
# Splice elevations alternate by Group A / Group B.
# ============================================================

def multi_piece_plan(
    start_z,
    end_z,
    bottom_hook,
    top_hook,
    stock,
    lap,
    group,
    zones
):

    pieces = []
    splices = []

    vertical_total = abs(
        end_z - start_z
    )

    direction = 1.0

    if end_z < start_z:
        direction = -1.0

    # Usable first piece after bottom hook.
    first_vertical_capacity = (
        stock
        - bottom_hook
    )

    # Usable intermediate advance.
    # Lap is consumed by overlap.

    normal_advance = (
        stock
        - lap
    )

    # Last stock must also contain top hook.

    last_vertical_capacity = (
        stock
        - top_hook
    )

    if (
        first_vertical_capacity <= 0
        or normal_advance <= 0
        or last_vertical_capacity <= 0
    ):

        return (
            [],
            [],
            [
                "ERROR: STOCK LENGTH TOO SHORT FOR HOOK / LAP REQUIREMENTS"
            ]
        )

    current_z = start_z
    remaining = vertical_total
    piece_no = 1

    diagnostics = []

    # --------------------------------------------------------
    # Preferred splice elevations
    # --------------------------------------------------------

    preferred_splices = []

    for z in zones:

        try:

            if str(group).upper() == "A":
                preferred_splices.append(
                    sf(z[7], None)
                )
            else:
                preferred_splices.append(
                    sf(z[8], None)
                )
        except:
            pass

    preferred_splices = [
        z for z in preferred_splices
        if z is not None
    ]

    preferred_splices.sort()

    if direction < 0:
        preferred_splices.reverse()

    # --------------------------------------------------------
    # Generate pieces
    # --------------------------------------------------------

    while True:

        is_first = (
            piece_no == 1
        )

        bh = (
            bottom_hook
            if is_first
            else 0.0
        )

        # Can remaining bar fit in one final stock piece?

        required_final = (
            remaining
            + top_hook
        )

        if required_final <= stock:

            cut_length = required_final

            next_z = end_z

            pieces.append(
                [
                    piece_no,
                    clean_number(current_z),
                    clean_number(next_z),
                    clean_number(remaining),
                    clean_number(bh),
                    clean_number(top_hook),
                    clean_number(
                        remaining
                        + bh
                        + top_hook
                    ),
                    clean_number(stock),
                    clean_number(
                        stock
                        - (
                            remaining
                            + bh
                            + top_hook
                        )
                    ),
                    (
                        "FOUNDATION / START"
                        if is_first
                        else "LAP START"
                    ),
                    "TOP TERMINATION"
                ]
            )

            break

        # Maximum vertical distance this piece can cover.

        capacity = (
            stock
            - bh
        )

        # Choose a splice inside allowable preferred zones
        # where possible.

        target_z = None

        for preferred in preferred_splices:

            advance = abs(
                preferred - current_z
            )

            if (
                advance > lap
                and advance <= capacity
            ):

                target_z = preferred

        if target_z is None:

            advance = capacity

            target_z = (
                current_z
                + direction * advance
            )

        else:

            advance = abs(
                target_z - current_z
            )

        cut_length = (
            advance
            + bh
        )

        pieces.append(
            [
                piece_no,
                clean_number(current_z),
                clean_number(target_z),
                clean_number(advance),
                clean_number(bh),
                0,
                clean_number(cut_length),
                clean_number(stock),
                clean_number(
                    stock - cut_length
                ),
                (
                    "FOUNDATION / START"
                    if is_first
                    else "LAP START"
                ),
                "LAP / SPLICE"
            ]
        )

        splices.append(
            clean_number(target_z)
        )

        # Next piece begins lap distance before splice end.

        current_z = (
            target_z
            - direction * lap
        )

        covered_advance = (
            advance - lap
        )

        if covered_advance <= 0:

            diagnostics.append(
                "ERROR: INVALID STOCK / LAP ADVANCE"
            )

            break

        remaining -= covered_advance

        piece_no += 1

        if piece_no > 100:

            diagnostics.append(
                "ERROR: STOCK PLANNER ITERATION LIMIT"
            )

            break

    return (
        pieces,
        splices,
        diagnostics
    )


# ============================================================
# GROUP PLAN
# ============================================================

def build_group_plan(
    group_name,
    bar_numbers,
    representative_path,
    stock,
    lap,
    zones
):

    diagnostics = []

    if representative_path is None:

        return [
            group_name,
            list(bar_numbers),
            [],
            [],
            diagnostics
        ]

    start_z = sf(
        representative_path[4],
        0.0
    )

    end_z = sf(
        representative_path[5],
        0.0
    )

    bottom_hook = sf(
        representative_path[6],
        0.0
    )

    top_hook = sf(
        representative_path[8],
        0.0
    )

    total_path = sf(
        representative_path[9],
        0.0
    )

    if total_path <= stock:

        pieces = [
            one_piece_plan(
                start_z,
                end_z,
                bottom_hook,
                top_hook,
                stock
            )
        ]

        splices = []

        diagnostics.append(
            "ONE STOCK BAR - NO LAP REQUIRED"
        )

    else:

        pieces, splices, extra = (
            multi_piece_plan(
                start_z,
                end_z,
                bottom_hook,
                top_hook,
                stock,
                lap,
                group_name,
                zones
            )
        )

        diagnostics.extend(extra)

        diagnostics.append(
            "{} STOCK PIECE(S), {} LAP SPLICE(S)".format(
                len(pieces),
                len(splices)
            )
        )

    return [
        group_name,
        list(bar_numbers),
        pieces,
        splices,
        diagnostics
    ]


# ============================================================
# INDIVIDUAL BAR PLAN
# ============================================================

def build_individual_plan(
    path,
    stock,
    lap,
    zones
):

    bar_number = si(
        path[0],
        -1
    )

    group = str(
        path[1]
    )

    start_z = sf(
        path[4],
        0.0
    )

    end_z = sf(
        path[5],
        0.0
    )

    bottom_hook = sf(
        path[6],
        0.0
    )

    top_hook = sf(
        path[8],
        0.0
    )

    total_path = sf(
        path[9],
        0.0
    )

    if total_path <= stock:

        pieces = [
            one_piece_plan(
                start_z,
                end_z,
                bottom_hook,
                top_hook,
                stock
            )
        ]

        splices = []

    else:

        pieces, splices, dummy = (
            multi_piece_plan(
                start_z,
                end_z,
                bottom_hook,
                top_hook,
                stock,
                lap,
                group,
                zones
            )
        )

    piece_count = len(pieces)
    splice_count = len(splices)

    total_cut = 0.0

    for p in pieces:
        total_cut += sf(
            p[6],
            0.0
        )

    purchased = (
        piece_count
        * stock
    )

    offcut = (
        purchased
        - total_cut
    )

    return [
        bar_number,                  # 0
        group,                       # 1
        pieces,                      # 2
        splices,                     # 3
        piece_count,                 # 4
        splice_count,                # 5
        clean_number(total_cut),     # 6
        clean_number(purchased),     # 7
        clean_number(offcut)         # 8
    ]


# ============================================================
# ANCHORAGE / HOOK GEOMETRY CHECK
# ============================================================

def anchorage_check(
    m03,
    dev
):

    db = sf(
        m03[2],
        0.0
    )

    hook_extension = sf(
        dev[9],
        0.0
    )

    ldh = sf(
        dev[10],
        0.0
    )

    # --------------------------------------------------------
    # Foundation
    # --------------------------------------------------------

    foundation = m03[10]

    foundation_detected = False
    foundation_id = None
    footing_bottom = None
    footing_top = None
    cover = None
    bend_z = None

    try:

        foundation_detected = bool(
            foundation[0]
        )

        foundation_id = foundation[2]
        footing_bottom = foundation[3]
        footing_top = foundation[4]
        cover = foundation[5]
        bend_z = foundation[6]

    except:
        pass

    foundation_available_depth = None

    if (
        bend_z is not None
        and footing_bottom is not None
    ):

        foundation_available_depth = (
            bend_z - footing_bottom
        )

    foundation_position_pass = bool(
        foundation_detected
        and bend_z is not None
        and footing_bottom is not None
        and footing_top is not None
        and bend_z >= footing_bottom
        and bend_z <= footing_top
    )

    foundation_check = [
        foundation_detected,
        foundation_id,
        footing_bottom,
        footing_top,
        cover,
        bend_z,
        clean_number(
            foundation_available_depth
        ),
        foundation_position_pass,
        True,
        clean_number(
            hook_extension
        ),
        (
            "PASS: FOUNDATION HOOK GEOMETRY IS POSITIONED AT BOTTOM COVER"
            if foundation_position_pass
            else "FOUNDATION HOOK GEOMETRY NOT AVAILABLE / CHECK REQUIRED"
        )
    ]

    # --------------------------------------------------------
    # Top
    # --------------------------------------------------------

    top = m03[11]

    top_detected = False
    beam_id = None
    beam_bottom = None
    beam_top = None
    beam_depth = None
    top_bend = None

    try:

        top_detected = bool(
            top[3]
        )

        beam_id = top[5]
        beam_bottom = top[6]
        beam_top = top[7]
        beam_depth = top[8]
        top_bend = top[16]

    except:
        pass

    top_position_pass = bool(
        top_detected
        and top_bend is not None
        and beam_bottom is not None
        and beam_top is not None
        and top_bend >= beam_bottom
        and top_bend <= beam_top
    )

    top_check = [
        top_detected,
        beam_id,
        beam_bottom,
        beam_top,
        beam_depth,
        top_bend,
        top_position_pass,
        clean_number(
            hook_extension
        ),
        (
            "PASS: TOP BAR TERMINATION IS WITHIN DETECTED JOINT"
            if top_position_pass
            else "TOP BAR TERMINATION / JOINT CHECK REQUIRED"
        )
    ]

    # --------------------------------------------------------
    # Hook geometry
    # --------------------------------------------------------

    minimum_inside_bend_diameter = (
        6.0 * db
    )

    outside_bend_diameter = (
        minimum_inside_bend_diameter
        + db
    )

    centerline_bend_radius = (
        outside_bend_diameter
        / 2.0
    )

    hook_geometry = [
        clean_number(db),
        clean_number(hook_extension),
        clean_number(
            minimum_inside_bend_diameter
        ),
        clean_number(
            outside_bend_diameter
        ),
        clean_number(
            centerline_bend_radius
        ),
        ldh
    ]

    note = (
        "LDH REPORTED SEPARATELY - FULL HOOKED DEVELOPMENT "
        "COMPLIANCE REQUIRES APPLICABLE NSCP COVER / "
        "CONFINEMENT CONDITIONS"
    )

    diagnostics = [
        "STANDARD 90 DEG HOOK EXTENSION = {:.1f} mm".format(
            hook_extension
        ),

        "MINIMUM INSIDE BEND DIAMETER = {:.1f} mm".format(
            minimum_inside_bend_diameter
        ),

        "OUTSIDE BEND DIAMETER = {:.1f} mm".format(
            outside_bend_diameter
        ),

        "BAR CENTERLINE BEND RADIUS = {:.1f} mm".format(
            centerline_bend_radius
        ),

        "BASIC HOOKED DEVELOPMENT ldh = {:.1f} mm".format(
            ldh
        ),

        foundation_check[10],

        top_check[8],

        note
    ]

    return [
        foundation_check,
        top_check,
        hook_geometry,
        note,
        diagnostics
    ]


# ============================================================
# PROCESS ONE M03 STACK
# ============================================================

def process_m03(
    m03,
    stock
):

    stack_index = si(
        m03[0],
        -1
    )

    column_ids = list(
        m03[1]
    )

    db = sf(
        m03[2],
        0.0
    )

    total_main_bars = si(
        m03[3],
        0
    )

    group_a = list(
        m03[6]
    )

    group_b = list(
        m03[7]
    )

    bar_paths = list(
        m03[12]
    )

    # --------------------------------------------------------
    # Development
    # --------------------------------------------------------

    dev = development_data(
        m03
    )

    adopted_lap = sf(
        dev[8],
        60.0 * db
    )

    # --------------------------------------------------------
    # Splice zones
    # --------------------------------------------------------

    splice_zones = (
        build_splice_zones(
            m03
        )
    )

    # --------------------------------------------------------
    # Representative paths for A/B
    # --------------------------------------------------------

    path_a = None
    path_b = None

    for p in bar_paths:

        try:

            group = str(
                p[1]
            ).upper()

            if (
                group == "A"
                and path_a is None
            ):
                path_a = p

            elif (
                group == "B"
                and path_b is None
            ):
                path_b = p

        except:
            pass

    group_a_plan = (
        build_group_plan(
            "A",
            group_a,
            path_a,
            stock,
            adopted_lap,
            splice_zones
        )
    )

    group_b_plan = (
        build_group_plan(
            "B",
            group_b,
            path_b,
            stock,
            adopted_lap,
            splice_zones
        )
    )

    # --------------------------------------------------------
    # Individual bar plans
    # --------------------------------------------------------

    individual_plans = []

    for p in bar_paths:

        individual_plans.append(
            build_individual_plan(
                p,
                stock,
                adopted_lap,
                splice_zones
            )
        )

    individual_plans.sort(
        key=lambda x: x[0]
    )

    # --------------------------------------------------------
    # Stock summary
    # --------------------------------------------------------

    total_stock_pieces = 0
    total_laps = 0
    total_cut = 0.0
    total_purchased = 0.0
    total_offcut = 0.0

    for plan in individual_plans:

        total_stock_pieces += si(
            plan[4],
            0
        )

        total_laps += si(
            plan[5],
            0
        )

        total_cut += sf(
            plan[6],
            0.0
        )

        total_purchased += sf(
            plan[7],
            0.0
        )

        total_offcut += sf(
            plan[8],
            0.0
        )

    utilization = 0.0

    if total_purchased > 0:

        utilization = (
            total_cut
            / total_purchased
            * 100.0
        )

    stock_summary = [
        total_main_bars,
        total_stock_pieces,
        total_laps,
        clean_number(total_cut),
        clean_number(total_purchased),
        clean_number(total_offcut),
        utilization
    ]

    # --------------------------------------------------------
    # Diagnostics
    # --------------------------------------------------------

    diagnostics = [
        "DESIGN f'c = {:.1f} MPa".format(
            FC
        ),

        "DESIGN fy = {:.1f} MPa".format(
            FY
        ),

        "MAIN BAR DIAMETER = {:.1f} mm".format(
            db
        ),

        "ESTIMATED cb = {:.1f} mm".format(
            dev[3]
        ),

        "STRAIGHT TENSION ld = {:.1f} mm".format(
            dev[4]
        ),

        "CLASS B TENSION LAP = {:.1f} mm".format(
            dev[6]
        ),

        "60db CONSTRUCTION MINIMUM = {:.1f} mm".format(
            dev[7]
        ),

        "ADOPTED LAP = {:.1f} mm".format(
            adopted_lap
        ),

        "90 DEG HOOK STRAIGHT EXTENSION = {:.1f} mm".format(
            dev[9]
        ),

        "BASIC HOOKED DEVELOPMENT ldh = {:.1f} mm".format(
            dev[10]
        ),

        "{} CENTER-HALF SPLICE ZONE(S) GENERATED".format(
            len(splice_zones)
        )
    ]

    for d in group_a_plan[4]:
        diagnostics.append(d)

    for d in group_b_plan[4]:
        diagnostics.append(d)

    diagnostics.extend(
        [
            "COMMERCIAL STOCK = {:.0f} mm".format(
                stock
            ),

            "TOTAL MAIN BARS = {}".format(
                total_main_bars
            ),

            "TOTAL STOCK PIECES = {}".format(
                total_stock_pieces
            ),

            "TOTAL LAP SPLICES = {}".format(
                total_laps
            ),

            "TOTAL CUT LENGTH = {:.1f} mm".format(
                total_cut
            ),

            "TOTAL PURCHASED LENGTH = {:.1f} mm".format(
                total_purchased
            ),

            "TOTAL OFFCUT = {:.1f} mm".format(
                total_offcut
            ),

            "STOCK UTILIZATION = {:.3f}%".format(
                utilization
            )
        ]
    )

    # --------------------------------------------------------
    # Anchorage / hook checks
    # --------------------------------------------------------

    anchorage = (
        anchorage_check(
            m03,
            dev
        )
    )

    # --------------------------------------------------------
    # PRESERVE M04 OUTPUT ARCHITECTURE
    # --------------------------------------------------------

    return [
        stack_index,             # 0
        column_ids,              # 1
        clean_number(db),        # 2
        total_main_bars,         # 3
        clean_number(stock),     # 4
        clean_number(
            adopted_lap
        ),                       # 5
        group_a,                 # 6
        group_b,                 # 7
        splice_zones,            # 8
        group_a_plan,            # 9
        group_b_plan,            # 10
        individual_plans,        # 11
        stock_summary,           # 12
        diagnostics,             # 13
        m03,                     # 14
        dev,                     # 15
        anchorage                # 16
    ]


# ============================================================
# MAIN
# ============================================================

raw_m03 = IN[0]

try:
    raw_stock = IN[1]
except:
    raw_stock = DEFAULT_STOCK


stock_length = get_stock_length(
    raw_stock
)


# ------------------------------------------------------------
# FIND EVERY M03 STACK
# ------------------------------------------------------------

m03_packages = collect_m03(
    raw_m03
)


# ------------------------------------------------------------
# PROCESS EVERY STACK
# ------------------------------------------------------------

OUT_DATA = []


for m03 in m03_packages:

    try:

        result = process_m03(
            m03,
            stock_length
        )

        OUT_DATA.append(
            result
        )

    except Exception as ex:

        try:

            stack_index = si(
                m03[0],
                -1
            )

            column_ids = list(
                m03[1]
            )

            db = sf(
                m03[2],
                None
            )

            qty = si(
                m03[3],
                0
            )

        except:

            stack_index = -1
            column_ids = []
            db = None
            qty = 0

        OUT_DATA.append(
            [
                stack_index,         # 0
                column_ids,          # 1
                db,                  # 2
                qty,                 # 3
                stock_length,        # 4
                None,                # 5
                [],                  # 6
                [],                  # 7
                [],                  # 8
                [],                  # 9
                [],                  # 10
                [],                  # 11
                [],                  # 12
                [
                    "M04 ERROR",
                    str(ex)
                ],                    # 13
                m03,                 # 14
                [],                  # 15
                []                   # 16
            ]
        )


# ============================================================
# OUTPUT
# ============================================================

OUT = OUT_DATA
# ----------------------------------------
R01 = Python(IN[0]=M04)  # CPython3
# ---------- R01.python (422 lines) ----------
# ============================================================
# R01 — CLEAR EXISTING DYNAMO MAIN BARS ONLY
#
# IN[0] = COMPLETE M04 OUTPUT
#
# IMPORTANT:
#   Deletes ONLY rebar generated/owned by R02.
#
#   PRESERVES:
#       - T02 ties
#       - T02 crossties
#       - manually created reinforcement
#       - reinforcement from other routines
#
# OWNERSHIP PREFIX:
#   DYNAMO_R02_MAINBAR
#
# OUT:
# [0] Original M04 Package
# [1] Target Column IDs
# [2] Deleted Main Bar IDs
# [3] Number Deleted
# [4] Per-Column Results
# [5] Diagnostics
# ============================================================

import clr


# ------------------------------------------------------------
# REVIT SERVICES
# ------------------------------------------------------------

clr.AddReference("RevitServices")

from RevitServices.Persistence import DocumentManager
from RevitServices.Transactions import TransactionManager

doc = DocumentManager.Instance.CurrentDBDocument


# ------------------------------------------------------------
# REVIT API
# ------------------------------------------------------------

clr.AddReference("RevitAPI")

from Autodesk.Revit.DB import *
from Autodesk.Revit.DB.Structure import Rebar


# ------------------------------------------------------------
# INPUT
# ------------------------------------------------------------

m04_input = IN[0]


# ============================================================
# CONSTANT
# ============================================================

MAINBAR_PREFIX = "DYNAMO_R02_MAINBAR"


# ============================================================
# HELPERS
# ============================================================

def is_list(x):
    return isinstance(x, (list, tuple))


def safe_int(x, default=None):

    try:
        return int(x)
    except:
        pass

    try:
        return int(x.Value)
    except:
        pass

    try:
        return int(x.IntegerValue)
    except:
        return default


def id_value(eid):

    try:
        return int(eid.Value)
    except:
        pass

    try:
        return int(eid.IntegerValue)
    except:
        return None


def get_element_id(element):

    try:
        return id_value(element.Id)
    except:
        return None


# ============================================================
# M04 DETECTION
# ============================================================

def looks_like_m04(data):

    if not is_list(data):
        return False

    if len(data) < 17:
        return False

    try:

        stack_index = safe_int(
            data[0],
            None
        )

        column_ids = data[1]
        diameter = data[2]
        bar_plans = data[11]

        if stack_index is None:
            return False

        if not is_list(column_ids):
            return False

        if not is_list(bar_plans):
            return False

        float(diameter)

        return True

    except:
        return False


def collect_m04(data, results=None):

    if results is None:
        results = []

    if looks_like_m04(data):

        if data not in results:
            results.append(data)

        return results

    if is_list(data):

        for item in data:
            collect_m04(
                item,
                results
            )

    return results


# ============================================================
# TARGET COLUMN IDS
# ============================================================

def get_target_column_ids(data):

    packages = collect_m04(data)

    result = []

    for package in packages:

        try:
            ids = package[1]
        except:
            continue

        if not is_list(ids):
            ids = [ids]

        for cid in ids:

            value = safe_int(
                cid,
                None
            )

            if (
                value is not None and
                value not in result
            ):
                result.append(value)

    return result


# ============================================================
# COMMENTS
# ============================================================

def get_comment(element):

    try:

        p = element.get_Parameter(
            BuiltInParameter.ALL_MODEL_INSTANCE_COMMENTS
        )

        if p is None:
            return ""

        value = p.AsString()

        if value is None:
            return ""

        return value

    except:
        return ""


# ============================================================
# HOST ID
# ============================================================

def get_rebar_host_id(rebar):

    try:
        return id_value(
            rebar.GetHostId()
        )
    except:
        return None


# ============================================================
# MAIN
# ============================================================

target_column_ids = get_target_column_ids(
    m04_input
)

deleted_ids = []

per_column = []

diagnostics = []


if len(target_column_ids) == 0:

    OUT = [
        m04_input,
        [],
        [],
        0,
        [],
        [
            "ERROR: NO TARGET COLUMN IDS FOUND IN M04"
        ]
    ]

else:

    # --------------------------------------------------------
    # Build ownership table before transaction.
    # --------------------------------------------------------

    owned_by_column = {}

    for cid in target_column_ids:
        owned_by_column[cid] = []

    rebars = list(
        FilteredElementCollector(doc)
        .OfClass(Rebar)
        .WhereElementIsNotElementType()
    )

    for rebar in rebars:

        comment = get_comment(
            rebar
        )

        if not comment.startswith(
            MAINBAR_PREFIX
        ):
            continue

        host_id = get_rebar_host_id(
            rebar
        )

        if host_id not in target_column_ids:
            continue

        owned_by_column[
            host_id
        ].append(
            rebar
        )

    # --------------------------------------------------------
    # Delete only R02-owned reinforcement.
    # --------------------------------------------------------

    TransactionManager.Instance.EnsureInTransaction(
        doc
    )

    try:

        for cid in target_column_ids:

            column_deleted = []

            candidates = owned_by_column.get(
                cid,
                []
            )

            for rebar in candidates:

                rid = get_element_id(
                    rebar
                )

                try:

                    doc.Delete(
                        rebar.Id
                    )

                    if rid is not None:

                        deleted_ids.append(
                            rid
                        )

                        column_deleted.append(
                            rid
                        )

                except Exception as ex:

                    diagnostics.append(
                        "FAILED DELETE REBAR {}: {}".format(
                            rid,
                            str(ex)
                        )
                    )

            per_column.append(
                [
                    cid,
                    column_deleted,
                    len(column_deleted)
                ]
            )

    finally:

        TransactionManager.Instance.TransactionTaskDone()


    diagnostics.append(
        "R01 OWNERSHIP PREFIX = {}".format(
            MAINBAR_PREFIX
        )
    )

    diagnostics.append(
        "TARGET COLUMNS = {}".format(
            len(target_column_ids)
        )
    )

    diagnostics.append(
        "R02 MAIN BARS DELETED = {}".format(
            len(deleted_ids)
        )
    )

    diagnostics.append(
        "T02 TIES PRESERVED"
    )

    diagnostics.append(
        "MANUAL REBAR PRESERVED"
    )

    diagnostics.append(
        "PASS: SELECTIVE MAIN-BAR CLEAR COMPLETE"
    )


    OUT = [
        m04_input,              # [0]
        target_column_ids,      # [1]
        deleted_ids,            # [2]
        len(deleted_ids),       # [3]
        per_column,             # [4]
        diagnostics             # [5]
    ]
# ----------------------------------------
R02 = Python(IN[0]=R01)  # CPython3
# ---------- R02.python (1179 lines) ----------
# ============================================================
# R02 — GENERATE MAIN LONGITUDINAL COLUMN REINFORCEMENT
#       + OWNERSHIP TAGGING / ANTI-DUPLICATION
#
# IN[0] = COMPLETE R01 OUTPUT
#
# FIX:
# R01[0]  = M04
# M04[14] = M03
# M03[12] = Main Bar Path Packages
#
# OWNERSHIP:
# DYNAMO_R02_MAINBAR_C<ColumnID>_B<BarNo>_G<Group>
#
# OUT:
# [0] Per-Column Results
# [1] Created Rebar IDs
# [2] Number Created
# [3] Selected Rebar Type
# [4] Type Diagnostics
# [5] Ownership Diagnostics
# [6] Status
# ============================================================

import clr
import math


# ------------------------------------------------------------
# REVIT SERVICES
# ------------------------------------------------------------

clr.AddReference("RevitServices")

from RevitServices.Persistence import DocumentManager
from RevitServices.Transactions import TransactionManager

doc = DocumentManager.Instance.CurrentDBDocument


# ------------------------------------------------------------
# REVIT API
# ------------------------------------------------------------

clr.AddReference("RevitAPI")

from Autodesk.Revit.DB import *
from Autodesk.Revit.DB.Structure import *


# ------------------------------------------------------------
# INPUT
# ------------------------------------------------------------

r01 = IN[0]


# ============================================================
# CONSTANTS
# ============================================================

MM_TO_FT = 1.0 / 304.8
FT_TO_MM = 304.8

MAINBAR_PREFIX = "DYNAMO_R02_MAINBAR"

BAR_TYPE_TOLERANCE_MM = 0.50


# ============================================================
# HELPERS
# ============================================================

def is_list(x):
    return isinstance(x, (list, tuple))


def mm_to_ft(x):
    return float(x) * MM_TO_FT


def ft_to_mm(x):
    return float(x) * FT_TO_MM


def safe_int(x, default=None):

    try:
        return int(x)
    except:
        pass

    try:
        return int(x.Value)
    except:
        pass

    try:
        return int(x.IntegerValue)
    except:
        return default


def safe_float(x, default=None):

    try:
        return float(x)
    except:
        return default


def id_value(eid):

    try:
        return int(eid.Value)
    except:
        pass

    try:
        return int(eid.IntegerValue)
    except:
        return None


def element_id(element):

    try:
        return id_value(element.Id)
    except:
        return None


# ============================================================
# NORMALIZE R01
# ============================================================

def unwrap_single(data):

    current = data

    while (
        is_list(current) and
        len(current) == 1 and
        is_list(current[0])
    ):
        current = current[0]

    return current


r01 = unwrap_single(r01)


# ============================================================
# GET M04 DIRECTLY
# ============================================================

def looks_like_m04(data):

    if not is_list(data):
        return False

    if len(data) < 17:
        return False

    try:

        if safe_int(data[0], None) is None:
            return False

        if not is_list(data[1]):
            return False

        if safe_float(data[2], None) is None:
            return False

        if safe_int(data[3], None) is None:
            return False

        if not is_list(data[11]):
            return False

        if not is_list(data[14]):
            return False

        return True

    except:
        return False


def collect_m04(data, result=None):

    if result is None:
        result = []

    if looks_like_m04(data):

        result.append(data)
        return result

    if is_list(data):

        for item in data:
            collect_m04(item, result)

    return result


# R01[0] = original M04

try:
    m04_source = r01[0]
except:
    m04_source = r01


m04_packages = collect_m04(
    m04_source
)


# ============================================================
# REBAR TYPE
# ============================================================

def get_bar_diameter_mm(bar_type):

    try:
        return ft_to_mm(
            bar_type.BarNominalDiameter
        )
    except:
        pass

    try:

        p = bar_type.get_Parameter(
            BuiltInParameter.REBAR_BAR_DIAMETER
        )

        if p is not None:
            return ft_to_mm(
                p.AsDouble()
            )

    except:
        pass

    return None


def find_rebar_type(requested_mm):

    candidates = []

    collector = (
        FilteredElementCollector(doc)
        .OfClass(RebarBarType)
        .WhereElementIsElementType()
    )

    for bar_type in collector:

        dia = get_bar_diameter_mm(
            bar_type
        )

        if dia is None:
            continue

        diff = abs(
            dia - requested_mm
        )

        candidates.append(
            [
                diff,
                dia,
                bar_type
            ]
        )

    if len(candidates) == 0:

        return None, [
            "ERROR: NO REBAR BAR TYPES FOUND"
        ]

    candidates.sort(
        key=lambda x: x[0]
    )

    diff = candidates[0][0]
    actual = candidates[0][1]
    selected = candidates[0][2]

    diagnostics = [
        "REQUESTED MAIN BAR = {:.3f} mm".format(
            requested_mm
        ),
        "SELECTED REVIT BAR = {:.3f} mm".format(
            actual
        ),
        "DIFFERENCE = {:.3f} mm".format(
            diff
        ),
        "REBAR TYPE ID = {}".format(
            element_id(selected)
        )
    ]

    if diff > BAR_TYPE_TOLERANCE_MM:

        diagnostics.append(
            "ERROR: NO ACCEPTABLE BAR TYPE"
        )

        return None, diagnostics

    diagnostics.append(
        "PASS: REBAR TYPE MATCH ACCEPTED"
    )

    return selected, diagnostics


# ============================================================
# OWNERSHIP TAG
# ============================================================

def ownership_tag(
    column_id,
    bar_number,
    group_name
):

    return "{}_C{}_B{:02d}_G{}".format(
        MAINBAR_PREFIX,
        int(column_id),
        int(bar_number),
        str(group_name)
    )


def set_comment(
    element,
    text
):

    try:

        p = element.get_Parameter(
            BuiltInParameter.ALL_MODEL_INSTANCE_COMMENTS
        )

        if p is None:
            return False

        if p.IsReadOnly:
            return False

        p.Set(text)

        return True

    except:
        return False


# ============================================================
# COLUMN
# ============================================================

def get_column(column_id):

    try:
        return doc.GetElement(
            ElementId(int(column_id))
        )
    except:
        return None


# ============================================================
# M03 PATH
#
# IMPORTANT:
#
# M04[14] = M03
# M03[12] = BAR PATH PACKAGES
#
# ============================================================

def get_m03(m04):

    try:

        m03 = m04[14]

        if not is_list(m03):
            return None

        if len(m03) < 16:
            return None

        return m03

    except:
        return None


def get_bar_paths(m03):

    try:

        paths = m03[12]

        if not is_list(paths):
            return []

        return paths

    except:
        return []


def find_bar_path(
    paths,
    bar_number
):

    for path in paths:

        if not is_list(path):
            continue

        if len(path) < 14:
            continue

        number = safe_int(
            path[0],
            None
        )

        if number == bar_number:
            return path

    return None


# ============================================================
# PATH DECODER
#
# M03[12] BAR PATH:
#
# [0]  Bar Number
# [1]  Group
# [2]  X
# [3]  Y
# [4]  Bottom Bend Z
# [5]  Top Bend Z
# [6]  Bottom Hook Length
# [7]  Vertical Length
# [8]  Top Hook Length
# [9]  Total Path
# [10] Bottom Hook DX
# [11] Bottom Hook DY
# [12] Top Hook DX
# [13] Top Hook DY
# [14] Diagnostics
# ============================================================

def decode_path(path):

    try:

        return {
            "number":
                safe_int(path[0]),

            "group":
                str(path[1]),

            "x":
                safe_float(path[2]),

            "y":
                safe_float(path[3]),

            "bottom_z":
                safe_float(path[4]),

            "top_z":
                safe_float(path[5]),

            "bottom_hook":
                safe_float(path[6], 0.0),

            "top_hook":
                safe_float(path[8], 0.0),

            "bottom_dx":
                safe_float(path[10], 0.0),

            "bottom_dy":
                safe_float(path[11], 0.0),

            "top_dx":
                safe_float(path[12], 0.0),

            "top_dy":
                safe_float(path[13], 0.0)
        }

    except:
        return None


# ============================================================
# POINT
# ============================================================

def xyz_mm(
    x,
    y,
    z
):

    return XYZ(
        mm_to_ft(x),
        mm_to_ft(y),
        mm_to_ft(z)
    )


# ============================================================
# BUILD BAR CURVES
# ============================================================

def build_curves(data):

    curves = []

    x = data["x"]
    y = data["y"]

    zb = data["bottom_z"]
    zt = data["top_z"]

    bottom_hook = data["bottom_hook"]
    top_hook = data["top_hook"]

    bdx = data["bottom_dx"]
    bdy = data["bottom_dy"]

    tdx = data["top_dx"]
    tdy = data["top_dy"]


    # --------------------------------------------------------
    # Bottom bend
    # --------------------------------------------------------

    p_bottom = xyz_mm(
        x,
        y,
        zb
    )


    # --------------------------------------------------------
    # Bottom horizontal hook
    # --------------------------------------------------------

    if bottom_hook > 0.001:

        p_bottom_tail = xyz_mm(
            x + bdx * bottom_hook,
            y + bdy * bottom_hook,
            zb
        )

        curves.append(
            Line.CreateBound(
                p_bottom_tail,
                p_bottom
            )
        )


    # --------------------------------------------------------
    # Vertical bar
    # --------------------------------------------------------

    p_top = xyz_mm(
        x,
        y,
        zt
    )

    curves.append(
        Line.CreateBound(
            p_bottom,
            p_top
        )
    )


    # --------------------------------------------------------
    # Top horizontal hook
    # --------------------------------------------------------

    if top_hook > 0.001:

        p_top_tail = xyz_mm(
            x + tdx * top_hook,
            y + tdy * top_hook,
            zt
        )

        curves.append(
            Line.CreateBound(
                p_top,
                p_top_tail
            )
        )


    return curves


# ============================================================
# DETERMINE CURVE PLANE NORMAL
# ============================================================

def get_normal(
    curves,
    path_data
):

    # Prefer horizontal hook direction.

    try:

        dx = path_data["bottom_dx"]
        dy = path_data["bottom_dy"]

        length = math.sqrt(
            dx * dx +
            dy * dy
        )

        if length > 0.000001:

            horizontal = XYZ(
                dx / length,
                dy / length,
                0.0
            )

            normal = horizontal.CrossProduct(
                XYZ.BasisZ
            )

            if normal.GetLength() > 0.000001:
                return normal.Normalize()

    except:
        pass


    try:

        dx = path_data["top_dx"]
        dy = path_data["top_dy"]

        length = math.sqrt(
            dx * dx +
            dy * dy
        )

        if length > 0.000001:

            horizontal = XYZ(
                dx / length,
                dy / length,
                0.0
            )

            normal = horizontal.CrossProduct(
                XYZ.BasisZ
            )

            if normal.GetLength() > 0.000001:
                return normal.Normalize()

    except:
        pass


    return XYZ.BasisX


# ============================================================
# CREATE REBAR
# ============================================================

def create_rebar(
    column,
    bar_type,
    curves,
    path_data
):

    normal = get_normal(
        curves,
        path_data
    )

    return Rebar.CreateFromCurves(
        doc,
        RebarStyle.Standard,
        bar_type,
        None,
        None,
        column,
        normal,
        curves,
        RebarHookOrientation.Left,
        RebarHookOrientation.Left,
        True,
        True
    )


# ============================================================
# MAIN
# ============================================================

results = []

created_ids = []

type_diagnostics = []

ownership_diagnostics = []


# ------------------------------------------------------------
# VALIDATE M04
# ------------------------------------------------------------

if len(m04_packages) == 0:

    OUT = [
        [],
        [],
        0,
        None,
        [
            "ERROR: M04 PACKAGE NOT FOUND IN R01[0]"
        ],
        [],
        "R02 FAILED"
    ]

else:

    # --------------------------------------------------------
    # BAR DIAMETER
    # --------------------------------------------------------

    requested_diameter = safe_float(
        m04_packages[0][2],
        None
    )


    if requested_diameter is None:

        OUT = [
            [],
            [],
            0,
            None,
            [
                "ERROR: MAIN BAR DIAMETER NOT FOUND"
            ],
            [],
            "R02 FAILED"
        ]

    else:

        bar_type, type_diagnostics = find_rebar_type(
            requested_diameter
        )


        if bar_type is None:

            OUT = [
                [],
                [],
                0,
                None,
                type_diagnostics,
                [],
                "R02 FAILED - BAR TYPE"
            ]

        else:

            # =================================================
            # TRANSACTION
            # =================================================

            TransactionManager.Instance.EnsureInTransaction(
                doc
            )

            try:

                for m04 in m04_packages:

                    # -----------------------------------------
                    # DIRECT M03
                    # -----------------------------------------

                    m03 = get_m03(
                        m04
                    )

                    if m03 is None:

                        results.append(
                            [
                                None,
                                [],
                                0,
                                [],
                                [
                                    "ERROR: M03 NOT FOUND AT M04[14]"
                                ]
                            ]
                        )

                        continue


                    # -----------------------------------------
                    # PATHS
                    # -----------------------------------------

                    paths = get_bar_paths(
                        m03
                    )


                    # -----------------------------------------
                    # COLUMN IDS
                    # -----------------------------------------

                    column_ids = m04[1]

                    if not is_list(column_ids):
                        column_ids = [column_ids]


                    # -----------------------------------------
                    # TOTAL BAR COUNT
                    # -----------------------------------------

                    total_bars = safe_int(
                        m04[3],
                        0
                    )


                    # -----------------------------------------
                    # EACH COLUMN
                    # -----------------------------------------

                    for cid_raw in column_ids:

                        cid = safe_int(
                            cid_raw,
                            None
                        )

                        column_created = []

                        column_tags = []

                        failures = []


                        if cid is None:

                            failures.append(
                                "INVALID COLUMN ID"
                            )

                            results.append(
                                [
                                    cid,
                                    [],
                                    0,
                                    [],
                                    failures
                                ]
                            )

                            continue


                        column = get_column(
                            cid
                        )


                        if column is None:

                            failures.append(
                                "COLUMN {} NOT FOUND".format(
                                    cid
                                )
                            )

                            results.append(
                                [
                                    cid,
                                    [],
                                    0,
                                    [],
                                    failures
                                ]
                            )

                            continue


                        # -------------------------------------
                        # BAR LOOP
                        # -------------------------------------

                        for bar_number in range(
                            1,
                            total_bars + 1
                        ):

                            path = find_bar_path(
                                paths,
                                bar_number
                            )


                            if path is None:

                                failures.append(
                                    "BAR {}: M03 PATH NOT FOUND".format(
                                        bar_number
                                    )
                                )

                                continue


                            path_data = decode_path(
                                path
                            )


                            if path_data is None:

                                failures.append(
                                    "BAR {}: INVALID PATH DATA".format(
                                        bar_number
                                    )
                                )

                                continue


                            try:

                                curves = build_curves(
                                    path_data
                                )

                            except Exception as ex:

                                failures.append(
                                    "BAR {} CURVE ERROR: {}".format(
                                        bar_number,
                                        str(ex)
                                    )
                                )

                                continue


                            try:

                                rebar = create_rebar(
                                    column,
                                    bar_type,
                                    curves,
                                    path_data
                                )


                                if rebar is None:

                                    failures.append(
                                        "BAR {}: CREATE RETURNED NULL".format(
                                            bar_number
                                        )
                                    )

                                    continue


                                rid = element_id(
                                    rebar
                                )


                                # ---------------------------------
                                # OWNERSHIP TAG
                                # ---------------------------------

                                tag = ownership_tag(
                                    cid,
                                    bar_number,
                                    path_data["group"]
                                )

                                tag_success = set_comment(
                                    rebar,
                                    tag
                                )


                                column_created.append(
                                    rid
                                )

                                created_ids.append(
                                    rid
                                )

                                column_tags.append(
                                    [
                                        rid,
                                        tag,
                                        tag_success
                                    ]
                                )


                                if not tag_success:

                                    failures.append(
                                        "BAR {}: CREATED BUT TAG FAILED".format(
                                            bar_number
                                        )
                                    )


                            except Exception as ex:

                                failures.append(
                                    "BAR {} CREATE ERROR: {}".format(
                                        bar_number,
                                        str(ex)
                                    )
                                )


                        # -------------------------------------
                        # DIAGNOSTICS
                        # -------------------------------------

                        diagnostics = [
                            "COLUMN ID = {}".format(
                                cid
                            ),

                            "M03 PATH COUNT = {}".format(
                                len(paths)
                            ),

                            "EXPECTED MAIN BARS = {}".format(
                                total_bars
                            ),

                            "CREATED MAIN BARS = {}".format(
                                len(column_created)
                            ),

                            "OWNERSHIP PREFIX = {}".format(
                                MAINBAR_PREFIX
                            ),

                            "FAILED ITEMS = {}".format(
                                len(failures)
                            )
                        ]


                        if (
                            len(column_created) == total_bars and
                            len(failures) == 0
                        ):

                            diagnostics.append(
                                "PASS: ALL MAIN BARS CREATED AND TAGGED"
                            )

                        else:

                            diagnostics.append(
                                "WARNING: MAIN BAR GENERATION INCOMPLETE"
                            )


                        results.append(
                            [
                                cid,                    # [0]
                                column_created,         # [1]
                                len(column_created),    # [2]
                                column_tags,            # [3]
                                failures,               # [4]
                                diagnostics             # [5]
                            ]
                        )


            finally:

                TransactionManager.Instance.TransactionTaskDone()


            # =================================================
            # OWNERSHIP DIAGNOSTICS
            # =================================================

            ownership_diagnostics = [
                "OWNERSHIP PREFIX = {}".format(
                    MAINBAR_PREFIX
                ),

                "TOTAL MAIN BARS CREATED = {}".format(
                    len(created_ids)
                ),

                "R01 WILL DELETE ONLY R02-TAGGED MAIN BARS",

                "T02 TIES ARE PRESERVED",

                "MANUAL / UNTAGGED REBAR IS PRESERVED"
            ]


            # =================================================
            # OUTPUT
            # =================================================

            OUT = [
                results,                 # [0]
                created_ids,             # [1]
                len(created_ids),        # [2]
                bar_type,                # [3]
                type_diagnostics,        # [4]
                ownership_diagnostics,   # [5]
                "R02 COMPLETE"           # [6]
            ]
# ----------------------------------------
watch = Watch(R02)  # graph output
T01 = Python(IN[0]=s04_confinement_zones, IN[1]=M02)  # CPython3
# ---------- T01.python (1868 lines) ----------
# ============================================================
# T01 — NSCP COLUMN TIE LAYOUT PLANNER
#
# IN[0] = COMPLETE S04 PACKAGE
# IN[1] = COMPLETE M02 PACKAGE
#
# PURPOSE:
#   1. Read clear column segments from S04
#   2. Read actual longitudinal-bar layout from M02
#   3. Match M02 storey data to each S04 column
#   4. Calculate confinement spacing limits
#   5. Calculate regular-zone spacing limits
#   6. Round construction spacing DOWN to nearest 10 mm
#   7. Generate final tie elevations
#
# IMPORTANT:
#   T01 DOES NOT CREATE REVIT REBAR.
#
# CONSTRUCTION ROUNDING:
#
#   87.5 mm -> 80 mm
#   96.0 mm -> 90 mm
#   100 mm  -> 100 mm
#   125 mm  -> 120 mm
#   150 mm  -> 150 mm
#
# ============================================================

import math


# ============================================================
# INPUT
# ============================================================

s04_input = IN[0]
m02_input = IN[1]


# ============================================================
# CONSTANTS
# ============================================================

TOL = 0.1
DUPLICATE_TOL = 0.5

SO_MIN = 100.0
SO_MAX = 150.0

ABSOLUTE_REGULAR_MAX = 150.0

# Construction spacing increment
CONSTRUCTION_INCREMENT = 10.0


# ============================================================
# BASIC HELPERS
# ============================================================

def is_list(x):
    return isinstance(x, (list, tuple))


def safe_float(x, default=None):

    try:
        return float(x)
    except:
        return default


def safe_int(x, default=None):

    try:
        return int(x)
    except:
        pass

    try:
        return int(x.Value)
    except:
        pass

    try:
        return int(x.IntegerValue)
    except:
        return default


def unique_sorted(values, tolerance=DUPLICATE_TOL):

    clean = []

    for value in values:

        z = safe_float(
            value,
            None
        )

        if z is None:
            continue

        duplicate = False

        for existing in clean:

            if abs(
                existing - z
            ) <= tolerance:

                duplicate = True
                break

        if not duplicate:
            clean.append(z)

    clean.sort()

    return clean


# ============================================================
# CONSTRUCTION ROUNDING
# ============================================================
#
# Always round DOWN.
#
# Example:
#
# 87.5 -> 80
# 96.0 -> 90
# 100  -> 100
#
# This prevents construction rounding from exceeding the
# calculated maximum allowable spacing.
#
# ============================================================

def round_down_construction(value):

    value = safe_float(
        value,
        None
    )

    if value is None:
        return None

    if value <= 0:
        return value

    rounded = (
        math.floor(
            value /
            CONSTRUCTION_INCREMENT
        ) *
        CONSTRUCTION_INCREMENT
    )

    if rounded <= 0:
        return value

    return rounded


# ============================================================
# S04 DETECTION
# ============================================================

def looks_like_s04(data):

    if not is_list(data):
        return False

    if len(data) < 12:
        return False

    try:

        column_id = safe_int(
            data[1],
            None
        )

        if column_id is None:
            return False

        if not is_list(data[2]):
            return False

        if not is_list(data[3]):
            return False

        if not is_list(data[4]):
            return False

        if safe_float(
            data[5],
            None
        ) is None:
            return False

        if safe_float(
            data[6],
            None
        ) is None:
            return False

        if safe_float(
            data[8],
            None
        ) is None:
            return False

        if safe_float(
            data[10],
            None
        ) is None:
            return False

        if safe_float(
            data[11],
            None
        ) is None:
            return False

        return True

    except:
        return False


def collect_s04_packages(
    data,
    results=None
):

    if results is None:
        results = []

    if looks_like_s04(data):

        cid = safe_int(
            data[1],
            None
        )

        duplicate = False

        for existing in results:

            existing_id = safe_int(
                existing[1],
                None
            )

            if existing_id == cid:

                duplicate = True
                break

        if not duplicate:
            results.append(data)

        return results

    if is_list(data):

        for item in data:

            collect_s04_packages(
                item,
                results
            )

    return results


# ============================================================
# M02 DETECTION
# ============================================================

def looks_like_m02(data):

    if not is_list(data):
        return False

    if len(data) < 12:
        return False

    try:

        stack_index = safe_int(
            data[0],
            None
        )

        main_db = safe_float(
            data[2],
            None
        )

        total_bars = safe_int(
            data[3],
            None
        )

        storeys = data[6]

        if stack_index is None:
            return False

        if main_db is None:
            return False

        if total_bars is None:
            return False

        if not is_list(storeys):
            return False

        return True

    except:
        return False


def collect_m02_packages(
    data,
    results=None
):

    if results is None:
        results = []

    if looks_like_m02(data):

        stack_index = safe_int(
            data[0],
            None
        )

        duplicate = False

        for existing in results:

            existing_index = safe_int(
                existing[0],
                None
            )

            if existing_index == stack_index:

                duplicate = True
                break

        if not duplicate:
            results.append(data)

        return results

    if is_list(data):

        for item in data:

            collect_m02_packages(
                item,
                results
            )

    return results


# ============================================================
# FIND M02 STOREY FOR COLUMN
# ============================================================

def find_m02_storey_for_column(
    m02_packages,
    column_id
):

    for m02 in m02_packages:

        try:
            storeys = m02[6]
        except:
            continue

        if not is_list(storeys):
            continue

        for storey in storeys:

            if not is_list(storey):
                continue

            if len(storey) < 15:
                continue

            sid = safe_int(
                storey[1],
                None
            )

            if sid == column_id:

                return (
                    m02,
                    storey
                )

    return (
        None,
        None
    )


# ============================================================
# CLEAR SEGMENT PARSER
# ============================================================

def extract_segment_bounds(segment):

    if not is_list(segment):
        return None

    if len(segment) < 2:
        return None

    z1 = safe_float(
        segment[0],
        None
    )

    z2 = safe_float(
        segment[1],
        None
    )

    if (
        z1 is None or
        z2 is None
    ):
        return None

    bottom = min(
        z1,
        z2
    )

    top = max(
        z1,
        z2
    )

    if (
        top -
        bottom
    ) <= TOL:
        return None

    return (
        bottom,
        top
    )


# ============================================================
# CONFINEMENT LENGTH
# ============================================================

def get_lc(
    confinement_data,
    segment_index,
    clear_height,
    column_max_dimension
):

    # --------------------------------------------------------
    # First use S04 Final Lc if available.
    #
    # Try both zero-based and one-based segment indexing.
    # --------------------------------------------------------

    if is_list(
        confinement_data
    ):

        for target_index in [
            segment_index - 1,
            segment_index
        ]:

            for item in confinement_data:

                if not is_list(item):
                    continue

                if len(item) < 8:
                    continue

                idx = safe_int(
                    item[0],
                    None
                )

                if idx != target_index:
                    continue

                lc = safe_float(
                    item[7],
                    None
                )

                if (
                    lc is not None and
                    lc > 0
                ):
                    return lc

    # --------------------------------------------------------
    # Fallback:
    #
    # lo = max(
    #     column dimension,
    #     clear height / 6,
    #     450 mm
    # )
    #
    # Adopted construction rule:
    #
    # Lc = max(
    #     clear height / 4,
    #     lo
    # )
    # --------------------------------------------------------

    l_quarter = (
        clear_height /
        4.0
    )

    l_sixth = (
        clear_height /
        6.0
    )

    lo = max(
        column_max_dimension,
        l_sixth,
        450.0
    )

    return max(
        l_quarter,
        lo
    )


# ============================================================
# GET MAIN BAR XY COORDINATES
# ============================================================

def get_bar_xy(layout):

    points = []

    if not is_list(layout):
        return points

    for bar in layout:

        if not is_list(bar):
            continue

        if len(bar) < 6:
            continue

        x = safe_float(
            bar[4],
            None
        )

        y = safe_float(
            bar[5],
            None
        )

        if (
            x is None or
            y is None
        ):
            continue

        points.append(
            [
                x,
                y
            ]
        )

    return points


# ============================================================
# CALCULATE hx
# ============================================================
#
# Uses maximum adjacent longitudinal-bar center spacing
# along the rectangular column perimeter.
#
# ============================================================

def calculate_hx(layout):

    points = get_bar_xy(
        layout
    )

    if len(points) < 2:
        return None

    xs = [
        p[0]
        for p in points
    ]

    ys = [
        p[1]
        for p in points
    ]

    min_x = min(xs)
    max_x = max(xs)

    min_y = min(ys)
    max_y = max(ys)

    coordinate_tolerance = 1.0

    face_1 = []
    face_2 = []
    face_3 = []
    face_4 = []

    for x, y in points:

        if abs(
            y -
            min_y
        ) <= coordinate_tolerance:

            face_1.append(x)

        if abs(
            y -
            max_y
        ) <= coordinate_tolerance:

            face_2.append(x)

        if abs(
            x -
            min_x
        ) <= coordinate_tolerance:

            face_3.append(y)

        if abs(
            x -
            max_x
        ) <= coordinate_tolerance:

            face_4.append(y)

    spacings = []

    def add_face_spacings(values):

        values = sorted(
            list(
                set(values)
            )
        )

        if len(values) < 2:
            return

        for i in range(
            len(values) - 1
        ):

            spacing = abs(
                values[i + 1] -
                values[i]
            )

            if spacing > TOL:

                spacings.append(
                    spacing
                )

    add_face_spacings(
        face_1
    )

    add_face_spacings(
        face_2
    )

    add_face_spacings(
        face_3
    )

    add_face_spacings(
        face_4
    )

    if len(spacings) == 0:
        return None

    return max(
        spacings
    )


# ============================================================
# COLUMN DIMENSIONS
# ============================================================

def get_column_dimensions(
    storey,
    fallback_dimension
):

    width = None
    depth = None

    if (
        storey is not None and
        len(storey) > 3
    ):

        width = safe_float(
            storey[2],
            None
        )

        depth = safe_float(
            storey[3],
            None
        )

    if (
        width is None or
        width <= 0
    ):

        width = (
            fallback_dimension
        )

    if (
        depth is None or
        depth <= 0
    ):

        depth = (
            fallback_dimension
        )

    return (
        width,
        depth
    )


# ============================================================
# CALCULATE so
# ============================================================

def calculate_so(hx):

    if hx is None:

        return (
            SO_MAX,
            None
        )

    raw_so = (
        100.0 +
        (
            350.0 -
            hx
        ) /
        3.0
    )

    final_so = max(
        SO_MIN,
        min(
            SO_MAX,
            raw_so
        )
    )

    return (
        final_so,
        raw_so
    )


# ============================================================
# CALCULATE SPACING LIMITS
# ============================================================

def calculate_spacing_limits(
    requested_conf,
    requested_regular,
    width,
    depth,
    main_db,
    hx
):

    # --------------------------------------------------------
    # Minimum column dimension
    # --------------------------------------------------------

    bmin = min(
        width,
        depth
    )

    # --------------------------------------------------------
    # bmin / 4
    # --------------------------------------------------------

    limit_b4 = (
        bmin /
        4.0
    )

    # --------------------------------------------------------
    # 6db
    # --------------------------------------------------------

    limit_6db = (
        6.0 *
        main_db
    )

    # --------------------------------------------------------
    # so
    # --------------------------------------------------------

    so, raw_so = (
        calculate_so(
            hx
        )
    )

    # ========================================================
    # CONFINEMENT SPACING
    # ========================================================

    confinement_candidates = [
        requested_conf,
        limit_b4,
        limit_6db,
        so
    ]

    confinement_candidates = [
        value
        for value in confinement_candidates
        if (
            value is not None and
            value > 0
        )
    ]

    conf_exact = min(
        confinement_candidates
    )

    # --------------------------------------------------------
    # ROUND DOWN TO NEAREST 10 mm
    # --------------------------------------------------------

    conf_final = (
        round_down_construction(
            conf_exact
        )
    )

    # ========================================================
    # REGULAR SPACING
    # ========================================================

    regular_candidates = [
        requested_regular,
        limit_6db,
        ABSOLUTE_REGULAR_MAX
    ]

    regular_candidates = [
        value
        for value in regular_candidates
        if (
            value is not None and
            value > 0
        )
    ]

    regular_exact = min(
        regular_candidates
    )

    # --------------------------------------------------------
    # ROUND DOWN TO NEAREST 10 mm
    # --------------------------------------------------------

    regular_final = (
        round_down_construction(
            regular_exact
        )
    )

    return [
        bmin,                 # [0]
        limit_b4,             # [1]
        limit_6db,            # [2]
        hx,                   # [3]
        raw_so,               # [4]
        so,                   # [5]

        requested_conf,       # [6]
        conf_exact,           # [7]
        conf_final,           # [8]

        requested_regular,    # [9]
        regular_exact,        # [10]
        regular_final,        # [11]

        CONSTRUCTION_INCREMENT # [12]
    ]


# ============================================================
# DISTRIBUTE TIES IN A ZONE
# ============================================================

def distribute_zone(
    start_z,
    end_z,
    maximum_spacing
):

    if (
        start_z is None or
        end_z is None
    ):
        return []

    start_z = float(
        start_z
    )

    end_z = float(
        end_z
    )

    if end_z < start_z:

        temp = start_z
        start_z = end_z
        end_z = temp

    length = (
        end_z -
        start_z
    )

    if length <= TOL:

        return [
            start_z
        ]

    if (
        maximum_spacing is None or
        maximum_spacing <= 0
    ):

        return [
            start_z,
            end_z
        ]

    # --------------------------------------------------------
    # Number of spaces required so actual spacing never
    # exceeds the adopted maximum.
    # --------------------------------------------------------

    intervals = int(
        math.ceil(
            length /
            maximum_spacing
        )
    )

    if intervals < 1:
        intervals = 1

    actual_spacing = (
        length /
        float(intervals)
    )

    elevations = []

    for i in range(
        intervals + 1
    ):

        z = (
            start_z +
            actual_spacing *
            i
        )

        elevations.append(
            z
        )

    return elevations


# ============================================================
# MAXIMUM ACTUAL ADJACENT SPACING
# ============================================================

def maximum_adjacent_spacing(
    values
):

    values = unique_sorted(
        values
    )

    if len(values) < 2:
        return 0.0

    maximum = 0.0

    for i in range(
        len(values) - 1
    ):

        spacing = (
            values[i + 1] -
            values[i]
        )

        if spacing > maximum:

            maximum = spacing

    return maximum


# ============================================================
# BUILD SEGMENT PLAN
# ============================================================

def build_segment_plan(
    segment_index,
    bottom,
    top,
    lc,
    conf_spacing,
    regular_spacing
):

    diagnostics = []

    height = (
        top -
        bottom
    )

    # ========================================================
    # WHOLE SEGMENT CONFINED
    # ========================================================

    if (
        2.0 *
        lc >=
        height -
        TOL
    ):

        lower_start = bottom
        lower_end = top

        regular_start = None
        regular_end = None

        upper_start = top
        upper_end = top

        lower_ties = (
            distribute_zone(
                bottom,
                top,
                conf_spacing
            )
        )

        regular_ties = []
        upper_ties = []

        all_ties = (
            unique_sorted(
                lower_ties
            )
        )

        diagnostics.append(
            "WHOLE CLEAR SEGMENT REQUIRES "
            "CONFINEMENT SPACING"
        )

    # ========================================================
    # LOWER + REGULAR + UPPER
    # ========================================================

    else:

        lower_start = (
            bottom
        )

        lower_end = (
            bottom +
            lc
        )

        upper_start = (
            top -
            lc
        )

        upper_end = (
            top
        )

        regular_start = (
            lower_end
        )

        regular_end = (
            upper_start
        )

        # ----------------------------------------------------
        # LOWER CONFINEMENT
        # ----------------------------------------------------

        lower_ties = (
            distribute_zone(
                lower_start,
                lower_end,
                conf_spacing
            )
        )

        # ----------------------------------------------------
        # REGULAR REGION
        # ----------------------------------------------------

        regular_ties = (
            distribute_zone(
                regular_start,
                regular_end,
                regular_spacing
            )
        )

        # ----------------------------------------------------
        # UPPER CONFINEMENT
        # ----------------------------------------------------

        upper_ties = (
            distribute_zone(
                upper_start,
                upper_end,
                conf_spacing
            )
        )

        # ----------------------------------------------------
        # Remove duplicate boundary elevations.
        # ----------------------------------------------------

        all_ties = (
            unique_sorted(
                lower_ties +
                regular_ties +
                upper_ties
            )
        )

        diagnostics.append(
            "LOWER / REGULAR / UPPER "
            "TIE REGIONS GENERATED"
        )

    # ========================================================
    # ACTUAL SPACING CHECK
    # ========================================================

    actual_max = (
        maximum_adjacent_spacing(
            all_ties
        )
    )

    diagnostics.append(
        "SEGMENT TIES = {}".format(
            len(all_ties)
        )
    )

    diagnostics.append(
        "MAX ACTUAL ADJACENT SPACING = "
        "{:.1f} mm".format(
            actual_max
        )
    )

    return [
        segment_index,       # [0]
        bottom,              # [1]
        top,                 # [2]
        height,              # [3]
        lc,                  # [4]

        lower_start,         # [5]
        lower_end,           # [6]

        upper_start,         # [7]
        upper_end,           # [8]

        regular_start,       # [9]
        regular_end,         # [10]

        lower_ties,          # [11]
        regular_ties,        # [12]
        upper_ties,          # [13]

        all_ties,            # [14]

        diagnostics          # [15]
    ]


# ============================================================
# BUILD COLUMN PLAN
# ============================================================

def build_column_plan(
    s04,
    m02_packages
):

    diagnostics = []

    # ========================================================
    # S04 DATA
    # ========================================================

    column = s04[0]

    column_id = safe_int(
        s04[1],
        None
    )

    clear_segments = s04[2]

    confinement_zones = s04[3]
    normal_zones = s04[4]

    requested_conf = safe_float(
        s04[5],
        100.0
    )

    requested_regular = safe_float(
        s04[6],
        150.0
    )

    beam_joints = s04[7]

    column_max_dimension = safe_float(
        s04[8],
        0.0
    )

    confinement_data = s04[9]

    tie_diameter = safe_float(
        s04[10],
        0.0
    )

    cover = safe_float(
        s04[11],
        40.0
    )

    # ========================================================
    # MATCH M02
    # ========================================================

    m02, storey = (
        find_m02_storey_for_column(
            m02_packages,
            column_id
        )
    )

    if (
        m02 is None or
        storey is None
    ):

        return [
            column,
            column_id,
            tie_diameter,
            cover,

            None,
            None,

            None,
            None,
            None,

            requested_conf,
            requested_regular,

            None,
            None,

            [],
            [],

            beam_joints,

            [],

            [
                "ERROR: MATCHING M02 STOREY NOT FOUND",
                "COLUMN ID = {}".format(
                    column_id
                )
            ],

            s04,
            None
        ]

    # ========================================================
    # MAIN BAR DATA
    # ========================================================

    main_db = safe_float(
        m02[2],
        None
    )

    total_main_bars = safe_int(
        m02[3],
        None
    )

    layout = storey[14]

    # ========================================================
    # COLUMN DIMENSIONS
    # ========================================================

    width, depth = (
        get_column_dimensions(
            storey,
            column_max_dimension
        )
    )

    # ========================================================
    # hx
    # ========================================================

    hx = calculate_hx(
        layout
    )

    # ========================================================
    # SPACING CALCULATION
    # ========================================================

    spacing_data = (
        calculate_spacing_limits(
            requested_conf,
            requested_regular,
            width,
            depth,
            main_db,
            hx
        )
    )

    bmin = spacing_data[0]
    b4 = spacing_data[1]
    six_db = spacing_data[2]

    raw_so = spacing_data[4]
    so = spacing_data[5]

    conf_exact = spacing_data[7]
    conf_final = spacing_data[8]

    regular_exact = spacing_data[10]
    regular_final = spacing_data[11]

    # ========================================================
    # BUILD CLEAR SEGMENT PLANS
    # ========================================================

    segment_plans = []

    all_ties = []

    valid_segments = 0

    for i, segment in enumerate(
        clear_segments
    ):

        bounds = (
            extract_segment_bounds(
                segment
            )
        )

        if bounds is None:

            diagnostics.append(
                "WARNING: SEGMENT {} "
                "COULD NOT BE PARSED".format(
                    i + 1
                )
            )

            continue

        bottom = bounds[0]
        top = bounds[1]

        clear_height = (
            top -
            bottom
        )

        lc = (
            get_lc(
                confinement_data,
                i + 1,
                clear_height,
                column_max_dimension
            )
        )

        plan = (
            build_segment_plan(
                i + 1,
                bottom,
                top,
                lc,
                conf_final,
                regular_final
            )
        )

        segment_plans.append(
            plan
        )

        all_ties.extend(
            plan[14]
        )

        valid_segments += 1

    all_ties = (
        unique_sorted(
            all_ties
        )
    )

    # ========================================================
    # DIAGNOSTICS
    # ========================================================

    diagnostics.append(
        "COLUMN ID = {}".format(
            column_id
        )
    )

    diagnostics.append(
        "COLUMN SIZE = "
        "{:.1f} x {:.1f} mm".format(
            width,
            depth
        )
    )

    diagnostics.append(
        "MAIN BAR DIAMETER = "
        "{:.1f} mm".format(
            main_db
        )
    )

    diagnostics.append(
        "TOTAL MAIN BARS = {}".format(
            total_main_bars
        )
    )

    diagnostics.append(
        "TIE DIAMETER = "
        "{:.1f} mm".format(
            tie_diameter
        )
    )

    diagnostics.append(
        "CONCRETE COVER = "
        "{:.1f} mm".format(
            cover
        )
    )

    diagnostics.append(
        "bmin/4 LIMIT = "
        "{:.1f} mm".format(
            b4
        )
    )

    diagnostics.append(
        "6db LIMIT = "
        "{:.1f} mm".format(
            six_db
        )
    )

    if hx is not None:

        diagnostics.append(
            "CALCULATED hx = "
            "{:.1f} mm".format(
                hx
            )
        )

    else:

        diagnostics.append(
            "WARNING: hx COULD NOT BE CALCULATED"
        )

    if raw_so is not None:

        diagnostics.append(
            "RAW so = "
            "{:.1f} mm".format(
                raw_so
            )
        )

    diagnostics.append(
        "ADOPTED so = "
        "{:.1f} mm".format(
            so
        )
    )

    diagnostics.append(
        "USER CONFINEMENT SPACING = "
        "{:.1f} mm".format(
            requested_conf
        )
    )

    diagnostics.append(
        "MAXIMUM CALCULATED "
        "CONFINEMENT SPACING = "
        "{:.1f} mm".format(
            conf_exact
        )
    )

    diagnostics.append(
        "FINAL CONSTRUCTION "
        "CONFINEMENT SPACING = "
        "{:.1f} mm".format(
            conf_final
        )
    )

    diagnostics.append(
        "USER REGULAR SPACING = "
        "{:.1f} mm".format(
            requested_regular
        )
    )

    diagnostics.append(
        "MAXIMUM CALCULATED "
        "REGULAR SPACING = "
        "{:.1f} mm".format(
            regular_exact
        )
    )

    diagnostics.append(
        "FINAL CONSTRUCTION "
        "REGULAR SPACING = "
        "{:.1f} mm".format(
            regular_final
        )
    )

    diagnostics.append(
        "CONSTRUCTION ROUNDING = "
        "DOWN TO NEAREST "
        "{:.0f} mm".format(
            CONSTRUCTION_INCREMENT
        )
    )

    diagnostics.append(
        "VALID CLEAR SEGMENTS = {}".format(
            valid_segments
        )
    )

    diagnostics.append(
        "TOTAL UNIQUE TIE ELEVATIONS = {}".format(
            len(all_ties)
        )
    )

    diagnostics.append(
        "PASS: MAIN-BAR-DEPENDENT "
        "SPACING CHECK COMPLETED"
    )

    diagnostics.append(
        "PASS: CONSTRUCTION SPACING "
        "ROUNDED DOWN TO 10 mm MULTIPLES"
    )

    # ========================================================
    # OUTPUT
    # ========================================================

    return [
        column,                 # [0]
        column_id,              # [1]

        tie_diameter,           # [2]
        cover,                  # [3]

        main_db,                # [4]
        total_main_bars,        # [5]

        width,                  # [6]
        depth,                  # [7]
        bmin,                   # [8]

        requested_conf,         # [9]
        requested_regular,      # [10]

        conf_final,             # [11]
        regular_final,          # [12]

        segment_plans,          # [13]
        all_ties,               # [14]

        beam_joints,            # [15]

        spacing_data,           # [16]
        diagnostics,            # [17]

        s04,                    # [18]
        m02                     # [19]
    ]


# ============================================================
# MAIN
# ============================================================

s04_packages = (
    collect_s04_packages(
        s04_input
    )
)

m02_packages = (
    collect_m02_packages(
        m02_input
    )
)


# ============================================================
# VALIDATE S04
# ============================================================

if len(s04_packages) == 0:

    OUT = [
        [
            None,
            None,
            None,
            None,
            None,
            None,
            None,
            None,
            None,
            None,
            None,
            None,
            None,
            [],
            [],
            [],
            [],
            [
                "ERROR: VALID S04 PACKAGE NOT FOUND"
            ],
            s04_input,
            m02_input
        ]
    ]


# ============================================================
# VALIDATE M02
# ============================================================

elif len(m02_packages) == 0:

    OUT = [
        [
            None,
            None,
            None,
            None,
            None,
            None,
            None,
            None,
            None,
            None,
            None,
            None,
            None,
            [],
            [],
            [],
            [],
            [
                "ERROR: VALID M02 PACKAGE NOT FOUND"
            ],
            s04_input,
            m02_input
        ]
    ]


# ============================================================
# BUILD ALL COLUMN PLANS
# ============================================================

else:

    results = []

    for s04 in s04_packages:

        try:

            result = (
                build_column_plan(
                    s04,
                    m02_packages
                )
            )

            results.append(
                result
            )

        except Exception as ex:

            column_id = None

            try:
                column_id = s04[1]
            except:
                pass

            results.append(
                [
                    None,
                    column_id,
                    None,
                    None,
                    None,
                    None,
                    None,
                    None,
                    None,
                    None,
                    None,
                    None,
                    None,
                    [],
                    [],
                    [],
                    [],
                    [
                        "ERROR BUILDING T01 PLAN",
                        str(ex)
                    ],
                    s04,
                    None
                ]
            )

    OUT = results
# ----------------------------------------
T02 = Python(IN[0]=T01)  # CPython3
# ---------- T02.python (2083 lines) ----------
# ============================================================
# T02 — GENERATE ACTUAL COLUMN TIES / CROSSTIES
# CORRECTED — NATIVE REVIT HOST / UNWRAP FIX
#
# IN[0] = COMPLETE T01 OUTPUT
#
# Creates:
#   1. Perimeter rectangular ties
#   2. X-direction crossties
#   3. Y-direction crossties
#
# Anti-duplication:
#   Deletes ONLY previous T02-generated reinforcement.
#   R02 main bars are preserved.
#   Manual / untagged reinforcement is preserved.
#
# Ownership:
#   DYNAMO_T02_TIE_C<ColumnID>_...
#
# Legacy cleanup:
#   DYNAMO_T02_COLUMN_TIE_C<ColumnID>_...
#
# OUT:
# [0] Per-column results
# [1] Target Column IDs
# [2] Deleted T02 Rebar IDs
# [3] Number Deleted
# [4] Number Created
# [5] Rebar Type Diagnostics
# [6] Ownership Diagnostics
# [7] Status
# ============================================================

import clr
import math


# ------------------------------------------------------------
# REVIT SERVICES
# ------------------------------------------------------------

clr.AddReference("RevitServices")

from RevitServices.Persistence import DocumentManager
from RevitServices.Transactions import TransactionManager

doc = DocumentManager.Instance.CurrentDBDocument


# ------------------------------------------------------------
# REVIT API
# ------------------------------------------------------------

clr.AddReference("RevitAPI")

from Autodesk.Revit.DB import *
from Autodesk.Revit.DB.Structure import *


# ------------------------------------------------------------
# REVIT / DYNAMO
# ------------------------------------------------------------

clr.AddReference("RevitNodes")

import Revit

clr.ImportExtensions(Revit.Elements)


# ------------------------------------------------------------
# CONSTANTS
# ------------------------------------------------------------

MM_TO_FT = 1.0 / 304.8
FT_TO_MM = 304.8

NEW_PREFIX = "DYNAMO_T02_TIE"
OLD_PREFIX = "DYNAMO_T02_COLUMN_TIE"

TYPE_TOLERANCE_MM = 0.75
GEOM_TOL_MM = 1.0


# ------------------------------------------------------------
# BASIC HELPERS
# ------------------------------------------------------------

def is_sequence(obj):

    return isinstance(
        obj,
        (list, tuple)
    )


def safe_float(value, default=0.0):

    try:
        return float(value)
    except:
        return default


def safe_int(value, default=0):

    try:
        return int(value)
    except:
        return default


def mm_to_ft(value):

    return float(value) * MM_TO_FT


def ft_to_mm(value):

    return float(value) * FT_TO_MM


def id_value(eid):

    if eid is None:
        return -1

    try:
        return int(eid.Value)
    except:
        pass

    try:
        return int(eid.IntegerValue)
    except:
        pass

    try:
        return int(str(eid))
    except:
        return -1


# ------------------------------------------------------------
# UNWRAP DYNAMO LIST WRAPPERS
# ------------------------------------------------------------

def unwrap_single(value):

    current = value

    for i in range(12):

        if (
            is_sequence(current)
            and len(current) == 1
            and is_sequence(current[0])
        ):

            current = current[0]

        else:
            break

    return current


# ------------------------------------------------------------
# UNWRAP DYNAMO ELEMENT
# ------------------------------------------------------------

def native_element(element):

    if element is None:
        return None

    # Already native Revit element
    try:

        if isinstance(
            element,
            Autodesk.Revit.DB.Element
        ):
            return element

    except:
        pass

    # Dynamo UnwrapElement
    try:

        unwrapped = UnwrapElement(
            element
        )

        if unwrapped is not None:
            return unwrapped

    except:
        pass

    # InternalElement
    try:

        internal = element.InternalElement

        if internal is not None:
            return internal

    except:
        pass

    # InternalElementId
    try:

        internal_id = element.InternalElementId

        if internal_id is not None:

            found = doc.GetElement(
                internal_id
            )

            if found is not None:
                return found

    except:
        pass

    # Dynamo element Id
    try:

        dyn_id = element.Id

        try:
            eid = ElementId(
                int(dyn_id)
            )

            found = doc.GetElement(
                eid
            )

            if found is not None:
                return found

        except:
            pass

    except:
        pass

    return None


# ------------------------------------------------------------
# IDENTIFY T01 PACKAGE
# ------------------------------------------------------------

def is_t01_package(item):

    if not is_sequence(item):
        return False

    if len(item) < 20:
        return False

    try:

        cid = safe_int(
            item[1],
            -1
        )

        tie_dia = safe_float(
            item[2],
            -1.0
        )

        segment_plans = item[13]
        all_ties = item[14]

        if cid < 0:
            return False

        if tie_dia <= 0:
            return False

        if not is_sequence(
            segment_plans
        ):
            return False

        if not is_sequence(
            all_ties
        ):
            return False

        return True

    except:
        return False


def collect_t01_packages(data):

    data = unwrap_single(
        data
    )

    if is_t01_package(
        data
    ):
        return [data]

    result = []

    if is_sequence(
        data
    ):

        for item in data:

            item = unwrap_single(
                item
            )

            if is_t01_package(
                item
            ):

                result.append(
                    item
                )

    return result


# ------------------------------------------------------------
# COMMENTS
# ------------------------------------------------------------

def get_comments(element):

    try:

        p = element.get_Parameter(
            BuiltInParameter.ALL_MODEL_INSTANCE_COMMENTS
        )

        if p:

            value = p.AsString()

            if value:
                return value

    except:
        pass

    try:

        p = element.LookupParameter(
            "Comments"
        )

        if p:

            value = p.AsString()

            if value:
                return value

    except:
        pass

    return ""


def set_comments(element, text):

    try:

        p = element.get_Parameter(
            BuiltInParameter.ALL_MODEL_INSTANCE_COMMENTS
        )

        if p and not p.IsReadOnly:

            p.Set(
                text
            )

            return True

    except:
        pass

    try:

        p = element.LookupParameter(
            "Comments"
        )

        if p and not p.IsReadOnly:

            p.Set(
                text
            )

            return True

    except:
        pass

    return False


# ------------------------------------------------------------
# BAR DIAMETER
# ------------------------------------------------------------

def get_bar_diameter_mm(bar_type):

    candidates = []

    try:

        candidates.append(
            ft_to_mm(
                bar_type.BarNominalDiameter
            )
        )

    except:
        pass

    try:

        candidates.append(
            ft_to_mm(
                bar_type.BarModelDiameter
            )
        )

    except:
        pass

    try:

        p = bar_type.get_Parameter(
            BuiltInParameter.REBAR_BAR_DIAMETER
        )

        if p:

            candidates.append(
                ft_to_mm(
                    p.AsDouble()
                )
            )

    except:
        pass

    for value in candidates:

        if value > 0:
            return value

    return None


# ------------------------------------------------------------
# FIND REBAR TYPE
# ------------------------------------------------------------

def find_rebar_type(
    requested_mm
):

    candidates = []

    collector = (
        FilteredElementCollector(doc)
        .OfClass(RebarBarType)
    )

    for bar_type in collector:

        diameter = get_bar_diameter_mm(
            bar_type
        )

        if diameter is None:
            continue

        difference = abs(
            diameter
            - requested_mm
        )

        candidates.append(
            (
                difference,
                diameter,
                bar_type
            )
        )

    candidates.sort(
        key=lambda x: x[0]
    )

    if not candidates:

        return None, [
            "REQUESTED = {:.3f} mm".format(
                requested_mm
            ),
            "FAIL: NO REBAR TYPES FOUND"
        ]

    difference = candidates[0][0]
    diameter = candidates[0][1]
    bar_type = candidates[0][2]

    diagnostics = [
        "REQUESTED NOMINAL = {:.3f} mm".format(
            requested_mm
        ),
        "SELECTED REVIT BAR = {:.3f} mm".format(
            diameter
        ),
        "DIFFERENCE = {:.3f} mm".format(
            difference
        ),
        "REBAR TYPE ID = {}".format(
            id_value(
                bar_type.Id
            )
        ),
        "TOLERANCE = {:.3f} mm".format(
            TYPE_TOLERANCE_MM
        )
    ]

    if difference > TYPE_TOLERANCE_MM:

        diagnostics.append(
            "FAIL: REBAR TYPE OUTSIDE TOLERANCE"
        )

        return None, diagnostics

    diagnostics.append(
        "PASS: REBAR TYPE MATCH ACCEPTED"
    )

    return bar_type, diagnostics


# ------------------------------------------------------------
# GET NATIVE COLUMN
# ------------------------------------------------------------

def get_native_column(
    t01
):

    source = t01[0]

    column = native_element(
        source
    )

    if column is not None:

        return column


    # --------------------------------------------------------
    # FALLBACK USING COLUMN ID
    # --------------------------------------------------------

    cid = safe_int(
        t01[1],
        -1
    )

    if cid >= 0:

        try:

            column = doc.GetElement(
                ElementId(
                    cid
                )
            )

            if column is not None:
                return column

        except:
            pass


    return None


# ------------------------------------------------------------
# COLUMN FRAME
# ------------------------------------------------------------

def get_column_frame(
    column,
    t01
):

    origin = None
    angle = None


    # --------------------------------------------------------
    # LOCATION POINT
    # --------------------------------------------------------

    try:

        loc = column.Location

        if isinstance(
            loc,
            LocationPoint
        ):

            p = loc.Point

            origin = XYZ(
                p.X,
                p.Y,
                0.0
            )

            try:

                angle = float(
                    loc.Rotation
                )

            except:
                angle = None

    except:
        pass


    # --------------------------------------------------------
    # M02 FALLBACK
    # --------------------------------------------------------

    if origin is None:

        try:

            m02 = t01[19]

            storeys = m02[6]

            cid = safe_int(
                t01[1]
            )

            target = None

            for storey in storeys:

                if (
                    is_sequence(storey)
                    and len(storey) > 14
                    and safe_int(
                        storey[1],
                        -1
                    ) == cid
                ):

                    target = storey

                    break


            if (
                target is None
                and len(storeys) > 0
            ):

                target = storeys[0]


            if target is not None:

                layout = target[14]

                global_x = []
                global_y = []

                for bar in layout:

                    if len(bar) > 5:

                        global_x.append(
                            safe_float(
                                bar[4]
                            )
                        )

                        global_y.append(
                            safe_float(
                                bar[5]
                            )
                        )


                if global_x and global_y:

                    cx = (
                        min(global_x)
                        + max(global_x)
                    ) / 2.0

                    cy = (
                        min(global_y)
                        + max(global_y)
                    ) / 2.0


                    origin = XYZ(
                        mm_to_ft(
                            cx
                        ),
                        mm_to_ft(
                            cy
                        ),
                        0.0
                    )


                try:

                    rotation_deg = safe_float(
                        target[6]
                    )

                    angle = math.radians(
                        rotation_deg
                    )

                except:
                    pass

        except:
            pass


    # --------------------------------------------------------
    # BOUNDING BOX FALLBACK
    # --------------------------------------------------------

    if origin is None:

        try:

            bb = column.get_BoundingBox(
                None
            )

            if bb is not None:

                origin = XYZ(
                    (
                        bb.Min.X
                        + bb.Max.X
                    ) / 2.0,

                    (
                        bb.Min.Y
                        + bb.Max.Y
                    ) / 2.0,

                    0.0
                )

        except:
            pass


    if origin is None:
        return None


    if angle is None:
        angle = 0.0


    local_x = XYZ(
        math.cos(angle),
        math.sin(angle),
        0.0
    )


    local_y = XYZ(
        -math.sin(angle),
        math.cos(angle),
        0.0
    )


    return [
        origin,
        local_x,
        local_y,
        angle
    ]


# ------------------------------------------------------------
# LOCAL → GLOBAL
# ------------------------------------------------------------

def local_point(
    origin,
    local_x,
    local_y,
    x_mm,
    y_mm,
    z_mm
):

    x = mm_to_ft(
        x_mm
    )

    y = mm_to_ft(
        y_mm
    )

    z = mm_to_ft(
        z_mm
    )


    return XYZ(
        origin.X
        + local_x.X * x
        + local_y.X * y,

        origin.Y
        + local_x.Y * x
        + local_y.Y * y,

        z
    )


# ------------------------------------------------------------
# MAIN BAR LAYOUT
# ------------------------------------------------------------

def get_main_bar_layout(
    t01
):

    try:

        cid = safe_int(
            t01[1]
        )

        m02 = t01[19]

        storeys = m02[6]

        for storey in storeys:

            if (
                is_sequence(storey)
                and len(storey) > 14
                and safe_int(
                    storey[1],
                    -1
                ) == cid
            ):

                return storey[14]


        if storeys:

            return storeys[0][14]

    except:
        pass

    return []


# ------------------------------------------------------------
# UNIQUE VALUES
# ------------------------------------------------------------

def unique_sorted(
    values,
    tolerance=1.0
):

    result = []

    for value in sorted(
        values
    ):

        if not result:

            result.append(
                value
            )

        elif abs(
            value
            - result[-1]
        ) > tolerance:

            result.append(
                value
            )

    return result


# ------------------------------------------------------------
# CROSSTIE OFFSETS
# ------------------------------------------------------------

def get_crosstie_offsets(
    layout,
    hx,
    hy
):

    xs = []
    ys = []

    for bar in layout:

        try:

            xs.append(
                safe_float(
                    bar[2]
                )
            )

            ys.append(
                safe_float(
                    bar[3]
                )
            )

        except:
            pass


    xs = unique_sorted(
        xs
    )

    ys = unique_sorted(
        ys
    )


    interior_x = []

    interior_y = []


    for x in xs:

        if (
            abs(x)
            < hx - GEOM_TOL_MM
        ):

            interior_x.append(
                x
            )


    for y in ys:

        if (
            abs(y)
            < hy - GEOM_TOL_MM
        ):

            interior_y.append(
                y
            )


    return [
        interior_x,
        interior_y
    ]


# ------------------------------------------------------------
# PERIMETER TIE
# ------------------------------------------------------------

def perimeter_curves(
    origin,
    local_x,
    local_y,
    hx,
    hy,
    z
):

    p1 = local_point(
        origin,
        local_x,
        local_y,
        -hx,
        -hy,
        z
    )

    p2 = local_point(
        origin,
        local_x,
        local_y,
        hx,
        -hy,
        z
    )

    p3 = local_point(
        origin,
        local_x,
        local_y,
        hx,
        hy,
        z
    )

    p4 = local_point(
        origin,
        local_x,
        local_y,
        -hx,
        hy,
        z
    )


    return [
        Line.CreateBound(
            p1,
            p2
        ),

        Line.CreateBound(
            p2,
            p3
        ),

        Line.CreateBound(
            p3,
            p4
        ),

        Line.CreateBound(
            p4,
            p1
        )
    ]


# ------------------------------------------------------------
# X CROSSTIE
# ------------------------------------------------------------

def x_crosstie_curves(
    origin,
    local_x,
    local_y,
    hx,
    y,
    z
):

    p1 = local_point(
        origin,
        local_x,
        local_y,
        -hx,
        y,
        z
    )

    p2 = local_point(
        origin,
        local_x,
        local_y,
        hx,
        y,
        z
    )


    return [
        Line.CreateBound(
            p1,
            p2
        )
    ]


# ------------------------------------------------------------
# Y CROSSTIE
# ------------------------------------------------------------

def y_crosstie_curves(
    origin,
    local_x,
    local_y,
    x,
    hy,
    z
):

    p1 = local_point(
        origin,
        local_x,
        local_y,
        x,
        -hy,
        z
    )

    p2 = local_point(
        origin,
        local_x,
        local_y,
        x,
        hy,
        z
    )


    return [
        Line.CreateBound(
            p1,
            p2
        )
    ]


# ------------------------------------------------------------
# CREATE REBAR
# ------------------------------------------------------------

def create_rebar(
    host,
    bar_type,
    curves
):

    # Host MUST be native Autodesk.Revit.DB.Element

    native_host = native_element(
        host
    )

    if native_host is None:

        native_host = host


    return Rebar.CreateFromCurves(
        doc,
        RebarStyle.StirrupTie,
        bar_type,
        None,
        None,
        native_host,
        XYZ.BasisZ,
        curves,
        RebarHookOrientation.Left,
        RebarHookOrientation.Left,
        True,
        True
    )


# ------------------------------------------------------------
# INPUT
# ------------------------------------------------------------

raw_input = IN[0]


t01_packages = collect_t01_packages(
    raw_input
)


# ------------------------------------------------------------
# VALIDATE INPUT
# ------------------------------------------------------------

if not t01_packages:

    OUT = [
        [],
        [],
        [],
        0,
        0,
        [],
        [],
        "ERROR: NO T01 PACKAGES FOUND"
    ]


else:

    # --------------------------------------------------------
    # TARGET IDS
    # --------------------------------------------------------

    target_ids = []

    valid_packages = []

    input_diagnostics = []


    for pkg in t01_packages:

        cid = safe_int(
            pkg[1],
            -1
        )

        column = get_native_column(
            pkg
        )


        if column is None:

            input_diagnostics.append(
                [
                    cid,
                    "FAIL: NATIVE REVIT COLUMN NOT FOUND"
                ]
            )

            continue


        valid_packages.append(
            pkg
        )


        if cid not in target_ids:

            target_ids.append(
                cid
            )


    # --------------------------------------------------------
    # REQUIRED TYPES
    # --------------------------------------------------------

    type_cache = {}

    type_diagnostics = []

    requested_diameters = []


    for pkg in valid_packages:

        diameter = round(
            safe_float(
                pkg[2]
            ),
            3
        )

        if diameter not in requested_diameters:

            requested_diameters.append(
                diameter
            )


    for requested in requested_diameters:

        bar_type, diag = find_rebar_type(
            requested
        )


        type_cache[
            requested
        ] = bar_type


        type_diagnostics.append(
            [
                requested,
                diag
            ]
        )


    # --------------------------------------------------------
    # ABORT BEFORE DELETE IF TYPE MISSING
    # --------------------------------------------------------

    missing_types = []

    for diameter in requested_diameters:

        if type_cache.get(
            diameter
        ) is None:

            missing_types.append(
                diameter
            )


    if missing_types:

        OUT = [
            input_diagnostics,
            target_ids,
            [],
            0,
            0,
            type_diagnostics,
            [
                "NO T02 REBAR DELETED",
                "R02 MAIN BARS PRESERVED",
                "MANUAL REBAR PRESERVED"
            ],
            "ERROR: REQUIRED TIE BAR TYPE NOT FOUND"
        ]


    else:

        # ----------------------------------------------------
        # TRANSACTION
        # ----------------------------------------------------

        TransactionManager.Instance.EnsureInTransaction(
            doc
        )


        deleted_ids = []


        # ----------------------------------------------------
        # DELETE OLD T02 ONLY
        # ----------------------------------------------------

        existing_rebars = (
            FilteredElementCollector(doc)
            .OfClass(Rebar)
            .WhereElementIsNotElementType()
            .ToElements()
        )


        for rebar in existing_rebars:

            try:

                host_id = id_value(
                    rebar.GetHostId()
                )


                if host_id not in target_ids:
                    continue


                comments = get_comments(
                    rebar
                )


                if not (
                    comments.startswith(
                        NEW_PREFIX
                    )
                    or
                    comments.startswith(
                        OLD_PREFIX
                    )
                ):

                    continue


                rid = id_value(
                    rebar.Id
                )


                doc.Delete(
                    rebar.Id
                )


                deleted_ids.append(
                    rid
                )

            except:
                pass


        # ----------------------------------------------------
        # CREATE
        # ----------------------------------------------------

        results = []

        total_created = 0

        total_perimeter = 0
        total_x = 0
        total_y = 0

        tag_success = 0
        tag_failed = 0


        for t01 in valid_packages:

            column_id = safe_int(
                t01[1]
            )


            column = get_native_column(
                t01
            )


            requested_tie_dia = safe_float(
                t01[2]
            )


            cover = safe_float(
                t01[3]
            )


            main_db = safe_float(
                t01[4]
            )


            total_main_bars = safe_int(
                t01[5]
            )


            width = safe_float(
                t01[6]
            )


            depth = safe_float(
                t01[7]
            )


            conf_spacing = safe_float(
                t01[11]
            )


            regular_spacing = safe_float(
                t01[12]
            )


            tie_elevations = t01[14]


            diagnostics = [
                "COLUMN ID = {}".format(
                    column_id
                ),
                "NATIVE HOST TYPE = {}".format(
                    column.GetType().FullName
                ),
                "SIZE = {:.0f} x {:.0f} mm".format(
                    width,
                    depth
                ),
                "MAIN = {}-D{:.0f}".format(
                    total_main_bars,
                    main_db
                ),
                "REQUESTED TIE = {:.1f} mm".format(
                    requested_tie_dia
                ),
                "COVER = {:.1f} mm".format(
                    cover
                ),
                "CONF SPACING = {:.1f} mm".format(
                    conf_spacing
                ),
                "REGULAR SPACING = {:.1f} mm".format(
                    regular_spacing
                )
            ]


            # ------------------------------------------------
            # TYPE
            # ------------------------------------------------

            type_key = round(
                requested_tie_dia,
                3
            )


            bar_type = type_cache[
                type_key
            ]


            actual_tie_dia = get_bar_diameter_mm(
                bar_type
            )


            diagnostics.append(
                "REVIT ACTUAL TIE DIA = {:.3f} mm".format(
                    actual_tie_dia
                )
            )


            # ------------------------------------------------
            # FRAME
            # ------------------------------------------------

            frame = get_column_frame(
                column,
                t01
            )


            if frame is None:

                diagnostics.append(
                    "FAIL: COLUMN FRAME NOT FOUND"
                )


                results.append(
                    [
                        column_id,
                        [],
                        0,
                        0,
                        0,
                        0,
                        [
                            "COLUMN FRAME NOT FOUND"
                        ],
                        diagnostics
                    ]
                )

                continue


            origin = frame[0]
            local_x = frame[1]
            local_y = frame[2]


            # ------------------------------------------------
            # TIE CENTERLINE
            # ------------------------------------------------

            offset = (
                cover
                + actual_tie_dia / 2.0
            )


            hx = (
                width / 2.0
                - offset
            )


            hy = (
                depth / 2.0
                - offset
            )


            if hx <= 0 or hy <= 0:

                diagnostics.append(
                    "FAIL: INVALID TIE CENTERLINE"
                )


                results.append(
                    [
                        column_id,
                        [],
                        0,
                        0,
                        0,
                        0,
                        [
                            "INVALID TIE CENTERLINE"
                        ],
                        diagnostics
                    ]
                )

                continue


            # ------------------------------------------------
            # CROSSTIE LOCATIONS
            # ------------------------------------------------

            layout = get_main_bar_layout(
                t01
            )


            cross = get_crosstie_offsets(
                layout,
                hx,
                hy
            )


            interior_x = cross[0]
            interior_y = cross[1]


            if total_main_bars >= 8:

                if not interior_x:

                    interior_x = [
                        0.0
                    ]


                if not interior_y:

                    interior_y = [
                        0.0
                    ]


            # ------------------------------------------------
            # ELEVATIONS
            # ------------------------------------------------

            elevations = []


            for z in tie_elevations:

                try:

                    elevations.append(
                        float(z)
                    )

                except:
                    pass


            elevations = unique_sorted(
                elevations,
                0.5
            )


            created_ids = []

            failures = []

            perimeter_count = 0
            x_count = 0
            y_count = 0


            # ------------------------------------------------
            # GENERATE EACH ELEVATION
            # ------------------------------------------------

            for i, z in enumerate(
                elevations
            ):

                z_index = i + 1


                # --------------------------------------------
                # PERIMETER
                # --------------------------------------------

                try:

                    curves = perimeter_curves(
                        origin,
                        local_x,
                        local_y,
                        hx,
                        hy,
                        z
                    )


                    rebar = create_rebar(
                        column,
                        bar_type,
                        curves
                    )


                    tag = (
                        "{}_C{}_Z{:03d}_PERIMETER"
                    ).format(
                        NEW_PREFIX,
                        column_id,
                        z_index
                    )


                    if set_comments(
                        rebar,
                        tag
                    ):

                        tag_success += 1

                    else:

                        tag_failed += 1


                    rid = id_value(
                        rebar.Id
                    )


                    created_ids.append(
                        rid
                    )


                    perimeter_count += 1
                    total_perimeter += 1
                    total_created += 1


                except Exception as ex:

                    failures.append(
                        "PERIMETER Z {:.1f}: {}".format(
                            z,
                            str(ex)
                        )
                    )


                # --------------------------------------------
                # X CROSSTIES
                # --------------------------------------------

                for j, y_offset in enumerate(
                    interior_y
                ):

                    try:

                        curves = x_crosstie_curves(
                            origin,
                            local_x,
                            local_y,
                            hx,
                            y_offset,
                            z
                        )


                        rebar = create_rebar(
                            column,
                            bar_type,
                            curves
                        )


                        tag = (
                            "{}_C{}_Z{:03d}_X{:02d}"
                        ).format(
                            NEW_PREFIX,
                            column_id,
                            z_index,
                            j + 1
                        )


                        if set_comments(
                            rebar,
                            tag
                        ):

                            tag_success += 1

                        else:

                            tag_failed += 1


                        rid = id_value(
                            rebar.Id
                        )


                        created_ids.append(
                            rid
                        )


                        x_count += 1
                        total_x += 1
                        total_created += 1


                    except Exception as ex:

                        failures.append(
                            "X CROSSTIE Z {:.1f}: {}".format(
                                z,
                                str(ex)
                            )
                        )


                # --------------------------------------------
                # Y CROSSTIES
                # --------------------------------------------

                for j, x_offset in enumerate(
                    interior_x
                ):

                    try:

                        curves = y_crosstie_curves(
                            origin,
                            local_x,
                            local_y,
                            x_offset,
                            hy,
                            z
                        )


                        rebar = create_rebar(
                            column,
                            bar_type,
                            curves
                        )


                        tag = (
                            "{}_C{}_Z{:03d}_Y{:02d}"
                        ).format(
                            NEW_PREFIX,
                            column_id,
                            z_index,
                            j + 1
                        )


                        if set_comments(
                            rebar,
                            tag
                        ):

                            tag_success += 1

                        else:

                            tag_failed += 1


                        rid = id_value(
                            rebar.Id
                        )


                        created_ids.append(
                            rid
                        )


                        y_count += 1
                        total_y += 1
                        total_created += 1


                    except Exception as ex:

                        failures.append(
                            "Y CROSSTIE Z {:.1f}: {}".format(
                                z,
                                str(ex)
                            )
                        )


            # ------------------------------------------------
            # COLUMN SUMMARY
            # ------------------------------------------------

            diagnostics.extend(
                [
                    "TIE ELEVATIONS = {}".format(
                        len(elevations)
                    ),
                    "PERIMETER CREATED = {}".format(
                        perimeter_count
                    ),
                    "X CROSSTIES CREATED = {}".format(
                        x_count
                    ),
                    "Y CROSSTIES CREATED = {}".format(
                        y_count
                    ),
                    "TOTAL CREATED = {}".format(
                        len(created_ids)
                    ),
                    "FAILED ITEMS = {}".format(
                        len(failures)
                    )
                ]
            )


            if (
                created_ids
                and not failures
            ):

                diagnostics.append(
                    "PASS: ALL T02 REINFORCEMENT CREATED"
                )


            elif created_ids:

                diagnostics.append(
                    "WARNING: PARTIAL T02 CREATION"
                )


            else:

                diagnostics.append(
                    "FAIL: NO T02 REINFORCEMENT CREATED"
                )


            results.append(
                [
                    column_id,
                    created_ids,
                    len(elevations),
                    perimeter_count,
                    x_count,
                    y_count,
                    failures,
                    diagnostics
                ]
            )


        # ----------------------------------------------------
        # FINISH TRANSACTION
        # ----------------------------------------------------

        TransactionManager.Instance.TransactionTaskDone()


        # ----------------------------------------------------
        # OWNERSHIP SUMMARY
        # ----------------------------------------------------

        ownership = [
            "OWNERSHIP PREFIX = {}".format(
                NEW_PREFIX
            ),
            "LEGACY PREFIX = {}".format(
                OLD_PREFIX
            ),
            "TARGET COLUMNS = {}".format(
                len(target_ids)
            ),
            "OLD T02 REBAR DELETED = {}".format(
                len(deleted_ids)
            ),
            "NEW T02 REBAR CREATED = {}".format(
                total_created
            ),
            "PERIMETER TIES = {}".format(
                total_perimeter
            ),
            "X CROSSTIES = {}".format(
                total_x
            ),
            "Y CROSSTIES = {}".format(
                total_y
            ),
            "TAG SUCCESS = {}".format(
                tag_success
            ),
            "TAG FAILED = {}".format(
                tag_failed
            ),
            "R02 MAIN BARS PRESERVED",
            "MANUAL / UNTAGGED REBAR PRESERVED"
        ]


        # ----------------------------------------------------
        # OUTPUT
        # ----------------------------------------------------

        OUT = [
            results,
            target_ids,
            deleted_ids,
            len(deleted_ids),
            total_created,
            type_diagnostics,
            ownership,
            "T02 COMPLETE"
        ]
# ----------------------------------------
