# Dynamo graph Column_Clear.dyn (Dynamo 3.6.0.9395)

structural_column_types = StructuralColumnTypes("C1")  # graph input
S01 = Python(IN[0]=structural_column_types)  # CPython3
# ---------- S01.python (426 lines) ----------
# ============================================================
# S01 — GET STRUCTURAL COLUMNS BY SELECTED TYPE
#       + DELETE ALL REBAR HOSTED BY MATCHING COLUMNS
#
# IN[0] = Structural Column Type
#         from Dynamo native "Structural Column Types" node
#
# OUT:
# [0] Matching Column Elements
# [1] Column Element IDs
# [2] Type Name
# [3] Number of Columns Found
# [4] Number of Rebars Deleted
# [5] Deleted Rebar IDs
# [6] Status
# ============================================================

import clr


# ------------------------------------------------------------
# REVIT SERVICES
# ------------------------------------------------------------

clr.AddReference("RevitServices")

from RevitServices.Persistence import DocumentManager
from RevitServices.Transactions import TransactionManager

doc = DocumentManager.Instance.CurrentDBDocument


# ------------------------------------------------------------
# REVIT API
# ------------------------------------------------------------

clr.AddReference("RevitAPI")

from Autodesk.Revit.DB import *
from Autodesk.Revit.DB.Structure import Rebar


# ------------------------------------------------------------
# REVIT / DYNAMO
# ------------------------------------------------------------

clr.AddReference("RevitNodes")

import Revit

clr.ImportExtensions(Revit.Elements)


# ------------------------------------------------------------
# INPUT
# ------------------------------------------------------------

input_type = IN[0]


# ------------------------------------------------------------
# SAFE ELEMENT ID VALUE
#
# Revit 2024+ = ElementId.Value
# Older Revit = ElementId.IntegerValue
# ------------------------------------------------------------

def id_value(element_id):

    if element_id is None:
        return None

    try:
        return int(element_id.Value)
    except:
        pass

    try:
        return int(element_id.IntegerValue)
    except:
        return None


# ------------------------------------------------------------
# DEFAULT OUTPUT VALUES
# ------------------------------------------------------------

matching_columns = []
matching_ids = []

deleted_rebar_ids = []

type_name = None
column_count = 0
deleted_count = 0

status_messages = []


# ------------------------------------------------------------
# VALIDATE INPUT
# ------------------------------------------------------------

if input_type is None:

    OUT = [
        [],
        [],
        None,
        0,
        0,
        [],
        "No Structural Column Type received."
    ]


else:

    # ========================================================
    # 1. UNWRAP SELECTED COLUMN TYPE
    # ========================================================

    try:
        selected_type = UnwrapElement(input_type)
    except:
        selected_type = input_type


    # ========================================================
    # 2. GET SELECTED TYPE ID
    # ========================================================

    selected_type_id = None
    selected_type_id_value = None

    try:

        selected_type_id = selected_type.Id

        selected_type_id_value = id_value(
            selected_type_id
        )

    except:
        pass


    # ========================================================
    # 3. GET TYPE NAME
    # ========================================================

    try:
        type_name = selected_type.Name
    except:
        pass


    if not type_name:

        try:

            p = selected_type.get_Parameter(
                BuiltInParameter.SYMBOL_NAME_PARAM
            )

            if p:
                type_name = p.AsString()

        except:
            pass


    if not type_name:
        type_name = "Unknown Type"


    # ========================================================
    # 4. COLLECT STRUCTURAL COLUMN INSTANCES
    # ========================================================

    collector = (
        FilteredElementCollector(doc)
        .OfCategory(
            BuiltInCategory.OST_StructuralColumns
        )
        .WhereElementIsNotElementType()
    )


    # ========================================================
    # 5. FIND COLUMNS USING SELECTED TYPE
    # ========================================================

    for column in collector:

        try:

            column_type_id = column.GetTypeId()

            column_type_value = id_value(
                column_type_id
            )

            if column_type_value == selected_type_id_value:

                matching_columns.append(column)

                cid = id_value(column.Id)

                if cid is not None:
                    matching_ids.append(cid)

        except:
            pass


    column_count = len(matching_columns)


    # ========================================================
    # 6. CREATE SET OF COLUMN IDs
    #
    # This makes host checking much faster.
    # ========================================================

    target_column_ids = set(matching_ids)


    # ========================================================
    # 7. COLLECT ALL REBAR IN PROJECT
    # ========================================================

    all_rebars = (
        FilteredElementCollector(doc)
        .OfClass(Rebar)
        .WhereElementIsNotElementType()
        .ToElements()
    )


    # ========================================================
    # 8. FIND REBAR HOSTED BY TARGET COLUMNS
    #
    # IMPORTANT:
    # Rebar.GetHostId() is used instead of dependent
    # elements because hosted rebar is not reliably returned
    # as a normal dependent element.
    # ========================================================

    rebars_to_delete = []

    for rebar in all_rebars:

        try:

            host_id = rebar.GetHostId()

            host_value = id_value(host_id)

            if host_value in target_column_ids:

                rebars_to_delete.append(rebar)

                rid = id_value(rebar.Id)

                if rid is not None:
                    deleted_rebar_ids.append(rid)

        except:
            pass


    # ========================================================
    # 9. DELETE REBAR
    # ========================================================

    if len(rebars_to_delete) > 0:

        transaction_started = False

        try:

            TransactionManager.Instance.EnsureInTransaction(doc)

            transaction_started = True


            for rebar in rebars_to_delete:

                try:
                    doc.Delete(rebar.Id)

                except Exception as delete_error:

                    status_messages.append(
                        "Failed to delete Rebar ID {}: {}".format(
                            id_value(rebar.Id),
                            str(delete_error)
                        )
                    )


            TransactionManager.Instance.TransactionTaskDone()

            transaction_started = False


        except Exception as transaction_error:

            if transaction_started:

                try:
                    TransactionManager.Instance.ForceCloseTransaction()
                except:
                    pass

            status_messages.append(
                "Delete transaction error: {}".format(
                    str(transaction_error)
                )
            )


    # ========================================================
    # 10. COUNT SUCCESSFULLY DELETED REBARS
    #
    # Verify that the elements no longer exist.
    # ========================================================

    successfully_deleted_ids = []

    for rid in deleted_rebar_ids:

        try:

            element_id = ElementId(rid)

            existing_element = doc.GetElement(element_id)

            if existing_element is None:
                successfully_deleted_ids.append(rid)

        except:

            # If Revit can no longer resolve the ID,
            # treat it as successfully deleted.

            successfully_deleted_ids.append(rid)


    deleted_rebar_ids = successfully_deleted_ids

    deleted_count = len(deleted_rebar_ids)


    # ========================================================
    # 11. STATUS
    # ========================================================

    if selected_type_id_value is None:

        status = (
            "ERROR: Could not determine selected "
            "Structural Column Type ID."
        )


    elif column_count == 0:

        status = (
            "No structural columns found using type: {}"
            .format(type_name)
        )


    elif len(rebars_to_delete) == 0:

        status = (
            "Found {} structural column(s) using type: {}. "
            "No hosted Rebar elements were found."
            .format(
                column_count,
                type_name
            )
        )


    else:

        status = (
            "Found {} structural column(s) using type: {}. "
            "Found {} hosted rebar element(s). "
            "Successfully deleted {} rebar element(s)."
            .format(
                column_count,
                type_name,
                len(rebars_to_delete),
                deleted_count
            )
        )


    # Add errors if there were any

    if len(status_messages) > 0:

        status += "\n\nWARNINGS:\n"

        status += "\n".join(
            status_messages
        )


    # ========================================================
    # 12. OUTPUT
    # ========================================================

    OUT = [
        matching_columns,       # [0]
        matching_ids,           # [1]
        type_name,              # [2]
        column_count,           # [3]
        deleted_count,          # [4]
        deleted_rebar_ids,      # [5]
        status                  # [6]
    ]
# ----------------------------------------
watch = Watch(S01)
