# Dynamo graph Master-Beam-Reinforcement-Graph.dyn (Dynamo 3.6.0.9395)

string = StringInput("CB-1\n")  # graph input
T01 = Python()  # CPython3
# ---------- T01.python (182 lines) ----------
import clr

clr.AddReference("RevitAPI")
clr.AddReference("RevitServices")

from Autodesk.Revit.DB import *
from Autodesk.Revit.DB.Structure import StructuralType
from RevitServices.Persistence import DocumentManager

doc = DocumentManager.Instance.CurrentDBDocument


# ============================================================
# T01 — USED STRUCTURAL BEAM TYPES
#
# Scans actual structural beam instances in the project
# and returns unique beam types currently in use.
#
# OUT:
# [0] Type Names
# [1] Type IDs
# [2] Type Elements
# [3] Instance Counts
# [4] Number of Types
# ============================================================


def id_value(element_id):

    try:
        return int(element_id.Value)
    except:
        pass

    try:
        return int(element_id.IntegerValue)
    except:
        return None


def get_type_name(beam_type):

    name = None

    try:
        p = beam_type.get_Parameter(
            BuiltInParameter.SYMBOL_NAME_PARAM
        )

        if p is not None:
            name = p.AsString()

    except:
        pass


    if not name:

        try:
            name = beam_type.Name
        except:
            pass


    if not name:
        name = "Unnamed Type"

    return str(name)


all_framing = (
    FilteredElementCollector(doc)
    .OfCategory(BuiltInCategory.OST_StructuralFraming)
    .WhereElementIsNotElementType()
    .ToElements()
)


type_map = {}


for element in all_framing:

    try:

        if element.StructuralType != StructuralType.Beam:
            continue


        type_id = element.GetTypeId()

        tid = id_value(
            type_id
        )


        if tid is None:
            continue


        if tid not in type_map:

            beam_type = doc.GetElement(
                type_id
            )

            if beam_type is None:
                continue


            type_map[tid] = {
                "name": get_type_name(beam_type),
                "type": beam_type,
                "count": 0
            }


        type_map[tid]["count"] += 1


    except:
        pass


# ============================================================
# SORT BY TYPE NAME
# ============================================================

items = []


for tid in type_map:

    data = type_map[tid]

    items.append(
        [
            str(data["name"]),
            tid,
            data["type"],
            data["count"]
        ]
    )


items.sort(
    key=lambda x: x[0].lower()
)


type_names = []
type_ids = []
type_elements = []
instance_counts = []


for item in items:

    type_names.append(
        item[0]
    )

    type_ids.append(
        item[1]
    )

    type_elements.append(
        item[2]
    )

    instance_counts.append(
        item[3]
    )


OUT = [
    type_names,
    type_ids,
    type_elements,
    instance_counts,
    len(type_names)
]
# ----------------------------------------
T02 = Python(IN[0]=string, IN[1]=T01)  # CPython3
# ---------- T02.python (190 lines) ----------
import clr

clr.AddReference("RevitAPI")
clr.AddReference("RevitServices")

from Autodesk.Revit.DB import *
from Autodesk.Revit.DB.Structure import StructuralType
from RevitServices.Persistence import DocumentManager

doc = DocumentManager.Instance.CurrentDBDocument


# ============================================================
# T02 — SELECT BEAM TYPE FROM CURRENT T01
#
# IN[0] = Beam Type Name
#         Example: 300 x 600mm
#
# IN[1] = Entire T01 output
#
# CURRENT T01:
# [0] Type Names
# [1] Type IDs
# [2] Type Elements
# [3] Instance Counts
# [4] Number of Types
#
#
# OUT:
# [0] Selected Type Name
# [1] Selected Type ID
# [2] Selected Type Element
# [3] Expected Instance Count
# [4] Ready
# [5] Status
# ============================================================


# ============================================================
# CLEAN NAME
# ============================================================

def clean_name(value):

    if value is None:
        return ""

    text = str(value).strip()

    if len(text) >= 2:

        if (
            text[0] == '"'
            and
            text[-1] == '"'
        ):
            text = text[1:-1].strip()

        elif (
            text[0] == "'"
            and
            text[-1] == "'"
        ):
            text = text[1:-1].strip()

    return " ".join(
        text.split()
    )


# ============================================================
# INPUTS
# ============================================================

selected_name = clean_name(
    IN[0]
)

t01 = IN[1]


# ============================================================
# READ CURRENT T01 FORMAT
# ============================================================

try:

    type_names = list(
        t01[0]
    )

    type_ids = list(
        t01[1]
    )

    type_elements = list(
        t01[2]
    )

    instance_counts = list(
        t01[3]
    )

except:

    type_names = []
    type_ids = []
    type_elements = []
    instance_counts = []


# ============================================================
# FIND TYPE
# ============================================================

selected_type_name = None
selected_type_id = None
selected_type_element = None
selected_instance_count = 0


target = selected_name.lower()


for i in range(
    len(type_names)
):

    try:

        current_name = clean_name(
            type_names[i]
        )

        if current_name.lower() == target:

            selected_type_name = current_name

            selected_type_id = (
                type_ids[i]
            )

            selected_type_element = (
                type_elements[i]
            )

            selected_instance_count = int(
                instance_counts[i]
            )

            break

    except:
        pass


# ============================================================
# OUTPUT
# ============================================================

ready = (
    selected_type_element is not None
)


if ready:

    status = "BEAM TYPE SELECTED"

else:

    status = "BEAM TYPE NOT FOUND"


OUT = [

    selected_type_name
    if ready
    else selected_name,             # 0

    selected_type_id,               # 1

    selected_type_element,          # 2

    selected_instance_count,        # 3

    ready,                          # 4

    status                          # 5
]
# ----------------------------------------
T03 = Python(IN[0]=T02)  # CPython3
# ---------- T03.python (150 lines) ----------
import clr

clr.AddReference("RevitAPI")
clr.AddReference("RevitServices")
clr.AddReference("RevitNodes")

import Revit
clr.ImportExtensions(Revit.Elements)

from Autodesk.Revit.DB import *
from Autodesk.Revit.DB.Structure import StructuralType
from RevitServices.Persistence import DocumentManager

doc = DocumentManager.Instance.CurrentDBDocument


# ============================================================
# T03 — GET ALL BEAM INSTANCES OF SELECTED TYPE
#
# IN[0] = Entire T02 output
#
# OUT:
# [0] Type Name
# [1] Type ID
# [2] Beam Instances
# [3] Beam Count
# [4] Beam IDs
# [5] Ready
# [6] Status
# ============================================================


def id_value(element_id):

    try:
        return int(element_id.Value)
    except:
        pass

    try:
        return int(element_id.IntegerValue)
    except:
        return None


t02 = IN[0]


try:

    type_name = t02[0]
    selected_type_id = int(t02[1])
    selected_ready = bool(t02[4])

except:

    selected_ready = False
    type_name = None
    selected_type_id = None


beams = []
beam_ids = []


if selected_ready:

    all_framing = (
        FilteredElementCollector(doc)
        .OfCategory(
            BuiltInCategory.OST_StructuralFraming
        )
        .WhereElementIsNotElementType()
        .ToElements()
    )


    for element in all_framing:

        try:

            if (
                element.StructuralType
                != StructuralType.Beam
            ):

                continue


            current_type_id = id_value(
                element.GetTypeId()
            )


            if current_type_id != selected_type_id:
                continue


            beams.append(
                element
            )


            beam_ids.append(
                id_value(
                    element.Id
                )
            )


        except:
            pass


ready = (
    selected_ready
    and
    len(beams) > 0
)


if ready:

    status = "SELECTED BEAM INSTANCES READY"

elif not selected_ready:

    status = "NO VALID TYPE SELECTED"

else:

    status = "NO BEAM INSTANCES FOUND"


OUT = [

    type_name,              # 0

    selected_type_id,       # 1

    beams,                  # 2

    len(beams),             # 3

    beam_ids,               # 4

    ready,                  # 5

    status                  # 6
]
# ----------------------------------------
top_bars = IntegerSlider(4, range=2..16 step 2)  # graph input
top_diameter = IntegerSlider(16, range=10..25 step 1)  # graph input
bottom_bars = IntegerSlider(4, range=2..16 step 1)  # graph input
bottom_diameter = IntegerSlider(16, range=10..25 step 1)  # graph input
stirrupDiameter = IntegerSlider(10, range=10..10 step 1)  # graph input
endSpacing = IntegerSlider(95, range=75..125 step 10)  # graph input
midspacing = IntegerSlider(150, range=100..200 step 25)  # graph input
cover = IntegerSlider(40, range=40..75 step 35)  # graph input
J01 = Python(IN[0]=top_bars, IN[1]=top_diameter, IN[2]=bottom_bars, IN[3]=bottom_diameter, IN[4]=stirrupDiameter, IN[5]=endSpacing, IN[6]=midspacing, IN[7]=cover)  # CPython3
# ---------- J01.python (293 lines) ----------
# ============================================================
# J01 — USER REBAR INPUT JUNCTION
#
# IN[0] = Top Bars
# IN[1] = Top Diameter
# IN[2] = Bottom Bars
# IN[3] = Bottom Diameter
# IN[4] = Stirrup Diameter
# IN[5] = End Spacing
# IN[6] = Mid Spacing
# IN[7] = Cover
#
# OUT:
# [0] TopQty
# [1] BottomQty
# [2] TopDia
# [3] BottomDia
# [4] StirrupDia
# [5] Cover
# [6] EndSpacing
# [7] MidSpacing
# [8] ContinuousQty
# [9] ExtraQty
# [10] SupportExtraLayer
# [11] MidspanExtraLayer
# [12] SupportSection
# [13] MidspanSection
# [14] Ready
# [15] Errors
# [16] Status
# ============================================================


# ============================================================
# CONVERSION HELPERS
# ============================================================

def to_int(value):

    try:
        return int(
            round(
                float(value)
            )
        )

    except:
        return None


def to_float(value):

    try:
        return float(value)

    except:
        return None


# ============================================================
# READ PLAYER INPUTS
# ============================================================

top_qty = to_int(
    IN[0]
)

top_dia = to_float(
    IN[1]
)

bottom_qty = to_int(
    IN[2]
)

bottom_dia = to_float(
    IN[3]
)

stirrup_dia = to_float(
    IN[4]
)

end_spacing = to_float(
    IN[5]
)

mid_spacing = to_float(
    IN[6]
)

cover = to_float(
    IN[7]
)


# ============================================================
# VALIDATION
# ============================================================

errors = []


if top_qty is None:

    errors.append(
        "Top Bars is invalid."
    )

elif top_qty < 2:

    errors.append(
        "Top Bars must be at least 2."
    )


if bottom_qty is None:

    errors.append(
        "Bottom Bars is invalid."
    )

elif bottom_qty < 2:

    errors.append(
        "Bottom Bars must be at least 2."
    )


if top_dia is None or top_dia <= 0:

    errors.append(
        "Top Diameter is invalid."
    )


if bottom_dia is None or bottom_dia <= 0:

    errors.append(
        "Bottom Diameter is invalid."
    )


if stirrup_dia is None or stirrup_dia <= 0:

    errors.append(
        "Stirrup Diameter is invalid."
    )


if cover is None or cover <= 0:

    errors.append(
        "Cover is invalid."
    )


if end_spacing is None or end_spacing <= 0:

    errors.append(
        "End Spacing is invalid."
    )


if mid_spacing is None or mid_spacing <= 0:

    errors.append(
        "Mid Spacing is invalid."
    )


# ============================================================
# REBAR QUANTITY LOGIC
# ============================================================

continuous_qty = None
extra_qty = None

support_extra_layer = None
midspan_extra_layer = None

support_section = None
midspan_section = None


if (
    top_qty is not None
    and
    bottom_qty is not None
):

    continuous_qty = min(
        top_qty,
        bottom_qty
    )


    extra_qty = abs(
        top_qty - bottom_qty
    )


    if top_qty > bottom_qty:

        support_extra_layer = "TOP"

        midspan_extra_layer = "BOTTOM"


    elif bottom_qty > top_qty:

        support_extra_layer = "BOTTOM"

        midspan_extra_layer = "TOP"


    else:

        support_extra_layer = "NONE"

        midspan_extra_layer = "NONE"


    support_section = [
        top_qty,
        bottom_qty
    ]


    midspan_section = [
        bottom_qty,
        top_qty
    ]


# ============================================================
# FINAL STATUS
# ============================================================

ready = (
    len(errors) == 0
)


if ready:

    status = "USER REBAR INPUT READY"

else:

    status = "USER REBAR INPUT FAILED"


# ============================================================
# OUTPUT
# ============================================================

OUT = [

    top_qty,                    # 0

    bottom_qty,                 # 1

    top_dia,                    # 2

    bottom_dia,                 # 3

    stirrup_dia,                # 4

    cover,                      # 5

    end_spacing,                # 6

    mid_spacing,                # 7

    continuous_qty,             # 8

    extra_qty,                  # 9

    support_extra_layer,        # 10

    midspan_extra_layer,        # 11

    support_section,            # 12

    midspan_section,            # 13

    ready,                      # 14

    errors,                     # 15

    status                      # 16
]
# ----------------------------------------
T04 = Python(IN[0]=T03, IN[1]=J01)  # CPython3
# ---------- T04.python (326 lines) ----------
# ============================================================
# T04 — COMBINE SELECTED BEAM TYPE + USER REBAR INPUT
#
# IN[0] = Entire T03 output
# IN[1] = Entire J01 output
#
# T03:
# [0] Type Name
# [1] Type ID
# [2] Beam Instances
# [3] Beam Count
# [4] Beam IDs
# [5] Ready
# [6] Status
#
# J01:
# [0] TopQty
# [1] BottomQty
# [2] TopDia
# [3] BottomDia
# [4] StirrupDia
# [5] Cover
# [6] EndSpacing
# [7] MidSpacing
# [8] ContinuousQty
# [9] ExtraQty
# [10] SupportExtraLayer
# [11] MidspanExtraLayer
# [12] SupportSection
# [13] MidspanSection
# [14] Ready
# [15] Errors
# [16] Status
#
# OUT:
# [0] Type Name
# [1] Type ID
# [2] Beam Count
# [3] Beam IDs
# [4] TopQty
# [5] BottomQty
# [6] TopDia
# [7] BottomDia
# [8] StirrupDia
# [9] Cover
# [10] EndSpacing
# [11] MidSpacing
# [12] ContinuousQty
# [13] ExtraQty
# [14] SupportExtraLayer
# [15] MidspanExtraLayer
# [16] SupportSection
# [17] MidspanSection
# [18] Beam Instances
# [19] Ready
# [20] Status
# [21] Errors
# ============================================================


def as_list(value):

    if value is None:
        return []

    if isinstance(value, list):
        return value

    try:
        return list(value)
    except:
        return [value]


t03 = IN[0]
j01 = IN[1]


errors = []


# ============================================================
# READ T03
# ============================================================

try:

    type_name = t03[0]
    type_id = t03[1]

    beams = as_list(
        t03[2]
    )

    beam_count = int(
        t03[3]
    )

    beam_ids = as_list(
        t03[4]
    )

    t03_ready = bool(
        t03[5]
    )

except Exception as ex:

    type_name = None
    type_id = None

    beams = []
    beam_count = 0
    beam_ids = []

    t03_ready = False

    errors.append(
        "Invalid T03 input: {}".format(
            str(ex)
        )
    )


# ============================================================
# READ J01
# ============================================================

try:

    top_qty = int(
        j01[0]
    )

    bottom_qty = int(
        j01[1]
    )

    top_dia = float(
        j01[2]
    )

    bottom_dia = float(
        j01[3]
    )

    stirrup_dia = float(
        j01[4]
    )

    cover = float(
        j01[5]
    )

    end_spacing = float(
        j01[6]
    )

    mid_spacing = float(
        j01[7]
    )

    continuous_qty = int(
        j01[8]
    )

    extra_qty = int(
        j01[9]
    )

    support_extra_layer = str(
        j01[10]
    )

    midspan_extra_layer = str(
        j01[11]
    )

    support_section = as_list(
        j01[12]
    )

    midspan_section = as_list(
        j01[13]
    )

    j01_ready = bool(
        j01[14]
    )

    j01_errors = as_list(
        j01[15]
    )

except Exception as ex:

    top_qty = None
    bottom_qty = None

    top_dia = None
    bottom_dia = None

    stirrup_dia = None
    cover = None

    end_spacing = None
    mid_spacing = None

    continuous_qty = None
    extra_qty = None

    support_extra_layer = None
    midspan_extra_layer = None

    support_section = []
    midspan_section = []

    j01_ready = False
    j01_errors = []

    errors.append(
        "Invalid J01 input: {}".format(
            str(ex)
        )
    )


# ============================================================
# FORWARD J01 ERRORS
# ============================================================

for err in j01_errors:

    errors.append(
        str(err)
    )


# ============================================================
# FINAL VALIDATION
# ============================================================

if not t03_ready:

    errors.append(
        "T03 is not ready."
    )


if not j01_ready:

    errors.append(
        "J01 is not ready."
    )


if beam_count <= 0:

    errors.append(
        "No beam instances found."
    )


ready = (
    len(errors) == 0
)


status = (
    "T04 CONFIGURATION READY"
    if ready
    else
    "T04 CONFIGURATION FAILED"
)


# ============================================================
# OUTPUT
# ============================================================

OUT = [

    type_name,                  # 0

    type_id,                    # 1

    beam_count,                 # 2

    beam_ids,                   # 3

    top_qty,                    # 4

    bottom_qty,                 # 5

    top_dia,                    # 6

    bottom_dia,                 # 7

    stirrup_dia,                # 8

    cover,                      # 9

    end_spacing,                # 10

    mid_spacing,                # 11

    continuous_qty,             # 12

    extra_qty,                  # 13

    support_extra_layer,        # 14

    midspan_extra_layer,        # 15

    support_section,            # 16

    midspan_section,            # 17

    beams,                      # 18

    ready,                      # 19

    status,                     # 20

    errors                      # 21
]
# ----------------------------------------
B01 = Python(IN[0]=T04)  # CPython3
# ---------- B01.python (520 lines) ----------
import clr

clr.AddReference("RevitAPI")
clr.AddReference("RevitServices")
clr.AddReference("RevitNodes")

import Revit
clr.ImportExtensions(Revit.Elements)

from Autodesk.Revit.DB import *
from RevitServices.Persistence import DocumentManager

doc = DocumentManager.Instance.CurrentDBDocument


# ============================================================
# B01 — SELECTED TYPE GEOMETRY PREFLIGHT
#
# IN[0] = entire T04 output
#
# T04:
# [0]  Type Name
# [1]  Type ID
# [2]  Beam Count
# [3]  Beam IDs
# [4]  TopQty
# [5]  BottomQty
# [6]  TopDia
# [7]  BottomDia
# [8]  StirrupDia
# [9]  Cover
# [10] EndSpacing
# [11] MidSpacing
# [12] ContinuousQty
# [13] ExtraQty
# [14] Support Extra Layer
# [15] Midspan Extra Layer
# [16] Support Section
# [17] Midspan Section
# [18] Beam Instances
# [19] Ready
# [20] Status
#
# OUT:
# [0] Beam reports
# [1] Input beam count
# [2] Ready beams
# [3] Ready count
# [4] Ready beam IDs
# [5] Failed reports
# [6] Failed count
# [7] Overall ready
# [8] T04 config
# [9] Status
# ============================================================


# ============================================================
# HELPERS
# ============================================================

def as_list(value):
    if value is None:
        return []
    if isinstance(value, list):
        return value
    try:
        return list(value)
    except:
        return [value]


def id_value(element):
    try:
        return int(element.Id.Value)
    except:
        pass

    try:
        return int(element.Id.IntegerValue)
    except:
        return None


def internal_to_mm(value):
    return UnitUtils.ConvertFromInternalUnits(
        value,
        UnitTypeId.Millimeters
    )


def get_type_dimension_mm(beam_type, names):

    for name in names:

        try:
            p = beam_type.LookupParameter(name)

            if (
                p is not None
                and
                p.StorageType == StorageType.Double
            ):
                return internal_to_mm(
                    p.AsDouble()
                )

        except:
            pass

    return None


# ============================================================
# READ T04
# ============================================================

t04 = IN[0]

try:

    type_name = t04[0]
    type_id = t04[1]

    expected_beam_count = int(t04[2])

    top_qty = int(t04[4])
    bottom_qty = int(t04[5])

    top_dia = float(t04[6])
    bottom_dia = float(t04[7])

    stirrup_dia = float(t04[8])
    cover = float(t04[9])

    end_spacing = float(t04[10])
    mid_spacing = float(t04[11])

    continuous_qty = int(t04[12])
    extra_qty = int(t04[13])

    support_extra_layer = t04[14]
    midspan_extra_layer = t04[15]

    beams_raw = as_list(
        t04[18]
    )

    t04_ready = bool(
        t04[19]
    )

except Exception as ex:

    OUT = [
        [],
        0,
        [],
        0,
        [],
        [],
        0,
        False,
        None,
        "INVALID T04 INPUT: {}".format(str(ex))
    ]

    raise Exception(
        "Invalid T04 input: {}".format(str(ex))
    )


# ============================================================
# UNWRAP BEAMS
# ============================================================

beams = []

for item in beams_raw:

    try:
        beam = UnwrapElement(item)
    except:
        beam = item

    if beam is not None:
        beams.append(beam)


# ============================================================
# PROCESS
# ============================================================

reports = []

ready_beams = []
ready_ids = []

failed_reports = []


for beam in beams:

    errors = []
    warnings = []

    beam_id = id_value(
        beam
    )


    # ========================================================
    # LOCATION CURVE
    # ========================================================

    curve = None
    length_mm = None


    try:

        location = beam.Location

        if location is None:
            errors.append(
                "Beam has no Location."
            )

        else:

            curve = location.Curve

            if curve is None:
                errors.append(
                    "Beam has no LocationCurve."
                )

            else:

                length_mm = internal_to_mm(
                    curve.Length
                )

                if length_mm <= 0:
                    errors.append(
                        "Beam length is invalid."
                    )

    except Exception as ex:

        errors.append(
            "LocationCurve error: {}".format(
                str(ex)
            )
        )


    # ========================================================
    # TYPE
    # ========================================================

    beam_type = None
    beam_width = None
    beam_depth = None


    try:

        beam_type = doc.GetElement(
            beam.GetTypeId()
        )

    except:
        beam_type = None


    if beam_type is None:

        errors.append(
            "Beam type not found."
        )

    else:

        beam_width = get_type_dimension_mm(
            beam_type,
            [
                "b",
                "Width",
                "B"
            ]
        )

        beam_depth = get_type_dimension_mm(
            beam_type,
            [
                "h",
                "Depth",
                "H"
            ]
        )


        if beam_width is None or beam_width <= 0:

            errors.append(
                "Beam width not found."
            )


        if beam_depth is None or beam_depth <= 0:

            errors.append(
                "Beam depth not found."
            )


    # ========================================================
    # VERIFY TYPE MATCH
    # ========================================================

    try:

        current_type_id = id_value(
            beam_type
        )

        if current_type_id != int(type_id):

            errors.append(
                "Beam does not match selected type."
            )

    except:
        pass


    # ========================================================
    # CONFIG VALIDATION
    # ========================================================

    if top_qty < 2:
        errors.append(
            "TopQty must be >= 2."
        )

    if bottom_qty < 2:
        errors.append(
            "BottomQty must be >= 2."
        )

    if top_dia <= 0:
        errors.append(
            "TopDia invalid."
        )

    if bottom_dia <= 0:
        errors.append(
            "BottomDia invalid."
        )

    if stirrup_dia <= 0:
        errors.append(
            "StirrupDia invalid."
        )

    if cover <= 0:
        errors.append(
            "Cover invalid."
        )

    if end_spacing <= 0:
        errors.append(
            "EndSpacing invalid."
        )

    if mid_spacing <= 0:
        errors.append(
            "MidSpacing invalid."
        )


    if abs(top_dia - bottom_dia) > 0.5:

        warnings.append(
            "TopDia and BottomDia differ."
        )


    ready = (
        len(errors) == 0
    )


    status = (
        "READY"
        if ready
        else "FAILED"
    )


    report = [

        beam_id,                   # 0
        ready,                     # 1
        status,                    # 2

        errors,                    # 3
        warnings,                  # 4

        [
            length_mm,
            beam_width,
            beam_depth
        ],                          # 5

        [
            top_qty,
            bottom_qty,
            top_dia,
            bottom_dia
        ],                          # 6

        [
            continuous_qty,
            extra_qty,
            support_extra_layer,
            midspan_extra_layer
        ],                          # 7

        [
            stirrup_dia,
            cover,
            end_spacing,
            mid_spacing
        ],                          # 8

        beam                       # 9
    ]


    reports.append(
        report
    )


    if ready:

        ready_beams.append(
            beam
        )

        ready_ids.append(
            beam_id
        )

    else:

        failed_reports.append(
            report
        )


# ============================================================
# FINAL
# ============================================================

overall_ready = (
    t04_ready
    and
    len(beams) > 0
    and
    len(failed_reports) == 0
)


status = (
    "B01 PREFLIGHT COMPLETE"
    if overall_ready
    else "B01 PREFLIGHT FAILED"
)


OUT = [

    reports,                       # 0

    len(beams),                    # 1

    ready_beams,                   # 2

    len(ready_beams),              # 3

    ready_ids,                     # 4

    failed_reports,                # 5

    len(failed_reports),           # 6

    overall_ready,                 # 7

    [
        type_name,
        type_id,
        top_qty,
        bottom_qty,
        top_dia,
        bottom_dia,
        stirrup_dia,
        cover,
        end_spacing,
        mid_spacing,
        continuous_qty,
        extra_qty,
        support_extra_layer,
        midspan_extra_layer
    ],                              # 8

    status                         # 9
]
# ----------------------------------------
B02 = Python(IN[0]=B01)  # CPython3
# ---------- B02.python (1589 lines) ----------
import clr
import math

clr.AddReference("RevitAPI")
clr.AddReference("RevitServices")
clr.AddReference("RevitNodes")

import Revit
clr.ImportExtensions(Revit.Elements)

from Autodesk.Revit.DB import *
from Autodesk.Revit.DB.Structure import StructuralType
from RevitServices.Persistence import DocumentManager

doc = DocumentManager.Instance.CurrentDBDocument


# ============================================================
# B02 — SUPPORT / CONTINUITY PREFLIGHT
#
# IN[0] = Entire B01 output
#
# B01 beam report:
# [0] Beam ID
# [1] Ready
# [2] Status
# [3] Errors
# [4] Warnings
# [5] [Length, Width, Depth]
# [6] [TopQty, BottomQty, TopDia, BottomDia]
# [7] [ContinuousQty, ExtraQty,
#      SupportExtraLayer, MidspanExtraLayer]
# [8] [StirrupDia, Cover, EndSpacing, MidSpacing]
# [9] Beam
#
#
# OUT:
# [0] Detailed reports
# [1] Beams received
# [2] Fully ready beams
# [3] Ready count
# [4] Ready IDs
# [5] Failed reports
# [6] Failed count
# [7] Overall ready
# [8] Status
# ============================================================


# ============================================================
# SETTINGS
# ============================================================

# Maximum XY distance from beam endpoint to column bounding box.
SUPPORT_TOLERANCE_MM = 600.0

# Continuation beam endpoint tolerance.
CONTINUITY_END_TOLERANCE_MM = 500.0

# Maximum sideways offset of continuation beam.
CONTINUITY_LATERAL_TOLERANCE_MM = 150.0

# Parallel/alignment tolerance.
CONTINUITY_ALIGNMENT = 0.98

# Maximum XY distance from a beam endpoint to a supporting
# beam/girder bounding box. Used only when no column is found.
BEAM_SUPPORT_TOLERANCE_MM = 300.0

# A supporting beam/girder should not be almost collinear with
# the current beam. Collinear members are handled separately
# by the continuation-beam logic.
BEAM_SUPPORT_MAX_ALIGNMENT = 0.95


# ============================================================
# BASIC HELPERS
# ============================================================

def as_list(value):

    if value is None:
        return []

    if isinstance(value, list):
        return value

    try:
        return list(value)
    except:
        return [value]


def unwrap(element):

    try:
        return UnwrapElement(element)
    except:
        return element


def id_value(element):

    if element is None:
        return None

    try:
        return int(element.Id.Value)
    except:
        pass

    try:
        return int(element.Id.IntegerValue)
    except:
        return None


def internal_to_mm(value):

    return UnitUtils.ConvertFromInternalUnits(
        value,
        UnitTypeId.Millimeters
    )


def mm_to_internal(value):

    return UnitUtils.ConvertToInternalUnits(
        float(value),
        UnitTypeId.Millimeters
    )


def xyz_to_mm(point):

    if point is None:
        return None

    return [
        internal_to_mm(point.X),
        internal_to_mm(point.Y),
        internal_to_mm(point.Z)
    ]


def distance_mm(p1, p2):

    return internal_to_mm(
        p1.DistanceTo(p2)
    )


def get_beam_curve(beam):

    try:

        location = beam.Location

        if location is None:
            return None

        return location.Curve

    except:
        return None


def unit_xy(vector):

    try:

        v = XYZ(
            vector.X,
            vector.Y,
            0.0
        )

        if v.GetLength() <= 0.000001:
            return None

        return v.Normalize()

    except:
        return None


# ============================================================
# COLLECT COLUMNS
# ============================================================

columns = (
    FilteredElementCollector(doc)
    .OfCategory(BuiltInCategory.OST_StructuralColumns)
    .WhereElementIsNotElementType()
    .ToElements()
)


# ============================================================
# COLLECT ALL BEAMS
#
# Used for continuity detection.
# ============================================================

all_framing = (
    FilteredElementCollector(doc)
    .OfCategory(BuiltInCategory.OST_StructuralFraming)
    .WhereElementIsNotElementType()
    .ToElements()
)


all_beams = []


for element in all_framing:

    try:

        if element.StructuralType == StructuralType.Beam:

            all_beams.append(
                element
            )

    except:
        pass


# ============================================================
# POINT → BOUNDING BOX XY DISTANCE
#
# Returns zero when endpoint is inside the column bbox in plan.
# ============================================================

def point_to_bbox_xy_distance_mm(point, bbox):

    if point.X < bbox.Min.X:

        dx = bbox.Min.X - point.X

    elif point.X > bbox.Max.X:

        dx = point.X - bbox.Max.X

    else:

        dx = 0.0


    if point.Y < bbox.Min.Y:

        dy = bbox.Min.Y - point.Y

    elif point.Y > bbox.Max.Y:

        dy = point.Y - bbox.Max.Y

    else:

        dy = 0.0


    d = math.sqrt(
        dx * dx
        +
        dy * dy
    )


    return internal_to_mm(
        d
    )


# ============================================================
# COLUMN SUPPORT DETECTION
#
# New method:
#
# 1. Check every structural column.
# 2. Measure beam-end XY distance to column bounding box.
# 3. Pick nearest valid column.
# 4. Project its bbox corners along beam axis.
# 5. Derive near/far faces.
#
# This is much less sensitive than the old probe-line method.
# ============================================================

def detect_column_support(
    beam_end,
    beam_direction,
    is_start
):

    candidates = []


    for column in columns:

        try:

            bbox = column.get_BoundingBox(
                None
            )

            if bbox is None:
                continue


            # =================================================
            # XY DISTANCE TO COLUMN
            # =================================================

            bbox_distance = (
                point_to_bbox_xy_distance_mm(
                    beam_end,
                    bbox
                )
            )


            if (
                bbox_distance
                > SUPPORT_TOLERANCE_MM
            ):

                continue


            # =================================================
            # COLUMN CENTER
            # =================================================

            center = XYZ(

                (
                    bbox.Min.X
                    +
                    bbox.Max.X
                ) / 2.0,

                (
                    bbox.Min.Y
                    +
                    bbox.Max.Y
                ) / 2.0,

                beam_end.Z
            )


            center_distance = distance_mm(
                beam_end,
                center
            )


            candidates.append([
                bbox_distance,
                center_distance,
                column,
                bbox,
                center
            ])


        except:
            pass


    if len(candidates) == 0:

        return None


    # Prefer beam endpoint actually inside/intersecting bbox,
    # then nearest column center.

    candidates.sort(
        key=lambda x: (
            x[0],
            x[1]
        )
    )


    selected = candidates[0]

    column = selected[2]
    bbox = selected[3]
    center = selected[4]

    center_distance = selected[1]


    # ========================================================
    # PROJECT COLUMN BBOX CORNERS ONTO BEAM DIRECTION
    # ========================================================

    corners = [

        XYZ(
            bbox.Min.X,
            bbox.Min.Y,
            beam_end.Z
        ),

        XYZ(
            bbox.Min.X,
            bbox.Max.Y,
            beam_end.Z
        ),

        XYZ(
            bbox.Max.X,
            bbox.Min.Y,
            beam_end.Z
        ),

        XYZ(
            bbox.Max.X,
            bbox.Max.Y,
            beam_end.Z
        )
    ]


    projections = []


    for corner in corners:

        delta = corner.Subtract(
            beam_end
        )

        projection = delta.DotProduct(
            beam_direction
        )

        projections.append(
            projection
        )


    minimum = min(
        projections
    )

    maximum = max(
        projections
    )


    # ========================================================
    # FACE ORDER
    #
    # START:
    # beam runs toward +direction
    # near face = positive/span side
    # far face  = opposite side
    #
    # END:
    # beam arrives from -direction
    # near face = negative/span side
    # far face  = positive/outside side
    # ========================================================

    if is_start:

        near_offset = maximum
        far_offset = minimum

    else:

        near_offset = minimum
        far_offset = maximum


    near_face = beam_end.Add(

        beam_direction.Multiply(
            near_offset
        )
    )


    far_face = beam_end.Add(

        beam_direction.Multiply(
            far_offset
        )
    )


    thickness_mm = abs(

        internal_to_mm(
            maximum - minimum
        )
    )


    return [

        column,             # 0
        near_face,          # 1
        far_face,           # 2
        thickness_mm,       # 3
        center_distance,    # 4
        center              # 5
    ]


# ============================================================
# BEAM / GIRDER SUPPORT DETECTION
#
# Used when no structural column is found at a beam end.
# This detects a beam framing into the side/topological location
# of another beam or girder, including perpendicular/T-junctions.
#
# Returns the same geometric data shape as column support:
# [support element, near face, far face, thickness along current
#  beam axis, center distance, support center]
# ============================================================

def detect_beam_support(
    current_beam,
    beam_end,
    beam_direction,
    is_start
):

    current_id = id_value(
        current_beam
    )

    current_dir_xy = unit_xy(
        beam_direction
    )

    if current_dir_xy is None:
        return None

    candidates = []


    for candidate in all_beams:

        try:

            candidate_id = id_value(
                candidate
            )

            if candidate_id == current_id:
                continue


            candidate_curve = get_beam_curve(
                candidate
            )

            if candidate_curve is None:
                continue


            cp0 = candidate_curve.GetEndPoint(0)
            cp1 = candidate_curve.GetEndPoint(1)

            candidate_dir_xy = unit_xy(
                cp1.Subtract(cp0)
            )

            if candidate_dir_xy is None:
                continue


            # ------------------------------------------------
            # Do not treat an almost-collinear member as a
            # transverse supporting beam/girder. That condition
            # belongs to continuation detection.
            # ------------------------------------------------

            alignment = abs(
                current_dir_xy.DotProduct(
                    candidate_dir_xy
                )
            )

            if alignment >= BEAM_SUPPORT_MAX_ALIGNMENT:
                continue


            bbox = candidate.get_BoundingBox(
                None
            )

            if bbox is None:
                continue


            bbox_distance = (
                point_to_bbox_xy_distance_mm(
                    beam_end,
                    bbox
                )
            )

            if (
                bbox_distance
                >
                BEAM_SUPPORT_TOLERANCE_MM
            ):
                continue


            # ------------------------------------------------
            # Confirm that the current beam endpoint is close
            # to the candidate beam LocationCurve, not merely
            # close to an oversized bounding box.
            # Curve.Project works for bounded Revit beam curves.
            # ------------------------------------------------

            projected_distance = None

            try:

                projection = candidate_curve.Project(
                    beam_end
                )

                if projection is not None:

                    projected_distance = distance_mm(
                        beam_end,
                        projection.XYZPoint
                    )

            except:
                projected_distance = None


            if projected_distance is None:
                continue


            # Allow the endpoint to stop at the physical face of
            # the girder rather than exactly at its centerline.
            if (
                projected_distance
                >
                BEAM_SUPPORT_TOLERANCE_MM
            ):
                continue


            center = XYZ(

                (
                    bbox.Min.X
                    +
                    bbox.Max.X
                ) / 2.0,

                (
                    bbox.Min.Y
                    +
                    bbox.Max.Y
                ) / 2.0,

                beam_end.Z
            )


            center_distance = distance_mm(
                beam_end,
                center
            )


            candidates.append([
                projected_distance,
                bbox_distance,
                center_distance,
                candidate,
                bbox,
                center
            ])


        except:
            pass


    if len(candidates) == 0:
        return None


    candidates.sort(
        key=lambda x: (
            x[0],
            x[1],
            x[2]
        )
    )


    selected = candidates[0]

    support_beam = selected[3]
    bbox = selected[4]
    center = selected[5]
    center_distance = selected[2]


    # ========================================================
    # PROJECT SUPPORTING BEAM BBOX ONTO CURRENT BEAM AXIS
    # ========================================================

    corners = [

        XYZ(
            bbox.Min.X,
            bbox.Min.Y,
            beam_end.Z
        ),

        XYZ(
            bbox.Min.X,
            bbox.Max.Y,
            beam_end.Z
        ),

        XYZ(
            bbox.Max.X,
            bbox.Min.Y,
            beam_end.Z
        ),

        XYZ(
            bbox.Max.X,
            bbox.Max.Y,
            beam_end.Z
        )
    ]


    projections = []


    for corner in corners:

        delta = corner.Subtract(
            beam_end
        )

        projections.append(
            delta.DotProduct(
                beam_direction
            )
        )


    minimum = min(projections)
    maximum = max(projections)


    if is_start:

        near_offset = maximum
        far_offset = minimum

    else:

        near_offset = minimum
        far_offset = maximum


    near_face = beam_end.Add(

        beam_direction.Multiply(
            near_offset
        )
    )


    far_face = beam_end.Add(

        beam_direction.Multiply(
            far_offset
        )
    )


    thickness_mm = abs(

        internal_to_mm(
            maximum - minimum
        )
    )


    return [

        support_beam,        # 0
        near_face,           # 1
        far_face,            # 2
        thickness_mm,        # 3
        center_distance,     # 4
        center               # 5
    ]


# ============================================================
# CONTINUATION BEAM DETECTION
# ============================================================

def find_continuation_beams(
    current_beam,
    target_end,
    current_direction
):

    current_id = id_value(
        current_beam
    )


    current_dir_xy = unit_xy(
        current_direction
    )


    if current_dir_xy is None:

        return []


    results = []


    for candidate in all_beams:

        candidate_id = id_value(
            candidate
        )


        if candidate_id == current_id:

            continue


        curve = get_beam_curve(
            candidate
        )


        if curve is None:

            continue


        try:

            p0 = curve.GetEndPoint(
                0
            )

            p1 = curve.GetEndPoint(
                1
            )

        except:
            continue


        candidate_direction = (
            p1.Subtract(
                p0
            )
        )


        candidate_dir_xy = unit_xy(
            candidate_direction
        )


        if candidate_dir_xy is None:

            continue


        # ====================================================
        # DIRECTION ALIGNMENT
        # ====================================================

        alignment = abs(

            current_dir_xy.DotProduct(
                candidate_dir_xy
            )
        )


        if alignment < CONTINUITY_ALIGNMENT:

            continue


        # ====================================================
        # ENDPOINT DISTANCE
        # ====================================================

        d0 = distance_mm(
            target_end,
            p0
        )

        d1 = distance_mm(
            target_end,
            p1
        )


        endpoint_distance = min(
            d0,
            d1
        )


        if (
            endpoint_distance
            >
            CONTINUITY_END_TOLERANCE_MM
        ):

            continue


        nearest = (
            p0
            if d0 <= d1
            else p1
        )


        # ====================================================
        # LATERAL OFFSET
        # ====================================================

        delta = nearest.Subtract(
            target_end
        )


        axial_component = (
            current_dir_xy.Multiply(

                delta.DotProduct(
                    current_dir_xy
                )
            )
        )


        lateral_component = (
            delta.Subtract(
                axial_component
            )
        )


        lateral_mm = internal_to_mm(
            lateral_component.GetLength()
        )


        if (
            lateral_mm
            >
            CONTINUITY_LATERAL_TOLERANCE_MM
        ):

            continue


        results.append(
            candidate_id
        )


    return results


# ============================================================
# READ B01
# ============================================================

b01 = IN[0]


try:

    b01_reports = as_list(
        b01[0]
    )


    b01_ready = bool(
        b01[7]
    )


except Exception as ex:

    OUT = [

        [],
        0,
        [],
        0,
        [],
        [],
        0,
        False,

        "INVALID B01 INPUT: {}".format(
            str(ex)
        )
    ]

    raise Exception(
        "Invalid B01 input."
    )


# ============================================================
# PROCESS BEAMS
# ============================================================

reports = []

ready_beams = []
ready_ids = []

failed_reports = []


for b01_report in b01_reports:

    errors = []


    try:

        beam_id = b01_report[0]

        b01_beam_ready = bool(
            b01_report[1]
        )

        beam = unwrap(
            b01_report[9]
        )


    except Exception as ex:

        failure = [

            None,
            False,
            "FAILED",

            [
                "Invalid B01 report: {}".format(
                    str(ex)
                )
            ],

            None,
            None,

            None,
            None,

            None,
            None,

            None,
            None,

            None,
            None,

            False,
            False,

            [],
            [],

            None,

            b01_report
        ]


        reports.append(
            failure
        )

        failed_reports.append(
            failure
        )

        continue


    # ========================================================
    # B01 READY CHECK
    # ========================================================

    if not b01_beam_ready:

        failure = [

            beam_id,
            False,
            "FAILED",

            [
                "Beam failed B01 preflight."
            ],

            None,
            None,

            None,
            None,

            None,
            None,

            None,
            None,

            None,
            None,

            False,
            False,

            [],
            [],

            beam,

            b01_report
        ]


        reports.append(
            failure
        )

        failed_reports.append(
            failure
        )

        continue


    # ========================================================
    # BEAM GEOMETRY
    # ========================================================

    curve = get_beam_curve(
        beam
    )


    if curve is None:

        errors.append(
            "Beam LocationCurve not found."
        )


        p0 = None
        p1 = None
        direction = None


    else:

        try:

            p0 = curve.GetEndPoint(
                0
            )

            p1 = curve.GetEndPoint(
                1
            )


            direction = (

                p1.Subtract(
                    p0
                )
                .Normalize()
            )


        except:

            p0 = None
            p1 = None
            direction = None


            errors.append(
                "Could not determine beam endpoints."
            )


    # ========================================================
    # SUPPORTS
    # ========================================================

    start_support = None
    end_support = None


    if (
        p0 is not None
        and
        direction is not None
    ):

        start_support = detect_column_support(

            p0,
            direction,
            True
        )

        # No column: try a transverse beam/girder support.
        if start_support is None:

            start_support = detect_beam_support(

                beam,
                p0,
                direction,
                True
            )


    if (
        p1 is not None
        and
        direction is not None
    ):

        end_support = detect_column_support(

            p1,
            direction,
            False
        )

        # No column: try a transverse beam/girder support.
        if end_support is None:

            end_support = detect_beam_support(

                beam,
                p1,
                direction,
                False
            )


    # ========================================================
    # SUPPORT VALIDATION
    #
    # A beam end does not require a column when a valid
    # continuation beam exists at that end.
    # Final validation is performed after continuity detection.
    # ========================================================


    # ========================================================
    # START DATA
    # ========================================================

    if start_support is not None:

        start_column_id = id_value(
            start_support[0]
        )

        start_near = xyz_to_mm(
            start_support[1]
        )

        start_far = xyz_to_mm(
            start_support[2]
        )

        start_thickness = (
            start_support[3]
        )

        start_center_distance = (
            start_support[4]
        )


    else:

        start_column_id = None

        start_near = None
        start_far = None

        start_thickness = None
        start_center_distance = None


    # ========================================================
    # END DATA
    # ========================================================

    if end_support is not None:

        end_column_id = id_value(
            end_support[0]
        )

        end_near = xyz_to_mm(
            end_support[1]
        )

        end_far = xyz_to_mm(
            end_support[2]
        )

        end_thickness = (
            end_support[3]
        )

        end_center_distance = (
            end_support[4]
        )


    else:

        end_column_id = None

        end_near = None
        end_far = None

        end_thickness = None
        end_center_distance = None


    # ========================================================
    # CONTINUITY
    # ========================================================

    if (
        p0 is not None
        and
        direction is not None
    ):

        start_continuation_ids = (
            find_continuation_beams(

                beam,
                p0,
                direction
            )
        )

    else:

        start_continuation_ids = []


    if (
        p1 is not None
        and
        direction is not None
    ):

        end_continuation_ids = (
            find_continuation_beams(

                beam,
                p1,
                direction
            )
        )

    else:

        end_continuation_ids = []


    start_continuous = (
        len(start_continuation_ids) > 0
    )


    end_continuous = (
        len(end_continuation_ids) > 0
    )


    # ========================================================
    # END-CONDITION VALIDATION
    #
    # An end is valid when either:
    # 1. a structural column is detected, or
    # 2. a continuation beam is detected.
    # ========================================================

    start_has_column = (
        start_support is not None
    )

    end_has_column = (
        end_support is not None
    )

    if (
        not start_has_column
        and
        not start_continuous
    ):
        errors.append(
            "Start end unresolved: no column, supporting beam/girder, or continuation beam found."
        )

    if (
        not end_has_column
        and
        not end_continuous
    ):
        errors.append(
            "End end unresolved: no column, supporting beam/girder, or continuation beam found."
        )


    # ========================================================
    # RESULT
    # ========================================================

    ready = (
        len(errors) == 0
    )


    status = (
        "READY"
        if ready
        else "FAILED"
    )


    report = [

        beam_id,                       # 0

        ready,                         # 1
        status,                        # 2

        errors,                        # 3

        start_column_id,               # 4
        end_column_id,                 # 5

        start_near,                    # 6
        start_far,                     # 7

        end_near,                      # 8
        end_far,                       # 9

        start_thickness,               # 10
        end_thickness,                 # 11

        start_center_distance,         # 12
        end_center_distance,           # 13

        start_continuous,              # 14
        end_continuous,                # 15

        start_continuation_ids,        # 16
        end_continuation_ids,          # 17

        beam,                          # 18

        b01_report                     # 19
    ]


    reports.append(
        report
    )


    if ready:

        ready_beams.append(
            beam
        )

        ready_ids.append(
            beam_id
        )


    else:

        failed_reports.append(
            report
        )


# ============================================================
# FINAL STATUS
# ============================================================

overall_ready = (

    b01_ready

    and

    len(reports) > 0

    and

    len(failed_reports) == 0
)


if overall_ready:

    final_status = (
        "B02 SUPPORT/CONTINUITY COMPLETE"
    )

else:

    final_status = (
        "B02 SUPPORT/CONTINUITY FAILED"
    )


OUT = [

    reports,                       # 0

    len(b01_reports),              # 1

    ready_beams,                   # 2

    len(ready_beams),              # 3

    ready_ids,                     # 4

    failed_reports,                # 5

    len(failed_reports),           # 6

    overall_ready,                 # 7

    final_status                   # 8
]   
# ----------------------------------------
watch = Watch(B02)
B03 = Python(IN[0]=B02)  # CPython3
# ---------- B03.python (2804 lines) ----------
import clr
import math

clr.AddReference("RevitAPI")
clr.AddReference("RevitServices")
clr.AddReference("RevitNodes")

import Revit
clr.ImportExtensions(Revit.Elements)

from Autodesk.Revit.DB import *
from Autodesk.Revit.DB.Structure import *
from RevitServices.Persistence import DocumentManager
from RevitServices.Transactions import TransactionManager
from System.Collections.Generic import List

doc = DocumentManager.Instance.CurrentDBDocument


# ============================================================
# B03 — SELECTED BEAM TYPE AUTO-REBAR GENERATOR
#
# IN[0] = ENTIRE B02 OUTPUT
#
# ------------------------------------------------------------
# B02 PER-BEAM REPORT
#
# [0]  Beam ID
# [1]  Ready
# [2]  Status
# [3]  Errors
#
# [4]  Start Column ID
# [5]  End Column ID
#
# [6]  Start Near Face
# [7]  Start Far Face
#
# [8]  End Near Face
# [9]  End Far Face
#
# [10] Start Support Thickness
# [11] End Support Thickness
#
# [12] Start Center Distance
# [13] End Center Distance
#
# [14] Start Continuous
# [15] End Continuous
#
# [16] Start Continuation IDs
# [17] End Continuation IDs
#
# [18] Beam
# [19] Original B01 Report
#
#
# ------------------------------------------------------------
# B01 PER-BEAM REPORT
#
# [0] Beam ID
# [1] Ready
# [2] Status
# [3] Errors
# [4] Warnings
#
# [5] [Length, Width, Depth]
#
# [6] [
#       TopQty,
#       BottomQty,
#       TopDia,
#       BottomDia
#     ]
#
# [7] [
#       ContinuousQty,
#       ExtraQty,
#       SupportExtraLayer,
#       MidspanExtraLayer
#     ]
#
# [8] [
#       StirrupDia,
#       Cover,
#       EndSpacing,
#       MidSpacing
#     ]
#
# [9] Beam
#
#
# ------------------------------------------------------------
# NOMINAL BAR INPUT MAPPING
#
# Dynamo input uses nominal metric sizes:
#
# 10, 12, 16, 20, 25, 32 mm
#
# Current Revit template contains imperial-derived diameters:
#
# 9.5, 12.7, 15.9, 19.1, 25.4, 31.8 mm
#
# B03 maps nominal user input to the actual Revit diameter.
# ============================================================


# ============================================================
# HELPERS
# ============================================================

def as_list(value):

    if value is None:
        return []

    if isinstance(value, list):
        return value

    try:
        return list(value)
    except:
        return [value]


def unwrap(element):

    try:
        return UnwrapElement(element)
    except:
        return element


def element_id_value(element):

    if element is None:
        return None

    try:
        return int(element.Id.Value)
    except:
        pass

    try:
        return int(element.Id.IntegerValue)
    except:
        return None


# ============================================================
# UNITS
# ============================================================

def mm_to_internal(value):

    return UnitUtils.ConvertToInternalUnits(
        float(value),
        UnitTypeId.Millimeters
    )


def internal_to_mm(value):

    return UnitUtils.ConvertFromInternalUnits(
        value,
        UnitTypeId.Millimeters
    )


def xyz_to_mm(point):

    return [
        internal_to_mm(point.X),
        internal_to_mm(point.Y),
        internal_to_mm(point.Z)
    ]


def mm_to_xyz(point):

    return XYZ(
        mm_to_internal(point[0]),
        mm_to_internal(point[1]),
        mm_to_internal(point[2])
    )


# ============================================================
# VECTOR / POINT HELPERS
# ============================================================

def move_point(
    point,
    direction,
    distance
):

    return [
        point[0] + direction[0] * distance,
        point[1] + direction[1] * distance,
        point[2] + direction[2] * distance
    ]


def midpoint(
    p1,
    p2
):

    return [
        (p1[0] + p2[0]) / 2.0,
        (p1[1] + p2[1]) / 2.0,
        (p1[2] + p2[2]) / 2.0
    ]


# ============================================================
# COMMENTS
# ============================================================

def set_comments(
    element,
    text
):

    try:

        p = element.get_Parameter(
            BuiltInParameter.ALL_MODEL_INSTANCE_COMMENTS
        )

        if (
            p is not None
            and
            not p.IsReadOnly
        ):

            p.Set(text)

            return

    except:
        pass


    try:

        p = element.LookupParameter(
            "Comments"
        )

        if (
            p is not None
            and
            not p.IsReadOnly
        ):

            p.Set(text)

    except:
        pass


# ============================================================
# FIND REBAR TYPE BY DIAMETER
#
# IMPORTANT:
#
# User enters nominal metric diameter.
#
# Example:
#
# 20 mm input
#
# Actual Revit bar:
#
# 19.1 mm
#
# Therefore:
#
# 20 -> 19.1
# ============================================================

def get_bar_diameter(
    bar_type
):

    try:
        return bar_type.BarDiameter
    except:
        pass


    try:

        p = bar_type.get_Parameter(
            BuiltInParameter.REBAR_BAR_DIAMETER
        )

        if p is not None:
            return p.AsDouble()

    except:
        pass


    return None


def get_bar_type_name(
    bar_type
):

    try:

        p = bar_type.get_Parameter(
            BuiltInParameter.SYMBOL_NAME_PARAM
        )

        if p is not None:

            value = p.AsString()

            if value:
                return value

    except:
        pass


    try:

        return Element.Name.GetValue(
            bar_type
        )

    except:
        pass


    try:

        return bar_type.Name

    except:
        pass


    return "Unnamed"


def nominal_to_revit_diameter(
    diameter_mm
):

    requested = float(
        diameter_mm
    )


    diameter_map = {

        10.0: 9.5,

        12.0: 12.7,

        16.0: 15.9,

        20.0: 19.1,

        25.0: 25.4,

        32.0: 31.8
    }


    for nominal, actual in diameter_map.items():

        if abs(
            requested - nominal
        ) <= 0.10:

            return actual


    # Allow actual Revit diameter to be entered directly.
    return requested


def available_bar_diameters():

    result = []


    bar_types = (
        FilteredElementCollector(doc)
        .OfClass(RebarBarType)
        .ToElements()
    )


    for bar_type in bar_types:

        diameter = get_bar_diameter(
            bar_type
        )


        if diameter is None:
            continue


        diameter_mm = internal_to_mm(
            diameter
        )


        name = get_bar_type_name(
            bar_type
        )


        result.append([
            name,
            round(diameter_mm, 3)
        ])


    result.sort(
        key=lambda x: x[1]
    )


    return result


def find_bar_type(
    diameter_mm
):

    requested = float(
        diameter_mm
    )


    search_diameter_mm = (
        nominal_to_revit_diameter(
            requested
        )
    )


    target = mm_to_internal(
        search_diameter_mm
    )


    # Mapping already compensates for nominal vs actual diameter.
    tolerance = mm_to_internal(
        0.25
    )


    bar_types = (
        FilteredElementCollector(doc)
        .OfClass(RebarBarType)
        .ToElements()
    )


    best_type = None
    best_difference = None


    for bar_type in bar_types:

        diameter = get_bar_diameter(
            bar_type
        )


        if diameter is None:
            continue


        difference = abs(
            diameter - target
        )


        if (
            best_difference is None
            or
            difference < best_difference
        ):

            best_difference = difference
            best_type = bar_type


        if difference <= tolerance:

            return bar_type


    return None


# ============================================================
# FIND 135 DEGREE HOOK
# ============================================================

def find_135_hook():

    target = math.radians(
        135.0
    )

    tolerance = math.radians(
        0.5
    )


    hook_types = (
        FilteredElementCollector(doc)
        .OfClass(RebarHookType)
        .ToElements()
    )


    for hook in hook_types:

        try:

            if abs(
                hook.HookAngle - target
            ) <= tolerance:

                return hook

        except:
            pass


    return None


hook_135 = find_135_hook()


# ============================================================
# DELETE EXISTING REBAR HOSTED BY BEAM
#
# IMPORTANT:
# Only reinforcement hosted by the selected beam is removed.
#
# It does NOT clear unrelated project reinforcement.
# ============================================================

def clear_hosted_rebar(
    beam
):

    rebar_elements = (
        FilteredElementCollector(doc)
        .OfClass(Rebar)
        .WhereElementIsNotElementType()
        .ToElements()
    )


    ids = []


    for rebar in rebar_elements:

        try:

            if rebar.GetHostId() == beam.Id:

                ids.append(
                    rebar.Id
                )

        except:
            pass


    count = len(
        ids
    )


    for rid in ids:

        doc.Delete(
            rid
        )


    return count


# ============================================================
# TRANSVERSE BAR POSITIONING
# ============================================================

def evenly_spaced_offsets(
    quantity,
    beam_width,
    centerline_cover
):

    if quantity <= 0:

        return []


    usable_width = (
        beam_width
        - 2.0 * centerline_cover
    )


    if usable_width <= 0:

        raise Exception(
            "No usable width remains for longitudinal reinforcement."
        )


    if quantity == 1:

        return [
            0.0
        ]


    spacing = (
        usable_width
        /
        float(
            quantity - 1
        )
    )


    offsets = []


    for i in range(
        quantity
    ):

        offsets.append(
            -usable_width / 2.0
            + spacing * i
        )


    return offsets


def get_bar_offsets(
    top_qty,
    bottom_qty,
    beam_width,
    centerline_cover
):

    maximum_qty = max(
        top_qty,
        bottom_qty
    )


    continuous_qty = min(
        top_qty,
        bottom_qty
    )


    all_offsets = evenly_spaced_offsets(
        maximum_qty,
        beam_width,
        centerline_cover
    )


    if maximum_qty == continuous_qty:

        return (
            list(all_offsets),
            []
        )


    continuous_indices = []


    if continuous_qty == 1:

        continuous_indices = [

            int(
                round(
                    (
                        maximum_qty - 1
                    ) / 2.0
                )
            )
        ]


    else:

        for i in range(
            continuous_qty
        ):

            raw = (
                float(i)
                *
                float(
                    maximum_qty - 1
                )
                /
                float(
                    continuous_qty - 1
                )
            )


            index = int(
                round(raw)
            )


            if index not in continuous_indices:

                continuous_indices.append(
                    index
                )


    if len(
        continuous_indices
    ) < continuous_qty:

        for i in range(
            maximum_qty
        ):

            if i not in continuous_indices:

                continuous_indices.append(
                    i
                )


            if len(
                continuous_indices
            ) >= continuous_qty:

                break


    continuous_indices = sorted(
        continuous_indices
    )


    continuous_offsets = []
    extra_offsets = []


    for i, offset in enumerate(
        all_offsets
    ):

        if i in continuous_indices:

            continuous_offsets.append(
                offset
            )

        else:

            extra_offsets.append(
                offset
            )


    return (
        continuous_offsets,
        extra_offsets
    )


# ============================================================
# STANDARD REBAR CREATION
# ============================================================

def create_standard_rebar(
    beam,
    bar_type,
    normal,
    points
):

    curves = List[Curve]()


    for i in range(
        len(points) - 1
    ):

        p1 = mm_to_xyz(
            points[i]
        )

        p2 = mm_to_xyz(
            points[i + 1]
        )


        if p1.DistanceTo(p2) <= 0.000001:

            continue


        curves.Add(
            Line.CreateBound(
                p1,
                p2
            )
        )


    if curves.Count == 0:

        raise Exception(
            "No valid longitudinal rebar curves."
        )


    rebar = Rebar.CreateFromCurves(

        doc,

        RebarStyle.Standard,

        bar_type,

        None,
        None,

        beam,

        normal,

        curves,

        RebarHookOrientation.Left,
        RebarHookOrientation.Right,

        False,
        True
    )


    if rebar is None:

        raise Exception(
            "Revit failed to create longitudinal reinforcement."
        )


    return rebar


# ============================================================
# CONTINUOUS BAR GEOMETRY
# ============================================================

def continuous_bar_points(
    start_axis,
    end_axis,
    transverse_offset,
    elevation,
    local_y,
    is_top,
    start_hook,
    end_hook,
    hook_leg
):

    start = [

        start_axis[0]
        + local_y[0] * transverse_offset,

        start_axis[1]
        + local_y[1] * transverse_offset,

        elevation
    ]


    end = [

        end_axis[0]
        + local_y[0] * transverse_offset,

        end_axis[1]
        + local_y[1] * transverse_offset,

        elevation
    ]


    points = []


    if start_hook:

        if is_top:

            hook_point = [

                start[0],
                start[1],

                start[2]
                - hook_leg
            ]

        else:

            hook_point = [

                start[0],
                start[1],

                start[2]
                + hook_leg
            ]


        points.append(
            hook_point
        )


    points.append(
        start
    )


    points.append(
        end
    )


    if end_hook:

        if is_top:

            hook_point = [

                end[0],
                end[1],

                end[2]
                - hook_leg
            ]

        else:

            hook_point = [

                end[0],
                end[1],

                end[2]
                + hook_leg
            ]


        points.append(
            hook_point
        )


    return points


# ============================================================
# SUPPORT EXTRA BAR
# ============================================================

def support_extra_points(
    support_anchor,
    cutoff,
    transverse_offset,
    elevation,
    local_y,
    is_top,
    hook_required,
    hook_leg,
    is_start
):

    anchor = [

        support_anchor[0]
        + local_y[0] * transverse_offset,

        support_anchor[1]
        + local_y[1] * transverse_offset,

        elevation
    ]


    cutoff_point = [

        cutoff[0]
        + local_y[0] * transverse_offset,

        cutoff[1]
        + local_y[1] * transverse_offset,

        elevation
    ]


    if is_top:

        hook_point = [

            anchor[0],
            anchor[1],

            anchor[2]
            - hook_leg
        ]

    else:

        hook_point = [

            anchor[0],
            anchor[1],

            anchor[2]
            + hook_leg
        ]


    if is_start:

        if hook_required:

            return [
                hook_point,
                anchor,
                cutoff_point
            ]

        else:

            return [
                anchor,
                cutoff_point
            ]


    else:

        if hook_required:

            return [
                cutoff_point,
                anchor,
                hook_point
            ]

        else:

            return [
                cutoff_point,
                anchor
            ]


# ============================================================
# MIDSPAN EXTRA BAR
# ============================================================

def midspan_extra_points(
    quarter,
    three_quarter,
    transverse_offset,
    elevation,
    local_y
):

    return [

        [

            quarter[0]
            + local_y[0] * transverse_offset,

            quarter[1]
            + local_y[1] * transverse_offset,

            elevation
        ],

        [

            three_quarter[0]
            + local_y[0] * transverse_offset,

            three_quarter[1]
            + local_y[1] * transverse_offset,

            elevation
        ]
    ]


# ============================================================
# STIRRUP CURVES
# ============================================================

def stirrup_curve_list(
    points
):

    curves = List[Curve]()


    for i in range(
        len(points) - 1
    ):

        curves.Add(

            Line.CreateBound(

                mm_to_xyz(
                    points[i]
                ),

                mm_to_xyz(
                    points[i + 1]
                )
            )
        )


    return curves


# ============================================================
# CREATE STIRRUP ZONE
# ============================================================

def create_stirrup_zone(
    beam,
    stirrup_type,
    beam_direction_xyz,
    beam_direction,
    base_shape,
    base_location,
    zone_start,
    zone_length,
    spacing,
    tag
):

    if zone_length <= 0:

        return None


    shift = (
        zone_start
        - base_location
    )


    moved_shape = []


    for point in base_shape:

        moved_shape.append([

            point[0]
            + beam_direction[0] * shift,

            point[1]
            + beam_direction[1] * shift,

            point[2]
            + beam_direction[2] * shift
        ])


    curves = stirrup_curve_list(
        moved_shape
    )


    rebar = Rebar.CreateFromCurves(

        doc,

        RebarStyle.StirrupTie,

        stirrup_type,

        hook_135,
        hook_135,

        beam,

        beam_direction_xyz,

        curves,

        RebarHookOrientation.Left,
        RebarHookOrientation.Left,

        True,
        True
    )


    if rebar is None:

        raise Exception(
            "Revit failed to create stirrup reinforcement."
        )


    accessor = (
        rebar.GetShapeDrivenAccessor()
    )


    accessor.SetLayoutAsMaximumSpacing(

        mm_to_internal(
            spacing
        ),

        mm_to_internal(
            zone_length
        ),

        True,
        True,
        True
    )


    set_comments(
        rebar,
        tag
    )


    return rebar


# ============================================================
# PROCESS ONE BEAM
# ============================================================

def process_beam(
    b02_report
):

    beam_id = b02_report[0]


    beam = unwrap(
        b02_report[18]
    )


    b01_report = b02_report[19]


    # ========================================================
    # CONFIG FROM B01
    # ========================================================

    length_mm = float(
        b01_report[5][0]
    )

    beam_width = float(
        b01_report[5][1]
    )

    beam_depth = float(
        b01_report[5][2]
    )


    top_qty = int(
        b01_report[6][0]
    )

    bottom_qty = int(
        b01_report[6][1]
    )

    top_dia = float(
        b01_report[6][2]
    )

    bottom_dia = float(
        b01_report[6][3]
    )


    continuous_qty = int(
        b01_report[7][0]
    )

    extra_qty = int(
        b01_report[7][1]
    )

    support_extra_layer = str(
        b01_report[7][2]
    )

    midspan_extra_layer = str(
        b01_report[7][3]
    )


    stirrup_dia = float(
        b01_report[8][0]
    )

    cover = float(
        b01_report[8][1]
    )

    end_spacing = float(
        b01_report[8][2]
    )

    mid_spacing = float(
        b01_report[8][3]
    )


    # ========================================================
    # B02 SUPPORT INFORMATION
    # ========================================================

    start_near = b02_report[6]
    start_far = b02_report[7]

    end_near = b02_report[8]
    end_far = b02_report[9]


    start_continuous = bool(
        b02_report[14]
    )

    end_continuous = bool(
        b02_report[15]
    )


    start_hook_required = (
        not start_continuous
    )

    end_hook_required = (
        not end_continuous
    )


    # ========================================================
    # VALIDATION
    # ========================================================

    if beam is None:

        raise Exception(
            "Beam could not be resolved."
        )


    if start_near is None or start_far is None:

        raise Exception(
            "Start support geometry is invalid."
        )


    if end_near is None or end_far is None:

        raise Exception(
            "End support geometry is invalid."
        )


    if top_qty < 2:

        raise Exception(
            "TopQty must be at least 2."
        )


    if bottom_qty < 2:

        raise Exception(
            "BottomQty must be at least 2."
        )


    if abs(
        top_dia - bottom_dia
    ) > 0.5:

        raise Exception(
            "Current B03 requires TopDia and BottomDia to match."
        )


    if hook_135 is None:

        raise Exception(
            "No 135 degree RebarHookType found."
        )


    # ========================================================
    # BAR TYPES
    # ========================================================

    main_dia = top_dia


    main_type = find_bar_type(
        main_dia
    )


    stirrup_type = find_bar_type(
        stirrup_dia
    )


    if main_type is None:

        search_dia = nominal_to_revit_diameter(
            main_dia
        )

        raise Exception(

            "No RebarBarType found. "
            "Requested nominal diameter = {:.1f} mm; "
            "searched Revit diameter = {:.1f} mm; "
            "available Revit bars = {}"
            .format(
                main_dia,
                search_dia,
                available_bar_diameters()
            )
        )


    if stirrup_type is None:

        search_dia = nominal_to_revit_diameter(
            stirrup_dia
        )

        raise Exception(

            "No RebarBarType found for stirrup. "
            "Requested nominal diameter = {:.1f} mm; "
            "searched Revit diameter = {:.1f} mm; "
            "available Revit bars = {}"
            .format(
                stirrup_dia,
                search_dia,
                available_bar_diameters()
            )
        )


    # ========================================================
    # BEAM GEOMETRY
    # ========================================================

    try:

        curve = beam.Location.Curve

    except:

        curve = None


    if curve is None:

        raise Exception(
            "Beam has no LocationCurve."
        )


    start_xyz = curve.GetEndPoint(
        0
    )

    end_xyz = curve.GetEndPoint(
        1
    )


    beam_start = xyz_to_mm(
        start_xyz
    )


    direction_xyz = (
        end_xyz
        .Subtract(
            start_xyz
        )
        .Normalize()
    )


    local_x = [

        direction_xyz.X,
        direction_xyz.Y,
        direction_xyz.Z
    ]


    global_z = XYZ(
        0.0,
        0.0,
        1.0
    )


    local_y_xyz = (
        global_z.CrossProduct(
            direction_xyz
        )
    )


    if local_y_xyz.GetLength() <= 0.000001:

        raise Exception(
            "Could not determine beam transverse direction."
        )


    local_y_xyz = (
        local_y_xyz.Normalize()
    )


    local_y = [

        local_y_xyz.X,
        local_y_xyz.Y,
        local_y_xyz.Z
    ]


    # ========================================================
    # COVER / BAR CENTERLINES
    # ========================================================

    longitudinal_center_cover = (

        cover
        + stirrup_dia
        + main_dia / 2.0
    )


    stirrup_center_cover = (

        cover
        + stirrup_dia / 2.0
    )


    far_side_clearance = (

        cover
        + main_dia / 2.0
    )


    hook_leg = (

        12.0
        * main_dia
    )


    # ========================================================
    # MAIN BAR ELEVATIONS
    # ========================================================

    top_z = (

        beam_start[2]
        - longitudinal_center_cover
    )


    bottom_z = (

        beam_start[2]
        - beam_depth
        + longitudinal_center_cover
    )


    # ========================================================
    # SUPPORT MAIN BAR AXES
    # ========================================================

    if start_hook_required:

        start_main_axis = move_point(

            start_far,

            local_x,

            far_side_clearance
        )

    else:

        start_main_axis = list(
            start_far
        )


    if end_hook_required:

        end_main_axis = move_point(

            end_far,

            local_x,

            -far_side_clearance
        )

    else:

        end_main_axis = list(
            end_far
        )


    # ========================================================
    # COLUMN CENTERS
    # ========================================================

    start_column_center = midpoint(

        start_near,
        start_far
    )


    end_column_center = midpoint(

        end_near,
        end_far
    )


    # ========================================================
    # SUPPORT EXTRA ANCHORS
    # ========================================================

    if start_continuous:

        start_extra_anchor = (
            start_column_center
        )

    else:

        start_extra_anchor = (
            start_main_axis
        )


    if end_continuous:

        end_extra_anchor = (
            end_column_center
        )

    else:

        end_extra_anchor = (
            end_main_axis
        )


    # ========================================================
    # L/4 LOCATIONS
    # ========================================================

    quarter_point = move_point(

        beam_start,

        local_x,

        length_mm / 4.0
    )


    three_quarter_point = move_point(

        beam_start,

        local_x,

        length_mm * 0.75
    )


    # ========================================================
    # BAR POSITIONS
    # ========================================================

    (
        continuous_offsets,
        extra_offsets
    ) = get_bar_offsets(

        top_qty,
        bottom_qty,

        beam_width,
        longitudinal_center_cover
    )


    if len(
        continuous_offsets
    ) != continuous_qty:

        raise Exception(
            "Continuous bar offset count mismatch."
        )


    if len(
        extra_offsets
    ) != extra_qty:

        raise Exception(
            "Extra bar offset count mismatch."
        )


    # ========================================================
    # DELETE EXISTING REBAR
    # ========================================================

    deleted_count = clear_hosted_rebar(
        beam
    )


    tag_prefix = (

        "AUTO_BEAM_REBAR:"
        + str(
            beam_id
        )
        + ":"
    )


    created_top_cont = []
    created_bottom_cont = []
    created_start_extra = []
    created_end_extra = []
    created_mid_extra = []
    created_stirrups = []


    # ========================================================
    # CONTINUOUS TOP
    # ========================================================

    for offset in continuous_offsets:

        points = continuous_bar_points(

            start_main_axis,
            end_main_axis,

            offset,

            top_z,

            local_y,

            True,

            start_hook_required,
            end_hook_required,

            hook_leg
        )


        rebar = create_standard_rebar(

            beam,
            main_type,
            local_y_xyz,
            points
        )


        set_comments(

            rebar,

            tag_prefix
            + "TOP_CONT"
        )


        created_top_cont.append(
            rebar
        )


    # ========================================================
    # CONTINUOUS BOTTOM
    # ========================================================

    for offset in continuous_offsets:

        points = continuous_bar_points(

            start_main_axis,
            end_main_axis,

            offset,

            bottom_z,

            local_y,

            False,

            start_hook_required,
            end_hook_required,

            hook_leg
        )


        rebar = create_standard_rebar(

            beam,
            main_type,
            local_y_xyz,
            points
        )


        set_comments(

            rebar,

            tag_prefix
            + "BOTTOM_CONT"
        )


        created_bottom_cont.append(
            rebar
        )


    # ========================================================
    # SUPPORT EXTRAS
    # ========================================================

    if extra_qty > 0:

        support_is_top = (

            support_extra_layer.upper()
            == "TOP"
        )


        support_z = (

            top_z
            if support_is_top
            else bottom_z
        )


        for offset in extra_offsets:

            points = support_extra_points(

                start_extra_anchor,

                quarter_point,

                offset,

                support_z,

                local_y,

                support_is_top,

                start_hook_required,

                hook_leg,

                True
            )


            rebar = create_standard_rebar(

                beam,
                main_type,
                local_y_xyz,
                points
            )


            set_comments(

                rebar,

                tag_prefix
                + support_extra_layer
                + "_EXTRA_START"
            )


            created_start_extra.append(
                rebar
            )


        for offset in extra_offsets:

            points = support_extra_points(

                end_extra_anchor,

                three_quarter_point,

                offset,

                support_z,

                local_y,

                support_is_top,

                end_hook_required,

                hook_leg,

                False
            )


            rebar = create_standard_rebar(

                beam,
                main_type,
                local_y_xyz,
                points
            )


            set_comments(

                rebar,

                tag_prefix
                + support_extra_layer
                + "_EXTRA_END"
            )


            created_end_extra.append(
                rebar
            )


    # ========================================================
    # MIDSPAN EXTRAS
    # ========================================================

    if extra_qty > 0:

        midspan_is_top = (

            midspan_extra_layer.upper()
            == "TOP"
        )


        midspan_z = (

            top_z
            if midspan_is_top
            else bottom_z
        )


        for offset in extra_offsets:

            points = midspan_extra_points(

                quarter_point,
                three_quarter_point,

                offset,

                midspan_z,

                local_y
            )


            rebar = create_standard_rebar(

                beam,
                main_type,
                local_y_xyz,
                points
            )


            set_comments(

                rebar,

                tag_prefix
                + midspan_extra_layer
                + "_EXTRA_MID"
            )


            created_mid_extra.append(
                rebar
            )


    # ========================================================
    # STIRRUP GEOMETRY
    # ========================================================

    end_clearance = (

        cover
        + stirrup_dia / 2.0
    )


    usable_length = (

        length_mm
        - 2.0 * end_clearance
    )


    if usable_length <= 0:

        raise Exception(
            "Invalid stirrup usable length."
        )


    end_zone = (

        2.0
        * beam_depth
    )


    maximum_end_zone = (

        usable_length / 2.0
    )


    left_zone_length = min(

        end_zone,
        maximum_end_zone
    )


    right_zone_length = min(

        end_zone,
        maximum_end_zone
    )


    middle_zone_length = (

        usable_length
        - left_zone_length
        - right_zone_length
    )


    if middle_zone_length < 0:

        middle_zone_length = 0.0


    left_zone_start = (
        end_clearance
    )


    middle_zone_start = (

        left_zone_start
        + left_zone_length
    )


    right_zone_start = (

        middle_zone_start
        + middle_zone_length
    )


    first_stirrup_axis = move_point(

        beam_start,

        local_x,

        end_clearance
    )


    half_stirrup_width = (

        beam_width / 2.0
        - stirrup_center_cover
    )


    left_side = move_point(

        first_stirrup_axis,

        local_y,

        -half_stirrup_width
    )


    right_side = move_point(

        first_stirrup_axis,

        local_y,

        half_stirrup_width
    )


    stirrup_top_z = (

        beam_start[2]
        - stirrup_center_cover
    )


    stirrup_bottom_z = (

        beam_start[2]
        - beam_depth
        + stirrup_center_cover
    )


    p1 = [

        left_side[0],
        left_side[1],
        stirrup_bottom_z
    ]


    p2 = [

        right_side[0],
        right_side[1],
        stirrup_bottom_z
    ]


    p3 = [

        right_side[0],
        right_side[1],
        stirrup_top_z
    ]


    p4 = [

        left_side[0],
        left_side[1],
        stirrup_top_z
    ]


    base_stirrup_shape = [

        p1,
        p2,
        p3,
        p4,
        p1
    ]


    # ========================================================
    # LEFT STIRRUP ZONE
    # ========================================================

    left_set = create_stirrup_zone(

        beam,
        stirrup_type,

        direction_xyz,
        local_x,

        base_stirrup_shape,

        end_clearance,

        left_zone_start,
        left_zone_length,

        end_spacing,

        tag_prefix
        + "STIRRUP_LEFT"
    )


    if left_set is not None:

        created_stirrups.append(
            left_set
        )


    # ========================================================
    # MIDDLE STIRRUP ZONE
    # ========================================================

    if middle_zone_length > 0:

        middle_set = create_stirrup_zone(

            beam,
            stirrup_type,

            direction_xyz,
            local_x,

            base_stirrup_shape,

            end_clearance,

            middle_zone_start,
            middle_zone_length,

            mid_spacing,

            tag_prefix
            + "STIRRUP_MID"
        )


        if middle_set is not None:

            created_stirrups.append(
                middle_set
            )


    # ========================================================
    # RIGHT STIRRUP ZONE
    # ========================================================

    right_set = create_stirrup_zone(

        beam,
        stirrup_type,

        direction_xyz,
        local_x,

        base_stirrup_shape,

        end_clearance,

        right_zone_start,
        right_zone_length,

        end_spacing,

        tag_prefix
        + "STIRRUP_RIGHT"
    )


    if right_set is not None:

        created_stirrups.append(
            right_set
        )


    # ========================================================
    # CREATION VALIDATION
    # ========================================================

    if len(
        created_top_cont
    ) != continuous_qty:

        raise Exception(
            "Top continuous count mismatch."
        )


    if len(
        created_bottom_cont
    ) != continuous_qty:

        raise Exception(
            "Bottom continuous count mismatch."
        )


    if len(
        created_start_extra
    ) != extra_qty:

        raise Exception(
            "Start extra count mismatch."
        )


    if len(
        created_end_extra
    ) != extra_qty:

        raise Exception(
            "End extra count mismatch."
        )


    if len(
        created_mid_extra
    ) != extra_qty:

        raise Exception(
            "Midspan extra count mismatch."
        )


    if len(
        created_stirrups
    ) < 2:

        raise Exception(
            "Stirrup zones were not created correctly."
        )


    # ========================================================
    # RESULTING CROSS SECTIONS
    # ========================================================

    support_section = [

        top_qty,
        bottom_qty
    ]


    midspan_section = [

        bottom_qty,
        top_qty
    ]


    # ========================================================
    # SUCCESS REPORT
    # ========================================================

    return [

        beam_id,                       # 0

        True,                          # 1

        "SUCCESS",                     # 2

        deleted_count,                 # 3

        len(created_top_cont),          # 4

        len(created_bottom_cont),       # 5

        len(created_start_extra),       # 6

        len(created_end_extra),         # 7

        len(created_mid_extra),         # 8

        len(created_stirrups),          # 9

        start_continuous,               # 10
        end_continuous,                 # 11

        start_hook_required,            # 12
        end_hook_required,              # 13

        main_dia,                       # 14

        stirrup_dia,                    # 15

        top_qty,                        # 16

        bottom_qty,                     # 17

        continuous_qty,                 # 18

        extra_qty,                      # 19

        support_extra_layer,            # 20

        midspan_extra_layer,            # 21

        support_section,                # 22

        midspan_section,                # 23

        [
            left_zone_length,
            middle_zone_length,
            right_zone_length
        ],                              # 24

        [
            end_spacing,
            mid_spacing,
            end_spacing
        ],                              # 25

        continuous_offsets,             # 26

        extra_offsets,                  # 27

        nominal_to_revit_diameter(
            main_dia
        ),                              # 28

        nominal_to_revit_diameter(
            stirrup_dia
        )                               # 29
    ]


# ============================================================
# READ B02
# ============================================================

b02 = IN[0]


try:

    b02_reports = as_list(
        b02[0]
    )

    b02_ready = bool(
        b02[7]
    )

    b02_error = None


except Exception as ex:

    b02_reports = []
    b02_ready = False

    b02_error = str(
        ex
    )


# ============================================================
# INVALID INPUT
# ============================================================

if b02_error is not None:

    OUT = [

        False,                          # 0

        "INVALID B02 INPUT",            # 1

        [],                             # 2

        0,                              # 3

        [],                             # 4

        0,                              # 5

        [
            b02_error
        ]                               # 6
    ]


# ============================================================
# NO B02 REPORTS
# ============================================================
# IMPORTANT:
# Do NOT stop the entire batch just because B02[7] is False.
# B02[7] means every beam passed. Individual beam readiness is
# stored in each B02 report at index [1]. Ready beams are allowed
# to continue; failed beams are skipped and reported individually.
# ============================================================

elif len(b02_reports) == 0:

    OUT = [

        False,                          # 0

        "B02 HAS NO BEAM REPORTS",      # 1

        [],                             # 2

        0,                              # 3

        [],                             # 4

        0,                              # 5

        [
            ["B02 overall ready", b02_ready]
        ]                               # 6
    ]


# ============================================================
# RUN BATCH
# ============================================================

else:

    batch_reports = []

    successful_ids = []

    failed_reports = []


    TransactionManager.Instance.EnsureInTransaction(
        doc
    )


    try:

        for b02_report in b02_reports:

            try:

                beam_ready = bool(
                    b02_report[1]
                )

                beam_id = b02_report[0]


            except Exception as ex:

                failure = [

                    None,

                    False,

                    "INVALID B02 REPORT",

                    str(ex)
                ]


                batch_reports.append(
                    failure
                )

                failed_reports.append(
                    failure
                )

                continue


            if not beam_ready:

                failure = [

                    beam_id,

                    False,

                    "SKIPPED - B02 FAILED",

                    b02_report[3]
                ]


                batch_reports.append(
                    failure
                )

                failed_reports.append(
                    failure
                )

                continue


            sub_transaction = SubTransaction(
                doc
            )


            sub_transaction.Start()


            try:

                result = process_beam(
                    b02_report
                )


                sub_transaction.Commit()


                batch_reports.append(
                    result
                )


                successful_ids.append(
                    result[0]
                )


            except Exception as ex:

                try:

                    sub_transaction.RollBack()

                except:
                    pass


                failure = [

                    beam_id,

                    False,

                    "FAILED",

                    str(ex)
                ]


                batch_reports.append(
                    failure
                )


                failed_reports.append(
                    failure
                )


    finally:

        TransactionManager.Instance.TransactionTaskDone()


    # ========================================================
    # FINAL
    # ========================================================

    batch_ok = (

        len(
            successful_ids
        ) > 0

        and

        len(
            failed_reports
        ) == 0
    )


    OUT = [

        batch_ok,                        # 0

        (
            "BATCH AUTO-REBAR COMPLETE"
            if batch_ok
            else
            "BATCH COMPLETED WITH ERRORS"
        ),                               # 1

        batch_reports,                   # 2

        len(
            successful_ids
        ),                               # 3

        successful_ids,                 # 4

        len(
            failed_reports
        ),                               # 5

        failed_reports                   # 6
    ]   
# ----------------------------------------
bar_types = Python()  # CPython3; unwired: IN[0]
# ---------- bar_types.python (122 lines) ----------
import clr

clr.AddReference("RevitAPI")
clr.AddReference("RevitServices")

from Autodesk.Revit.DB import *
from Autodesk.Revit.DB.Structure import RebarBarType
from RevitServices.Persistence import DocumentManager

doc = DocumentManager.Instance.CurrentDBDocument


# ============================================================
# GET REBAR DIAMETER
# ============================================================

def get_bar_diameter(bar_type):

    try:
        return bar_type.BarDiameter
    except:
        pass

    try:
        p = bar_type.get_Parameter(
            BuiltInParameter.REBAR_BAR_DIAMETER
        )

        if p is not None:
            return p.AsDouble()

    except:
        pass

    return None


# ============================================================
# CONVERT INTERNAL UNITS TO MM
# ============================================================

def internal_to_mm(value):

    return UnitUtils.ConvertFromInternalUnits(
        value,
        UnitTypeId.Millimeters
    )


# ============================================================
# COLLECT ALL REBAR BAR TYPES
# ============================================================

bar_types = (
    FilteredElementCollector(doc)
    .OfClass(RebarBarType)
    .ToElements()
)


results = []


for bar_type in bar_types:

    diameter_internal = get_bar_diameter(
        bar_type
    )

    if diameter_internal is None:
        diameter_mm = None
    else:
        diameter_mm = internal_to_mm(
            diameter_internal
        )

    try:
        type_name = bar_type.Name
    except:
        type_name = "Unnamed"

    try:
        element_id = int(
            bar_type.Id.Value
        )
    except:
        try:
            element_id = int(
                bar_type.Id.IntegerValue
            )
        except:
            element_id = None

    results.append([
        type_name,
        diameter_mm,
        element_id,
        bar_type
    ])


# ============================================================
# SORT BY DIAMETER
# ============================================================

results.sort(
    key=lambda x: (
        999999 if x[1] is None else x[1]
    )
)


# ============================================================
# OUTPUT
#
# [0] Type Name
# [1] Diameter mm
# [2] Element ID
# [3] RebarBarType
# ============================================================

OUT = results
# ----------------------------------------
