# Dynamo graph Rebar_Clear.dyn (Dynamo 3.6.0.9395)

select_model_element = DSModelElementSelection()  # 1 picked in the model; graph input
S01 = Python(IN[0]=select_model_element)  # CPython3
# ---------- S01.python (235 lines) ----------
# ============================================================
# R00 — DELETE ALL REBAR FROM SELECTED HOST ELEMENTS
#
# Dynamo / Revit Python
#
# IN[0] = Selected Revit element OR list of elements
#
# Supported hosts:
#   - Structural Columns
#   - Structural Framing / Beams
#   - Floors / Slabs
#   - Walls
#   - Foundations
#   - Other valid Rebar hosts
#
# ACTION:
#   Finds all Rebar elements whose HostId matches the
#   selected element(s), then deletes those rebars.
#
# OUT:
# [0] Deleted Rebar Count
# [1] Deleted Rebar IDs
# [2] Selected Host IDs
# [3] Status
# ============================================================

import clr

# ------------------------------------------------------------
# REVIT SERVICES
# ------------------------------------------------------------

clr.AddReference("RevitServices")

from RevitServices.Persistence import DocumentManager
from RevitServices.Transactions import TransactionManager

doc = DocumentManager.Instance.CurrentDBDocument


# ------------------------------------------------------------
# REVIT API
# ------------------------------------------------------------

clr.AddReference("RevitAPI")

from Autodesk.Revit.DB import *
from Autodesk.Revit.DB.Structure import Rebar


# ------------------------------------------------------------
# DYNAMO / REVIT NODES
# ------------------------------------------------------------

clr.AddReference("RevitNodes")

import Revit
clr.ImportExtensions(Revit.Elements)


# ------------------------------------------------------------
# INPUT
# ------------------------------------------------------------

input_elements = IN[0]

if input_elements is None:
    OUT = [
        0,
        [],
        [],
        "No element selected."
    ]

else:

    # --------------------------------------------------------
    # FORCE INPUT INTO LIST
    # --------------------------------------------------------

    if isinstance(input_elements, list):
        elements = input_elements
    else:
        elements = [input_elements]


    # --------------------------------------------------------
    # UNWRAP DYNAMO ELEMENTS
    # --------------------------------------------------------

    hosts = []

    for item in elements:

        if item is None:
            continue

        try:
            element = UnwrapElement(item)
        except:
            element = item

        if element is not None:
            hosts.append(element)


    # --------------------------------------------------------
    # HOST IDS
    # --------------------------------------------------------

    host_ids = set()
    host_id_output = []

    for host in hosts:

        try:

            host_id = host.Id

            try:
                host_id_value = host_id.Value
            except:
                host_id_value = host_id.IntegerValue

            host_ids.add(host_id_value)
            host_id_output.append(host_id_value)

        except:
            pass


    # --------------------------------------------------------
    # COLLECT ALL REBAR
    # --------------------------------------------------------

    all_rebars = FilteredElementCollector(doc) \
        .OfClass(Rebar) \
        .WhereElementIsNotElementType() \
        .ToElements()


    # --------------------------------------------------------
    # FIND REBAR HOSTED BY SELECTED ELEMENTS
    # --------------------------------------------------------

    rebars_to_delete = []
    rebar_id_output = []

    for rebar in all_rebars:

        try:

            host_id = rebar.GetHostId()

            if host_id is None:
                continue

            try:
                host_id_value = host_id.Value
            except:
                host_id_value = host_id.IntegerValue

            if host_id_value in host_ids:

                rebars_to_delete.append(rebar)

                try:
                    rebar_id_output.append(rebar.Id.Value)
                except:
                    rebar_id_output.append(rebar.Id.IntegerValue)

        except:
            pass


    # --------------------------------------------------------
    # DELETE REBAR
    # --------------------------------------------------------

    deleted_count = 0
    errors = []

    if len(rebars_to_delete) > 0:

        TransactionManager.Instance.EnsureInTransaction(doc)

        for rebar in rebars_to_delete:

            try:

                doc.Delete(rebar.Id)
                deleted_count += 1

            except Exception as ex:

                errors.append(str(ex))

        TransactionManager.Instance.TransactionTaskDone()


    # --------------------------------------------------------
    # STATUS
    # --------------------------------------------------------

    if len(hosts) == 0:

        status = "No valid Revit host elements received."

    elif deleted_count == 0:

        status = "No hosted rebars found."

    else:

        status = "Successfully deleted {} rebar element(s).".format(
            deleted_count
        )

    if len(errors) > 0:

        status += " {} deletion error(s).".format(
            len(errors)
        )


    # --------------------------------------------------------
    # OUTPUT
    # --------------------------------------------------------

    OUT = [
        deleted_count,
        rebar_id_output,
        host_id_output,
        status
    ]
# ----------------------------------------
watch = Watch(S01)
