# Dynamo graph Slab_Reinforcement.dyn (Dynamo 3.0.3.7597)

n00_select_model_elements = DSModelElementsSelection()  # "00 Select Model Elements"; 2 picked in the model; graph input
s01_clear_reinforcement = Python(IN[0]=n00_select_model_elements)  # CPython3
# ---------- s01_clear_reinforcement.python (785 lines) ----------
import clr

# ============================================================
# REVIT SERVICES
# ============================================================

clr.AddReference("RevitServices")

from RevitServices.Persistence import DocumentManager
from RevitServices.Transactions import TransactionManager

doc = DocumentManager.Instance.CurrentDBDocument


# ============================================================
# REVIT API
# ============================================================

clr.AddReference("RevitAPI")

from Autodesk.Revit.DB import *
from Autodesk.Revit.DB.Structure import *


# ============================================================
# HELPERS
# ============================================================

def as_list(value):

    if value is None:
        return []

    if isinstance(value, list):
        return value

    try:
        if hasattr(value, "__iter__") and not isinstance(value, str):
            return list(value)
    except:
        pass

    return [value]


# ------------------------------------------------------------
# GET ID VALUE
# ------------------------------------------------------------

def id_value(obj):

    if obj is None:
        return None

    # Element
    try:
        return obj.Id.Value
    except:
        pass

    try:
        return obj.Id.IntegerValue
    except:
        pass

    # ElementId
    try:
        return obj.Value
    except:
        pass

    try:
        return obj.IntegerValue
    except:
        pass

    try:
        return int(str(obj))
    except:
        return None


# ------------------------------------------------------------
# ADD ELEMENT OR ID
# ------------------------------------------------------------

def add_delete_item(
    obj,
    category_name,
    floor_id,
    delete_ids,
    seen,
    report
):

    if obj is None:
        return

    # --------------------------------------------------------
    # If API returned an Element, use its Id
    # If API returned ElementId, use it directly
    # --------------------------------------------------------

    try:
        eid = obj.Id
    except:
        eid = obj

    value = id_value(eid)

    if value is None:
        return

    if value in seen:
        return

    seen.add(value)

    delete_ids.append(eid)

    report.append(
        "FOUND | Floor {} | {} | ID {}".format(
            floor_id,
            category_name,
            value
        )
    )


# ============================================================
# INPUT
# ============================================================

# IN[0] = Select Model Elements

selected = as_list(IN[0])


# ============================================================
# OUTPUT HOLDERS
# ============================================================

floors = []

delete_ids = []

seen_ids = set()

deleted_ids = []

errors = []

report = []


# ============================================================
# VALIDATE SELECTED ELEMENTS
# ============================================================

for item in selected:

    if item is None:
        continue

    try:
        element = UnwrapElement(item)
    except:
        element = item

    try:

        if isinstance(element, Floor):

            floors.append(element)

            report.append(
                "SELECTED FLOOR | ID {}".format(
                    id_value(element)
                )
            )

        else:

            report.append(
                "SKIPPED | ID {} | NOT FLOOR".format(
                    id_value(element)
                )
            )

    except Exception as ex:

        errors.append(
            "SELECTION ERROR | {}".format(
                str(ex)
            )
        )


# ============================================================
# NO FLOOR SELECTED
# ============================================================

if len(floors) == 0:

    errors.append(
        "NO VALID FLOOR SELECTED"
    )


# ============================================================
# GET ALL REINFORCEMENT FROM EACH HOST
# ============================================================

for floor in floors:

    floor_id = id_value(floor)

    report.append(
        "================================"
    )

    report.append(
        "CHECKING FLOOR {}".format(
            floor_id
        )
    )


    # --------------------------------------------------------
    # HOST DATA
    # --------------------------------------------------------

    try:

        host_data = RebarHostData.GetRebarHostData(
            floor
        )

    except Exception as ex:

        host_data = None

        errors.append(
            "Floor {} | Cannot get RebarHostData | {}".format(
                floor_id,
                str(ex)
            )
        )


    if host_data is None:

        report.append(
            "Floor {} | RebarHostData = NONE".format(
                floor_id
            )
        )

        continue


    # ========================================================
    # STANDARD REBAR
    # ========================================================

    try:

        items = host_data.GetRebarsInHost()

        count = 0

        for item in items:

            add_delete_item(
                item,
                "REBAR",
                floor_id,
                delete_ids,
                seen_ids,
                report
            )

            count += 1

        report.append(
            "STANDARD REBAR FOUND = {}".format(
                count
            )
        )

    except Exception as ex:

        errors.append(
            "Floor {} | GetRebarsInHost ERROR | {}".format(
                floor_id,
                str(ex)
            )
        )


    # ========================================================
    # REBAR CONTAINERS
    # ========================================================

    try:

        items = host_data.GetRebarContainersInHost()

        count = 0

        for item in items:

            add_delete_item(
                item,
                "REBAR CONTAINER",
                floor_id,
                delete_ids,
                seen_ids,
                report
            )

            count += 1

        report.append(
            "REBAR CONTAINERS FOUND = {}".format(
                count
            )
        )

    except Exception as ex:

        # Some Revit versions may not expose it.
        report.append(
            "GetRebarContainersInHost unavailable/error | {}".format(
                str(ex)
            )
        )


    # ========================================================
    # AREA REINFORCEMENT
    # ========================================================

    try:

        items = host_data.GetAreaReinforcementsInHost()

        count = 0

        for item in items:

            add_delete_item(
                item,
                "AREA REINFORCEMENT",
                floor_id,
                delete_ids,
                seen_ids,
                report
            )

            count += 1

        report.append(
            "AREA REINFORCEMENT FOUND = {}".format(
                count
            )
        )

    except Exception as ex:

        errors.append(
            "Floor {} | GetAreaReinforcementsInHost ERROR | {}".format(
                floor_id,
                str(ex)
            )
        )


    # ========================================================
    # PATH REINFORCEMENT
    # ========================================================

    try:

        items = host_data.GetPathReinforcementsInHost()

        count = 0

        for item in items:

            add_delete_item(
                item,
                "PATH REINFORCEMENT",
                floor_id,
                delete_ids,
                seen_ids,
                report
            )

            count += 1

        report.append(
            "PATH REINFORCEMENT FOUND = {}".format(
                count
            )
        )

    except Exception as ex:

        errors.append(
            "Floor {} | GetPathReinforcementsInHost ERROR | {}".format(
                floor_id,
                str(ex)
            )
        )


    # ========================================================
    # FABRIC AREAS
    # ========================================================

    try:

        items = host_data.GetFabricAreasInHost()

        count = 0

        for item in items:

            add_delete_item(
                item,
                "FABRIC AREA",
                floor_id,
                delete_ids,
                seen_ids,
                report
            )

            count += 1

        report.append(
            "FABRIC AREAS FOUND = {}".format(
                count
            )
        )

    except Exception as ex:

        report.append(
            "GetFabricAreasInHost unavailable/error | {}".format(
                str(ex)
            )
        )


    # ========================================================
    # FABRIC SHEETS
    # ========================================================

    try:

        items = host_data.GetFabricSheetsInHost()

        count = 0

        for item in items:

            add_delete_item(
                item,
                "FABRIC SHEET",
                floor_id,
                delete_ids,
                seen_ids,
                report
            )

            count += 1

        report.append(
            "FABRIC SHEETS FOUND = {}".format(
                count
            )
        )

    except Exception as ex:

        report.append(
            "GetFabricSheetsInHost unavailable/error | {}".format(
                str(ex)
            )
        )


# ============================================================
# SECONDARY GLOBAL CHECK
#
# This deliberately scans all standard Rebar elements and
# compares their actual host ID against the selected floors.
#
# This is a fallback in case RebarHostData missed something.
# ============================================================

selected_floor_ids = set()

for floor in floors:

    fid = id_value(floor)

    if fid is not None:
        selected_floor_ids.add(fid)


try:

    all_rebars = (
        FilteredElementCollector(doc)
        .OfClass(Rebar)
        .WhereElementIsNotElementType()
        .ToElements()
    )


    for rebar in all_rebars:

        try:

            host_id = rebar.GetHostId()

            host_value = id_value(
                host_id
            )


            if host_value in selected_floor_ids:

                add_delete_item(
                    rebar,
                    "REBAR GLOBAL FALLBACK",
                    host_value,
                    delete_ids,
                    seen_ids,
                    report
                )

        except:
            pass


except Exception as ex:

    errors.append(
        "GLOBAL REBAR SCAN ERROR | {}".format(
            str(ex)
        )
    )


# ============================================================
# AREA REINFORCEMENT FALLBACK
# ============================================================

try:

    all_area = (
        FilteredElementCollector(doc)
        .OfClass(AreaReinforcement)
        .WhereElementIsNotElementType()
        .ToElements()
    )


    for area in all_area:

        try:

            host_value = id_value(
                area.GetHostId()
            )


            if host_value in selected_floor_ids:

                add_delete_item(
                    area,
                    "AREA GLOBAL FALLBACK",
                    host_value,
                    delete_ids,
                    seen_ids,
                    report
                )

        except:
            pass


except Exception as ex:

    errors.append(
        "GLOBAL AREA REBAR SCAN ERROR | {}".format(
            str(ex)
        )
    )


# ============================================================
# PATH REINFORCEMENT FALLBACK
# ============================================================

try:

    all_path = (
        FilteredElementCollector(doc)
        .OfClass(PathReinforcement)
        .WhereElementIsNotElementType()
        .ToElements()
    )


    for path in all_path:

        try:

            host_value = id_value(
                path.GetHostId()
            )


            if host_value in selected_floor_ids:

                add_delete_item(
                    path,
                    "PATH GLOBAL FALLBACK",
                    host_value,
                    delete_ids,
                    seen_ids,
                    report
                )

        except:
            pass


except Exception as ex:

    errors.append(
        "GLOBAL PATH REBAR SCAN ERROR | {}".format(
            str(ex)
        )
    )


# ============================================================
# DELETE
# ============================================================

if len(delete_ids) > 0:

    TransactionManager.Instance.EnsureInTransaction(
        doc
    )


    for eid in delete_ids:

        try:

            original_id = id_value(
                eid
            )


            # doc.Delete may also delete dependent elements
            deleted_collection = doc.Delete(
                eid
            )


            deleted_ids.append(
                original_id
            )


            report.append(
                "DELETED ROOT ID {}".format(
                    original_id
                )
            )


            try:

                report.append(
                    "DEPENDENT ELEMENTS DELETED = {}".format(
                        len(deleted_collection)
                    )
                )

            except:
                pass


        except Exception as ex:

            errors.append(
                "DELETE ERROR | ID {} | {}".format(
                    id_value(eid),
                    str(ex)
                )
            )


    TransactionManager.Instance.TransactionTaskDone()


else:

    report.append(
        "NO REINFORCEMENT FOUND TO DELETE"
    )


# ============================================================
# FORCE DOCUMENT REGENERATION
# ============================================================

try:
    doc.Regenerate()
except:
    pass


# ============================================================
# FINAL REPORT
# ============================================================

report.append(
    "================================"
)

report.append(
    "SELECTED FLOORS = {}".format(
        len(floors)
    )
)

report.append(
    "UNIQUE REINFORCEMENT OBJECTS FOUND = {}".format(
        len(delete_ids)
    )
)

report.append(
    "ROOT OBJECTS DELETED = {}".format(
        len(deleted_ids)
    )
)


# ============================================================
# OUTPUT
# ============================================================

OUT = {

    "Floors":
        floors,

    "FloorCount":
        len(floors),

    "FoundCount":
        len(delete_ids),

    "DeletedCount":
        len(deleted_ids),

    "DeletedIds":
        deleted_ids,

    "Errors":
        errors,

    "Report":
        report
}
# ----------------------------------------
n01_bar_diameter = IntegerSlider(12, range=10..12 step 2)  # "01-Bar Diameter"; graph input
n02_bottom_long_spacing = IntegerSlider(150, range=100..200 step 25)  # "02-Bottom Long Spacing"; graph input
n03_bottom_short_spacing = IntegerSlider(150, range=100..200 step 25)  # "03-Bottom Short Spacing"; graph input
n04_top_long_spacing = IntegerSlider(150, range=100..200 step 25)  # "04-Top Long Spacing"; graph input
n05_top_short_spacing = IntegerSlider(150, range=100..200 step 25)  # "05-Top Short Spacing"; graph input
n06_bottom_cover = IntegerSlider(20, range=20..40 step 1)  # "06-Bottom Cover"; graph input
n07_top_cover = IntegerSlider(20, range=20..40 step 1)  # "07-Top Cover"; graph input
s02_input = Python(IN[0]=n01_bar_diameter, IN[1]=n02_bottom_long_spacing, IN[2]=n03_bottom_short_spacing, IN[3]=n04_top_long_spacing, IN[4]=n05_top_short_spacing, IN[5]=n06_bottom_cover, IN[6]=n07_top_cover)  # CPython3
# ---------- s02_input.python (235 lines) ----------
# ============================================================
# S02 - SLAB REINFORCEMENT INPUT
# SINGLE BAR DIAMETER
# ============================================================
#
# IN[0] = Bar Diameter (mm)
#
# IN[1] = Bottom Long Spacing (mm)
# IN[2] = Bottom Short Spacing (mm)
#
# IN[3] = Top Long Spacing (mm)
# IN[4] = Top Short Spacing (mm)
#
# IN[5] = Bottom Cover (mm)
# IN[6] = Top Cover (mm)
#
# ============================================================


def get_number(value, name, errors):

    if value is None:
        errors.append("{} is NONE".format(name))
        return None

    if isinstance(value, list):

        if len(value) == 0:
            errors.append("{} is an empty list".format(name))
            return None

        if len(value) > 1:
            errors.append(
                "{} received multiple values".format(name)
            )
            return None

        value = value[0]

    try:
        value = float(value)
    except:
        errors.append(
            "{} is not a valid number".format(name)
        )
        return None

    if value <= 0:
        errors.append(
            "{} must be greater than zero".format(name)
        )
        return None

    return value


# ------------------------------------------------------------
# ERRORS
# ------------------------------------------------------------

errors = []


# ------------------------------------------------------------
# INPUT VALUES
# ------------------------------------------------------------

bar_diameter = get_number(
    IN[0],
    "Bar Diameter",
    errors
)

bottom_long_spacing = get_number(
    IN[1],
    "Bottom Long Spacing",
    errors
)

bottom_short_spacing = get_number(
    IN[2],
    "Bottom Short Spacing",
    errors
)

top_long_spacing = get_number(
    IN[3],
    "Top Long Spacing",
    errors
)

top_short_spacing = get_number(
    IN[4],
    "Top Short Spacing",
    errors
)

bottom_cover = get_number(
    IN[5],
    "Bottom Cover",
    errors
)

top_cover = get_number(
    IN[6],
    "Top Cover",
    errors
)


# ------------------------------------------------------------
# VALID
# ------------------------------------------------------------

valid = len(errors) == 0


# ------------------------------------------------------------
# REINFORCEMENT
# ------------------------------------------------------------

reinforcement = {

    "BarDiameter_mm": bar_diameter,

    "BottomLong": {
        "Spacing_mm": bottom_long_spacing
    },

    "BottomShort": {
        "Spacing_mm": bottom_short_spacing
    },

    "TopLong": {
        "Spacing_mm": top_long_spacing
    },

    "TopShort": {
        "Spacing_mm": top_short_spacing
    }
}


# ------------------------------------------------------------
# COVERS
# ------------------------------------------------------------

covers = {

    "Bottom_mm": bottom_cover,

    "Top_mm": top_cover
}


# ------------------------------------------------------------
# REPORT
# ------------------------------------------------------------

report = []

if valid:

    report.append(
        "BAR DIAMETER = D{} mm".format(
            bar_diameter
        )
    )

    report.append(
        "Bottom Long = D{} @ {} mm".format(
            bar_diameter,
            bottom_long_spacing
        )
    )

    report.append(
        "Bottom Short = D{} @ {} mm".format(
            bar_diameter,
            bottom_short_spacing
        )
    )

    report.append(
        "Top Long = D{} @ {} mm".format(
            bar_diameter,
            top_long_spacing
        )
    )

    report.append(
        "Top Short = D{} @ {} mm".format(
            bar_diameter,
            top_short_spacing
        )
    )

    report.append(
        "Bottom Cover = {} mm".format(
            bottom_cover
        )
    )

    report.append(
        "Top Cover = {} mm".format(
            top_cover
        )
    )

else:

    report.append(
        "INPUT DATA INVALID"
    )

    for error in errors:
        report.append(error)


# ------------------------------------------------------------
# OUTPUT
# ------------------------------------------------------------

OUT = {

    "Valid": valid,

    "Reinforcement": reinforcement,

    "Covers": covers,

    "Errors": errors,

    "Report": report
}
# ----------------------------------------
s03_math = Python(IN[0]=s01_clear_reinforcement, IN[1]=s02_input)  # CPython3
# ---------- s03_math.python (942 lines) ----------
import clr

# ============================================================
# REVIT API
# ============================================================

clr.AddReference("RevitAPI")
from Autodesk.Revit.DB import *

clr.AddReference("RevitServices")
from RevitServices.Persistence import DocumentManager

doc = DocumentManager.Instance.CurrentDBDocument


# ============================================================
# CONSTANTS
# ============================================================

MM_TO_FT = 1.0 / 304.8
FT_TO_MM = 304.8


# ============================================================
# HELPERS
# ============================================================

def mm_to_ft(value):
    return float(value) / 304.8


def ft_to_mm(value):
    return float(value) * 304.8


def as_list(value):

    if value is None:
        return []

    if isinstance(value, list):
        return value

    try:
        if hasattr(value, "__iter__") and not isinstance(value, str):
            return list(value)
    except:
        pass

    return [value]


# ------------------------------------------------------------
# SAFE DICTIONARY READER
# ------------------------------------------------------------

def read_key(data, key, default=None):

    if data is None:
        return default

    # Python dict
    try:
        return data[key]
    except:
        pass

    try:
        return data.get(key, default)
    except:
        pass

    # Dynamo / .NET dictionary
    try:

        keys = list(data.Keys)

        for k in keys:

            if str(k) == str(key):

                try:
                    return data[k]
                except:
                    pass

    except:
        pass

    return default


# ------------------------------------------------------------
# SAFE ELEMENT ID
# ------------------------------------------------------------

def get_id(element):

    if element is None:
        return None

    try:
        return element.Id.Value
    except:
        pass

    try:
        return element.Id.IntegerValue
    except:
        pass

    try:
        return str(element.Id)
    except:
        return None


# ------------------------------------------------------------
# SAFE NUMBER
# ------------------------------------------------------------

def number(value, name, errors):

    if value is None:

        errors.append(
            "{} is NONE".format(name)
        )

        return None

    try:

        value = float(value)

    except:

        errors.append(
            "{} is not a valid number: {}".format(
                name,
                value
            )
        )

        return None

    if value <= 0:

        errors.append(
            "{} must be greater than zero".format(
                name
            )
        )

        return None

    return value


# ============================================================
# INPUT
# ============================================================
#
# IN[0] = S01 output
# IN[1] = S02 output
#
# ============================================================

S01 = IN[0]
S02 = IN[1]

global_errors = []
results = []


# ============================================================
# READ FLOORS FROM S01
# ============================================================

floors = read_key(
    S01,
    "Floors",
    None
)

floors = as_list(
    floors
)


if len(floors) == 0:

    global_errors.append(
        "NO FLOORS RECEIVED FROM S01"
    )


# ============================================================
# VALIDATE S02
# ============================================================

input_valid = read_key(
    S02,
    "Valid",
    False
)


if input_valid is not True:

    global_errors.append(
        "S02 INPUT IS NOT VALID"
    )


# ============================================================
# READ S02 DATA
# ============================================================

reinforcement = read_key(
    S02,
    "Reinforcement",
    None
)

covers = read_key(
    S02,
    "Covers",
    None
)


if reinforcement is None:

    global_errors.append(
        "Cannot read Reinforcement from S02"
    )


if covers is None:

    global_errors.append(
        "Cannot read Covers from S02"
    )


# ============================================================
# READ SHARED BAR DIAMETER
# ============================================================

bar_diameter_mm = number(
    read_key(
        reinforcement,
        "BarDiameter_mm",
        None
    ),
    "Bar Diameter",
    global_errors
)


# ============================================================
# READ COVERS
# ============================================================

bottom_cover_mm = number(
    read_key(
        covers,
        "Bottom_mm",
        None
    ),
    "Bottom Cover",
    global_errors
)


top_cover_mm = number(
    read_key(
        covers,
        "Top_mm",
        None
    ),
    "Top Cover",
    global_errors
)


# ============================================================
# READ REBAR GROUPS
# ============================================================

BL = read_key(
    reinforcement,
    "BottomLong",
    None
)

BS = read_key(
    reinforcement,
    "BottomShort",
    None
)

TL = read_key(
    reinforcement,
    "TopLong",
    None
)

TS = read_key(
    reinforcement,
    "TopShort",
    None
)


if BL is None:
    global_errors.append(
        "BottomLong data missing"
    )

if BS is None:
    global_errors.append(
        "BottomShort data missing"
    )

if TL is None:
    global_errors.append(
        "TopLong data missing"
    )

if TS is None:
    global_errors.append(
        "TopShort data missing"
    )


# ============================================================
# READ SPACING
# ============================================================

BL_spacing_mm = number(
    read_key(
        BL,
        "Spacing_mm",
        None
    ),
    "Bottom Long Spacing",
    global_errors
)


BS_spacing_mm = number(
    read_key(
        BS,
        "Spacing_mm",
        None
    ),
    "Bottom Short Spacing",
    global_errors
)


TL_spacing_mm = number(
    read_key(
        TL,
        "Spacing_mm",
        None
    ),
    "Top Long Spacing",
    global_errors
)


TS_spacing_mm = number(
    read_key(
        TS,
        "Spacing_mm",
        None
    ),
    "Top Short Spacing",
    global_errors
)


# ============================================================
# PROCESS IF INPUT VALID
# ============================================================

if len(global_errors) == 0:

    # --------------------------------------------------------
    # Convert input units to Revit internal feet
    # --------------------------------------------------------

    bar_diameter = mm_to_ft(
        bar_diameter_mm
    )

    bottom_cover = mm_to_ft(
        bottom_cover_mm
    )

    top_cover = mm_to_ft(
        top_cover_mm
    )


    # ========================================================
    # PROCESS EACH FLOOR
    # ========================================================

    for floor_item in floors:

        slab_errors = []

        try:

            # ------------------------------------------------
            # UNWRAP
            # ------------------------------------------------

            try:

                floor = UnwrapElement(
                    floor_item
                )

            except:

                floor = floor_item


            # ------------------------------------------------
            # VERIFY FLOOR
            # ------------------------------------------------

            if not isinstance(
                floor,
                Floor
            ):

                results.append({

                    "FloorId":
                        get_id(floor),

                    "Valid":
                        False,

                    "Errors": [
                        "Selected element is not a Floor"
                    ]
                })

                continue


            floor_id = get_id(
                floor
            )


            # =================================================
            # FLOOR BOUNDING BOX
            # =================================================

            bbox = floor.get_BoundingBox(
                None
            )


            if bbox is None:

                results.append({

                    "Floor":
                        floor,

                    "FloorId":
                        floor_id,

                    "Valid":
                        False,

                    "Errors": [
                        "Cannot get Floor bounding box"
                    ]
                })

                continue


            pmin = bbox.Min
            pmax = bbox.Max


            # =================================================
            # DIMENSIONS
            # =================================================

            dx = pmax.X - pmin.X
            dy = pmax.Y - pmin.Y
            dz = pmax.Z - pmin.Z


            dx_mm = ft_to_mm(
                dx
            )

            dy_mm = ft_to_mm(
                dy
            )

            thickness_mm = ft_to_mm(
                dz
            )


            # =================================================
            # DETERMINE LONG / SHORT AXIS
            # ============================================================

            if dx >= dy:

                long_axis = "X"
                short_axis = "Y"

                long_direction = XYZ(
                    1,
                    0,
                    0
                )

                short_direction = XYZ(
                    0,
                    1,
                    0
                )

                long_length_mm = dx_mm
                short_length_mm = dy_mm


            else:

                long_axis = "Y"
                short_axis = "X"

                long_direction = XYZ(
                    0,
                    1,
                    0
                )

                short_direction = XYZ(
                    1,
                    0,
                    0
                )

                long_length_mm = dy_mm
                short_length_mm = dx_mm


            # =================================================
            # TOP / BOTTOM ELEVATION
            # ============================================================

            bottom_z = pmin.Z
            top_z = pmax.Z


            # =================================================
            # BOTTOM BAR LEVELS
            #
            # Lowest layer:
            # Bottom Short
            #
            # Above it:
            # Bottom Long
            # ============================================================

            BS_z = (
                bottom_z
                + bottom_cover
                + bar_diameter / 2.0
            )


            BL_z = (
                BS_z
                + bar_diameter
            )


            # =================================================
            # TOP BAR LEVELS
            #
            # Highest layer:
            # Top Short
            #
            # Below it:
            # Top Long
            # ============================================================

            TS_z = (
                top_z
                - top_cover
                - bar_diameter / 2.0
            )


            TL_z = (
                TS_z
                - bar_diameter
            )


            # =================================================
            # CHECK SLAB THICKNESS
            # ============================================================

            if BL_z >= TL_z:

                slab_errors.append(
                    "Slab is too thin for calculated reinforcement layers"
                )


            # =================================================
            # PLAN LIMITS
            # ============================================================
            #
            # This is still mainly useful for direct-rebar drawing.
            # Area Reinforcement can use the floor boundary directly.
            #
            # ============================================================

            edge_cover = max(
                bottom_cover,
                top_cover
            )


            xmin = (
                pmin.X
                + edge_cover
            )

            xmax = (
                pmax.X
                - edge_cover
            )

            ymin = (
                pmin.Y
                + edge_cover
            )

            ymax = (
                pmax.Y
                - edge_cover
            )


            if xmax <= xmin:

                slab_errors.append(
                    "Invalid X reinforcement limits"
                )


            if ymax <= ymin:

                slab_errors.append(
                    "Invalid Y reinforcement limits"
                )


            # =================================================
            # BUILD RESULT
            # ============================================================

            slab_data = {

                # --------------------------------------------
                # FLOOR
                # --------------------------------------------

                "Floor":
                    floor,

                "FloorId":
                    floor_id,

                "Valid":
                    len(slab_errors) == 0,

                "Errors":
                    slab_errors,


                # ============================================
                # SHARED BAR DIAMETER
                # ============================================

                "BarDiameter_mm":
                    bar_diameter_mm,


                # ============================================
                # COVERS
                # ============================================

                "Covers": {

                    "Bottom_mm":
                        bottom_cover_mm,

                    "Top_mm":
                        top_cover_mm
                },


                # ============================================
                # SLAB DATA
                # ============================================

                "Slab": {

                    "Thickness_mm":
                        thickness_mm,

                    "XLength_mm":
                        dx_mm,

                    "YLength_mm":
                        dy_mm,

                    "LongLength_mm":
                        long_length_mm,

                    "ShortLength_mm":
                        short_length_mm,

                    "LongAxis":
                        long_axis,

                    "ShortAxis":
                        short_axis,

                    "LongDirection":
                        long_direction,

                    "ShortDirection":
                        short_direction,

                    "BottomZ":
                        bottom_z,

                    "TopZ":
                        top_z,

                    "XMin":
                        xmin,

                    "XMax":
                        xmax,

                    "YMin":
                        ymin,

                    "YMax":
                        ymax
                },


                # ============================================
                # BOTTOM LONG
                # ============================================

                "BottomLong": {

                    "Diameter_mm":
                        bar_diameter_mm,

                    "Spacing_mm":
                        BL_spacing_mm,

                    "Z":
                        BL_z,

                    "Direction":
                        long_direction,

                    "Axis":
                        long_axis
                },


                # ============================================
                # BOTTOM SHORT
                # ============================================

                "BottomShort": {

                    "Diameter_mm":
                        bar_diameter_mm,

                    "Spacing_mm":
                        BS_spacing_mm,

                    "Z":
                        BS_z,

                    "Direction":
                        short_direction,

                    "Axis":
                        short_axis
                },


                # ============================================
                # TOP LONG
                # ============================================

                "TopLong": {

                    "Diameter_mm":
                        bar_diameter_mm,

                    "Spacing_mm":
                        TL_spacing_mm,

                    "Z":
                        TL_z,

                    "Direction":
                        long_direction,

                    "Axis":
                        long_axis
                },


                # ============================================
                # TOP SHORT
                # ============================================

                "TopShort": {

                    "Diameter_mm":
                        bar_diameter_mm,

                    "Spacing_mm":
                        TS_spacing_mm,

                    "Z":
                        TS_z,

                    "Direction":
                        short_direction,

                    "Axis":
                        short_axis
                }
            }


            results.append(
                slab_data
            )


        except Exception as ex:

            results.append({

                "FloorId":
                    get_id(
                        floor_item
                    ),

                "Valid":
                    False,

                "Errors": [
                    str(ex)
                ]
            })


# ============================================================
# COUNT RESULTS
# ============================================================

valid_count = 0
invalid_count = 0


for item in results:

    if read_key(
        item,
        "Valid",
        False
    ):

        valid_count += 1

    else:

        invalid_count += 1


# ============================================================
# FINAL OUTPUT
# ============================================================

OUT = {

    "Valid":
        (
            len(global_errors) == 0
            and valid_count > 0
            and invalid_count == 0
        ),

    "Slabs":
        results,

    "ValidSlabs":
        valid_count,

    "InvalidSlabs":
        invalid_count,

    "Errors":
        global_errors
}
# ----------------------------------------
beam_selection = Python(IN[0]=n00_select_model_elements)  # CPython3
# ---------- beam_selection.python (1042 lines) ----------
import clr
import math

# ============================================================
# REVIT SERVICES
# ============================================================

clr.AddReference("RevitServices")

from RevitServices.Persistence import DocumentManager

doc = DocumentManager.Instance.CurrentDBDocument


# ============================================================
# REVIT API
# ============================================================

clr.AddReference("RevitAPI")

from Autodesk.Revit.DB import *


# ============================================================
# SETTINGS
# ============================================================

# Maximum distance from slab edge to beam centerline
SEARCH_TOLERANCE_MM = 500.0

# Minimum overlap between beam and slab edge
MIN_OVERLAP_MM = 100.0

# Direction tolerance.
# 0.90 means beam must be reasonably close to X or Y direction.
DIRECTION_TOLERANCE = 0.90


# ============================================================
# UNIT HELPERS
# ============================================================

def mm_to_ft(value):
    return float(value) / 304.8


def ft_to_mm(value):
    return float(value) * 304.8


SEARCH_TOLERANCE = mm_to_ft(
    SEARCH_TOLERANCE_MM
)

MIN_OVERLAP = mm_to_ft(
    MIN_OVERLAP_MM
)


# ============================================================
# GENERAL HELPERS
# ============================================================

def read_key(data, key, default=None):

    if data is None:
        return default

    try:
        return data[key]
    except:
        pass

    try:
        return data.get(key, default)
    except:
        pass

    try:

        keys = list(data.Keys)

        for k in keys:

            if str(k) == str(key):

                try:
                    return data[k]
                except:
                    pass

    except:
        pass

    return default


def as_list(value):

    if value is None:
        return []

    if isinstance(value, list):
        return value

    try:

        if (
            hasattr(value, "__iter__")
            and not isinstance(value, str)
        ):

            return list(value)

    except:
        pass

    return [value]


def unwrap(element):

    try:
        return UnwrapElement(element)
    except:
        return element


def get_id_value(element):

    if element is None:
        return None

    try:
        return element.Id.Value
    except:
        pass

    try:
        return element.Id.IntegerValue
    except:
        pass

    return None


# ============================================================
# GET FLOORS FROM S01
# ============================================================

def get_floors_from_s01(data):

    floors = []

    # --------------------------------------------------------
    # CASE 1
    # S01 output itself is a list of floors
    # --------------------------------------------------------

    raw = as_list(data)

    for item in raw:

        element = unwrap(item)

        try:

            if isinstance(element, Floor):
                floors.append(element)

        except:
            pass


    if len(floors) > 0:
        return floors


    # --------------------------------------------------------
    # CASE 2
    # Dictionary output
    # --------------------------------------------------------

    possible_keys = [
        "Floors",
        "Slabs",
        "SelectedFloors",
        "SelectedSlabs",
        "Elements",
        "SelectedElements"
    ]


    for key in possible_keys:

        values = read_key(
            data,
            key,
            None
        )

        if values is None:
            continue


        for item in as_list(values):

            # Sometimes item itself is a dictionary
            candidate = read_key(
                item,
                "Floor",
                item
            )

            candidate = unwrap(
                candidate
            )


            try:

                if isinstance(candidate, Floor):

                    if candidate not in floors:
                        floors.append(candidate)

            except:
                pass


    return floors


# ============================================================
# FLOOR BOUNDING BOX
# ============================================================

def get_floor_bounds(floor):

    try:

        bbox = floor.get_BoundingBox(
            None
        )

        if bbox is None:
            return None


        return {

            "XMin": bbox.Min.X,
            "XMax": bbox.Max.X,

            "YMin": bbox.Min.Y,
            "YMax": bbox.Max.Y,

            "ZMin": bbox.Min.Z,
            "ZMax": bbox.Max.Z
        }

    except:

        return None


# ============================================================
# GET ALL STRUCTURAL FRAMING
# ============================================================

def get_all_beams():

    result = []


    collector = (
        FilteredElementCollector(doc)
        .OfCategory(
            BuiltInCategory.OST_StructuralFraming
        )
        .WhereElementIsNotElementType()
    )


    for element in collector:

        try:

            location = element.Location

            if not isinstance(
                location,
                LocationCurve
            ):
                continue


            curve = location.Curve

            if curve is None:
                continue


            result.append(
                element
            )

        except:
            pass


    return result


# ============================================================
# GET BEAM GEOMETRY
# ============================================================

def get_beam_data(beam):

    try:

        location = beam.Location

        if not isinstance(
            location,
            LocationCurve
        ):
            return None


        curve = location.Curve


        p0 = curve.GetEndPoint(0)
        p1 = curve.GetEndPoint(1)


        dx = p1.X - p0.X
        dy = p1.Y - p0.Y


        horizontal_length = math.sqrt(
            dx * dx +
            dy * dy
        )


        if horizontal_length < 0.000001:
            return None


        ux = dx / horizontal_length
        uy = dy / horizontal_length


        # ----------------------------------------------------
        # DETERMINE PRIMARY DIRECTION
        # ----------------------------------------------------

        direction = None


        if abs(ux) >= DIRECTION_TOLERANCE:

            direction = "X"


        elif abs(uy) >= DIRECTION_TOLERANCE:

            direction = "Y"


        else:

            # Diagonal beam.
            # Ignore for this rectangular slab detector.
            return None


        return {

            "Beam": beam,

            "BeamId":
                get_id_value(beam),

            "P0": p0,
            "P1": p1,

            "Direction":
                direction,

            "CenterX":
                (p0.X + p1.X) / 2.0,

            "CenterY":
                (p0.Y + p1.Y) / 2.0,

            "XMin":
                min(p0.X, p1.X),

            "XMax":
                max(p0.X, p1.X),

            "YMin":
                min(p0.Y, p1.Y),

            "YMax":
                max(p0.Y, p1.Y),

            "Z":
                (p0.Z + p1.Z) / 2.0
        }

    except:

        return None


# ============================================================
# RANGE OVERLAP
# ============================================================

def range_overlap(
    a_min,
    a_max,
    b_min,
    b_max
):

    return max(
        0.0,
        min(a_max, b_max)
        -
        max(a_min, b_min)
    )


# ============================================================
# EMPTY SUPPORT RESULT
# ============================================================

def empty_support(side):

    return {

        "Side":
            side,

        "Found":
            False,

        "Beam":
            None,

        "BeamId":
            None,

        "BeamDirection":
            None,

        "SlabEdge_ft":
            None,

        "BeamCenterline_ft":
            None,

        "Extension_ft":
            None,

        "SlabEdge_mm":
            None,

        "BeamCenterline_mm":
            None,

        "Extension_mm":
            None,

        "Overlap_mm":
            None,

        "Reason":
            "No valid supporting beam found"
    }


# ============================================================
# FIND SUPPORT FOR ONE SIDE
# ============================================================

def find_support(
    side,
    bounds,
    beam_data_list
):

    result = empty_support(
        side
    )


    xmin = bounds["XMin"]
    xmax = bounds["XMax"]

    ymin = bounds["YMin"]
    ymax = bounds["YMax"]


    best = None
    best_distance = None
    best_overlap = None


    # ========================================================
    # XMIN / XMAX
    #
    # Supporting beam should run Y.
    # ========================================================

    if side == "XMin" or side == "XMax":

        if side == "XMin":
            slab_edge = xmin

        else:
            slab_edge = xmax


        for data in beam_data_list:

            if data["Direction"] != "Y":
                continue


            # ------------------------------------------------
            # Beam X centerline
            # ------------------------------------------------

            beam_center = data[
                "CenterX"
            ]


            distance = abs(
                beam_center
                -
                slab_edge
            )


            if distance > SEARCH_TOLERANCE:
                continue


            # ------------------------------------------------
            # Check beam overlaps slab in Y
            # ------------------------------------------------

            overlap = range_overlap(
                ymin,
                ymax,
                data["YMin"],
                data["YMax"]
            )


            if overlap < MIN_OVERLAP:
                continue


            # ------------------------------------------------
            # Closest valid beam wins
            # ------------------------------------------------

            if (
                best_distance is None
                or distance < best_distance
            ):

                best = data
                best_distance = distance
                best_overlap = overlap


    # ========================================================
    # YMIN / YMAX
    #
    # Supporting beam should run X.
    # ========================================================

    elif side == "YMin" or side == "YMax":

        if side == "YMin":
            slab_edge = ymin

        else:
            slab_edge = ymax


        for data in beam_data_list:

            if data["Direction"] != "X":
                continue


            beam_center = data[
                "CenterY"
            ]


            distance = abs(
                beam_center
                -
                slab_edge
            )


            if distance > SEARCH_TOLERANCE:
                continue


            # ------------------------------------------------
            # Check beam overlaps slab in X
            # ------------------------------------------------

            overlap = range_overlap(
                xmin,
                xmax,
                data["XMin"],
                data["XMax"]
            )


            if overlap < MIN_OVERLAP:
                continue


            if (
                best_distance is None
                or distance < best_distance
            ):

                best = data
                best_distance = distance
                best_overlap = overlap


    else:

        result["Reason"] = (
            "Unknown side"
        )

        return result


    # ========================================================
    # NOTHING FOUND
    # ========================================================

    if best is None:

        result["SlabEdge_ft"] = (
            slab_edge
        )

        result["SlabEdge_mm"] = (
            ft_to_mm(
                slab_edge
            )
        )

        return result


    # ========================================================
    # BEAM CENTERLINE
    # ========================================================

    if side == "XMin" or side == "XMax":

        beam_centerline = best[
            "CenterX"
        ]

    else:

        beam_centerline = best[
            "CenterY"
        ]


    # ========================================================
    # SIGNED EXTENSION
    #
    # This is useful later for S05.
    #
    # Example:
    #
    # XMin slab edge = 10.000
    # beam CL        = 9.850
    #
    # extension = -0.150
    #
    # XMax slab edge = 16.000
    # beam CL        = 16.150
    #
    # extension = +0.150
    # ========================================================

    extension = (
        beam_centerline
        -
        slab_edge
    )


    # ========================================================
    # RESULT
    # ========================================================

    result = {

        "Side":
            side,

        "Found":
            True,

        "Beam":
            best["Beam"],

        "BeamId":
            best["BeamId"],

        "BeamDirection":
            best["Direction"],

        "SlabEdge_ft":
            slab_edge,

        "BeamCenterline_ft":
            beam_centerline,

        "Extension_ft":
            extension,

        "SlabEdge_mm":
            ft_to_mm(
                slab_edge
            ),

        "BeamCenterline_mm":
            ft_to_mm(
                beam_centerline
            ),

        "Extension_mm":
            ft_to_mm(
                extension
            ),

        "Overlap_mm":
            ft_to_mm(
                best_overlap
            ),

        "Reason":
            (
                "Valid perpendicular beam; "
                "overlaps slab; "
                "centerline distance = "
                "{:.1f} mm"
            ).format(
                abs(
                    ft_to_mm(
                        extension
                    )
                )
            )
    }


    return result


# ============================================================
# INPUT
# ============================================================

# IN[0] = S01 OUTPUT

S01 = IN[0]


# ============================================================
# OUTPUT STORAGE
# ============================================================

errors = []

report = []

slab_supports = []


# ============================================================
# GET SELECTED FLOORS
# ============================================================

floors = get_floors_from_s01(
    S01
)


if len(floors) == 0:

    errors.append(
        "NO FLOOR ELEMENTS FOUND IN S01 OUTPUT"
    )


# ============================================================
# COLLECT BEAMS
# ============================================================

all_beams = get_all_beams()


beam_data_list = []


for beam in all_beams:

    data = get_beam_data(
        beam
    )

    if data is not None:
        beam_data_list.append(
            data
        )


# ============================================================
# PROCESS FLOORS
# ============================================================

for floor in floors:

    floor_id = get_id_value(
        floor
    )


    try:

        bounds = get_floor_bounds(
            floor
        )


        if bounds is None:

            errors.append(
                "Floor {} | Cannot get bounding box".format(
                    floor_id
                )
            )

            continue


        # ====================================================
        # FIND FOUR SUPPORTS
        # ====================================================

        support_xmin = find_support(
            "XMin",
            bounds,
            beam_data_list
        )


        support_xmax = find_support(
            "XMax",
            bounds,
            beam_data_list
        )


        support_ymin = find_support(
            "YMin",
            bounds,
            beam_data_list
        )


        support_ymax = find_support(
            "YMax",
            bounds,
            beam_data_list
        )


        # ====================================================
        # COUNT
        # ====================================================

        supports = [
            support_xmin,
            support_xmax,
            support_ymin,
            support_ymax
        ]


        found_count = 0


        for support in supports:

            if support["Found"]:
                found_count += 1


        # ====================================================
        # STORE
        # ====================================================

        slab_result = {

            "Floor":
                floor,

            "FloorId":
                floor_id,

            "Bounds":
                bounds,

            "XMin":
                support_xmin,

            "XMax":
                support_xmax,

            "YMin":
                support_ymin,

            "YMax":
                support_ymax,

            "SupportsFound":
                found_count,

            "AllFourFound":
                found_count == 4
        }


        slab_supports.append(
            slab_result
        )


        # ====================================================
        # HUMAN READABLE REPORT
        # ====================================================

        report.append(
            "FLOOR {} | Supports {}/4".format(
                floor_id,
                found_count
            )
        )


        for support in supports:

            if support["Found"]:

                report.append(
                    "{} | Beam {} | Extension = {:.1f} mm | Overlap = {:.1f} mm".format(
                        support["Side"],
                        support["BeamId"],
                        support["Extension_mm"],
                        support["Overlap_mm"]
                    )
                )

            else:

                report.append(
                    "{} | NOT FOUND".format(
                        support["Side"]
                    )
                )


    except Exception as ex:

        errors.append(
            "Floor {} | ERROR | {}".format(
                floor_id,
                str(ex)
            )
        )


# ============================================================
# OUTPUT
# ============================================================

OUT = {

    "Valid":
        (
            len(errors) == 0
            and len(slab_supports) > 0
        ),

    "SelectedFloorCount":
        len(floors),

    "StructuralFramingCount":
        len(all_beams),

    "UsableBeamCount":
        len(beam_data_list),

    "Slabs":
        slab_supports,

    "Errors":
        errors,

    "Report":
        report
}
# ----------------------------------------
alternated = Python(IN[0]=s03_math, IN[1]=beam_selection)  # CPython3
# ---------- alternated.python (2015 lines) ----------
import clr

# ============================================================
# REVIT SERVICES
# ============================================================

clr.AddReference("RevitServices")

from RevitServices.Persistence import DocumentManager
from RevitServices.Transactions import TransactionManager

doc = DocumentManager.Instance.CurrentDBDocument


# ============================================================
# REVIT API
# ============================================================

clr.AddReference("RevitAPI")

from Autodesk.Revit.DB import *
from Autodesk.Revit.DB.Structure import *


# ============================================================
# .NET
# ============================================================

clr.AddReference("System")
from System.Collections.Generic import List


# ============================================================
# CONSTANTS
# ============================================================

MM_TO_FT = 1.0 / 304.8
FT_TO_MM = 304.8

TOLERANCE_FT = 1.0 / 304.8


# ============================================================
# UNIT HELPERS
# ============================================================

def mm_to_ft(value):

    if value is None:
        return None

    return float(value) / 304.8


def ft_to_mm(value):

    if value is None:
        return None

    return float(value) * 304.8


# ============================================================
# SAFE HELPERS
# ============================================================

def read_key(data, key, default=None):

    if data is None:
        return default

    try:
        return data[key]
    except:
        pass

    try:
        return data.get(key, default)
    except:
        pass

    try:

        for k in list(data.Keys):

            if str(k) == str(key):

                try:
                    return data[k]
                except:
                    pass

    except:
        pass

    return default


def as_list(value):

    if value is None:
        return []

    if isinstance(value, list):
        return value

    try:

        if (
            hasattr(value, "__iter__")
            and not isinstance(value, str)
        ):

            return list(value)

    except:
        pass

    return [value]


def unwrap(element):

    try:
        return UnwrapElement(element)
    except:
        return element


def safe_float(value, default=None):

    if value is None:
        return default

    try:
        return float(value)
    except:
        return default


def id_value(obj):

    if obj is None:
        return None

    try:
        return obj.Id.Value
    except:
        pass

    try:
        return obj.Id.IntegerValue
    except:
        pass

    try:
        return obj.Value
    except:
        pass

    try:
        return obj.IntegerValue
    except:
        pass

    try:
        return str(obj.Id)
    except:
        return None


def element_id_value(eid):

    if eid is None:
        return None

    try:
        return eid.Value
    except:
        pass

    try:
        return eid.IntegerValue
    except:
        pass

    try:
        return str(eid)
    except:
        return None


# ============================================================
# REBAR TYPE
# ============================================================

def get_bar_diameter(bar_type):

    try:

        d = bar_type.BarModelDiameter

        if d is not None:
            return d

    except:
        pass


    try:

        d = bar_type.BarNominalDiameter

        if d is not None:
            return d

    except:
        pass


    try:

        p = bar_type.get_Parameter(
            BuiltInParameter.REBAR_BAR_DIAMETER
        )

        if p is not None:
            return p.AsDouble()

    except:
        pass


    return None


def find_bar_type(diameter_mm):

    target = mm_to_ft(
        diameter_mm
    )

    tolerance = mm_to_ft(
        0.5
    )


    collector = (
        FilteredElementCollector(doc)
        .OfClass(RebarBarType)
        .ToElements()
    )


    best = None
    best_diff = None


    for bar_type in collector:

        try:

            actual = get_bar_diameter(
                bar_type
            )

            if actual is None:
                continue


            diff = abs(
                actual - target
            )


            if (
                best_diff is None
                or diff < best_diff
            ):

                best = bar_type
                best_diff = diff

        except:
            pass


    if best is None:
        return None


    if best_diff is None:
        return None


    if best_diff > tolerance:
        return None


    return best


# ============================================================
# ORDINARY REBAR CLEANUP
# ============================================================

def get_rebar_host_id(rebar):

    try:

        return rebar.GetHostId()

    except:
        pass


    try:

        return rebar.HostId

    except:
        pass


    return None


def same_id(a, b):

    if a is None or b is None:
        return False

    return str(
        element_id_value(a)
    ) == str(
        element_id_value(b)
    )


def clear_floor_rebar(floor):

    deleted = 0
    messages = []

    floor_id = floor.Id

    ids = {}


    # --------------------------------------------------------
    # HOST DATA
    # --------------------------------------------------------

    try:

        host_data = RebarHostData.GetRebarHostData(
            floor
        )


        if host_data is not None:

            try:

                host_rebars = host_data.GetRebarsInHost()


                for eid in host_rebars:

                    ids[
                        str(
                            element_id_value(eid)
                        )
                    ] = eid

            except:
                pass

    except:
        pass


    # --------------------------------------------------------
    # GLOBAL FALLBACK
    # --------------------------------------------------------

    try:

        all_rebars = (
            FilteredElementCollector(doc)
            .OfClass(Rebar)
            .WhereElementIsNotElementType()
            .ToElements()
        )


        for rebar in all_rebars:

            try:

                host_id = get_rebar_host_id(
                    rebar
                )


                if same_id(
                    host_id,
                    floor_id
                ):

                    ids[
                        str(id_value(rebar))
                    ] = rebar.Id

            except:
                pass

    except Exception as ex:

        messages.append(
            "Rebar scan failed: {}".format(
                str(ex)
            )
        )


    # --------------------------------------------------------
    # DELETE
    # --------------------------------------------------------

    for key in ids:

        try:

            eid = ids[key]


            if doc.GetElement(eid) is None:
                continue


            doc.Delete(
                eid
            )


            deleted += 1

        except Exception as ex:

            messages.append(
                "Delete {} failed: {}".format(
                    key,
                    str(ex)
                )
            )


    doc.Regenerate()


    return (
        deleted,
        messages
    )


# ============================================================
# S04 SUPPORT SEARCH
# ============================================================

def get_s04_items(S04):

    if S04 is None:
        return []


    # --------------------------------------------------------
    # S04 MAY ALREADY BE A LIST
    # --------------------------------------------------------

    if isinstance(S04, list):
        return S04


    # --------------------------------------------------------
    # NORMAL DICTIONARY OUTPUT
    # --------------------------------------------------------

    slabs = read_key(
        S04,
        "Slabs",
        None
    )


    if slabs is not None:
        return as_list(slabs)


    # --------------------------------------------------------
    # OTHER POSSIBLE RESULT KEYS
    # --------------------------------------------------------

    results = read_key(
        S04,
        "Results",
        None
    )


    if results is not None:
        return as_list(results)


    # --------------------------------------------------------
    # POSSIBLY A SINGLE FLOOR RESULT
    # --------------------------------------------------------

    if read_key(
        S04,
        "FloorId",
        None
    ) is not None:

        return [S04]


    return []


def find_support_data(
    S04,
    floor_id
):

    items = get_s04_items(
        S04
    )


    for item in items:

        test_id = read_key(
            item,
            "FloorId",
            None
        )


        if str(
            test_id
        ) == str(
            floor_id
        ):

            return item


    return None


# ============================================================
# SUPPORT CENTERLINE
# ============================================================

def get_support_coordinate(
    support_data,
    side,
    fallback
):

    if support_data is None:

        return (
            fallback,
            False,
            None
        )


    data = read_key(
        support_data,
        side,
        None
    )


    if data is None:

        return (
            fallback,
            False,
            None
        )


    found = read_key(
        data,
        "Found",
        False
    )


    beam_id = read_key(
        data,
        "BeamId",
        None
    )


    # --------------------------------------------------------
    # ONLY TRUST SUPPORT WHEN FOUND = TRUE
    # --------------------------------------------------------

    if found is not True:

        return (
            fallback,
            False,
            beam_id
        )


    centerline = safe_float(
        read_key(
            data,
            "BeamCenterline_ft",
            None
        )
    )


    if centerline is None:

        return (
            fallback,
            False,
            beam_id
        )


    return (
        centerline,
        True,
        beam_id
    )


# ============================================================
# CREATE STRAIGHT REBAR
# ============================================================

def create_straight_rebar(
    host,
    bar_type,
    p1,
    p2,
    normal
):

    try:

        if p1.DistanceTo(p2) <= TOLERANCE_FT:
            return None

    except:
        return None


    curves = List[Curve]()


    curves.Add(
        Line.CreateBound(
            p1,
            p2
        )
    )


    try:

        return Rebar.CreateFromCurves(
            doc,
            RebarStyle.Standard,
            bar_type,
            None,
            None,
            host,
            normal,
            curves,
            RebarHookOrientation.Left,
            RebarHookOrientation.Left,
            True,
            True
        )

    except:
        return None


# ============================================================
# CREATE CRANKED REBAR
# ============================================================

def create_cranked_rebar(
    host,
    bar_type,
    points,
    normal
):

    if points is None:
        return None


    if len(points) != 6:
        return None


    curves = List[Curve]()


    for i in range(5):

        p1 = points[i]
        p2 = points[i + 1]


        if p1.DistanceTo(p2) <= TOLERANCE_FT:
            return None


        curves.Add(
            Line.CreateBound(
                p1,
                p2
            )
        )


    try:

        return Rebar.CreateFromCurves(
            doc,
            RebarStyle.Standard,
            bar_type,
            None,
            None,
            host,
            normal,
            curves,
            RebarHookOrientation.Left,
            RebarHookOrientation.Left,
            True,
            True
        )

    except:
        return None


# ============================================================
# APPLY REBAR SET
# ============================================================

def apply_layout(
    rebar,
    spacing,
    length
):

    if rebar is None:
        return False


    if spacing is None:
        return False


    if length is None:
        return False


    if spacing <= 0:
        return False


    if length <= 0:
        return False


    try:

        accessor = (
            rebar.GetShapeDrivenAccessor()
        )


        accessor.SetLayoutAsMaximumSpacing(
            spacing,
            length,
            True,
            True,
            True
        )


        return True

    except:
        return False


# ============================================================
# X CRANK
# ============================================================

def build_x_crank(
    xmin,
    xmax,
    support_min,
    support_max,
    y,
    top_z,
    bottom_z
):

    L = xmax - xmin


    if L <= 0:
        return None


    quarter = L / 4.0


    crank_run = abs(
        top_z - bottom_z
    )


    x1 = support_min

    x2 = xmin + quarter

    x3 = x2 + crank_run

    x5 = xmax - quarter

    x4 = x5 - crank_run

    x6 = support_max


    if x1 >= x2:
        return None

    if x2 >= x3:
        return None

    if x3 >= x4:
        return None

    if x4 >= x5:
        return None

    if x5 >= x6:
        return None


    return [

        XYZ(x1, y, top_z),

        XYZ(x2, y, top_z),

        XYZ(x3, y, bottom_z),

        XYZ(x4, y, bottom_z),

        XYZ(x5, y, top_z),

        XYZ(x6, y, top_z)
    ]


# ============================================================
# Y CRANK
# ============================================================

def build_y_crank(
    ymin,
    ymax,
    support_min,
    support_max,
    x,
    top_z,
    bottom_z
):

    L = ymax - ymin


    if L <= 0:
        return None


    quarter = L / 4.0


    crank_run = abs(
        top_z - bottom_z
    )


    y1 = support_min

    y2 = ymin + quarter

    y3 = y2 + crank_run

    y5 = ymax - quarter

    y4 = y5 - crank_run

    y6 = support_max


    if y1 >= y2:
        return None

    if y2 >= y3:
        return None

    if y3 >= y4:
        return None

    if y4 >= y5:
        return None

    if y5 >= y6:
        return None


    return [

        XYZ(x, y1, top_z),

        XYZ(x, y2, top_z),

        XYZ(x, y3, bottom_z),

        XYZ(x, y4, bottom_z),

        XYZ(x, y5, top_z),

        XYZ(x, y6, top_z)
    ]


# ============================================================
# INPUT
# ============================================================

S03 = IN[0]
S04 = IN[1]


# ============================================================
# OUTPUT STORAGE
# ============================================================

bottom_long_sets = []
bottom_short_sets = []

crank_long_sets = []
crank_short_sets = []

errors = []
warnings = []
report = []

deleted_total = 0


# ============================================================
# S03 VALIDATION
# ============================================================

if not read_key(
    S03,
    "Valid",
    False
):

    errors.append(
        "S03 OUTPUT IS NOT VALID"
    )


slabs = as_list(
    read_key(
        S03,
        "Slabs",
        None
    )
)


if len(slabs) == 0:

    errors.append(
        "NO SLABS FROM S03"
    )


# ============================================================
# TRANSACTION
# ============================================================

if len(errors) == 0:

    TransactionManager.Instance.EnsureInTransaction(
        doc
    )


    for slab_data in slabs:

        floor_id = "UNKNOWN"


        try:

            # =================================================
            # FLOOR
            # =================================================

            if not read_key(
                slab_data,
                "Valid",
                False
            ):

                continue


            floor = unwrap(
                read_key(
                    slab_data,
                    "Floor",
                    None
                )
            )


            if floor is None:

                errors.append(
                    "Floor is NONE"
                )

                continue


            floor_id = id_value(
                floor
            )


            # =================================================
            # CLEAR OLD ORDINARY REBAR
            # =================================================

            deleted, clear_messages = (
                clear_floor_rebar(
                    floor
                )
            )


            deleted_total += deleted


            for msg in clear_messages:

                warnings.append(
                    "Floor {} | {}".format(
                        floor_id,
                        msg
                    )
                )


            # =================================================
            # BAR TYPE
            # =================================================

            diameter_mm = safe_float(
                read_key(
                    slab_data,
                    "BarDiameter_mm",
                    None
                )
            )


            if diameter_mm is None:

                errors.append(
                    "Floor {} | Bar diameter missing".format(
                        floor_id
                    )
                )

                continue


            bar_type = find_bar_type(
                diameter_mm
            )


            if bar_type is None:

                errors.append(
                    "Floor {} | D{} bar type not found".format(
                        floor_id,
                        diameter_mm
                    )
                )

                continue


            bar_diameter_ft = get_bar_diameter(bar_type)

            if bar_diameter_ft is None or bar_diameter_ft <= 0:

                errors.append(
                    "Floor {} | Could not read actual rebar diameter".format(
                        floor_id
                    )
                )

                continue


            # =================================================
            # SLAB DATA
            # =================================================

            slab = read_key(
                slab_data,
                "Slab",
                None
            )


            xmin = safe_float(
                read_key(
                    slab,
                    "XMin",
                    None
                )
            )


            xmax = safe_float(
                read_key(
                    slab,
                    "XMax",
                    None
                )
            )


            ymin = safe_float(
                read_key(
                    slab,
                    "YMin",
                    None
                )
            )


            ymax = safe_float(
                read_key(
                    slab,
                    "YMax",
                    None
                )
            )


            long_axis = read_key(
                slab,
                "LongAxis",
                None
            )


            # =================================================
            # REBAR DATA
            # =================================================

            BL = read_key(
                slab_data,
                "BottomLong",
                None
            )


            BS = read_key(
                slab_data,
                "BottomShort",
                None
            )


            TL = read_key(
                slab_data,
                "TopLong",
                None
            )


            TS = read_key(
                slab_data,
                "TopShort",
                None
            )


            BL_spacing_mm = safe_float(
                read_key(
                    BL,
                    "Spacing_mm",
                    None
                )
            )


            BS_spacing_mm = safe_float(
                read_key(
                    BS,
                    "Spacing_mm",
                    None
                )
            )


            TL_spacing_mm = safe_float(
                read_key(
                    TL,
                    "Spacing_mm",
                    None
                )
            )


            TS_spacing_mm = safe_float(
                read_key(
                    TS,
                    "Spacing_mm",
                    None
                )
            )


            BL_z = safe_float(
                read_key(
                    BL,
                    "Z",
                    None
                )
            )


            BS_z = safe_float(
                read_key(
                    BS,
                    "Z",
                    None
                )
            )


            TL_z = safe_float(
                read_key(
                    TL,
                    "Z",
                    None
                )
            )


            TS_z = safe_float(
                read_key(
                    TS,
                    "Z",
                    None
                )
            )


            # =================================================
            # VALIDATE
            # =================================================

            required = [

                xmin, xmax,
                ymin, ymax,

                BL_spacing_mm,
                BS_spacing_mm,

                TL_spacing_mm,
                TS_spacing_mm,

                BL_z,
                BS_z,

                TL_z,
                TS_z
            ]


            if any(
                x is None
                for x in required
            ):

                errors.append(
                    "Floor {} | Required S03 data missing".format(
                        floor_id
                    )
                )

                continue


            BL_spacing = mm_to_ft(
                BL_spacing_mm
            )


            BS_spacing = mm_to_ft(
                BS_spacing_mm
            )


            TL_spacing = mm_to_ft(
                TL_spacing_mm
            )


            TS_spacing = mm_to_ft(
                TS_spacing_mm
            )


            # =================================================
            # CORRECTED TOP LAYER Z POSITIONS
            # =================================================
            # Top Short is kept as the upper/top-most layer.
            # Top Long is moved down by one ACTUAL bar diameter.
            # This prevents the two orthogonal top mats from occupying
            # the same physical Z elevation at their intersections.
            # No diameter is hardcoded here.

            top_reference_z = max(TL_z, TS_z)
            top_short_z = top_reference_z
            top_long_z = top_reference_z - bar_diameter_ft


            if top_long_z <= BL_z:

                warnings.append(
                    "Floor {} | Top Long layer is very close to/below Bottom Long layer after diameter offset".format(
                        floor_id
                    )
                )


            if top_short_z <= BS_z:

                warnings.append(
                    "Floor {} | Top Short layer is very close to/below Bottom Short layer".format(
                        floor_id
                    )
                )


            report.append(
                "Floor {} | Actual bar diameter = {:.1f} mm | TopLong Z = {:.1f} mm | TopShort Z = {:.1f} mm".format(
                    floor_id,
                    ft_to_mm(bar_diameter_ft),
                    ft_to_mm(top_long_z),
                    ft_to_mm(top_short_z)
                )
            )


            # =================================================
            # READ S04 SUPPORTS
            # =================================================

            support_data = find_support_data(
                S04,
                floor_id
            )


            (
                support_xmin,
                xmin_found,
                xmin_beam
            ) = get_support_coordinate(
                support_data,
                "XMin",
                xmin
            )


            (
                support_xmax,
                xmax_found,
                xmax_beam
            ) = get_support_coordinate(
                support_data,
                "XMax",
                xmax
            )


            (
                support_ymin,
                ymin_found,
                ymin_beam
            ) = get_support_coordinate(
                support_data,
                "YMin",
                ymin
            )


            (
                support_ymax,
                ymax_found,
                ymax_beam
            ) = get_support_coordinate(
                support_data,
                "YMax",
                ymax
            )


            # =================================================
            # IMPORTANT
            #
            # DO NOT CLAMP A FOUND BEAM CENTERLINE TO S03 LIMIT.
            #
            # S03 LIMIT IS COVER-INSET.
            # BEAM CENTERLINE MUST BE ALLOWED OUTSIDE IT.
            # =================================================

            report.append(
                "Floor {} | XMin support = {} | Beam = {} | {:.1f} mm from S03 XMin".format(
                    floor_id,
                    "BEAM" if xmin_found else "FALLBACK",
                    xmin_beam,
                    ft_to_mm(
                        support_xmin - xmin
                    )
                )
            )


            report.append(
                "Floor {} | XMax support = {} | Beam = {} | {:.1f} mm from S03 XMax".format(
                    floor_id,
                    "BEAM" if xmax_found else "FALLBACK",
                    xmax_beam,
                    ft_to_mm(
                        support_xmax - xmax
                    )
                )
            )


            report.append(
                "Floor {} | YMin support = {} | Beam = {} | {:.1f} mm from S03 YMin".format(
                    floor_id,
                    "BEAM" if ymin_found else "FALLBACK",
                    ymin_beam,
                    ft_to_mm(
                        support_ymin - ymin
                    )
                )
            )


            report.append(
                "Floor {} | YMax support = {} | Beam = {} | {:.1f} mm from S03 YMax".format(
                    floor_id,
                    "BEAM" if ymax_found else "FALLBACK",
                    ymax_beam,
                    ft_to_mm(
                        support_ymax - ymax
                    )
                )
            )


            # =================================================
            # DISTRIBUTION WIDTHS
            # =================================================

            dist_x = xmax - xmin
            dist_y = ymax - ymin


            # =================================================
            # LONG AXIS X
            # =================================================

            if long_axis == "X":

                # ------------------------------------------------
                # BOTTOM LONG
                # EXTENDS X TO BEAM CENTERLINES
                # ------------------------------------------------

                bottom_long = create_straight_rebar(
                    floor,
                    bar_type,

                    XYZ(
                        support_xmin,
                        ymin,
                        BL_z
                    ),

                    XYZ(
                        support_xmax,
                        ymin,
                        BL_z
                    ),

                    XYZ.BasisY
                )


                if (
                    bottom_long is not None
                    and apply_layout(
                        bottom_long,
                        BL_spacing,
                        dist_y
                    )
                ):

                    bottom_long_sets.append(
                        bottom_long
                    )

                else:

                    errors.append(
                        "Floor {} | Bottom Long failed".format(
                            floor_id
                        )
                    )


                # ------------------------------------------------
                # BOTTOM SHORT
                # EXTENDS Y TO BEAM CENTERLINES
                # ------------------------------------------------

                bottom_short = create_straight_rebar(
                    floor,
                    bar_type,

                    XYZ(
                        xmin,
                        support_ymin,
                        BS_z
                    ),

                    XYZ(
                        xmin,
                        support_ymax,
                        BS_z
                    ),

                    XYZ.BasisX
                )


                if (
                    bottom_short is not None
                    and apply_layout(
                        bottom_short,
                        BS_spacing,
                        dist_x
                    )
                ):

                    bottom_short_sets.append(
                        bottom_short
                    )

                else:

                    errors.append(
                        "Floor {} | Bottom Short failed".format(
                            floor_id
                        )
                    )


                # ------------------------------------------------
                # CRANK LONG
                # ------------------------------------------------

                crank_long_y = (
                    ymin
                    +
                    TL_spacing / 2.0
                )


                long_points = build_x_crank(
                    xmin,
                    xmax,

                    support_xmin,
                    support_xmax,

                    crank_long_y,

                    top_long_z,
                    BL_z
                )


                crank_long = create_cranked_rebar(
                    floor,
                    bar_type,
                    long_points,
                    XYZ.BasisY
                )


                if (
                    crank_long is not None
                    and apply_layout(
                        crank_long,
                        TL_spacing,
                        dist_y - TL_spacing
                    )
                ):

                    crank_long_sets.append(
                        crank_long
                    )

                else:

                    errors.append(
                        "Floor {} | Crank Long failed".format(
                            floor_id
                        )
                    )


                # ------------------------------------------------
                # CRANK SHORT
                # ------------------------------------------------

                crank_short_x = (
                    xmin
                    +
                    TS_spacing / 2.0
                )


                short_points = build_y_crank(
                    ymin,
                    ymax,

                    support_ymin,
                    support_ymax,

                    crank_short_x,

                    top_short_z,
                    BS_z
                )


                crank_short = create_cranked_rebar(
                    floor,
                    bar_type,
                    short_points,
                    XYZ.BasisX
                )


                if (
                    crank_short is not None
                    and apply_layout(
                        crank_short,
                        TS_spacing,
                        dist_x - TS_spacing
                    )
                ):

                    crank_short_sets.append(
                        crank_short
                    )

                else:

                    errors.append(
                        "Floor {} | Crank Short failed".format(
                            floor_id
                        )
                    )


            # =================================================
            # LONG AXIS Y
            # =================================================

            elif long_axis == "Y":

                # ------------------------------------------------
                # BOTTOM LONG
                # EXTENDS Y TO BEAM CENTERLINES
                # ------------------------------------------------

                bottom_long = create_straight_rebar(
                    floor,
                    bar_type,

                    XYZ(
                        xmin,
                        support_ymin,
                        BL_z
                    ),

                    XYZ(
                        xmin,
                        support_ymax,
                        BL_z
                    ),

                    XYZ.BasisX
                )


                if (
                    bottom_long is not None
                    and apply_layout(
                        bottom_long,
                        BL_spacing,
                        dist_x
                    )
                ):

                    bottom_long_sets.append(
                        bottom_long
                    )

                else:

                    errors.append(
                        "Floor {} | Bottom Long failed".format(
                            floor_id
                        )
                    )


                # ------------------------------------------------
                # BOTTOM SHORT
                # EXTENDS X TO BEAM CENTERLINES
                # ------------------------------------------------

                bottom_short = create_straight_rebar(
                    floor,
                    bar_type,

                    XYZ(
                        support_xmin,
                        ymin,
                        BS_z
                    ),

                    XYZ(
                        support_xmax,
                        ymin,
                        BS_z
                    ),

                    XYZ.BasisY
                )


                if (
                    bottom_short is not None
                    and apply_layout(
                        bottom_short,
                        BS_spacing,
                        dist_y
                    )
                ):

                    bottom_short_sets.append(
                        bottom_short
                    )

                else:

                    errors.append(
                        "Floor {} | Bottom Short failed".format(
                            floor_id
                        )
                    )


                # ------------------------------------------------
                # CRANK LONG
                # ------------------------------------------------

                crank_long_x = (
                    xmin
                    +
                    TL_spacing / 2.0
                )


                long_points = build_y_crank(
                    ymin,
                    ymax,

                    support_ymin,
                    support_ymax,

                    crank_long_x,

                    top_long_z,
                    BL_z
                )


                crank_long = create_cranked_rebar(
                    floor,
                    bar_type,
                    long_points,
                    XYZ.BasisX
                )


                if (
                    crank_long is not None
                    and apply_layout(
                        crank_long,
                        TL_spacing,
                        dist_x - TL_spacing
                    )
                ):

                    crank_long_sets.append(
                        crank_long
                    )

                else:

                    errors.append(
                        "Floor {} | Crank Long failed".format(
                            floor_id
                        )
                    )


                # ------------------------------------------------
                # CRANK SHORT
                # ------------------------------------------------

                crank_short_y = (
                    ymin
                    +
                    TS_spacing / 2.0
                )


                short_points = build_x_crank(
                    xmin,
                    xmax,

                    support_xmin,
                    support_xmax,

                    crank_short_y,

                    top_short_z,
                    BS_z
                )


                crank_short = create_cranked_rebar(
                    floor,
                    bar_type,
                    short_points,
                    XYZ.BasisY
                )


                if (
                    crank_short is not None
                    and apply_layout(
                        crank_short,
                        TS_spacing,
                        dist_y - TS_spacing
                    )
                ):

                    crank_short_sets.append(
                        crank_short
                    )

                else:

                    errors.append(
                        "Floor {} | Crank Short failed".format(
                            floor_id
                        )
                    )


            else:

                errors.append(
                    "Floor {} | Invalid LongAxis {}".format(
                        floor_id,
                        long_axis
                    )
                )


        except Exception as ex:

            errors.append(
                "Floor {} | ERROR | {}".format(
                    floor_id,
                    str(ex)
                )
            )


    TransactionManager.Instance.TransactionTaskDone()


# ============================================================
# OUTPUT
# ============================================================

OUT = {

    "Success":
        len(errors) == 0,

    "OldOrdinaryRebarDeleted":
        deleted_total,

    "BottomLongSetCount":
        len(bottom_long_sets),

    "BottomLongSets":
        bottom_long_sets,

    "BottomShortSetCount":
        len(bottom_short_sets),

    "BottomShortSets":
        bottom_short_sets,

    "CrankLongSetCount":
        len(crank_long_sets),

    "CrankLongSets":
        crank_long_sets,

    "CrankShortSetCount":
        len(crank_short_sets),

    "CrankShortSets":
        crank_short_sets,

    "Warnings":
        warnings,

    "Errors":
        errors,

    "Report":
        report
}   
# ----------------------------------------
watch = Watch(alternated)
s04_draw_bott = Python(IN[0]=s03_math, IN[1]=beam_selection)  # CPython3; frozen
# ---------- s04_draw_bott.python (2504 lines) ----------
import clr
import math

# ============================================================
# REVIT SERVICES
# ============================================================

clr.AddReference("RevitServices")

from RevitServices.Persistence import DocumentManager
from RevitServices.Transactions import TransactionManager

doc = DocumentManager.Instance.CurrentDBDocument


# ============================================================
# REVIT API
# ============================================================

clr.AddReference("RevitAPI")

from Autodesk.Revit.DB import *
from Autodesk.Revit.DB.Structure import *


# ============================================================
# .NET
# ============================================================

clr.AddReference("System")

from System.Collections.Generic import List


# ============================================================
# UNIT HELPERS
# ============================================================

def mm_to_ft(value):
    return float(value) / 304.8


def ft_to_mm(value):
    return float(value) * 304.8


# ============================================================
# GENERAL HELPERS
# ============================================================

def read_key(data, key, default=None):

    if data is None:
        return default

    try:
        return data[key]
    except:
        pass

    try:
        return data.get(key, default)
    except:
        pass

    try:

        keys = list(data.Keys)

        for k in keys:

            if str(k) == str(key):

                try:
                    return data[k]
                except:
                    pass

    except:
        pass

    return default


def as_list(value):

    if value is None:
        return []

    if isinstance(value, list):
        return value

    try:

        if (
            hasattr(value, "__iter__")
            and not isinstance(value, str)
        ):
            return list(value)

    except:
        pass

    return [value]


def unwrap(element):

    try:
        return UnwrapElement(element)
    except:
        return element


def id_value(obj):

    if obj is None:
        return None

    try:
        return obj.Id.Value
    except:
        pass

    try:
        return obj.Id.IntegerValue
    except:
        pass

    try:
        return obj.Value
    except:
        pass

    try:
        return obj.IntegerValue
    except:
        pass

    return None


# ============================================================
# BAR TYPE HELPERS
# ============================================================

def get_bar_diameter(bar_type):

    try:

        value = bar_type.BarModelDiameter

        if value is not None:
            return value

    except:
        pass


    try:

        value = bar_type.BarNominalDiameter

        if value is not None:
            return value

    except:
        pass


    try:

        p = bar_type.get_Parameter(
            BuiltInParameter.REBAR_BAR_DIAMETER
        )

        if p is not None:
            return p.AsDouble()

    except:
        pass


    return None


def find_bar_type(diameter_mm):

    target = mm_to_ft(
        diameter_mm
    )

    tolerance = mm_to_ft(
        0.5
    )


    types = (
        FilteredElementCollector(doc)
        .OfClass(RebarBarType)
        .ToElements()
    )


    best = None
    best_difference = None


    for bar_type in types:

        try:

            actual = get_bar_diameter(
                bar_type
            )

            if actual is None:
                continue


            difference = abs(
                actual - target
            )


            if (
                best_difference is None
                or difference < best_difference
            ):

                best = bar_type
                best_difference = difference

        except:
            pass


    if best is None:
        return None


    if best_difference is None:
        return None


    if best_difference > tolerance:
        return None


    return best


# ============================================================
# AREA REINFORCEMENT TYPE
# ============================================================

def get_or_create_area_type():

    # --------------------------------------------------------
    # TRY DEFAULT TYPE
    # --------------------------------------------------------

    try:

        type_id = doc.GetDefaultElementTypeId(
            ElementTypeGroup.AreaReinforcementType
        )

        if (
            type_id is not None
            and type_id != ElementId.InvalidElementId
        ):
            return type_id

    except:
        pass


    # --------------------------------------------------------
    # TRY EXISTING TYPE
    # --------------------------------------------------------

    try:

        types = (
            FilteredElementCollector(doc)
            .OfClass(AreaReinforcementType)
            .ToElements()
        )

        for area_type in types:
            return area_type.Id

    except:
        pass


    # --------------------------------------------------------
    # CREATE DEFAULT TYPE
    # --------------------------------------------------------

    try:

        type_id = (
            AreaReinforcementType
            .CreateDefaultAreaReinforcementType(
                doc
            )
        )

        if (
            type_id is not None
            and type_id != ElementId.InvalidElementId
        ):
            return type_id

    except:
        pass


    return ElementId.InvalidElementId


# ============================================================
# PARAMETER SETTER
# ============================================================

def set_bip(element, bip, value):

    try:

        p = element.get_Parameter(
            bip
        )

        if p is None:
            return False

        if p.IsReadOnly:
            return False

        p.Set(
            value
        )

        return True

    except:
        return False


# ============================================================
# CREATE BOTTOM AREA REINFORCEMENT
# ============================================================

def create_bottom_area(
    floor,
    area_type_id,
    bar_type,
    major_direction,
    long_spacing,
    short_spacing
):

    area = AreaReinforcement.Create(
        doc,
        floor,
        major_direction,
        area_type_id,
        bar_type.Id,
        ElementId.InvalidElementId
    )

    if area is None:
        return None


    doc.Regenerate()


    # --------------------------------------------------------
    # BOTTOM LONG / MAJOR = ON
    # --------------------------------------------------------

    set_bip(
        area,
        BuiltInParameter.REBAR_SYSTEM_ACTIVE_BOTTOM_DIR_1,
        1
    )


    # --------------------------------------------------------
    # BOTTOM SHORT / MINOR = ON
    # --------------------------------------------------------

    set_bip(
        area,
        BuiltInParameter.REBAR_SYSTEM_ACTIVE_BOTTOM_DIR_2,
        1
    )


    # --------------------------------------------------------
    # TOP MAJOR = OFF
    # --------------------------------------------------------

    set_bip(
        area,
        BuiltInParameter.REBAR_SYSTEM_ACTIVE_TOP_DIR_1,
        0
    )


    # --------------------------------------------------------
    # TOP MINOR = OFF
    # --------------------------------------------------------

    set_bip(
        area,
        BuiltInParameter.REBAR_SYSTEM_ACTIVE_TOP_DIR_2,
        0
    )


    # --------------------------------------------------------
    # BOTTOM LONG SPACING
    # --------------------------------------------------------

    set_bip(
        area,
        BuiltInParameter.REBAR_SYSTEM_SPACING_BOTTOM_DIR_1,
        long_spacing
    )


    # --------------------------------------------------------
    # BOTTOM SHORT SPACING
    # --------------------------------------------------------

    set_bip(
        area,
        BuiltInParameter.REBAR_SYSTEM_SPACING_BOTTOM_DIR_2,
        short_spacing
    )


    doc.Regenerate()

    return area


# ============================================================
# GET GENERATED AREA REINFORCEMENT BARS
# ============================================================

def get_area_rebars(area):

    result = []

    if area is None:
        return result


    # --------------------------------------------------------
    # PRIMARY METHOD
    # --------------------------------------------------------

    try:

        ids = area.GetRebarInSystemIds()

        if ids is not None:

            for eid in ids:

                try:

                    element = doc.GetElement(
                        eid
                    )

                    if element is not None:
                        result.append(
                            element
                        )

                except:
                    pass

    except:
        pass


    # --------------------------------------------------------
    # FALLBACK METHOD
    # --------------------------------------------------------

    if len(result) == 0:

        try:

            all_system_bars = (
                FilteredElementCollector(doc)
                .OfClass(RebarInSystem)
                .WhereElementIsNotElementType()
                .ToElements()
            )

            area_id = id_value(
                area
            )


            for bar in all_system_bars:

                try:

                    system_id = bar.SystemId

                    if id_value(system_id) == area_id:

                        result.append(
                            bar
                        )

                except:
                    pass

        except:
            pass


    return result


# ============================================================
# GET REBAR CENTERLINE CURVES
# ============================================================

def get_rebar_curves(bar):

    curves = []

    if bar is None:
        return curves


    # --------------------------------------------------------
    # FIRST OVERLOAD
    # --------------------------------------------------------

    try:

        raw_curves = bar.GetCenterlineCurves(
            False,
            False,
            False
        )

        if raw_curves is not None:

            for curve in raw_curves:
                curves.append(
                    curve
                )

    except:
        pass


    # --------------------------------------------------------
    # SECOND OVERLOAD
    # --------------------------------------------------------

    if len(curves) == 0:

        try:

            raw_curves = bar.GetCenterlineCurves(
                False,
                False,
                False,
                MultiplanarOption.IncludeOnlyPlanarCurves,
                0
            )

            if raw_curves is not None:

                for curve in raw_curves:
                    curves.append(
                        curve
                    )

        except:
            pass


    return curves


# ============================================================
# GET ACTUAL REBAR Z
# ============================================================

def get_bar_actual_z(bar):

    curves = get_rebar_curves(
        bar
    )

    z_values = []


    for curve in curves:

        try:

            p0 = curve.GetEndPoint(0)
            p1 = curve.GetEndPoint(1)

            z_values.append(
                p0.Z
            )

            z_values.append(
                p1.Z
            )

        except:
            pass


    if len(z_values) == 0:
        return None


    return (
        sum(z_values)
        /
        float(len(z_values))
    )


# ============================================================
# GET BAR PLAN DIRECTION
# ============================================================

def get_bar_direction(bar):

    curves = get_rebar_curves(
        bar
    )


    for curve in curves:

        try:

            p0 = curve.GetEndPoint(0)
            p1 = curve.GetEndPoint(1)

            dx = abs(
                p1.X - p0.X
            )

            dy = abs(
                p1.Y - p0.Y
            )


            if dx > dy:
                return "X"

            elif dy > dx:
                return "Y"

        except:
            pass


    return None


# ============================================================
# GET ACTUAL AREA REINFORCEMENT LEVELS
# ============================================================

def get_actual_area_z(
    area,
    long_axis
):

    bars = get_area_rebars(
        area
    )


    long_values = []
    short_values = []


    for bar in bars:

        try:

            direction = get_bar_direction(
                bar
            )

            z = get_bar_actual_z(
                bar
            )


            if direction is None:
                continue

            if z is None:
                continue


            # ------------------------------------------------
            # LONG AXIS = X
            # ------------------------------------------------

            if long_axis == "X":

                if direction == "X":

                    long_values.append(
                        z
                    )

                elif direction == "Y":

                    short_values.append(
                        z
                    )


            # ------------------------------------------------
            # LONG AXIS = Y
            # ------------------------------------------------

            elif long_axis == "Y":

                if direction == "Y":

                    long_values.append(
                        z
                    )

                elif direction == "X":

                    short_values.append(
                        z
                    )

        except:
            pass


    actual_long_z = None
    actual_short_z = None


    if len(long_values) > 0:

        actual_long_z = (
            sum(long_values)
            /
            float(len(long_values))
        )


    if len(short_values) > 0:

        actual_short_z = (
            sum(short_values)
            /
            float(len(short_values))
        )


    return (
        actual_long_z,
        actual_short_z,
        len(bars)
    )


# ============================================================
# FIND S04 SUPPORT DATA FOR FLOOR
# ============================================================

def find_support_data(
    beam_output,
    floor_id
):

    if beam_output is None:
        return None


    slabs = as_list(
        read_key(
            beam_output,
            "Slabs",
            None
        )
    )


    for slab_support in slabs:

        detected_floor_id = read_key(
            slab_support,
            "FloorId",
            None
        )


        try:

            if str(
                detected_floor_id
            ) == str(
                floor_id
            ):

                return slab_support

        except:
            pass


    return None


# ============================================================
# READ SUPPORT CENTERLINE
# ============================================================

def get_support_centerline(
    support_data,
    side,
    fallback
):

    if support_data is None:

        return (
            fallback,
            False,
            None
        )


    side_data = read_key(
        support_data,
        side,
        None
    )


    if side_data is None:

        return (
            fallback,
            False,
            None
        )


    found = read_key(
        side_data,
        "Found",
        False
    )


    if not found:

        return (
            fallback,
            False,
            read_key(
                side_data,
                "BeamId",
                None
            )
        )


    centerline = read_key(
        side_data,
        "BeamCenterline_ft",
        None
    )


    beam_id = read_key(
        side_data,
        "BeamId",
        None
    )


    if centerline is None:

        return (
            fallback,
            False,
            beam_id
        )


    return (
        centerline,
        True,
        beam_id
    )


# ============================================================
# CREATE ONE CRANKED REBAR
# ============================================================

def create_cranked_bar(
    floor,
    bar_type,
    points,
    normal
):

    curves = List[Curve]()


    # --------------------------------------------------------
    # 5 SEGMENTS
    #
    # P1-P2 = TOP
    # P2-P3 = CRANK DOWN
    # P3-P4 = BOTTOM
    # P4-P5 = CRANK UP
    # P5-P6 = TOP
    # --------------------------------------------------------

    for i in range(5):

        curves.Add(
            Line.CreateBound(
                points[i],
                points[i + 1]
            )
        )


    rebar = Rebar.CreateFromCurves(
        doc,
        RebarStyle.Standard,
        bar_type,
        None,
        None,
        floor,
        normal,
        curves,
        RebarHookOrientation.Left,
        RebarHookOrientation.Left,
        True,
        True
    )


    return rebar


# ============================================================
# APPLY SHAPE-DRIVEN SET LAYOUT
# ============================================================

def apply_layout(
    rebar,
    spacing,
    distribution_length
):

    if rebar is None:
        return False


    if distribution_length <= 0:
        return False


    try:

        accessor = (
            rebar.GetShapeDrivenAccessor()
        )


        accessor.SetLayoutAsMaximumSpacing(
            spacing,
            distribution_length,
            True,
            True,
            True
        )


        return True

    except:
        return False


# ============================================================
# BUILD X-DIRECTION CRANK
# ============================================================
#
# IMPORTANT:
#
# slab_xmin / slab_xmax
#     = actual slab edges
#
# bar_start / bar_end
#     = detected beam centerlines
#
# L/4 IS BASED ON THE SLAB SPAN.
#
# Therefore beam extension DOES NOT change L/4.
#
# ============================================================

def build_x_crank(
    slab_xmin,
    slab_xmax,
    bar_start,
    bar_end,
    y,
    top_z,
    bottom_z
):

    # --------------------------------------------------------
    # SLAB SPAN
    # --------------------------------------------------------

    L = (
        slab_xmax
        -
        slab_xmin
    )


    quarter = (
        L / 4.0
    )


    # --------------------------------------------------------
    # 45 DEGREE CRANK
    #
    # horizontal run = vertical drop
    # --------------------------------------------------------

    vertical_drop = abs(
        top_z
        -
        bottom_z
    )


    crank_run = vertical_drop


    # --------------------------------------------------------
    # POINTS
    # --------------------------------------------------------

    # Start at supporting beam centerline

    x1 = bar_start


    # L/4 measured from slab edge

    x2 = (
        slab_xmin
        +
        quarter
    )


    # End of left crank

    x3 = (
        x2
        +
        crank_run
    )


    # Start of right crank

    x5 = (
        slab_xmax
        -
        quarter
    )


    x4 = (
        x5
        -
        crank_run
    )


    # End at supporting beam centerline

    x6 = bar_end


    # --------------------------------------------------------
    # VALIDATE
    # --------------------------------------------------------

    if x1 >= x2:
        return None


    if x3 >= x4:
        return None


    if x5 >= x6:
        return None


    # --------------------------------------------------------
    # CREATE POINTS
    # --------------------------------------------------------

    return [

        XYZ(
            x1,
            y,
            top_z
        ),

        XYZ(
            x2,
            y,
            top_z
        ),

        XYZ(
            x3,
            y,
            bottom_z
        ),

        XYZ(
            x4,
            y,
            bottom_z
        ),

        XYZ(
            x5,
            y,
            top_z
        ),

        XYZ(
            x6,
            y,
            top_z
        )
    ]


# ============================================================
# BUILD Y-DIRECTION CRANK
# ============================================================

def build_y_crank(
    slab_ymin,
    slab_ymax,
    bar_start,
    bar_end,
    x,
    top_z,
    bottom_z
):

    # --------------------------------------------------------
    # SLAB SPAN
    # --------------------------------------------------------

    L = (
        slab_ymax
        -
        slab_ymin
    )


    quarter = (
        L / 4.0
    )


    # --------------------------------------------------------
    # 45 DEGREE CRANK
    # --------------------------------------------------------

    vertical_drop = abs(
        top_z
        -
        bottom_z
    )


    crank_run = vertical_drop


    # --------------------------------------------------------
    # POINTS
    # --------------------------------------------------------

    y1 = bar_start


    y2 = (
        slab_ymin
        +
        quarter
    )


    y3 = (
        y2
        +
        crank_run
    )


    y5 = (
        slab_ymax
        -
        quarter
    )


    y4 = (
        y5
        -
        crank_run
    )


    y6 = bar_end


    # --------------------------------------------------------
    # VALIDATE
    # --------------------------------------------------------

    if y1 >= y2:
        return None


    if y3 >= y4:
        return None


    if y5 >= y6:
        return None


    # --------------------------------------------------------
    # CREATE POINTS
    # --------------------------------------------------------

    return [

        XYZ(
            x,
            y1,
            top_z
        ),

        XYZ(
            x,
            y2,
            top_z
        ),

        XYZ(
            x,
            y3,
            bottom_z
        ),

        XYZ(
            x,
            y4,
            bottom_z
        ),

        XYZ(
            x,
            y5,
            top_z
        ),

        XYZ(
            x,
            y6,
            top_z
        )
    ]


# ============================================================
# INPUTS
# ============================================================

# IN[0] = S03 MATH OUTPUT
# IN[1] = S04 BEAM DETECTION OUTPUT

S03 = IN[0]
S04 = IN[1]


# ============================================================
# OUTPUT STORAGE
# ============================================================

areas = []

long_cranked_sets = []

short_cranked_sets = []

errors = []

warnings = []

report = []


# ============================================================
# VALIDATE S03
# ============================================================

if not read_key(
    S03,
    "Valid",
    False
):

    errors.append(
        "S03 OUTPUT IS NOT VALID"
    )


# ============================================================
# BEAM DETECTION STATUS
# ============================================================

if S04 is None:

    warnings.append(
        "S04 BEAM DETECTION IS NONE. "
        "CRANK ENDS WILL USE SLAB EDGES."
    )


elif not read_key(
    S04,
    "Valid",
    False
):

    warnings.append(
        "S04 BEAM DETECTION IS NOT VALID. "
        "MISSING SUPPORTS WILL USE SLAB EDGES."
    )


# ============================================================
# GET SLABS FROM S03
# ============================================================

slabs = as_list(
    read_key(
        S03,
        "Slabs",
        None
    )
)


if len(slabs) == 0:

    errors.append(
        "NO SLABS RECEIVED FROM S03"
    )


# ============================================================
# START TRANSACTION
# ============================================================

if len(errors) == 0:

    TransactionManager.Instance.EnsureInTransaction(
        doc
    )


    # ========================================================
    # AREA REINFORCEMENT TYPE
    # ========================================================

    area_type_id = get_or_create_area_type()


    if (
        area_type_id is None
        or area_type_id == ElementId.InvalidElementId
    ):

        errors.append(
            "FAILED TO GET OR CREATE AREA REINFORCEMENT TYPE"
        )


    # ========================================================
    # PROCESS EACH SLAB
    # ========================================================

    if len(errors) == 0:

        for slab_data in slabs:

            floor_id = "UNKNOWN"


            try:

                # =================================================
                # VALIDATE SLAB DATA
                # =================================================

                if not read_key(
                    slab_data,
                    "Valid",
                    False
                ):

                    report.append(
                        "SKIPPED INVALID SLAB"
                    )

                    continue


                # =================================================
                # FLOOR
                # =================================================

                floor = read_key(
                    slab_data,
                    "Floor",
                    None
                )


                if floor is None:

                    errors.append(
                        "FLOOR IS NONE"
                    )

                    continue


                floor = unwrap(
                    floor
                )


                floor_id = id_value(
                    floor
                )


                # =================================================
                # BAR DIAMETER
                # =================================================

                diameter_mm = read_key(
                    slab_data,
                    "BarDiameter_mm",
                    None
                )


                if diameter_mm is None:

                    errors.append(
                        "Floor {} | BarDiameter_mm is NONE".format(
                            floor_id
                        )
                    )

                    continue


                bar_type = find_bar_type(
                    diameter_mm
                )


                if bar_type is None:

                    errors.append(
                        "Floor {} | Cannot find D{} mm RebarBarType".format(
                            floor_id,
                            diameter_mm
                        )
                    )

                    continue


                # =================================================
                # SLAB GEOMETRY
                # =================================================

                slab = read_key(
                    slab_data,
                    "Slab",
                    None
                )


                if slab is None:

                    errors.append(
                        "Floor {} | Slab geometry is NONE".format(
                            floor_id
                        )
                    )

                    continue


                xmin = read_key(
                    slab,
                    "XMin",
                    None
                )


                xmax = read_key(
                    slab,
                    "XMax",
                    None
                )


                ymin = read_key(
                    slab,
                    "YMin",
                    None
                )


                ymax = read_key(
                    slab,
                    "YMax",
                    None
                )


                long_axis = read_key(
                    slab,
                    "LongAxis",
                    None
                )


                # =================================================
                # REINFORCEMENT DATA
                # =================================================

                bottom_long = read_key(
                    slab_data,
                    "BottomLong",
                    None
                )


                bottom_short = read_key(
                    slab_data,
                    "BottomShort",
                    None
                )


                top_long = read_key(
                    slab_data,
                    "TopLong",
                    None
                )


                top_short = read_key(
                    slab_data,
                    "TopShort",
                    None
                )


                # =================================================
                # SPACING
                # =================================================

                BL_spacing_mm = read_key(
                    bottom_long,
                    "Spacing_mm",
                    None
                )


                BS_spacing_mm = read_key(
                    bottom_short,
                    "Spacing_mm",
                    None
                )


                # =================================================
                # S03 BOTTOM Z
                #
                # USED ONLY AS FALLBACK IF ACTUAL AREA REBAR
                # CENTERLINE CANNOT BE READ.
                # =================================================

                S03_BL_z = read_key(
                    bottom_long,
                    "Z",
                    None
                )


                S03_BS_z = read_key(
                    bottom_short,
                    "Z",
                    None
                )


                # =================================================
                # TOP LEVELS
                # =================================================

                TL_top_z = read_key(
                    top_long,
                    "Z",
                    None
                )


                TS_top_z = read_key(
                    top_short,
                    "Z",
                    None
                )


                # =================================================
                # VALIDATE REQUIRED DATA
                # =================================================

                required = [

                    ("XMin", xmin),
                    ("XMax", xmax),

                    ("YMin", ymin),
                    ("YMax", ymax),

                    (
                        "Bottom Long Spacing",
                        BL_spacing_mm
                    ),

                    (
                        "Bottom Short Spacing",
                        BS_spacing_mm
                    ),

                    (
                        "Top Long Z",
                        TL_top_z
                    ),

                    (
                        "Top Short Z",
                        TS_top_z
                    )
                ]


                missing = False


                for name, value in required:

                    if value is None:

                        errors.append(
                            "Floor {} | {} is NONE".format(
                                floor_id,
                                name
                            )
                        )

                        missing = True


                if missing:
                    continue


                # =================================================
                # CONVERT SPACING TO REVIT INTERNAL UNITS
                # =================================================

                BL_spacing = mm_to_ft(
                    BL_spacing_mm
                )


                BS_spacing = mm_to_ft(
                    BS_spacing_mm
                )


                # =================================================
                # AREA REINFORCEMENT MAJOR DIRECTION
                # =================================================

                if long_axis == "X":

                    major_direction = XYZ.BasisX


                elif long_axis == "Y":

                    major_direction = XYZ.BasisY


                else:

                    errors.append(
                        "Floor {} | Invalid LongAxis = {}".format(
                            floor_id,
                            long_axis
                        )
                    )

                    continue


                # =================================================
                # STEP 1
                #
                # CREATE BOTTOM AREA REINFORCEMENT
                #
                # THIS CREATES:
                #
                # BOTTOM LONG
                # BOTTOM SHORT
                #
                # AT THEIR FULL INPUT SPACING.
                # =================================================

                area = create_bottom_area(
                    floor,
                    area_type_id,
                    bar_type,
                    major_direction,
                    BL_spacing,
                    BS_spacing
                )


                if area is None:

                    errors.append(
                        "Floor {} | Bottom Area Reinforcement creation failed".format(
                            floor_id
                        )
                    )

                    continue


                areas.append(
                    area
                )


                # =================================================
                # STEP 2
                #
                # FORCE REVIT TO GENERATE AREA SYSTEM BARS
                # =================================================

                doc.Regenerate()


                # =================================================
                # STEP 3
                #
                # READ ACTUAL BOTTOM AREA REBAR CENTERLINE Z
                # =================================================

                (
                    actual_long_bottom_z,
                    actual_short_bottom_z,
                    system_bar_count
                ) = get_actual_area_z(
                    area,
                    long_axis
                )


                # =================================================
                # FALLBACK TO S03 IF NEEDED
                # =================================================

                if actual_long_bottom_z is None:

                    actual_long_bottom_z = S03_BL_z

                    warnings.append(
                        "Floor {} | Actual Bottom Long Area Z not found; S03 fallback used".format(
                            floor_id
                        )
                    )


                if actual_short_bottom_z is None:

                    actual_short_bottom_z = S03_BS_z

                    warnings.append(
                        "Floor {} | Actual Bottom Short Area Z not found; S03 fallback used".format(
                            floor_id
                        )
                    )


                if actual_long_bottom_z is None:

                    errors.append(
                        "Floor {} | Cannot determine Bottom Long Z".format(
                            floor_id
                        )
                    )

                    continue


                if actual_short_bottom_z is None:

                    errors.append(
                        "Floor {} | Cannot determine Bottom Short Z".format(
                            floor_id
                        )
                    )

                    continue


                # =================================================
                # STEP 4
                #
                # MATCH THIS FLOOR WITH S04 BEAM DETECTION
                # =================================================

                support_data = find_support_data(
                    S04,
                    floor_id
                )


                if support_data is None:

                    warnings.append(
                        "Floor {} | No matching S04 support data; slab edges used".format(
                            floor_id
                        )
                    )


                # =================================================
                # XMIN SUPPORT
                # =================================================

                (
                    x_start,
                    xmin_found,
                    xmin_beam_id
                ) = get_support_centerline(
                    support_data,
                    "XMin",
                    xmin
                )


                # =================================================
                # XMAX SUPPORT
                # =================================================

                (
                    x_end,
                    xmax_found,
                    xmax_beam_id
                ) = get_support_centerline(
                    support_data,
                    "XMax",
                    xmax
                )


                # =================================================
                # YMIN SUPPORT
                # =================================================

                (
                    y_start,
                    ymin_found,
                    ymin_beam_id
                ) = get_support_centerline(
                    support_data,
                    "YMin",
                    ymin
                )


                # =================================================
                # YMAX SUPPORT
                # =================================================

                (
                    y_end,
                    ymax_found,
                    ymax_beam_id
                ) = get_support_centerline(
                    support_data,
                    "YMax",
                    ymax
                )


                # =================================================
                # SUPPORT SAFETY CHECK
                #
                # XMIN beam should be at or outside XMIN.
                # XMAX beam should be at or outside XMAX.
                #
                # YMIN beam should be at or outside YMIN.
                # YMAX beam should be at or outside YMAX.
                #
                # If detector gives a centerline inside the slab,
                # reject it.
                # =================================================

                if x_start > xmin:

                    warnings.append(
                        "Floor {} | XMin beam centerline is inside slab; slab edge used".format(
                            floor_id
                        )
                    )

                    x_start = xmin
                    xmin_found = False


                if x_end < xmax:

                    warnings.append(
                        "Floor {} | XMax beam centerline is inside slab; slab edge used".format(
                            floor_id
                        )
                    )

                    x_end = xmax
                    xmax_found = False


                if y_start > ymin:

                    warnings.append(
                        "Floor {} | YMin beam centerline is inside slab; slab edge used".format(
                            floor_id
                        )
                    )

                    y_start = ymin
                    ymin_found = False


                if y_end < ymax:

                    warnings.append(
                        "Floor {} | YMax beam centerline is inside slab; slab edge used".format(
                            floor_id
                        )
                    )

                    y_end = ymax
                    ymax_found = False


                # =================================================
                # STEP 5
                #
                # CRANK DISTRIBUTION OFFSET
                #
                # BOTTOM:
                #
                # B   B   B   B
                #
                # CRANK:
                #
                #   C   C   C
                #
                # OFFSET = S/2
                # =================================================

                long_offset = (
                    BL_spacing / 2.0
                )


                short_offset = (
                    BS_spacing / 2.0
                )


                # =================================================
                # STEP 6
                #
                # LONG CRANKED SET
                # =================================================

                if long_axis == "X":

                    # ------------------------------------------------
                    # LONG BARS RUN X
                    #
                    # Distribution runs Y.
                    # ------------------------------------------------

                    long_y = (
                        ymin
                        +
                        long_offset
                    )


                    long_points = build_x_crank(
                        xmin,
                        xmax,

                        # Beam centerline extensions
                        x_start,
                        x_end,

                        long_y,

                        TL_top_z,

                        # Actual Bottom Long Area Rebar Z
                        actual_long_bottom_z
                    )


                    long_normal = XYZ.BasisY


                    long_distribution = (
                        ymax
                        -
                        long_y
                    )


                else:

                    # ------------------------------------------------
                    # LONG BARS RUN Y
                    #
                    # Distribution runs X.
                    # ------------------------------------------------

                    long_x = (
                        xmin
                        +
                        long_offset
                    )


                    long_points = build_y_crank(
                        ymin,
                        ymax,

                        # Beam centerline extensions
                        y_start,
                        y_end,

                        long_x,

                        TL_top_z,

                        # Actual Bottom Long Area Rebar Z
                        actual_long_bottom_z
                    )


                    long_normal = XYZ.BasisX


                    long_distribution = (
                        xmax
                        -
                        long_x
                    )


                # =================================================
                # CREATE LONG CRANKED BAR SET
                # =================================================

                if long_points is None:

                    errors.append(
                        "Floor {} | Invalid LONG crank geometry".format(
                            floor_id
                        )
                    )


                else:

                    long_rebar = create_cranked_bar(
                        floor,
                        bar_type,
                        long_points,
                        long_normal
                    )


                    if long_rebar is None:

                        errors.append(
                            "Floor {} | Long cranked rebar creation failed".format(
                                floor_id
                            )
                        )


                    else:

                        long_layout_ok = apply_layout(
                            long_rebar,
                            BL_spacing,
                            long_distribution
                        )


                        if long_layout_ok:

                            long_cranked_sets.append(
                                long_rebar
                            )


                        else:

                            errors.append(
                                "Floor {} | Long cranked rebar layout failed".format(
                                    floor_id
                                )
                            )


                # =================================================
                # STEP 7
                #
                # SHORT CRANKED SET
                # =================================================

                if long_axis == "X":

                    # ------------------------------------------------
                    # SHORT BARS RUN Y
                    #
                    # Distribution runs X.
                    # ------------------------------------------------

                    short_x = (
                        xmin
                        +
                        short_offset
                    )


                    short_points = build_y_crank(
                        ymin,
                        ymax,

                        # Beam centerline extensions
                        y_start,
                        y_end,

                        short_x,

                        TS_top_z,

                        # Actual Bottom Short Area Rebar Z
                        actual_short_bottom_z
                    )


                    short_normal = XYZ.BasisX


                    short_distribution = (
                        xmax
                        -
                        short_x
                    )


                else:

                    # ------------------------------------------------
                    # SHORT BARS RUN X
                    #
                    # Distribution runs Y.
                    # ------------------------------------------------

                    short_y = (
                        ymin
                        +
                        short_offset
                    )


                    short_points = build_x_crank(
                        xmin,
                        xmax,

                        # Beam centerline extensions
                        x_start,
                        x_end,

                        short_y,

                        TS_top_z,

                        # Actual Bottom Short Area Rebar Z
                        actual_short_bottom_z
                    )


                    short_normal = XYZ.BasisY


                    short_distribution = (
                        ymax
                        -
                        short_y
                    )


                # =================================================
                # CREATE SHORT CRANKED BAR SET
                # =================================================

                if short_points is None:

                    errors.append(
                        "Floor {} | Invalid SHORT crank geometry".format(
                            floor_id
                        )
                    )


                else:

                    short_rebar = create_cranked_bar(
                        floor,
                        bar_type,
                        short_points,
                        short_normal
                    )


                    if short_rebar is None:

                        errors.append(
                            "Floor {} | Short cranked rebar creation failed".format(
                                floor_id
                            )
                        )


                    else:

                        short_layout_ok = apply_layout(
                            short_rebar,
                            BS_spacing,
                            short_distribution
                        )


                        if short_layout_ok:

                            short_cranked_sets.append(
                                short_rebar
                            )


                        else:

                            errors.append(
                                "Floor {} | Short cranked rebar layout failed".format(
                                    floor_id
                                )
                            )


                # =================================================
                # REPORT
                # =================================================

                report.append(
                    "Floor {} | D{} | Area Bars={} | Bottom Long @ {} mm | Bottom Short @ {} mm".format(
                        floor_id,
                        diameter_mm,
                        system_bar_count,
                        BL_spacing_mm,
                        BS_spacing_mm
                    )
                )


                report.append(
                    "Floor {} | Bottom Long actual Z = {:.2f} mm".format(
                        floor_id,
                        ft_to_mm(
                            actual_long_bottom_z
                        )
                    )
                )


                report.append(
                    "Floor {} | Bottom Short actual Z = {:.2f} mm".format(
                        floor_id,
                        ft_to_mm(
                            actual_short_bottom_z
                        )
                    )
                )


                report.append(
                    "Floor {} | XMin | {} | Beam {} | Extension = {:.1f} mm".format(
                        floor_id,
                        "FOUND" if xmin_found else "FALLBACK",
                        xmin_beam_id,
                        ft_to_mm(
                            x_start - xmin
                        )
                    )
                )


                report.append(
                    "Floor {} | XMax | {} | Beam {} | Extension = {:.1f} mm".format(
                        floor_id,
                        "FOUND" if xmax_found else "FALLBACK",
                        xmax_beam_id,
                        ft_to_mm(
                            x_end - xmax
                        )
                    )
                )


                report.append(
                    "Floor {} | YMin | {} | Beam {} | Extension = {:.1f} mm".format(
                        floor_id,
                        "FOUND" if ymin_found else "FALLBACK",
                        ymin_beam_id,
                        ft_to_mm(
                            y_start - ymin
                        )
                    )
                )


                report.append(
                    "Floor {} | YMax | {} | Beam {} | Extension = {:.1f} mm".format(
                        floor_id,
                        "FOUND" if ymax_found else "FALLBACK",
                        ymax_beam_id,
                        ft_to_mm(
                            y_end - ymax
                        )
                    )
                )


            except Exception as ex:

                errors.append(
                    "Floor {} | ERROR | {}".format(
                        floor_id,
                        str(ex)
                    )
                )


    # ========================================================
    # FINISH TRANSACTION
    # ========================================================

    TransactionManager.Instance.TransactionTaskDone()


# ============================================================
# FINAL OUTPUT
# ============================================================

OUT = {

    "Success":
        len(errors) == 0,

    # --------------------------------------------------------
    # BOTTOM REINFORCEMENT
    # --------------------------------------------------------

    "BottomAreaCount":
        len(areas),

    "BottomAreas":
        areas,

    # --------------------------------------------------------
    # CRANKED REINFORCEMENT
    # --------------------------------------------------------

    "LongCrankedSetCount":
        len(long_cranked_sets),

    "LongCrankedSets":
        long_cranked_sets,

    "ShortCrankedSetCount":
        len(short_cranked_sets),

    "ShortCrankedSets":
        short_cranked_sets,

    # --------------------------------------------------------
    # DIAGNOSTICS
    # --------------------------------------------------------

    "Warnings":
        warnings,

    "Errors":
        errors,

    "Report":
        report
}
# ----------------------------------------
